# Grasshopper definition 0A_con modify.gh (Grasshopper 1.0.7)
# plug-ins: KarambaIDEA

file_path = FilePath("C:\Users\NathanLuke\Desktop\Con Parameters Calculations\templateexport.contemp")
c_script = CSharpScript(filetype=".contemp")  # -> filepath; inputs filetype: String
# ---------- c_script: C# usings ----------
using System.IO;
# ---------- c_script: C# ----------
    string path = this.Component.OnPingDocument().FilePath;

    string directory = Path.GetDirectoryName(path);

    string[] files = Directory.GetFiles(directory, string.Concat('*', filetype));

    filepath = files;
# ---------- end c_script ----------
template_by_filepath = TemplateByFilepath(Path=c_script)
c_script_2 = CSharpScript(x=".ideaCon")  # -> out, A; inputs x: String
# ---------- c_script_2: C# ----------
    string path = this.Component.OnPingDocument().FilePath;

    string directory = Path.GetDirectoryName(path);

    string[] files = Directory.GetFiles(directory, string.Concat('*',x));

    A = files;
# ---------- end c_script_2 ----------
assign_template_by_filepath = AssignTemplateByFilepath()  # -> Project, Message, Brep
deconstruct_template = DeconstructTemplate(Template=template_by_filepath)
list_item = ListItem(List=c_script_2.A, Index=0, Wrap=True)  # -> Item, Item1
set_param_value = SetParamValue(Parameter=deconstruct_template, Value="0.005")
file_path_2 = FilePath(list_item.Item)
panel = Panel(deconstruct_template)
# Add dontsave/save/save-as button?
# Add save as suffix option
boolean_toggle = BooleanToggle(False)
button = Button()
modify_con_parameters = ModifyConParameters(Parameters=set_param_value)
reference_connection = ReferenceConnection(Path=file_path_2)

# ---- group: Method A: bad
stiffener_plates = Text()
stiffener_members = Text()
create_project = CreateProject()
create_idea_file = CreateIDEAFile(Project=create_project)

# ----
c_script_3 = CSharpScript(filetype=".contemp")  # -> filepath; inputs filetype: String; same code as c_script
c_script_4 = CSharpScript(filetype=".contemp")  # -> filepath; inputs filetype: String; same code as c_script
# Welded Partial Template
c_script_5 = CSharpScript(filetype=".contemp")  # -> filepath; inputs filetype: String; same code as c_script
template_bolted_endplate_connection = TemplateBoltedEndplateConnection(ThicknessEndplate_mm=10, EdgeDistance_mm=30, Bolttype="M20", Boltsteelgrade="8.8")  # -> Project, Message, Brep
# Welded Partial Template
c_script_6 = CSharpScript(filetype=".contemp")  # -> filepath; inputs filetype: String; same code as c_script
c_script_7 = CSharpScript(filetype=".contemp")  # -> filepath; inputs filetype: String; same code as c_script
# B: Programmed Template (will become obsolete in long term)
template_weld_all_members = TemplateWeldAllMembers()  # -> Project, Message
list = ValueList({"Beam": 1, "Plate": 2}, selected="Beam")
list_2 = ValueList({"Beam": 1, "Plate": 2}, selected="Plate")
list_3 = ValueList({"Beam": 1, "Plate": 2}, selected="Beam")
list_4 = ValueList({"Beam": 1, "Plate": 2}, selected="Plate")
calculate_connection = CalculateConnection(Connection=reference_connection, Modifications=modify_con_parameters, RunIDEA=boolean_toggle)
export_modelbim = ExportModelBIM()
panel_3 = Panel(modify_con_parameters)
# Bolted Partial Template
template_by_filepath_2 = TemplateByFilepath(Path=c_script_3)
# C & A2 combo: partial Visual Programmed Template & Partial template by filepath
c_script_8 = CSharpScript()
# Bolted Partial Template
template_by_filepath_3 = TemplateByFilepath(Path=c_script_4)
c_script_9 = CSharpScript()
c_script_10 = CSharpScript()
c_script_11 = CSharpScript()
c_script_12 = CSharpScript()
# A2: Partial Template by filepath
template_by_filepath_4 = TemplateByFilepath(Path=c_script_5)
c_script_13 = CSharpScript()
template_by_filepath_5 = TemplateByFilepath(Path=c_script_6)
c_script_14 = CSharpScript(ObjectTypeA=list, IndexOfA="0", ObjectTypeB=list_2, IndexOfB="0")
c_script_15 = CSharpScript(ObjectTypeA=list_3, IndexOfA="0", ObjectTypeB=list_4, IndexOfB="0")
# A1: Full Template by filepath
template_by_filepath_6 = TemplateByFilepath(Path=c_script_7)
beam_index = Panel("""1
2
3""")
deconstruct_template_2 = DeconstructTemplate(Template=template_by_filepath_2)
beam_index_2 = Panel("""1
2
3""")
deconstruct_template_3 = DeconstructTemplate(Template=template_by_filepath_3)
# C: Visual Programmed Template
c_script_16 = CSharpScript()
deconstruct_template_4 = DeconstructTemplate(Template=template_by_filepath_6)
beam_index_3 = Panel("""1
2
3""")
deconstruct_template_5 = DeconstructTemplate(Template=template_by_filepath_4)
panel_4 = Panel("PP1a")
beam_index_4 = Panel("""1
2
3""")
deconstruct_template_6 = DeconstructTemplate(Template=template_by_filepath_5)
deconstruct_template_7 = DeconstructTemplate(Template=template_by_filepath_6)
c_script_17 = CSharpScript()
connection_internalised = Data()
connection_results = ConnectionResults(Connection=connection_internalised)  # -> Name, SummaryResults, PlateResults, WeldResults, BoltResults, AnchorResults, ConcreteBlockResults
set_param_value_2 = SetParamValue(Parameter=deconstruct_template_2, Value=beam_index)
set_param_value_3 = SetParamValue(Parameter=deconstruct_template_3, Value=beam_index_2)
create_and_calculate_idea_file = CreateAndCalculateIDEAFile()  # -> SelectedJoint, Analysis, Plates, Bolts, Welds, Buckling, Summary
create_idea_file_2 = CreateIDEAFile()

# ---- group: Method B
create_project_2 = CreateProject()
stiffener_plates_2 = Text()
stiffener_members_2 = Text(stiffener_plates_2)
c_script_18 = CSharpScript(Project=create_project_2, TemplateAssign=stiffener_members_2)
create_idea_file_3 = CreateIDEAFile()

# ----
# Creating HUB (TU Delft student request)
c_script_19 = CSharpScript(StiffenerMember=c_script_8, StiffenerPlate=c_script_12)
set_param_value_4 = SetParamValue(Parameter=deconstruct_template_5, Value=beam_index_3)
c_script_20 = CSharpScript(
    StiffenerMember=c_script_9,
    StiffenerPlate=c_script_13,
    Cuts=[c_script_11, c_script_10],
    Weld=c_script_15,
    Bolt=c_script_14)
set_param_value_5 = SetParamValue(Parameter=deconstruct_template_6, Value=beam_index_4)
set_param_value_6 = SetParamValue(Parameter=deconstruct_template_4, Value="200")
set_param_value_7 = SetParamValue(Parameter=deconstruct_template_7, Value="0.005")
modify_con_parameters_2 = ModifyConParameters(Parameters=set_param_value_2)
modify_con_parameters_3 = ModifyConParameters(Parameters=set_param_value_3)
modify_con_parameters_4 = ModifyConParameters(Parameters=set_param_value_4)
modify_con_parameters_5 = ModifyConParameters(Parameters=set_param_value_5)
modify_con_parameters_6 = ModifyConParameters(Parameters=set_param_value_6)
deconstruct_item_result = DeconstructItemResult(ItemResult=connection_results.SummaryResults)  # -> Name, CheckStatus, UnityCheck, PlMaxStress, PlMaxStrain, Items, ItemId, CheckMsg
c_script_21 = CSharpScript(Brandname="00", Template=c_script_16, Modifications="No parameters here")
deconstruct_item_result_2 = DeconstructItemResult(ItemResult=connection_results.WeldResults)  # -> Name, CheckStatus, UnityCheck, PlMaxStress, PlMaxStrain, Items, ItemId, CheckMsg
# Modified template to brand 0016
modify_con_parameters_7 = ModifyConParameters(Parameters=set_param_value_7)
c_script_22 = CSharpScript(Brandname="0011", Template=c_script_17, Modifications="No parameters here")
c_script_23 = CSharpScript(Brandname="0011", Template=c_script_19, Modifications="No parameters here")
# Modified template to brand 0011
panel_5 = Panel("0011")
c_script_24 = CSharpScript(Brandname="0011", Template=c_script_20, Modifications="No parameters here")
c_script_25 = CSharpScript(Brandname="0016", Template=template_by_filepath_6, Modifications=modify_con_parameters_6)
c_script_26 = CSharpScript(Brandname=panel_5, Template=template_by_filepath_6, Modifications=modify_con_parameters_7)
c_script_27 = CSharpScript(Brandname="0011", Template=template_by_filepath_2, Modifications=modify_con_parameters_2)
c_script_28 = CSharpScript(Brandname="0011", Template=template_by_filepath_4, Modifications=modify_con_parameters_4)
c_script_29 = CSharpScript(Brandname="0011", Template=template_by_filepath_3, Modifications=modify_con_parameters_3)
panel_6 = Panel(deconstruct_item_result.CheckStatus)
panel_7 = Panel(deconstruct_item_result.UnityCheck)
panel_8 = Panel(deconstruct_item_result.Name)
panel_9 = Panel(deconstruct_item_result.CheckMsg)
c_script_30 = CSharpScript(Brandname="0011", Template=template_by_filepath_5, Modifications=modify_con_parameters_5)
panel_10 = Panel(deconstruct_item_result_2.Name)
panel_11 = Panel(deconstruct_item_result_2.UnityCheck)
# Template assign in same branch will be both applied to related joint? Allowing series of templates being applied
merge = Merge(Data1=c_script_28, Data2=c_script_27)
# Template assign in same branch will be both applied to related joint? Allowing series of templates being applied
merge_2 = Merge(Data1=c_script_23, Data2=c_script_30, Data3=c_script_29)

# ---- group: Method C:
create_project_3 = CreateProject()
create_idea_file_4 = CreateIDEAFile(Project=create_project_3)
stiffener_plates_3 = Text()
stiffener_members_3 = Text(stiffener_plates_3)
calculate_connection_2 = CalculateConnection(Connection=create_idea_file_4, Modifications=stiffener_members_3)

# ----
c_script_31 = CSharpScript(filetype=".contemp")  # -> filepath; inputs filetype: String; same code as c_script
# Types of brep geometry: Plate, Stiffener member, Bolt, Weld
template_by_filepath_7 = TemplateByFilepath(Path=c_script_31)
# Template assign in tree format related to joint tree format
entwine = Entwine(
    Branch00=c_script_26,
    Branch01=c_script_25,
    Branch02=merge,
    Branch03=c_script_21,
    Branch04=c_script_22,
    Branch05=c_script_24,
    Branch06=merge_2,
    FlattenInputs=True)

# ---- group: Method B
create_project_4 = CreateProject()
# All geometry of connection (plates and stiffeners members should be exported here as brep) Tree format {joint index; geometry type; i}
# Show error if i.e. referenced indices in template do not exist "for joint 4 beam index 3 does not exist"
c_script_32 = CSharpScript(Project=create_project_4, TemplateAssign=entwine)  # -> Project, VisualizeGeometry, ShowErrorIfIEReferencedIndicesDoNotExist
# Connections in joint tree format
create_idea_file_5 = CreateIDEAFile(Project=c_script_32.Project)

# ----
deconstruct_template_8 = DeconstructTemplate(Template=template_by_filepath_7)
# Modifications tree format related to joint tree format
set_param_value_8 = SetParamValue(Parameter=deconstruct_template_8, Value="0.005")
modify_con_parameters_8 = ModifyConParameters(Parameters=set_param_value_8)
entwine_2 = Entwine(Branch00=modify_con_parameters_8, FlattenInputs=True)
calculate_connection_3 = CalculateConnection(Connection=create_idea_file_5, Modifications=entwine_2)
