# Grasshopper definition 0B_con modify_multiple connection testing.gh (Grasshopper 1.0.7)
# plug-ins: KarambaIDEA

c_script = CSharpScript(x=".ideaCon")  # -> out, A; inputs x: String
# ---------- c_script: C# usings ----------
using System.IO;
# ---------- c_script: C# ----------
    string path = this.Component.OnPingDocument().FilePath;

    string directory = Path.GetDirectoryName(path);

    string[] files = Directory.GetFiles(directory, string.Concat('*',x));

    A = files;
# ---------- end c_script ----------
file_path = FilePath("C:\Users\NathanLuke\Desktop\Con Parameters Calculations\templateexport.contemp")
list_item = ListItem(List=c_script.A, Index=0, Wrap=True)  # -> Item, Item1
c_script_2 = CSharpScript(x=".contemp")  # -> out, A; inputs x: String
# ---------- c_script_2: C# ----------
    string path = this.Component.OnPingDocument().FilePath;

    string directory = Path.GetDirectoryName(path);

    string[] files = Directory.GetFiles(directory, string.Concat('*', x));

    A = files;
# ---------- end c_script_2 ----------
template_by_filepath = TemplateByFilepath(Path=c_script_2.A)
file_path_2 = FilePath(list_item.Item)
file_path_3 = FilePath(list_item.Item1)
deconstruct_template = DeconstructTemplate(Template=template_by_filepath)
reference_connection = ReferenceConnection(Path=file_path_3)
# Multiple Connection Testing
reference_connection_2 = ReferenceConnection(Path=file_path_2)
panel = Panel(deconstruct_template)
set_param_value = SetParamValue(Parameter=deconstruct_template, Value="0.005")
# Add dontsave/save/save-as button?
# Add save as suffix option
boolean_toggle = BooleanToggle(True)
panel_2 = Panel(set_param_value)
modify_con_parameters = ModifyConParameters(Parameters=set_param_value)
calculate_connection = CalculateConnection(Connection=[reference_connection_2, reference_connection], RunIDEA=boolean_toggle)
panel_3 = Panel(modify_con_parameters)
connection_results = ConnectionResults(Connection=calculate_connection, WeldKeys="PP1a")  # -> Name, SummaryResults, PlateResults, WeldResults, BoltResults, AnchorResults, ConcreteBlockResults
deconstruct_item_result = DeconstructItemResult(ItemResult=connection_results.SummaryResults)  # -> Name, CheckStatus, UnityCheck, PlMaxStress, PlMaxStrain, Items, ItemId, CheckMsg
deconstruct_item_result_2 = DeconstructItemResult(ItemResult=connection_results.WeldResults)  # -> Name, CheckStatus, UnityCheck, PlMaxStress, PlMaxStrain, Items, ItemId, CheckMsg
panel_4 = Panel(deconstruct_item_result.Name)
panel_5 = Panel(deconstruct_item_result.CheckStatus)
panel_6 = Panel(deconstruct_item_result.UnityCheck)
panel_7 = Panel(deconstruct_item_result.CheckMsg)
panel_8 = Panel(deconstruct_item_result_2.UnityCheck)
panel_9 = Panel(deconstruct_item_result_2.Name)
