# Grasshopper definition 0C_con modify with loop.gh (Grasshopper 1.0.7)
# plug-ins: KarambaIDEA, Anemone, Koala

c_script = CSharpScript(x=".contemp")  # -> out, A; inputs x: String
# ---------- c_script: C# usings ----------
using System.IO;
# ---------- c_script: C# ----------
    string path = this.Component.OnPingDocument().FilePath;

    string directory = Path.GetDirectoryName(path);

    string[] files = Directory.GetFiles(directory, string.Concat('*',x));

    A = files;
# ---------- end c_script ----------
c_script_2 = CSharpScript(x=".ideaCon")  # -> out, A; inputs x: String; same code as c_script
file_path = FilePath(c_script.A)
list_item = ListItem(List=c_script_2.A, Index=0, Wrap=True)  # -> Item, Item1
template_by_filepath = TemplateByFilepath(Path=file_path)
file_path_2 = FilePath(list_item.Item)
panel = Panel("10")
reference_connection = ReferenceConnection(Path=file_path_2)
projectinfo = ProjectInfo(
    ProjectName="Project 1",
    Part="Project 1",
    Description="Your description for project",
    Author="Your Name",
    Date="02-01-2020")
deconstruct_template = DeconstructTemplate(Template=template_by_filepath)
loop_start = LoopStart(Repeat=0, Trigger=Button(), Data="0.005")  # -> port, Counter, Data
panel_2 = Panel(loop_start.Counter)
panel_3 = Panel(deconstruct_template)
# Add dontsave/save/save-as button?
# Add save as suffix option
panel_4 = Panel(deconstruct_template)
addition = Addition(A=loop_start.Data, B="0.001")
set_param_value = SetParamValue(Parameter=deconstruct_template, Value=addition)
modify_con_parameters = ModifyConParameters(Parameters=set_param_value)
analysis = Analysis(CalcType=0, RunESAXML=False)  # -> Message, OutputFile, SavedSEProject
calculate_connection = CalculateConnection(Connection=reference_connection, Modifications=modify_con_parameters, RunIDEA=Toggle(False))
panel_5 = Panel(modify_con_parameters)
modelbim = ExportModelBIM()
connection_results = ConnectionResults(Connection=calculate_connection, WeldKeys="PP1a")  # -> Name, SummaryResults, PlateResults, WeldResults, BoltResults, AnchorResults, ConcreteBlockResults
deconstruct_item_result = DeconstructItemResult(ItemResult=connection_results.SummaryResults)  # -> Name, CheckStatus, UnityCheck, PlMaxStress, PlMaxStrain, Items, ItemId, CheckMsg
deconstruct_item_result_2 = DeconstructItemResult(ItemResult=connection_results.WeldResults)  # -> Name, CheckStatus, UnityCheck, PlMaxStress, PlMaxStrain, Items, ItemId, CheckMsg
loop_end = LoopEnd(
    port=loop_start.port,
    Exit=deconstruct_item_result_2.CheckStatus,
    Data=addition,
    TimeOutVal=0,
    pausedState=False,
    state="Constant output")
panel_6 = Panel(loop_end)
panel_7 = Panel(deconstruct_item_result.CheckStatus)
panel_8 = Panel(deconstruct_item_result_2.UnityCheck)
panel_9 = Panel(deconstruct_item_result_2.Name)
panel_10 = Panel(deconstruct_item_result.UnityCheck)
panel_11 = Panel(deconstruct_item_result.Name)
panel_12 = Panel(deconstruct_item_result.CheckMsg)
