# Grasshopper definition KarambaIDEA_Truss_Example_2.gh (Grasshopper 1.0.7)
# Copyright: B+G Engineers
# plug-ins: Karamba3D, KarambaIDEA, Bifocals

# ---- group: Truss Splices
splice_2 = Slider(0.791, range=0..1)
splice_1 = Slider(0.214, range=0..1)
merge = Merge(Data1=splice_1, Data2=splice_2)

# ----
splice_2_2 = Slider(0.542, range=0..1)

# ---- group: Geometry Input
kink_location = Slider(0.281, range=0.1..0.4)
length = Slider(25, range=0..30)
truss_divisions = Slider(12, range=2..20)
structure_height = Slider(4, range=0..10)
truss_height = Slider(1.7, range=0..5)
kink_height = Slider(0.5, range=0..1)

# ----
multiplication = Multiplication(A=truss_height, B=kink_height)
X = UnitX(Factor=length)
point = Point(Point(0, 0, 0))
move = Move(Geometry=point, Motion=X)  # -> Geometry, Transform
negative = Negative(Value=truss_height)
negative_2 = Negative(Value=multiplication)
ln = Line(StartPoint=point, EndPoint=move.Geometry)
Z = UnitZ(Factor=negative_2)
Z_2 = UnitZ(Factor=negative)
Z_3 = UnitZ(Factor=structure_height)
aligndim = AlignedDimension(Plane=PlaneXY(0, 0, 0), PointA=point, PointB=move.Geometry, Offset=-1, Text="{0:0.00}", Size=0.2)
move_2 = Move(Geometry=ln, Motion=Z_3)  # -> Geometry, Transform
move_3 = Move(Geometry=move_2.Geometry, Motion=Z_2)  # -> Geometry, Transform
length_2 = Length(Curve=move_3.Geometry)
multiplication_2 = Multiplication(A=kink_location, B=length_2)
divide = DivideCurve(Curve=move_2.Geometry, Count=truss_divisions, Kinks=False)  # -> Points, Tangents, Parameters
extend_curve = ExtendCurve(Curve=move_2.Geometry, Type=0, Start=expr("x*-1", multiplication_2), End=expr("x*-1", multiplication_2))
list_item = ListItem(List=divide.Points, Index=0, Wrap=True)  # -> Item1, Item
perp_frame = PerpFrame(Curve=move_2.Geometry, Parameter=merge)
merge_2 = Merge(Data1=list_item.Item, Data2=list_item.Item1)
end_points = EndPoints(Curve=extend_curve)  # -> Start, End
move_4 = Move(Geometry=merge_2, Motion=Z)  # -> Geometry, Transform
distance = Distance(PointA=graft([end_points.Start, end_points.End]), PointB=divide.Points)
list_item_2 = ListItem(List=move_4.Geometry, Index=0, Wrap=True)  # -> Item, Item1
end_points_2 = EndPoints(Curve=ln)  # -> Start, End
sort_list = SortList(Keys=distance, ValuesValuesA=divide.Points)  # -> Keys, ValuesValuesA
merge_3 = Merge(Data1=end_points_2.Start, Data2=end_points_2.End)
list_item_3 = ListItem(List=sort_list.ValuesValuesA, Index=0, Wrap=True)  # -> flatten(Item)
move_5 = Move(Geometry=list_item_3, Motion=Z_2)  # -> Geometry, Transform
merge_4 = Merge(Data1=flatten(list_item_2.Item), Data2=flatten(move_5.Geometry), Data3=flatten(list_item_2.Item1))
unit_z = UnitZ(Factor=-1)
polyline = PolyLine(Vertices=merge_4, Closed=False)
project_point = ProjectPoint(Point=divide.Points, Direction=unit_z, Geometry=polyline)  # -> Point, Index
pt = Point(merge_3)
line = Line(StartPoint=divide.Points, EndPoint=project_point.Point)
line_2 = Line(StartPoint=move_4.Geometry, EndPoint=pt)
lng = ListLength(List=line)  # -> expr("x-1", Length)
end_points_3 = EndPoints(Curve=line)  # -> Start, End
series = Series(Start=lng, Step="-1", Count=expr("x/2+1", lng))
series_2 = Series(Start=0, Step="1", Count=expr("x/2+1", lng))
entwine = Entwine(Branch00=end_points_3.Start, Branch01=end_points_3.End, FlattenInputs=True)  # -> simplify(Result)
panel = Panel("""0
-1""")
cull_index = CullIndex(List=line, Indices=panel, Wrap=True)
polyline_2 = PolyLine(Vertices=entwine, Closed=False)
list_item_4 = ListItem(List=line, Index=panel, Wrap=True)
list_item_5 = ListItem(List=line, Index=series, Wrap=True)
list_item_6 = ListItem(List=line, Index=series_2, Wrap=True)
explode = Explode(Curve=polyline_2, Recursive=True)  # -> Segments, Vertices
curve_plane = CurvePlane(Curve=simplify(polyline_2), Plane=perp_frame)  # -> Points, ParamsC, ParamsP
entwine_2 = Entwine(Branch00=list_item_5, Branch01=list_item_6, FlattenInputs=True)
merge_5 = Merge(Data1=list_item_4, Data2=line_2)
end_points_4 = EndPoints(Curve=entwine_2)  # -> Start, End
path_mapper = PathMapper(curve_plane.Points, source="{A;B}", target="{A}")
merge_6 = Merge(Data1=simplify(explode.Vertices), Data2=simplify(path_mapper))
sort_along_curve = SortAlongCurve(Points=merge_6, Curve=polyline_2)  # -> Points, Indices
shift_list = ShiftList(List=end_points_4.Start, Shift="-1", Wrap=False)
shift_list_2 = ShiftList(List=end_points_4.End, Shift="1", Wrap=False)
line_3 = Line(StartPoint=shift_list, EndPoint=shift_list_2)  # -> flatten(Line)
polyline_3 = PolyLine(Vertices=sort_along_curve.Points, Closed=False)
curve_plane_2 = CurvePlane(Curve=simplify(graft(line_3)), Plane=perp_frame)  # -> Points, ParamsC, ParamsP
unit_x = UnitX(Factor=1)
explode_tree = ExplodeTree(Data=polyline_3)  # -> Branch0, Branch1
explode_2 = Explode(Curve=explode_tree.Branch1, Recursive=True)  # -> Segments, Vertices
path_mapper_2 = PathMapper(curve_plane_2.Points, source="{A;B}", target="{A}")
vector = Vector(explode_2.Segments)
explode_3 = Explode(Curve=explode_tree.Branch0, Recursive=True)  # -> Segments, Vertices
dot_product = DotProduct(VectorA=unit_x, VectorB=vector, Unitize=False)
list_length = ListLength(List=path_mapper_2)
larger_than = LargerThan(FirstNumber=list_length, SecondNumber="0")  # -> flatten(LargerThan), OrEqualTo
smaller_than = SmallerThan(FirstNumber=dot_product, SecondNumber="1")  # -> SmallerThan, OrEqualTo
dispatch = Dispatch(List=explode_2.Segments, DispatchPattern=smaller_than.SmallerThan)  # -> ListA, ListB
dispatch_2 = Dispatch(List=line_3, DispatchPattern=larger_than.LargerThan)  # -> ListA, ListB
curve = Curve(dispatch_2.ListA)
entwine_3 = Entwine(
    Branch00=merge_5,
    Branch01=explode_3.Segments,
    Branch02=dispatch.ListB,
    Branch03=dispatch.ListA,
    Branch04=cull_index,
    Branch05=dispatch_2.ListB,
    Branch06=curve,
    FlattenInputs=True)

# ---- group: Karamba3D / Define Materials
matselect = MaterialSelectionKaramba3D(menu=[dropdown(1), dropdown(4)])

# ---- group: Karamba3D / Define Cross Sections / Cross Section Range Selector (Karamba3D)
crosecrselect = CrossSectionRangeSelectorKaramba3D(MaximumHeight_cm=-1, MaximumWidth_cm=-1, Material=matselect, menu=[dropdown(1), dropdown(3), dropdown(4)])

# ---- group: Karamba3D / Define Cross Sections / Cross Section Selector (Karamba3D)
crosecselect = CrossSectionSelectorKaramba3D(CrossSections=crosecrselect)  # -> CrossSection, Info

crosecselect_2 = CrossSectionSelectorKaramba3D(CrossSections=crosecrselect)  # -> CrossSection, Info

crosecselect_3 = CrossSectionSelectorKaramba3D(CrossSections=crosecrselect)  # -> CrossSection, Info

# ---- group: Karamba3D / Define Cross Sections
entwine_4 = Entwine(
    Branch00=crosecselect.CrossSection,
    Branch01=crosecselect_2.CrossSection,
    Branch02=crosecselect_2.CrossSection,
    Branch03=crosecselect_2.CrossSection,
    Branch04=crosecselect_3.CrossSection,
    Branch05=crosecselect_3.CrossSection,
    Branch06=crosecselect_3.CrossSection,
    FlattenInputs=True)
crosec = CrossSectionKaramba3D(crosecrselect)

# ---- group: Karamba3D / Define Loads
load_multiplier = Slider(20, range=0..500)
panel_2 = Panel("Topchord")
Z_4 = UnitZ(Factor=load_multiplier)
panel_3 = Panel("1")

load_multiplier_2 = Slider(-50, range=-100..0)
panel_4 = Panel("Topchord")
Z_5 = UnitZ(Factor=load_multiplier_2)
panel_5 = Panel("0")

# ---- group: Karamba3D / Define Elements
panel_6 = Panel("""Column
Topchord
Bottomchord
Kinkchord
Post
Diagonal
Splice""")

# ---- group: Karamba3D / Define Supports
panel_7 = Panel("""Diagonal
DiagonalSplice""")
beam_joints = BeamJointsKaramba(
    ElementIdentifiers=panel_7,
    CtKNMAtStartingNode=Vector(0, 0, 0),
    CrKNmRadAtStartingNode=Vector(0, 0, 0),
    CtKNMAtEndNode=Vector(0, 0, 0),
    CrKNmRadAtEndNode=Vector(0, 0, 0),
    menu=[buttons(off, off, off, off, on, off), buttons(off, off, off, off, on, off)])

# ---- group: Karamba3D / Define Loads / Loads (Karamba3D)
loads = LoadsKaramba3D(Vector=Z_4, BeamIdentifiers=panel_2, LCase=panel_3, mode="Uniform Line", menu=[buttons(on, off, off)])

loads_2 = LoadsKaramba3D(Vector=Z_5, BeamIdentifiers=panel_4, LCase=panel_5, mode="Uniform Line", menu=[buttons(on, off, off)])

# ---- group: Karamba3D
line_4 = Line(entwine_3)
pt_2 = Point(pt)
joint = JointKaramba3D(beam_joints)
load = LoadKaramba3D([loads_2, loads])

# ---- group: Karamba3D / Define Supports
pt_3 = Point(pt_2)
supp = SupportKaramba(PosInd=pt_3, menu=[buttons(on, on, on, on, off, off)])

# ---- group: Karamba3D / Define Elements / Line to Beam (Karamba3D)
linetobeam = LineToBeamKaramba3D(Line=line_4, Identifier=graft(panel_6), CrossSection=entwine_4, New=True, Remove=True, LimitDistance_m=0.005)  # -> Element, Points, Info

# ----
license_karamba3d = LicenseKaramba3D()
panel_8 = Panel(license_karamba3d)

# ---- group: Karamba3D
element = ElementKaramba3D(linetobeam.Element)
load_2 = LoadKaramba3D(load)
joint_2 = JointKaramba3D(joint)
support = SupportKaramba3D(supp)

# ---- group: Karamba3D / Optimize Crosssections
panel_9 = Panel("""Column
Topchord
Bottomchord
Kinkchord
Post
Diagonal
Splice""")
crosec_2 = CrossSectionKaramba3D(crosec)

# ---- group: Karamba3D / Assemble Model
assemble = AssembleModelKaramba3D(Elem=flatten(element), Support=flatten(support), Load=flatten(load_2), Joint=flatten(joint_2), LimitDistance_m=0.005)  # -> Model, Info, Mass_kg, CenterOfGravity

# ---- group: Karamba3D / Optimize Crosssections / Optimize Cross Section (Karamba3D)
opticrosec = OptimizeCrossSectionKaramba3D(
    Model=assemble.Model,
    GroupIdentifiers=panel_9,
    CrossSections=crosec_2,
    MaximumUtilization=1,
    MaximumDisplacement_cm=-1,
    UltimateLimitStateIterations=5,
    DisplacementIterations=5,
    NumberOfSamplePoints=3,
    ElasticDesign=True,
    GammaM0=1,
    GammaM1=1)  # -> ModelWithOptimizedCrossSections, Info, Mass_kg, MaximumDisplacement_cm, ElasticEnergy_kNm

# ---- group: Karamba3D / Analyze Model / Analyze (Karamba3D)
analyze = AnalyzeKaramba3D(Model=opticrosec.ModelWithOptimizedCrossSections)  # -> CalculatedModel, MaximumDisplacement_cm, ResultingForceOfGravity_kN, ElasticEnergy_kNm

# ---- group: Karamba3D / View Results / Model View (Karamba3D)
modelview = ModelViewKaramba3D(Model=analyze.CalculatedModel, LoadCaseFactorsForLinearSuperposition=1, IndexOfVisibleLoadcase="0")  # -> Model, DeformedMesh, DeformedAxes, DeformedModel

# ---- group: Karamba3D / View Results / Beam View (Karamba3D)
beamview = BeamViewKaramba3D(Model=modelview.Model)  # -> Model, MeshesOfRenderedBeams, DeformedBeamAxes, LegendColors, LegendTags

# ---- group: 2. Create Project / Stream filter to control data speed
# KarambaIDEA
toggle = BooleanToggle(True)
filter = StreamFilter(Gate=toggle, Stream1=beamview.Model)

# ---- group: 2. Create Project / Data collect / Disassemble Model (Karamba3D)
disassemble = DisassembleModelKaramba3D(Model=filter)  # -> Model, Point, Beam, Shell, Support, Load, Line, Mesh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

# ---- group: 2. Create Project / Data collect
k3dbeamprops = CSharpScript(
    Model=disassemble.Model,
    Reference=["C:\PROGRAM FILES\RHINO 7\PLUG-INS\KARAMBA\karambaCommon.dll", "C:\PROGRAM FILES\RHINO 7\PLUG-INS\KARAMBA\karamba.gha"])  # -> BeamIds, Material, CrosecNames, CrosecShapes, Heights, Widths, TFlanges, TWebs, FRads
# ---------- k3dbeamprops: C# usings ----------
using Karamba.Elements;
using Karamba.CrossSections;
# ---------- k3dbeamprops: C# ----------
    var model = Model as Karamba.Models.Model;
    if (model == null) {
      throw new ArgumentException ("The input is not of type model!");
    }

    var beam_ids = new List<string>();
    var cs_names = new List<string>();
    var cs_shapes = new List<string>();
    var cs_material = new List<string>();
    var heights = new List<double>();
    var widths = new List<double>();
    var tflanges = new List<double>();
    var twebs = new List<double>();
    var frads = new List<double>();

    foreach (var elem in model.elems)
    {
      var beam = elem as ModelElementStraightLine;
      if (beam != null) {
        beam_ids.Add(elem.id);
        cs_names.Add(elem.crosec.name);
        cs_shapes.Add(elem.crosec.shape());
        cs_material.Add(elem.crosec.materialName);

        // is it an I-profile?
        var crosec_i = beam.crosec as CroSec_I;
        if (crosec_i != null) {
          heights.Add(crosec_i.getHeight() * 1000);
          // use the upper flange thickness
          widths.Add(crosec_i.uf_width * 1000);
          tflanges.Add(crosec_i.uf_thick * 1000);
          twebs.Add(crosec_i.w_thick * 1000);
          // use the inner fillet radius
          frads.Add(crosec_i.fillet_r * 1000);
          // this would be the outer fillet radius
          // frads.Add(crosec.fillet_r1);
          continue;
        }

        // is it a CHS?
        var crosec_o = beam.crosec as CroSec_Circle;
        if (crosec_o != null) {
          heights.Add(crosec_o.getHeight() * 1000);
          // use the upper flange thickness
          widths.Add(0);
          tflanges.Add(crosec_o.thick * 1000);
          twebs.Add(crosec_o.thick * 1000);
          frads.Add(0);
          continue;
        }

        // options for Box, trapezoid and T-section are not implemented yet
        throw new Exception("Cross section encountered for which no export is implemented");
      }
    }

    BeamIds = beam_ids;
    CrosecNames = cs_names;
    CrosecShapes = cs_shapes;
    Material = cs_material;
    Heights = heights;
    Widths = widths;
    TFlanges = tflanges;
    TWebs = twebs;
    FRads = frads;
# ---------- end k3dbeamprops ----------
b_forces = BeamForcesKaramba3D(AnalyzedModel=disassemble.Model, LCase=-1, MaximumDistanceBetweenResults_m=-1, NumberOfResultsPerBeamElement=2)  # -> AnalyzedModel, NormalForce_kN, ShearForceVz_kN, ShearForceVy_kN, BendingMomentMt_kNm, BendingMomentMy_kNm, BendingMomentMz_kNm
disassemble_2 = DisassembleElementKaramba3D(Element=disassemble.Beam)  # -> Element, ElementIdentifier, AxisOfElement, CrossSection, Joints, Material, LocalCoordinateSystem, ElementIsActive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
vec_cm_to_mm = Vector(expr("x*10", disassemble_2.LocalEccentricity_cm))
hierarchy = Panel("""Column
Topchord
Bottomchord
Kinkchord
Post
Diagonal
Splice""")
cp = CreateProject(
    Hierarchy=hierarchy,
    Points=disassemble.Point,
    Lines=disassemble.Line,
    LCSRotations_Deg=disassemble_2.Alpha_deg,
    EccentricityVector=vec_cm_to_mm,
    Groupnames=k3dbeamprops.BeamIds,
    Materials=k3dbeamprops.Material,
    CrossSectionNames=k3dbeamprops.CrosecNames,
    Shapes=k3dbeamprops.CrosecShapes,
    Heights=k3dbeamprops.Heights,
    Widths=k3dbeamprops.Widths,
    ThicknessFlanges=k3dbeamprops.TFlanges,
    ThicknessWebs=k3dbeamprops.TWebs,
    Radius=k3dbeamprops.FRads,
    N=b_forces.NormalForce_kN,
    Vz=b_forces.ShearForceVz_kN,
    Vy=b_forces.ShearForceVy_kN,
    Mt=b_forces.BendingMomentMt_kNm,
    My=b_forces.BendingMomentMy_kNm,
    Mz=b_forces.BendingMomentMz_kNm)

# ----
panel_10 = Panel(cp)
deconstruct_project = DeconstructProject(Project=cp)  # -> Joints, BrandNames
export_to_modelbim = ExportToModelBIM(Project=cp, OutputFolder="C:\Data\GrasshopperExample", RunIDEA=Toggle(True))
deconstruct_joint = DeconstructJoint(Joint=deconstruct_project.Joints)  # -> Id, Name, MemberIds, BearingId, ConnectionData, graft(Brand)

# ----
# Joint Display
point_2 = Point(deconstruct_project.Joints)
panel_11 = Panel("""0.2
-0.2""")
unit_z_2 = UnitZ(Factor=panel_11)
move_6 = Move(Geometry=graft(point_2), Motion=unit_z_2)  # -> Geometry, Transform
list_item_7 = ListItem(List=move_6.Geometry, Index=0, Wrap=True)  # -> Item1, Item
text_tag = TextTag(Location=list_item_7.Item, Text=graft(deconstruct_joint.Id))
text_tag_2 = TextTag(Location=list_item_7.Item1, Text=deconstruct_joint.Brand)

data = Data(cp)

# ---- group: Map Joints to Trees Based on Brands
create_set = CreateSet(List=flatten(deconstruct_joint.Brand))  # -> Set, graft(Map)
graft_tree = GraftTree(Tree=deconstruct_project.Joints, IncludeEmptyLists=True, IncludeNullItems=True)  # -> simplify(Tree)
list_item_8 = ListItem(List=create_set.Set, Index=create_set.Map, Wrap=True)
tree_statistics = TreeStatistics(Tree=graft_tree)  # -> Paths, Length, Count
construct_path = ConstructPath(Indices=simplify(list_item_8))
replace_paths = ReplacePaths(Data=graft_tree, Search=tree_statistics.Paths, Replace=flatten(construct_path))

# ----
panel_12 = Panel("C:\Data\GrasshopperExample\top_chord_welded_template.contemp")
connection_category = Panel("1145")
tree_branch = TreeBranch(Tree=replace_paths, Path=connection_category, MaintainPaths=True)
list_length_2 = ListLength(List=tree_branch)
split_list = SplitList(List=tree_branch, Index=expr("x/2", list_length_2))  # -> ListA, ListB
# Calculate ideaCon file
concatenate = Concatenate(FragmentA="C:\Data\Test", FragmentB="template_1145.contemp", JoinSeparator="\")  # -> graft(Result)
import_idea_template = ImportIDEATemplate(Path=concatenate)
deconstruct_idea_template = DeconstructIDEATemplate(Template=import_idea_template)
idea_template_full = IDEATemplateFull(IDEATemplate=import_idea_template)
panel_13 = Panel("C:\Data\GrasshopperExample\WorkingJoints")
panel_14 = Panel(deconstruct_idea_template)
panel_15 = Panel("""0
-1""")
list_item_9 = ListItem(List=split_list.ListA, Index=panel_15, Wrap=True)
dj = DeconstructJoint(Joint=list_item_9)  # -> Id, Name, MemberIds, BearingId, ConnectionData, Brand
modify_joint = ModifyJoint(Joint=list_item_9, TemplateAssigns=idea_template_full)
concatenate_2 = Concatenate(FragmentA="C:\Data\Test", FragmentB=connection_category, JoinSeparator="\")  # -> graft(Result)
item = ListItem(List=disassemble.Line, Index=dj.MemberIds, Wrap=True)
create_idea_file = CreateIDEAFile(Joints=modify_joint, OutputFolder=concatenate_2, RunIDEA=Toggle(True))
panel_16 = Panel(dj.MemberIds)
deconstruct_connection = DeconstructConnection(Connection=create_idea_file)  # -> Name, LoadEffects, Parameters, CodeSetup, Filepath
panel_17 = Panel(deconstruct_connection.Parameters)
panel_18 = Panel("""0.010
0.015""")
panel_19 = Panel("""0.012
0.018""")
panel_20 = Panel(create_idea_file)
entwine_5 = Entwine(Branch00=panel_18, Branch01=panel_19, FlattenInputs=True)
set_param_value = SetParamValue(Parameter=deconstruct_connection.Parameters, Value=entwine_5)
code_setup = CodeSetup(CodeSetup=deconstruct_connection.CodeSetup, Key="stopAtLimitStrain", Value=Toggle(True))
modify_con_parameters = ModifyConParameters(Parameters=set_param_value)
panel_21 = Panel(code_setup)
calculate_connection = CalculateConnection(Connection=graft(create_idea_file), Modifications=modify_con_parameters, RunIDEA=Toggle(True))
panel_22 = Panel(modify_con_parameters)
panel_23 = Panel(calculate_connection)
connection_results = ConnectionResults(Connection=calculate_connection)  # -> Name, SummaryResults, PlateResults, WeldResults, BoltResults, AnchorResults, ConcreteBlockResults
panel_24 = Panel(connection_results.SummaryResults)
deconstruct_item_result = DeconstructItemResult(ItemResult=connection_results.SummaryResults)  # -> Name, CheckStatus, UnityCheck, PlMaxStress, PlMaxStrain, Items, ItemId, CheckMsg
deconstruct_item_result_2 = DeconstructItemResult(ItemResult=connection_results.WeldResults)  # -> Name, CheckStatus, UnityCheck, PlMaxStress, PlMaxStrain, Items, ItemId, CheckMsg
panel_25 = Panel(deconstruct_item_result.Name)
panel_26 = Panel(deconstruct_item_result.CheckStatus)
panel_27 = Panel(deconstruct_item_result_2.CheckStatus)
panel_28 = Panel(deconstruct_item_result_2.UnityCheck)
panel_29 = Panel(deconstruct_item_result_2.Name)

# ----
# Local Coordinate System Display
lcs = LocalCoordinateSystem(Project=data)  # -> LineOfElements, LocalXVectors, LocalYVectors, LocalZVectors
length_3 = Slider(0.149, range=0..2)
radius = Slider(0.01, range=0..0.01)
curvepoint = PointOnCurve(lcs.LineOfElements, parameter=0.182)

cluster = Cluster(num=length_3, num_2=radius, pt=curvepoint, vec_2=lcs.LocalXVectors, vec=lcs.LocalYVectors, vec_3=lcs.LocalZVectors)  # -> D, C

preview = CustomPreview(Geometry=cluster.D, Material=cluster.C)

# ==== cluster Cluster
vec = ClusterInput()
vec_2 = ClusterInput()
pt = ClusterInput()
vec_3 = ClusterInput()
num = ClusterInput()
num_2 = ClusterInput()
vec_4 = Vector(vec)
vec_5 = Vector(vec_2)
pt_2 = Point(pt)
vec_6 = Vector(vec_3)
num_3 = Number(num)
num_4 = Number(num_2)
line = LineSDL(Start=pt_2, Direction=vec_5, Length=num_3)
line_2 = LineSDL(Start=pt_2, Direction=vec_4, Length=num_3)
line_3 = LineSDL(Start=pt_2, Direction=vec_6, Length=num_3)
panel = Panel("""255
0
0""")
entwine = Entwine(Branch00=line, Branch01=line_2, Branch02=line_3, FlattenInputs=True)  # -> simplify(Result)
panel_2 = Panel("""0
255
0""")
panel_3 = Panel("""0
0
255""")
rgb = ColourRGB(Alpha=255, Red=panel, Green=panel_2, Blue=panel_3)  # -> graft(Colour)
pipe = Pipe(Curve=entwine, Radius=num_4, Caps=0)
pshift = ShiftPaths(Data=pipe, Offset=-1)
C = ClusterOutput(rgb)
D = ClusterOutput(pshift)
