# Grasshopper definition KarambaIDEA_Example_RotatingTower.gh (Grasshopper 1.0.7)
# Copyright: B+G Engineers
# plug-ins: karambaGH, KarambaIDEA

# ---- group: Parameters
degrees = Slider(180, range=0..180)
# KarambaIDEA Example Rotating Tower
height = Slider(25, range=10..40)
number_of_triangles = Slider(7, range=0..20)

radius_top = Slider(6, range=1..10)
radius_mid = Slider(3.1, range=1..10)
radius_base = Slider(4, range=1..10)

# ----
rgb = ColourRGB(Alpha=255, Red=0, Green=0, Blue=0)

panel = Panel("""Parameters
Geometry
Karamba3D
KarambaIDEA
3. Project utilities
4. IDEA utilities
5. IDEA templates""")
merge = Merge(
    Data1=ColourSwatch(SwatchColor=RGB(106, 144, 173)),
    Data2=ColourSwatch(SwatchColor=RGB(123, 189, 179)),
    Data3=ColourSwatch(SwatchColor=RGB(227, 136, 118)),
    Data4=ColourSwatch(SwatchColor=RGB(237, 221, 161)),
    Data5=ColourSwatch(SwatchColor=RGB(186, 222, 214)),
    Data6=ColourSwatch(SwatchColor=RGB(250, 227, 217)),
    Data7=ColourSwatch(SwatchColor=RGB(255, 181, 184)))
group_color = SliderGroupColor(run=Button(), groupNames=panel, colors=merge, defaultColor=ColourSwatch(SwatchColor=RGB(232, 227, 227)))  # inputs run: Boolean, groupNames: list of String, colors: list of Color, defaultColor: Color
# ---------- group_color: C# usings ----------
using System.Drawing;
using Grasshopper.Kernel.Special;
# ---------- group_color: C# ----------
    // Created by Timo Harboe Nielsen - Bjarke Ingels Group.
    
    if(!run){
      return;
    }
    GH_Document doc = owner.OnPingDocument();
    foreach (var dobj in doc.Objects)
    {
      GH_Group _group = dobj as GH_Group;
      if( _group == null){
        continue;
      }
      for(int i = 0; i < Math.Min(groupNames.Count, colors.Count); i++){
        string groupName = _group.NickName.ToString();
        string compareName = groupNames[i];
        if(groupName.IndexOf(compareName, StringComparison.OrdinalIgnoreCase) >= 0){
          _group.Colour = colors[i];
          break;
        } else{
          _group.Colour = defaultColor;
        }
      }
    }
# ---------- end group_color ----------

# ---- group: Geometry
Z = UnitZ(Factor=height)
pt = ConstructPoint(XCoordinate=0, YCoordinate=0, ZCoordinate=0)
move = Move(Geometry=pt, Motion=Z)  # -> Geometry, Transform
ln = Line(StartPoint=pt, EndPoint=move.Geometry)

division = Division(A="1", B=number_of_triangles)
series = Series(Start=0, Step=division, Count=expr("x+1", number_of_triangles))
divide = DivideCurve(Curve=ln, Count=number_of_triangles, Kinks=False)  # -> Points, Tangents, Parameters
pframe = PerpFrame(Curve=ln, Parameter=divide.Parameters)  # -> graft(Frame)

num = Number(expr("x/2", height))
merge_2 = Merge(Data1="0", Data2=num, Data3=height)
Z_2 = UnitZ(Factor=merge_2)

num_2 = Number(expr("x/2", degrees))
merge_3 = Merge(Data1="0", Data2=num_2, Data3=degrees)

merge_4 = Merge(Data1=radius_base, Data2=radius_mid, Data3=radius_top)
rad = Radians(Degrees=merge_3)
polygon = Polygon(Plane=Z_2, Radius=merge_4, Segments="3", FilletRadius=0)  # -> Polygon, Length
rotate = Rotate(Geometry=polygon.Polygon, Angle=rad, Plane=PlaneXY(0, 0, 0))  # -> Geometry, Transform
explode = Explode(Curve=rotate.Geometry, Recursive=Toggle(False))  # -> Segments, Vertices
flip = FlipMatrix(Data=explode.Vertices)
intcrv = Interpolate(Vertices=flip, Degree=3, Periodic=False, KnotStyle=1)  # -> flatten(Curve), Length, Domain

pt_2 = Point(pframe)
crv = Curve(intcrv.Curve)
lng = ListLength(List=crv)
culln = CullNth(List=crv, CullFrequency=lng)
pcx = CurvePlane(Curve=culln, Plane=pt_2)  # -> Points, ParamsC, ParamsP
pt_3 = Point(simplify(flatten(pcx.Points)))
lng_2 = ListLength(List=culln)
partition = PartitionList(List=pt_3, Size=lng_2)
pt_4 = Point(partition)
flip_2 = FlipMatrix(Data=pt_4)
flip_3 = FlipMatrix(Data=partition)
cull_i = CullIndex(List=flip_2, Indices="0", Wrap=True)
flip_4 = FlipMatrix(Data=cull_i)
shift = ShiftList(List=flip_4, Shift="-1", Wrap=True)
ln_2 = Line(StartPoint=partition, EndPoint=shift)
pt_5 = Point(flip_3)
line = Line(ln_2)

pt_6 = Point(pt_5)
lng_3 = ListLength(List=pt_6)
cull_i_2 = CullIndex(List=pt_6, Indices="0", Wrap=True)
culln_2 = CullNth(List=pt_6, CullFrequency=lng_3)
ln_3 = Line(StartPoint=cull_i_2, EndPoint=culln_2)

# ----
pt_7 = Point(pt_5)

# ----
# Columns
line_2 = Line(ln_3)

# ----
# Triangles
line_3 = Line(line)

pt_8 = Point(pt_7)
pt_9 = Point(pt_7)

# ---- group: Geometry
vec = Vector(line_2)
vec_2 = VectorXYZ(XComponent=0, YComponent=0, ZComponent=0)  # -> Vector, Length
lng_4 = ListLength(List=vec)
ins = InsertItems(List=vec, Item=vec_2.Vector, Indices=lng_4, Wrap=True)
ins_2 = InsertItems(List=vec, Item=vec_2.Vector, Indices="0", Wrap=True)
devec = DeconstructVector(Vector=ins_2)  # -> XComponent, YComponent, ZComponent
devec_2 = DeconstructVector(Vector=ins)  # -> XComponent, YComponent, ZComponent
expression = Expression(x=devec.XComponent, y=devec_2.XComponent, Expression="(x+y)/2")
expression_2 = Expression(x=devec.ZComponent, y=devec_2.ZComponent, Expression="(x+y)/2")
expression_3 = Expression(x=devec.YComponent, y=devec_2.YComponent, Expression="(x+y)/2")
vec_3 = VectorXYZ(XComponent=expression, YComponent=expression_3, ZComponent=expression_2)  # -> Vector, Length

# ----
number_slider = Slider(0.5, range=0.5..1)
pt_10 = Point(pt_9)
rev = Reverse(Vector=vec_3.Vector)

# ---- group: Geometry
line_4 = LineSDL(Start=pt_10, Direction=vec_3.Vector, Length=number_slider)
move_2 = Move(Geometry=pt_10, Motion=line_4)  # -> Geometry, Transform
cull_i_3 = CullIndex(List=move_2.Geometry, Indices="0", Wrap=True)
pt_11 = Point(cull_i_3)

line_5 = LineSDL(Start=pt_10, Direction=rev, Length=number_slider)
move_3 = Move(Geometry=pt_10, Motion=line_5)  # -> Geometry, Transform
lng_5 = ListLength(List=move_3.Geometry)
culln_3 = CullNth(List=move_3.Geometry, CullFrequency=lng_5)
pt_12 = Point(culln_3)

# ----
pt_13 = Point(pt_10)
panel_2 = Panel("""0
1
2""")
weave = Weave(Pattern=panel_2, Stream0=pt_13, Stream1=pt_12, Stream2=pt_11, NullGaps=False)

# ---- group: Geometry
pt_14 = Point(weave)
lng_6 = ListLength(List=pt_14)
culln_4 = CullNth(List=pt_14, CullFrequency=lng_6)
cull_i_4 = CullIndex(List=pt_14, Indices="0", Wrap=True)
ln_4 = Line(StartPoint=culln_4, EndPoint=cull_i_4)

# ----
line_6 = Line(flatten(ln_4))
pt_15 = Point(pt_8)
line_7 = Line(line_3)
entwine = Entwine(Branch00=line_6, Branch01=line_7, FlattenInputs=True)
item = ListItem(List=pt_15, Index=0, Wrap=True)

# ---- group: Karamba3D / Define Materials
matselect = MaterialSelectionKaramba3D(menu=[dropdown(1), dropdown(4)])

# ---- group: Karamba3D / Define Cross Sections
crosecrselect = CrossSectionRangeSelectorKaramba3D(MaximumHeight_cm=-1, MaximumWidth_cm=-1, Material=matselect, menu=[dropdown(1), dropdown(2), dropdown(1)])
crosecselect = CrossSectionSelectorKaramba3D(CrossSections=crosecrselect, NameOrListIndexOfCrossSection=Slider(10, range=0..100))  # -> CrossSection, Info
crosec = CrossSectionKaramba3D(crosecrselect)

crosecrselect_2 = CrossSectionRangeSelectorKaramba3D(MaximumHeight_cm=-1, MaximumWidth_cm=-1, Material=matselect, menu=[dropdown(1), dropdown(2), dropdown(1)])
crosecselect_2 = CrossSectionSelectorKaramba3D(CrossSections=crosecrselect_2, NameOrListIndexOfCrossSection=Slider(10, range=0..100))  # -> CrossSection, Info
crosec_2 = CrossSectionKaramba3D(crosecrselect_2)

# ---- group: Karamba3D
pt_16 = Point(item)
line_8 = Line(entwine)
panel_3 = Panel("Columns")
entwine_2 = Entwine(Branch00=crosecselect.CrossSection, Branch01=crosecselect_2.CrossSection, FlattenInputs=True)
merge_5 = Merge(Data1=crosec, Data2=crosec_2)  # -> flatten(Result)

# ---- group: Karamba3D / Define Loads
load_multiplier = Slider(8, range=0..20)
Y = UnitY(Factor=load_multiplier)
loads = LoadsKaramba3D(Vector=Y, BeamIdentifiers=panel_3, LCase=0, mode="Uniform Line", menu=[buttons(off, on, off)])

# ---- group: Karamba3D / Define Elements
panel_4 = Panel("""Columns
Triangles""")
linetobeam = LineToBeamKaramba3D(Line=line_8, Identifier=graft(panel_4), CrossSection=entwine_2, New=True, Remove=True, LimitDistance_m=0.005)  # -> Element, Points, Info

# ---- group: Karamba3D / Define Supports
pt_17 = Point(pt_16)
supp = SupportKaramba(PosInd=pt_17, menu=[buttons(on, on, on, off, off, off)])

# ---- group: Karamba3D
element = ElementKaramba3D(linetobeam.Element)
support = SupportKaramba3D(supp)
load = LoadKaramba3D(loads)

# ---- group: Karamba3D / Assemble Model
assemble = AssembleModelKaramba3D(Elem=flatten(element), Support=flatten(support), Load=flatten(load), LimitDistance_m=0.005)  # -> Model, Info, Mass_kg, CenterOfGravity

# ---- group: Karamba3D / Optimize Crosssections
panel_5 = Panel("""Columns
Triangles""")
crosec_3 = CrossSectionKaramba3D(merge_5)
opticrosec = OptimizeCrossSectionKaramba3D(
    Model=assemble.Model,
    GroupIdentifiers=panel_5,
    CrossSections=crosec_3,
    MaximumUtilization=1,
    MaximumDisplacement_cm=-1,
    UltimateLimitStateIterations=5,
    DisplacementIterations=5,
    NumberOfSamplePoints=3,
    ElasticDesign=True,
    GammaM0=1,
    GammaM1=1)  # -> ModelWithOptimizedCrossSections, Info, Mass_kg, MaximumDisplacement_cm, ElasticEnergy_kNm

# ---- group: Karamba3D / Analyze Model
analyze = AnalyzeKaramba3D(Model=assemble.Model)  # -> CalculatedModel, MaximumDisplacement_cm, ResultingForceOfGravity_kN, ElasticEnergy_kNm

# ---- group: Karamba3D / View Results
modelview = ModelViewKaramba3D(Model=opticrosec.ModelWithOptimizedCrossSections, LoadCaseFactorsForLinearSuperposition=1, IndexOfVisibleLoadcase=-1)  # -> Model, DeformedMesh, DeformedAxes, DeformedModel
beamview = BeamViewKaramba3D(Model=modelview.Model)  # -> Model, MeshesOfRenderedBeams, DeformedBeamAxes, LegendColors, LegendTags

# ---- group: 2. Create Project / Stream filter to control data speed
# KarambaIDEA
toggle = BooleanToggle(True)
filter = StreamFilter(Gate=toggle, Stream1=beamview.Model)

# ---- group: Relevant nodes
pt_18 = Point(flatten(pt_15))

# ---- group: 2. Create Project / Data collect
disassemble = DisassembleModelKaramba3D(Model=filter)  # -> Model, Point, Beam, Shell, Support, Load, Line, Mesh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
k3dbeamprops = CSharpScript(
    Model=disassemble.Model,
    Reference=["C:\PROGRAM FILES\RHINO 7\PLUG-INS\KARAMBA\karambaCommon.dll", "C:\PROGRAM FILES\RHINO 7\PLUG-INS\KARAMBA\karamba.gha"])  # -> BeamIds, Material, CrosecNames, CrosecShapes, Heights, Widths, TFlanges, TWebs, FRads
# ---------- k3dbeamprops: C# usings ----------
using Karamba.Elements;
using Karamba.CrossSections;
# ---------- k3dbeamprops: C# ----------
    var model = Model as Karamba.Models.Model;
    if (model == null) {
      throw new ArgumentException ("The input is not of type model!");
    }

    var beam_ids = new List<string>();
    var cs_names = new List<string>();
    var cs_shapes = new List<string>();
    var cs_material = new List<string>();
    var heights = new List<double>();
    var widths = new List<double>();
    var tflanges = new List<double>();
    var twebs = new List<double>();
    var frads = new List<double>();

    foreach (var elem in model.elems)
    {
      var beam = elem as ModelElementStraightLine;
      if (beam != null) {
        beam_ids.Add(elem.id);
        cs_names.Add(elem.crosec.name);
        cs_shapes.Add(elem.crosec.shape());
        cs_material.Add(elem.crosec.materialName);

        // is it an I-profile?
        var crosec_i = beam.crosec as CroSec_I;
        if (crosec_i != null) {
          heights.Add(crosec_i.getHeight() * 1000);
          // use the upper flange thickness
          widths.Add(crosec_i.uf_width * 1000);
          tflanges.Add(crosec_i.uf_thick * 1000);
          twebs.Add(crosec_i.w_thick * 1000);
          // use the inner fillet radius
          frads.Add(crosec_i.fillet_r * 1000);
          // this would be the outer fillet radius
          // frads.Add(crosec.fillet_r1);
          continue;
        }

        // is it a CHS?
        var crosec_o = beam.crosec as CroSec_Circle;
        if (crosec_o != null) {
          heights.Add(crosec_o.getHeight() * 1000);
          // use the upper flange thickness
          widths.Add(0);
          tflanges.Add(crosec_o.thick * 1000);
          twebs.Add(crosec_o.thick * 1000);
          frads.Add(0);
          continue;
        }

        // options for Box, trapezoid and T-section are not implemented yet
        throw new Exception("Cross section encountered for which no export is implemented");
      }
    }

    BeamIds = beam_ids;
    CrosecNames = cs_names;
    CrosecShapes = cs_shapes;
    Material = cs_material;
    Heights = heights;
    Widths = widths;
    TFlanges = tflanges;
    TWebs = twebs;
    FRads = frads;
# ---------- end k3dbeamprops ----------
b_forces = BeamForcesKaramba3D(AnalyzedModel=disassemble.Model, LCase=-1, MaximumDistanceBetweenResults_m=-1, NumberOfResultsPerBeamElement=2)  # -> AnalyzedModel, NormalForce_kN, ShearForceVz_kN, ShearForceVy_kN, BendingMomentMt_kNm, BendingMomentMy_kNm, BendingMomentMz_kNm
disassemble_2 = DisassembleElementKaramba3D(Element=disassemble.Beam)  # -> Element, ElementIdentifier, AxisOfElement, CrossSection, Joints, Material, LocalCoordinateSystem, ElementIsActive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
vec_cm_to_mm = Vector(expr("x*10", disassemble_2.LocalEccentricity_cm))
hierarchy = Panel("""Columns
Triangles""")
cp = CreateProject(
    Hierarchy=hierarchy,
    Points=pt_18,
    Lines=disassemble.Line,
    LCSRotations_Deg=disassemble_2.Alpha_deg,
    EccentricityVector=vec_cm_to_mm,
    Groupnames=k3dbeamprops.BeamIds,
    Materials=k3dbeamprops.Material,
    CrossSectionNames=k3dbeamprops.CrosecNames,
    Shapes=k3dbeamprops.CrosecShapes,
    Heights=k3dbeamprops.Heights,
    Widths=k3dbeamprops.Widths,
    ThicknessFlanges=k3dbeamprops.TFlanges,
    ThicknessWebs=k3dbeamprops.TWebs,
    Radius=k3dbeamprops.FRads,
    N=b_forces.NormalForce_kN,
    Vz=b_forces.ShearForceVz_kN,
    Vy=b_forces.ShearForceVy_kN,
    Mt=b_forces.BendingMomentMt_kNm,
    My=b_forces.BendingMomentMy_kNm,
    Mz=b_forces.BendingMomentMz_kNm)

# ----
panel_6 = Panel("C:\Users\r.ajouz\source\repos\KarambaIDEA\0_IDEA_Templates\")
concat = Concatenate(FragmentA=panel_6, FragmentB="RotatingTowerTemplate", FragmentC=".contemp")

data = Data(cp)
panel_7 = Panel("""0111
0011""")
data_2 = Data(data)

# ---- group: 4. Analytical templates
analytical_template_weld_all_members = AnalyticalTemplateWeldsAllMembers(Project=data, BrandNames=panel_7)  # -> Project, Message, ThroatsBeginOfElement, ThroatsEndOfElement
show_weldsizes = BooleanToggle(True)
position = Slider(0.2, range=0..1)
textsize = Slider(0.02, range=0..0.15)
retrievelinespoints = RetrieveLinesPoints(Project=analytical_template_weld_all_members.Project)  # -> Lines, Points
num_3 = Number(position)
num_4 = Number(Slider(-12, range=-100..100))
expression_4 = Expression(x=num_3, Expression="1-x")
cluster = Cluster_3(C=retrievelinespoints.Lines, t=num_3, D=num_4)
txt = Text(analytical_template_weld_all_members.ThroatsBeginOfElement)
cluster_2 = Cluster_3(C=retrievelinespoints.Lines, t=expression_4, D=num_4)
txt_2 = Text(analytical_template_weld_all_members.ThroatsEndOfElement)
filter_2 = StreamFilter(Gate=show_weldsizes, Stream0=flatten("0"), Stream1=textsize)
swatch = ColourSwatch(SwatchColor=RGB(0, 0, 0))
tag = TextTag3D(Location=cluster, Text=txt, Size=filter_2, Colour=swatch, Justification="5")
tag_2 = TextTag3D(Location=cluster_2, Text=txt_2, Size=filter_2, Colour=swatch, Justification="5")

# ----
panel_8 = Panel("""011
0011""")
data_3 = Data(data)

# ---- group: 3. Project utilities
# Visualize joints
visualize_joints = VisualizeJoints(Project=data_2)  # -> JointTypes, Brandnames, Centerpoints
radius = Slider(0.2, range=0.2..0.5)
spread = Slider(26, range=0..100)
move_along_x = Slider(27, range=0..100)
textsize_2 = Slider(0.4, range=0..1)
cluster_3 = Cluster_2(line=visualize_joints.JointTypes, num_2=spread, num=move_along_x, num_3=radius)  # -> P, R
cluster_4 = Cluster(G=visualize_joints.Centerpoints, data_3=spread, X=move_along_x)
preview = CustomPreview(Geometry=cluster_3.P, Material=cluster_3.R)
xz = XZPlane(Origin=flatten(cluster_4))
data_4 = Data(flatten(visualize_joints.Brandnames))
tag_3 = TextTag3D(Location=xz, Text=data_4, Size=textsize_2, Colour=ColourSwatch(SwatchColor=RGB(0, 0, 0)), Justification=7)

# ---- group: 5. IDEA Templates
template_weld_all_members = TemplateWeldAllMembers(Project=data_3, BrandNames=panel_8)  # -> Project, Message; disabled

template_by_filepath = TemplateByFilepath(Project=data_3, BrandNames="0011", TemplateFilePath=concat)  # -> Project, Message, Brep
preview_2 = CustomPreview(Geometry=template_by_filepath.Brep, Material=ColourSwatch(SwatchColor=RGB(63, 217, 209)))

# ----
data_5 = Data(analytical_template_weld_all_members.Project)
data_6 = Data(template_by_filepath.Project)

# ---- group: 6. IDEA utilities
user_feedback = BooleanToggle(False)
run_all_joints = BooleanToggle(False)
run_idea = Button()
data_7 = Data(data_6)
output_folderpath = Panel("C:\Data")
create_and_calculate_idea_file = CreateAndCalculateIDEAFile(
    Project=data_7,
    OutputFolder=output_folderpath,
    UserFeecback=user_feedback,
    RunAllJoints=run_all_joints,
    ChooseJoint=[Slider(8, range=0..30), Slider(0, range=0..30), Slider(3, range=0..30)],
    RunIDEA=run_idea)  # -> SelectedJoint, Analysis, Plates, Bolts, Welds, Buckling, Summary
rec = DataRecorder(create_and_calculate_idea_file.Welds, DataLimit=-10, RecordData=True)
rec_2 = DataRecorder(create_and_calculate_idea_file.Buckling, DataLimit=-10, RecordData=True)
rec_3 = DataRecorder(create_and_calculate_idea_file.Analysis, DataLimit=-10, RecordData=True)
rec_4 = DataRecorder(create_and_calculate_idea_file.Plates, DataLimit=-10, RecordData=True)
rec_5 = DataRecorder(create_and_calculate_idea_file.Bolts, DataLimit=-10, RecordData=True)
rec_6 = DataRecorder(create_and_calculate_idea_file.Summary, DataLimit=-10, RecordData=True)
summary_message = Panel(rec_6)
analysis = Panel(rec_3)
ucplates = Panel(rec_4)
ucbolts = Panel(rec_5)
ucwelds = Panel(rec)
ucbuckling = Panel(rec_2)

data_8 = Data(data_6)
user_feedback_2 = BooleanToggle(False)
run_all_joints_2 = BooleanToggle(False)
run_idea_2 = Button()
output_folderpath_2 = Panel("C:\Data")
create_idea_file = CreateIDEAFile(
    Project=data_8,
    OutputFolder=output_folderpath_2,
    UserFeecback=user_feedback_2,
    CreateAllJoints=run_all_joints_2,
    ChooseJoint=Slider(8, range=0..100),
    RunIDEA=run_idea_2)

# ----
pt_19 = Point(flatten(pt_18))
xz_2 = XZPlane(Origin=pt_19)

# ---- group: 7. Cost calculation
data_9 = Data(data_5)
boltprices_from_m12_up_till_m52 = Panel("""0.30
0.60
1.10
1.50
2.30
2.70
5.10
26.56
31.81
31.40""")
bolt_costs = BoltCosts(Project=data_9, Boltprices=boltprices_from_m12_up_till_m52)  # -> BoltCosts, Message
weld_volume_generator = WeldVolumeGenerator(Project=data_9)
total_weight = TotalWeight(Project=data_9)  # -> WeightElements_kg, WeightPlates_kg, Brep
retrievelinespoints_2 = RetrieveLinesPoints(Project=data_9)  # -> Lines, Points
price_steel = Panel("1")
price_welding = Panel("2.6")
applied_boltprices = Panel(bolt_costs.Message)
costcalculator = CostCalculator(
    WeightElements_kg=total_weight.WeightElements_kg,
    WeightPlates_kg=total_weight.WeightPlates_kg,
    WeldingVolume_cm3=weld_volume_generator,
    BoltCosts=bolt_costs.BoltCosts,
    NumberOfElements=0,
    SteelPricePerKg=price_steel,
    WeldingPricePerCm3=price_welding,
    TransportPricePerElement=20)  # -> CostsOfBeamMaterial_, CostsPerJoint_, CostsPerJointDetailed_, TransportCost_
preview_3 = CustomPreview(Geometry=total_weight.Brep, Material=ColourSwatch(SwatchColor=RGBA(158, 138, 138, 138)))
xz_3 = XZPlane(Origin=retrievelinespoints_2.Points)
Z_3 = UnitZ(Factor=Slider(0.23, range=0..1))
ma = MassAddition(Input=costcalculator.CostsPerJointDetailed_)  # -> flatten(Result), PartialResults
Y_2 = UnitY(Factor="0.2")
move_4 = Move(Geometry=xz_2, Motion=Z_3)  # -> Geometry, Transform
move_5 = Move(Geometry=move_4.Geometry, Motion=Y_2)  # -> Geometry, Transform
tag_4 = TextTag3D(Location=move_5.Geometry, Text=costcalculator.CostsPerJoint_, Size=Slider(0.54, range=0..3), Justification=7)

# ----
panel_9 = Panel(costcalculator.CostsPerJoint_)

# ==== cluster Cluster
G = ClusterInput()
X = ClusterInput()
vec = VectorXYZ(XComponent=X, YComponent=0, ZComponent=0)  # -> Vector, Length
move = Move(Geometry=G, Motion=vec.Vector)  # -> Geometry, Transform
data = Data(move.Geometry)
tstat = TreeStatistics(Tree=data)  # -> Paths, Length, Count
dpath = DeconstructPath(Branch=tstat.Paths)
data_2 = Data(graft(tstat.Length))
flip = FlipMatrix(Data=dpath)
data_3 = ClusterInput()
bang = ExplodeTree(Data=flip)  # -> flatten(Branch0), flatten(Branch1)
data_4 = Data(data_3)
data_5 = Data(graft(bang.Branch0))
data_6 = Data(graft(bang.Branch1))
multiplication = Multiplication(A=bang.Branch0, B=data_4)
multiplication_2 = Multiplication(A=bang.Branch1, B=data_4)
path = ConstructPath(Indices=[data_5, data_6])  # -> flatten(Branch)
vec_2 = VectorXYZ(XComponent=multiplication, YComponent=multiplication_2, ZComponent=0)  # -> Vector, Length
unflatten = UnflattenTree(Tree=vec_2.Vector, Guide=path)  # -> graft(Tree)
data_7 = Data(flatten(data))
dup = DuplicateData(Data=unflatten, Number=data_2, Order=True)  # -> flatten(Data)
move_2 = Move(Geometry=data_7, Motion=dup)  # -> Geometry, Transform
G_2 = ClusterOutput(move_2.Geometry)
panel = Panel(move_2.Geometry)

# ==== cluster Cluster_2
num = ClusterInput()
num_2 = ClusterInput()
line = ClusterInput()
num_3 = ClusterInput()
num_4 = Number(num)
num_5 = Number(num_2)
line_2 = Line(line)
num_6 = Number(num_3)
cluster = Cluster(G=line_2, data_3=num_5, X=num_4)
line_3 = Line(cluster)
pipe = Pipe(Curve=line_3, Radius=num_6, Caps=0)  # -> flatten(Pipe)
dom = ConstructDomain(DomainStart="0", DomainEnd="1")
pshift = ShiftPaths(Data=line_2, Offset=-1)
P = ClusterOutput(pipe)
range = Range(Domain=dom, Steps=Slider(8, range=0..100))
lng = ListLength(List=pshift)
data = Data(flatten(lng))
data_2 = Data(range)
c_script = CSharpScript(lengths=data, colorlist=data_2)  # -> out, A; inputs lengths: list of Double, colorlist: list of Double
# ---------- c_script: C# ----------
    DataTree<double> tree = new DataTree<double>();
    GH_Path path = new GH_Path();
    int w = 0;


    for (int b = 0; b < lengths.Count; b++)
    {
      for (int c = 0;c < lengths[b];c++)
      {
        double num = colorlist[(w % colorlist.Count)];
        //tree.Add(num, path);
        tree.Add(num);
      }
      w = w + 1;

    }
    A = tree;
# ---------- end c_script ----------
data_3 = Data(flatten(c_script.A))
gradient = Gradient(
    LowerLimit=0,
    UpperLimit=1,
    Parameter=data_3,
    stops=[0: RGB(35, 99, 187), 0: RGB(234, 38, 0), 0: RGBA(255, 255, 255, 0), 0.25: RGB(234, 126, 0), 0.5: RGB(254, 244, 84), 0.75: RGB(173, 203, 249)])
lng_2 = ListLength(List=gradient)
dup = DuplicateData(Data=" (100)", Number=lng_2, Order=True)  # -> flatten(Data)
merge = Merge(Data1=graft(gradient), Data2=graft(dup))
join = TextJoin(Text=merge)  # -> flatten(Result)
R = ClusterOutput(join)

# ==== cluster Cluster_3
C = ClusterInput()
t = ClusterInput()
D = ClusterInput()
eval = EvaluateCurve(Curve=C, Parameter=t)  # -> Point, Tangent, Angle
rad = Radians(Degrees=D)
xz = XZPlane(Origin=eval.Point)
rotate = Rotate(Geometry=xz, Angle=rad, Plane=xz)  # -> Geometry, Transform
G = ClusterOutput(rotate.Geometry)
