# Grasshopper definition KarambaIDEA_RFEM_example.gh (Grasshopper 1.0.7)
# Copyright: B+G Engineers
# plug-ins: Parametric_FEM_Toolbox, KarambaIDEA

# KarambaIDEA RFEM example
number_slider = Slider(0, range=0..10)
number_slider_2 = Slider(7, range=0..10)
pt = ConstructPoint(XCoordinate=number_slider, YCoordinate=Slider(0, range=0..10), ZCoordinate=Slider(0, range=0..10))
pt_2 = ConstructPoint(XCoordinate=Slider(0, range=0..10), YCoordinate=Slider(0, range=0..10), ZCoordinate=Slider(4, range=-10..10))
pt_3 = ConstructPoint(XCoordinate=number_slider_2, YCoordinate=Slider(0, range=0..10), ZCoordinate=Slider(0, range=0..10))
pt_4 = ConstructPoint(XCoordinate=number_slider_2, YCoordinate=Slider(0, range=0..10), ZCoordinate=Slider(3, range=-10..10))
ln = Line(StartPoint=pt, EndPoint=pt_2)
merge = Merge(Data1=pt_2, Data2=pt_4)
ln_2 = Line(StartPoint=pt_2, EndPoint=pt_4)
merge_2 = Merge(Data1=pt, Data2=pt_3)
ln_3 = Line(StartPoint=pt_4, EndPoint=pt_3)
merge_3 = Merge(Data1=ln, Data2=ln_3, Data3=ln_2)
panel = Panel(" RO 26.9x2.6 | EN 10210-2:2006")
merge_4 = Merge(Data1=ln, Data2=ln_3)
panel_2 = Panel("QRO 100x10")
line = Line(merge_3)
pt_5 = Point(merge)

# ----
# Supports
pt_6 = Point(merge_2)
list = ValueList({"UnknownRotationSequence": 0, "SequenceZYX": 1, "SequenceZXY": 2, "SequenceYZX": 3, "SequenceYXZ": 4, "SequenceXZY": 5, "SequenceXYZ": 6}, selected="SequenceXYZ")
rfnodalsupport = RFNodalSupport(
    Location=pt_6,
    DisplacementDirX="-1",
    DisplacementDirY="-1",
    DisplacementDirZ="-1",
    RotationDirX="-1",
    RotationSequence=list,
    mode="Assemble")

# ----
# Loads
list_2 = ValueList({"UnknownActionCategory": 0, "Permanent": 1, "Prestress": 2, "Imposed": 3, "TrafficLoads": 4, "SnowIce": 5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}, selected="DeadLoad": 16)
list_3 = ValueList({"UnknownDesignSituation": 0, "NoneDesignSituation": 1, "OtherDesignSituation": 2, "ManualUls": 3, "ManualUlsAccidental": 4, "ManualSeismic": 5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}, selected="SlsCharacteristic": 47)
list_4 = ValueList({"UnknownActionCategory": 0, "Permanent": 1, "Prestress": 2, "Imposed": 3, "TrafficLoads": 4, "SnowIce": 5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}, selected="ImposedCategoryH": 34)
list_5 = ValueList({"UnknownLoadDirectionType": 0, "GlobalXType": 1, "GlobalYType": 2, "GlobalZType": 3, "LocalXType": 4, "LocalYType": 5, "LocalZType": 6, "LocalUType": 7, "LocalVType": 8, "ProjectXType": 9, "ProjectYType": 10, "ProjectZType": 11, "PerpendicularZType": 12}, selected="GlobalZType")
Z = UnitZ(Factor=1)
rfloadcase = RFLoadCase(LoadCaseNumber="1", Description="Selfweight", ActionCategory=list_2, SelfWeightFactor=Z, mode="Assemble")
rfloadcombo = RFLoadCombination(LoadComboNumber="1", Definition="LC1 + LC2", DesignSituation=list_3, mode="Assemble")
rfloadcase_2 = RFLoadCase(LoadCaseNumber="2", Description="Live Load", ActionCategory=list_4, mode="Assemble")
rfmemberload = RFMemberLoad(Member="3", LC="2", F1=Slider(1, range=0..10), Dir=list_5, mode="Assemble")
merge_5 = Merge(Data1=rfloadcase, Data2=rfloadcase_2)

# ----
# Member
line_2 = Line(merge_4)
groupname = Panel("Column")
groupname_2 = Panel("Beam")
line_3 = Line(ln_2)
rfmember = RFMember(Line=line_2, StartCrossSection="1", Comment=groupname, mode="Assemble")
rfmember_2 = RFMember(Line=line_3, StartCrossSection="1", Comment=groupname_2, mode="Assemble")

# ----
# Crosssection
panel_3 = Panel("HEB 300")
rfcrosec = RFCrossSection(Description=panel_3, MaterialNumber="1", CrossSectionNumber="1", mode="Assemble")

# ----
# Material
panel_4 = Panel("Steel S 235")
rfmaterial = RFMaterial(Description=panel_4, MaterialNumber="1", mode="Assemble")

# ----
# Export model to RFEM
create_rfem_model = Button()
set_data = SetData(
    RunComponent=create_rfem_model,
    RFMembers=[rfmember, rfmember_2],
    RFNodalSupports=rfnodalsupport,
    RFCrossSections=rfcrosec,
    RFMaterials=rfmaterial,
    RFMemberLoads=rfmemberload,
    RFLoadCases=merge_5,
    RFLoadCombos=rfloadcombo)  # -> RFNodes, RFLines, RFMembers, RFSurfaces, RFOpenings, RFNodalSupports, RFLineSupports, RFSurfaceSupports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

# ----
# Analyse model in RFEM
calculate = Button()
calculate_2 = CalculateModel(RunComponent=calculate)  # -> LoadCases, MaximumDisplacement

panel_5 = Panel("""0
-1""")
panel_6 = Panel("""0
-1""")

panel_7 = Panel("C:\Users\r.ajouz\source\repos\KarambaIDEA\0_IDEA_Templates\")
concat = Concatenate(FragmentA=panel_7, FragmentB="IDEA_NL", FragmentC=".contemp")

panel_8 = Panel("Tjoint")
user_feedback = BooleanToggle(False)
run_all_joints = BooleanToggle(False)

# ----
# Retrieve Results from RFEM
toggle = BooleanToggle(True)

retrieve_results = Button()
get_data = GetData(
    RunComponent=retrieve_results,
    Members=toggle,
    CrossSections=Toggle(True),
    Materials=Toggle(True),
    LoadCases=Toggle(True))  # -> RFNodes, RFLines, RFMembers, RFSurfaces, RFOpenings, RFNodalSupports, RFLineSupports, RFSurfaceSupports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
int = Integer(get_data.RFLoadCases)
list_6 = ValueList({"UnknownValueType": 0, "StandardValueType": 1, "MaximumValueType": 2, "MinimumValueType": 3, "MaximumAlongX": 4, "MinimumAlongX": 5, "MaximumAlongY": 6, "MinimumAlongY": 7, "MaximumAlongZ": 8, "MinimumAlongZ": 9, "MaximumAroundX": 10, "MinimumAroundX": 11, "MaximumAroundY": 12, "MinimumAroundY": 13, "MaximumAroundZ": 14, "MinimumAroundZ": 15}, selected="StandardValueType")
concat_2 = Concatenate(FragmentA="LoadCase", FragmentB=int, JoinSeparator=" ")

get_results = GetResults(
    RunComponent=retrieve_results,
    OverwriteLoadCaseOrCombo=concat_2,
    OverwriteResultType=list_6,
    menu=[dropdown(0), dropdown(0), buttons(on, off), checkbox(on), checkbox(on), checkbox(on), checkbox(on), checkbox(on)])  # -> CalculationResults, Curves, MemberNo, Meshes, SurfaceNo
rfmember_3 = RFMember(RFMember=get_data.RFMembers, mode="Disassemble")  # -> Line, MemberNumber, Comment, LineNumber, MemberType, RotationAngle_, RotationType, StartCrossSection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
rfcrosec_2 = RFCrossSection(RFCrossSection=get_data.RFCrossSections, mode="Disassemble")  # -> Description, CrossSectionNumber, Comment, MaterialNumber, AxialArea_m², ShearAreaY_m², ShearAreaZ_m², BendingMomentY_m⁴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
rfmaterial_2 = RFMaterial(RFMaterial=get_data.RFMaterials, mode="Disassemble")  # -> Description, MaterialNumber, Comment, ElasticityModulus_kN_cm², PoissonRatio, ShearModulus_kN_cm², SpecificWeight_N_m³, ThermalExpansion_1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
lcs_rotations_degree = Number(rfmember_3.RotationAngle_)
groupnames = Text(rfmember_3.Comment)
panel_9 = Panel(rfcrosec_2.ShearAreaY_m²)
mindex = MemberIndex(Set=rfcrosec_2.CrossSectionNumber, Member=rfmember_3.StartCrossSection)  # -> flatten(Index), Count
mindex_2 = MemberIndex(Set=rfmaterial_2.MaterialNumber, Member=rfcrosec_2.MaterialNumber)  # -> flatten(Index), Count
item = ListItem(List=rfcrosec_2.Description, Index=mindex.Index, Wrap=True)
heights = Number(rfcrosec_2.Height_m)
widths = Number(rfcrosec_2.Width_m)
tflanges = Number(rfcrosec_2.FlangeThickness_m)
twebs = Number(rfcrosec_2.WebThickness_m)
frads = Number(rfcrosec_2.InnerRadius_m)
lcs_rotations_degree_2 = Number(lcs_rotations_degree)
groupnames_2 = Text(groupnames)
rf_object = RFObject(get_results.CalculationResults)

rep = ReplaceText(Text=rfcrosec_2.Description, Find=" ", RecursiveReplace=False)

panel_10 = Panel("""ISection
Hollow
Pipe""")
tmatch = MatchText(Text=rfcrosec_2.Type, Pattern=graft(panel_10), Case=True)
int_2 = Integer(tmatch)
tstat = TreeStatistics(Tree=simplify(int_2))  # -> Paths, Length, Count
dpath = DeconstructPath(Branch=tstat.Paths)
multiplication = Multiplication(A=int_2, B=dpath)
flip = FlipMatrix(Data=multiplication)
panel_11 = Panel("""I
[]
O""")
ma = MassAddition(Input=flip)  # -> flatten(Result), PartialResults
item_2 = ListItem(List=panel_11, Index=ma.Result, Wrap=True)

item_3 = ListItem(List=rfmaterial_2.Description, Index=mindex_2.Index, Wrap=True)
split = TextSplit(Text=item_3, Separators=" ")
panel_12 = Panel("""1
2""")
item_4 = ListItem(List=split, Index=panel_12, Wrap=True)
join = TextJoin(Text=item_4)

materials = Text(join)
crosecnames = Text(rep)
shapes = Text(item_2)
entwine = Entwine(
    Branch00=materials,
    Branch01=crosecnames,
    Branch02=shapes,
    Branch03=heights,
    Branch04=widths,
    Branch05=tflanges,
    Branch06=twebs,
    Branch07=frads,
    FlattenInputs=True)  # -> simplify(Result)
flip_2 = FlipMatrix(Data=entwine)
branch = TreeBranch(Tree=flip_2, Path=mindex.Index, MaintainPaths=False)
flip_3 = FlipMatrix(Data=branch)
crosssection_properties = Data(flip_3)

mforces = MemberForces(CalculationResults=rf_object)  # -> MemberNumber, Location, Forces, Moments, ResultsFlag
item_5 = ListItem(List=mforces.Forces, Index=panel_5, Wrap=True)
item_6 = ListItem(List=mforces.Moments, Index=panel_6, Wrap=True)
devec = DeconstructVector(Vector=item_5)  # -> XComponent, YComponent, ZComponent
devec_2 = DeconstructVector(Vector=item_6)  # -> XComponent, YComponent, ZComponent

# ----
# Local Coordinate System Transformation
# LCS tranformations to other FEM packages can be found at:
# https://github.com/BouwenmetStaal/KarambaIDEA/blob/master/0_Documentation/LCS_transformations.pdf
panel_13 = Panel("-1")
multiplication_2 = Multiplication(A=devec.YComponent, B=panel_13)

multiplication_3 = Multiplication(A=devec.ZComponent, B="-1")

multiplication_4 = Multiplication(A=devec_2.YComponent, B="-1")

multiplication_5 = Multiplication(A=devec_2.ZComponent, B="-1")

crosssection_properties_2 = Data(crosssection_properties)

# ---- group: 2. Create Project
# KarambaIDEA
pt_7 = Point(pt_5)
line_4 = Line(line)
lcs_rotations_degree_3 = Number(lcs_rotations_degree_2)
groupnames_3 = Text(groupnames_2)
bang = ExplodeTree(Data=crosssection_properties_2)  # -> Branch0, Branch1, Branch2, Branch3, Branch4, Branch5, Branch6, Branch7
shapes_2 = Text(bang.Branch2)
heights_m_to_mm = Number(expr("x*1000", bang.Branch3))
widths_m_to_mm = Number(expr("x*1000", bang.Branch4))
frads_m_to_mm = Number(expr("x*1000", bang.Branch7))
materials_2 = Text(bang.Branch0)
crosecnames_2 = Text(bang.Branch1)
tflanges_m_to_mm = Number(expr("x*1000", bang.Branch5))
twebs_m_to_mm = Number(expr("x*1000", bang.Branch6))
hierarchy = Panel("""Column
Beam""")
cp = CreateProject(
    Hierarchy=hierarchy,
    Points=pt_7,
    Lines=line_4,
    LCSRotations_Deg=lcs_rotations_degree_3,
    Groupnames=groupnames_3,
    Materials=materials_2,
    CrossSectionNames=crosecnames_2,
    Shapes=shapes_2,
    Heights=heights_m_to_mm,
    Widths=widths_m_to_mm,
    ThicknessFlanges=tflanges_m_to_mm,
    ThicknessWebs=twebs_m_to_mm,
    Radius=frads_m_to_mm,
    N=devec.XComponent,
    Vz=multiplication_3,
    Vy=multiplication_2,
    Mt=devec_2.XComponent,
    My=multiplication_4,
    Mz=multiplication_5)

# ----
panel_14 = Panel(groupnames_3)
panel_15 = Panel(shapes_2)
panel_16 = Panel(crosecnames_2)

# ---- group: 5. IDEA Templates
template_by_filepath = TemplateByFilepath(Project=cp, BrandNames="01", TemplateFilePath=concat)  # -> Project, Message, Brep
preview = CustomPreview(Geometry=template_by_filepath.Brep, Material=ColourSwatch(SwatchColor=RGB(63, 217, 209)))

# ----
data = Data(template_by_filepath.Project)

# ---- group: 3. Project utilities
# Visualize joints
visualize_joints = VisualizeJoints(Project=data)  # -> JointTypes, Brandnames, Centerpoints
radius = Slider(0.2, range=0.2..0.5)
spread = Slider(10, range=0..100)
move_along_x = Slider(27, range=0..100)
textsize = Slider(0.4, range=0..1)
cluster = Cluster_3(line=visualize_joints.JointTypes, num_2=spread, num=move_along_x, num_3=radius)  # -> P, R
cluster_2 = Cluster_2(G=visualize_joints.Centerpoints, data_3=spread, X=move_along_x)
preview_2 = CustomPreview(Geometry=cluster.P, Material=cluster.R)
xz = XZPlane(Origin=flatten(cluster_2))
data_2 = Data(flatten(visualize_joints.Brandnames))
tag = TextTag3D(Location=xz, Text=data_2, Size=textsize, Colour=ColourSwatch(SwatchColor=RGB(0, 0, 0)), Justification=7)

# ---- group: 6. IDEA utilities
data_3 = Data(data)
output_folderpath = Panel("C:\Data")
user_feedback_2 = BooleanToggle(False)
run_all_joints_2 = BooleanToggle(False)
run_idea = Button()
create_idea_file = CreateIDEAFile(
    Project=data_3,
    OutputFolder=output_folderpath,
    UserFeecback=user_feedback_2,
    CreateAllJoints=run_all_joints_2,
    ChooseJoint=Slider(1, range=0..100),
    RunIDEA=run_idea)

data_4 = Data(data)
output_folderpath_2 = Panel("C:\Data")
number_slider_3 = Slider(33, range=0..100)
run_idea_2 = Button()

# ----
create_and_calculate_idea_file = CreateAndCalculateIDEAFile(
    Project=data_4,
    OutputFolder=output_folderpath_2,
    UserFeecback=user_feedback,
    RunAllJoints=run_all_joints,
    ChooseJoint=number_slider_3,
    RunIDEA=run_idea_2)  # -> SelectedJoint, Analysis, Plates, Bolts, Welds, Buckling, Summary

# ---- group: 6. IDEA utilities (continued)
cluster_3 = Cluster(T=create_and_calculate_idea_file.Analysis)
cluster_4 = Cluster(T=create_and_calculate_idea_file.Plates)
cluster_5 = Cluster(T=create_and_calculate_idea_file.Bolts)
cluster_6 = Cluster(T=create_and_calculate_idea_file.Welds)
cluster_7 = Cluster(T=create_and_calculate_idea_file.Buckling)
cluster_8 = Cluster(T=create_and_calculate_idea_file.Summary)
summary_message = Panel(cluster_8)
analysis = Panel(cluster_3)
ucplates = Panel(cluster_4)
ucwelds = Panel(cluster_6)
ucbuckling = Panel(cluster_7)
ucbolts = Panel(cluster_5)

# ==== cluster Cluster
T = ClusterInput()
join = TextJoin(Text=T)
rec = DataRecorder(join, DataLimit=2, RecordData=True)
item = ListItem(List=flatten(rec), Index=0, Wrap=True)
i = ClusterOutput(item)
panel = Panel(item)

# ==== cluster Cluster_2
G = ClusterInput()
X = ClusterInput()
vec = VectorXYZ(XComponent=X, YComponent=0, ZComponent=0)  # -> Vector, Length
move = Move(Geometry=G, Motion=vec.Vector)  # -> Geometry, Transform
data = Data(move.Geometry)
tstat = TreeStatistics(Tree=data)  # -> Paths, Length, Count
dpath = DeconstructPath(Branch=tstat.Paths)
data_2 = Data(graft(tstat.Length))
flip = FlipMatrix(Data=dpath)
data_3 = ClusterInput()
bang = ExplodeTree(Data=flip)  # -> flatten(Branch0), flatten(Branch1)
data_4 = Data(data_3)
data_5 = Data(graft(bang.Branch0))
data_6 = Data(graft(bang.Branch1))
multiplication = Multiplication(A=bang.Branch0, B=data_4)
multiplication_2 = Multiplication(A=bang.Branch1, B=data_4)
path = ConstructPath(Indices=[data_5, data_6])  # -> flatten(Branch)
vec_2 = VectorXYZ(XComponent=multiplication, YComponent=multiplication_2, ZComponent=0)  # -> Vector, Length
unflatten = UnflattenTree(Tree=vec_2.Vector, Guide=path)  # -> graft(Tree)
data_7 = Data(flatten(data))
dup = DuplicateData(Data=unflatten, Number=data_2, Order=True)  # -> flatten(Data)
move_2 = Move(Geometry=data_7, Motion=dup)  # -> Geometry, Transform
G_2 = ClusterOutput(move_2.Geometry)
panel = Panel(move_2.Geometry)

# ==== cluster Cluster_3
num = ClusterInput()
num_2 = ClusterInput()
line = ClusterInput()
num_3 = ClusterInput()
num_4 = Number(num)
num_5 = Number(num_2)
line_2 = Line(line)
num_6 = Number(num_3)
cluster = Cluster_2(G=line_2, data_3=num_5, X=num_4)
line_3 = Line(cluster)
pipe = Pipe(Curve=line_3, Radius=num_6, Caps=0)  # -> flatten(Pipe)
dom = ConstructDomain(DomainStart="0", DomainEnd="1")
pshift = ShiftPaths(Data=line_2, Offset=-1)
P = ClusterOutput(pipe)
range = Range(Domain=dom, Steps=Slider(8, range=0..100))
lng = ListLength(List=pshift)
data = Data(flatten(lng))
data_2 = Data(range)
c_script = CSharpScript(lengths=data, colorlist=data_2)  # -> out, A; inputs lengths: list of Double, colorlist: list of Double
# ---------- c_script: C# ----------
    DataTree<double> tree = new DataTree<double>();
    GH_Path path = new GH_Path();
    int w = 0;


    for (int b = 0; b < lengths.Count; b++)
    {
      for (int c = 0;c < lengths[b];c++)
      {
        double num = colorlist[(w % colorlist.Count)];
        //tree.Add(num, path);
        tree.Add(num);
      }
      w = w + 1;

    }
    A = tree;
# ---------- end c_script ----------
data_3 = Data(flatten(c_script.A))
gradient = Gradient(
    LowerLimit=0,
    UpperLimit=1,
    Parameter=data_3,
    stops=[0: RGB(35, 99, 187), 0: RGB(234, 38, 0), 0: RGBA(255, 255, 255, 0), 0.25: RGB(234, 126, 0), 0.5: RGB(254, 244, 84), 0.75: RGB(173, 203, 249)])
lng_2 = ListLength(List=gradient)
dup = DuplicateData(Data=" (100)", Number=lng_2, Order=True)  # -> flatten(Data)
merge = Merge(Data1=graft(gradient), Data2=graft(dup))
join = TextJoin(Text=merge)  # -> flatten(Result)
R = ClusterOutput(join)
