# Grasshopper definition KarambaIDEA_TestJoint.gh (Grasshopper 1.0.7)
# Copyright: B+G Engineers
# plug-ins: KarambaIDEA, karambaGH

number_slider = Slider(16, range=0..20)
vec = VectorXYZ(XComponent=expr("x/2", number_slider), YComponent=expr("x/2", number_slider), ZComponent=expr("x/2", number_slider))  # -> Vector, Length
pt = ConstructPoint(XCoordinate=0, YCoordinate=0, ZCoordinate=0)
pt_2 = Point(pt)
vec_2 = VectorXYZ(XComponent=expr("x/2", number_slider), YComponent=number_slider, ZComponent=0)  # -> Vector, Length
vec_3 = VectorXYZ(XComponent=expr("x/2", number_slider), YComponent=0, ZComponent=0)  # -> Vector, Length
vec_4 = VectorXYZ(XComponent=expr("x/2", number_slider), YComponent=0, ZComponent=number_slider)  # -> Vector, Length
vec_5 = VectorXYZ(XComponent=number_slider, YComponent=expr("x/2", number_slider), ZComponent=0)  # -> Vector, Length
vec_6 = VectorXYZ(XComponent=expr("x/2", number_slider), YComponent=number_slider, ZComponent=number_slider)  # -> Vector, Length
vec_7 = VectorXYZ(XComponent=expr("x/2", number_slider), YComponent=expr("x/2", number_slider), ZComponent=0)  # -> Vector, Length
vec_8 = VectorXYZ(XComponent=expr("x/2", number_slider), YComponent=expr("x/2", number_slider), ZComponent=number_slider)  # -> Vector, Length
vec_9 = VectorXYZ(XComponent=expr("x/2", number_slider), YComponent=0, ZComponent=expr("x/2", number_slider))  # -> Vector, Length
vec_10 = VectorXYZ(XComponent=0, YComponent=expr("x/2", number_slider), ZComponent=number_slider)  # -> Vector, Length
vec_11 = VectorXYZ(XComponent=expr("x/2", number_slider), YComponent=number_slider, ZComponent=expr("x/2", number_slider))  # -> Vector, Length
vec_12 = VectorXYZ(XComponent=pt_2, YComponent=expr("x/2", number_slider), ZComponent=0)  # -> Vector, Length
vec_13 = VectorXYZ(XComponent=number_slider, YComponent=expr("x/2", number_slider), ZComponent=number_slider)  # -> Vector, Length
vec_14 = VectorXYZ(XComponent=0, YComponent=expr("x/2", number_slider), ZComponent=expr("x/2", number_slider))  # -> Vector, Length
vec_15 = VectorXYZ(XComponent=number_slider, YComponent=expr("x/2", number_slider), ZComponent=expr("x/2", number_slider))  # -> Vector, Length
move = Move(Geometry=pt_2, Motion=vec.Vector)  # -> Geometry, Transform
move_2 = Move(Geometry=pt_2, Motion=vec_9.Vector)  # -> Geometry, Transform
move_3 = Move(Geometry=pt_2, Motion=vec_11.Vector)  # -> Geometry, Transform
move_4 = Move(Geometry=pt_2, Motion=vec_8.Vector)  # -> Geometry, Transform
move_5 = Move(Geometry=pt_2, Motion=vec_3.Vector)  # -> Geometry, Transform
move_6 = Move(Geometry=pt_2, Motion=vec_10.Vector)  # -> Geometry, Transform
move_7 = Move(Geometry=pt_2, Motion=vec_4.Vector)  # -> Geometry, Transform
move_8 = Move(Geometry=pt_2, Motion=vec_6.Vector)  # -> Geometry, Transform
move_9 = Move(Geometry=pt_2, Motion=vec_5.Vector)  # -> Geometry, Transform
move_10 = Move(Geometry=pt_2, Motion=vec_7.Vector)  # -> Geometry, Transform
move_11 = Move(Geometry=pt_2, Motion=vec_13.Vector)  # -> Geometry, Transform
move_12 = Move(Geometry=pt_2, Motion=vec_12.Vector)  # -> Geometry, Transform
move_13 = Move(Geometry=pt_2, Motion=vec_14.Vector)  # -> Geometry, Transform
move_14 = Move(Geometry=pt_2, Motion=vec_2.Vector)  # -> Geometry, Transform
move_15 = Move(Geometry=pt_2, Motion=vec_15.Vector)  # -> Geometry, Transform
ln = Line(StartPoint=move.Geometry, EndPoint=move_15.Geometry)
ln_2 = Line(StartPoint=move.Geometry, EndPoint=move_3.Geometry)
ln_3 = Line(StartPoint=move.Geometry, EndPoint=move_2.Geometry)
ln_4 = Line(StartPoint=move_13.Geometry, EndPoint=move.Geometry)
ln_5 = Line(StartPoint=move.Geometry, EndPoint=move_4.Geometry)
pt_3 = Point([move_10.Geometry, move_4.Geometry, move_2.Geometry, move_3.Geometry, move_13.Geometry, move_15.Geometry])
ln_6 = Line(StartPoint=move.Geometry, EndPoint=move_10.Geometry)
pt_4 = Point([move_12.Geometry, move_5.Geometry, move_6.Geometry, move_11.Geometry, move_7.Geometry, move_8.Geometry, move_9.Geometry])
ln_7 = Line(StartPoint=move.Geometry, EndPoint=move_12.Geometry)
ln_8 = Line(StartPoint=move.Geometry, EndPoint=move_6.Geometry)
ln_9 = Line(StartPoint=move_14.Geometry, EndPoint=move.Geometry)
ln_10 = Line(StartPoint=move.Geometry, EndPoint=move_7.Geometry)
ln_11 = Line(StartPoint=move.Geometry, EndPoint=move_8.Geometry)
ln_12 = Line(StartPoint=move.Geometry, EndPoint=move_5.Geometry)
ln_13 = Line(StartPoint=move.Geometry, EndPoint=move_9.Geometry)
ln_14 = Line(StartPoint=move.Geometry, EndPoint=move_11.Geometry)
line = Line([ln_14, ln_7])
line_2 = Line([ln_13, ln_8])
line_3 = Line([ln_9, ln_10])
line_4 = Line([ln_11, ln_12])
line_5 = Line([ln_5, ln_6])
line_6 = Line([ln_2, ln_3])
line_7 = Line([ln_4, ln])
panel = Panel("""xdir
ydir
zdir
Dia""")
X = UnitX(Factor=1)
Y = UnitY(Factor=1)
Z = UnitZ(Factor=1)
readcstable = ReadCrossSectionTableFromFileKaramba3D()  # -> CrossSection, Info
panel_2 = Panel("Dia")
readcstable_2 = ReadCrossSectionTableFromFileKaramba3D()  # -> CrossSection, Info
supp = SupportKaramba3D(PosInd=pt_3, menu=[buttons(on, on, on, off, off, off)])
linetobeam = LineToBeamKaramba3D(Line=[line, line_2, line_3, line_4], Identifier="Dia", New=True, Remove=True, LimitDistance_m=0.005)  # -> Element, Points, Info
linetobeam_2 = LineToBeamKaramba3D(Line=line_5, Identifier="zdir", New=True, Remove=True, LimitDistance_m=0.005)  # -> Element, Points, Info
linetobeam_3 = LineToBeamKaramba3D(Line=line_6, Identifier="ydir", New=True, Remove=True, LimitDistance_m=0.005)  # -> Element, Points, Info
linetobeam_4 = LineToBeamKaramba3D(Line=line_7, Identifier="xdir", New=True, Remove=True, LimitDistance_m=0.005)  # -> Element, Points, Info
loads = LoadsKaramba3D(Vector=[Z, Y, X], BeamIdentifiers=panel, LCase=0, mode="Uniform Line", menu=[buttons(on, off, off)])
crosecrselect = CrossSectionRangeSelectorKaramba3D(
    CrossSections=readcstable_2.CrossSection,
    MaximumHeight_cm=-1,
    MaximumWidth_cm=-1,
    ElementsIdentifiers="Dia",
    menu=[dropdown(2), dropdown(2), dropdown(1)])
panel_3 = Panel("""xdir
ydir
zdir""")
crosecrselect_2 = CrossSectionRangeSelectorKaramba3D(
    CrossSections=readcstable.CrossSection,
    MaximumHeight_cm=-1,
    MaximumWidth_cm=-1,
    ElementsIdentifiers=panel_3,
    menu=[dropdown(1), dropdown(1), dropdown(3)])
item = ListItem(List=crosecrselect_2, Index=Slider(10, range=0..10), Wrap=True)
item_2 = ListItem(List=crosecrselect, Index=Slider(95, range=0..100), Wrap=True)
element = ElementKaramba3D([linetobeam_2.Element, linetobeam_3.Element, linetobeam_4.Element, linetobeam.Element])
modify_crosec = ModifyCrossSectionKaramba3D(CroSec=item, ElementIdentifiers=panel_3, mode="Beam")
matselect = MaterialSelectionKaramba3D(menu=[dropdown(1), dropdown(2)])
assemble = AssembleModelKaramba3D(
    Elem=element,
    Support=supp,
    Load=loads,
    CrossSection=flatten([modify_crosec, item_2]),
    Material=matselect,
    LimitDistance_m=0.005)  # -> Model, Info, Mass_kg, CenterOfGravity
cross_section = CrossSectionKaramba3D(
    FamilyNameOfCrossSection="DefaultCroSec",
    Height_cm=9.6,
    UpperFlangeWidth_cm=10,
    LowerFlangeWidth_cm=10,
    UpperFlangeThickness_cm=0.8,
    LowerFlangeThickness_cm=0.8,
    WebThickness_cm=0.5,
    FilletRadius_cm=0,
    mode="I")
analyze = AnalyzeKaramba3D(Model=assemble.Model)  # -> CalculatedModel, MaximumDisplacement_cm, ResultingForceOfGravity_kN, ElasticEnergy_kNm
panel_4 = Panel(item_2)
modelview = ModelViewKaramba3D(Model=analyze.CalculatedModel, LoadCaseFactorsForLinearSuperposition=1, IndexOfVisibleLoadcase=-1)  # -> Model, DeformedMesh, DeformedAxes, DeformedModel
beamview = BeamViewKaramba3D(Model=modelview.Model)  # -> Model, MeshesOfRenderedBeams, DeformedBeamAxes, LegendColors, LegendTags

# ---- group: 2. Create Project / Stream filter to control data speed
filter = StreamFilter(Gate=Toggle(True), Stream1=beamview.Model)

# ---- group: 2. Create Project / Data collect
disassemble = DisassembleModelKaramba3D(Model=filter)  # -> Model, Point, Beam, Shell, Support, Load, Line, Mesh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
k3dbeamprops = CSharpScript(
    Model=disassemble.Model,
    Reference=["C:\Program Files\Rhino 6\Plug-ins\karambaCommon.dll", "C:\Program Files\Rhino 6\Plug-ins\karamba.gha"])  # -> BeamIds, Material, CrosecNames, CrosecShapes, Heights, Widths, TFlanges, TWebs, FRads
# ---------- k3dbeamprops: C# usings ----------
using Karamba.Elements;
using Karamba.CrossSections;
# ---------- k3dbeamprops: C# ----------
    var model = Model as Karamba.Models.Model;
    if (model == null) {
      throw new ArgumentException ("The input is not of type model!");
    }

    var beam_ids = new List<string>();
    var cs_names = new List<string>();
    var cs_shapes = new List<string>();
    var cs_material = new List<string>();
    var heights = new List<double>();
    var widths = new List<double>();
    var tflanges = new List<double>();
    var twebs = new List<double>();
    var frads = new List<double>();

    foreach (var elem in model.elems)
    {
      var beam = elem as ModelElementStraightLine;
      if (beam != null) {
        beam_ids.Add(elem.id);
        cs_names.Add(elem.crosec.name);
        cs_shapes.Add(elem.crosec.shape());
        cs_material.Add(elem.crosec.materialName);

        // is it an I-profile?
        var crosec_i = beam.crosec as CroSec_I;
        if (crosec_i != null) {
          heights.Add(crosec_i.getHeight() * 1000);
          // use the upper flange thickness
          widths.Add(crosec_i.uf_width * 1000);
          tflanges.Add(crosec_i.uf_thick * 1000);
          twebs.Add(crosec_i.w_thick * 1000);
          // use the inner fillet radius
          frads.Add(crosec_i.fillet_r * 1000);
          // this would be the outer fillet radius
          // frads.Add(crosec.fillet_r1);
          continue;
        }

        // is it a CHS?
        var crosec_o = beam.crosec as CroSec_Circle;
        if (crosec_o != null) {
          heights.Add(crosec_o.getHeight() * 1000);
          // use the upper flange thickness
          widths.Add(0);
          tflanges.Add(crosec_o.thick * 1000);
          twebs.Add(crosec_o.thick * 1000);
          frads.Add(0);
          continue;
        }

        // options for Box, trapezoid and T-section are not implemented yet
        throw new Exception("Cross section encountered for which no export is implemented");
      }
    }

    BeamIds = beam_ids;
    CrosecNames = cs_names;
    CrosecShapes = cs_shapes;
    Material = cs_material;
    Heights = heights;
    Widths = widths;
    TFlanges = tflanges;
    TWebs = twebs;
    FRads = frads;
# ---------- end k3dbeamprops ----------
disassemble_2 = DisassembleElementKaramba3D(Element=disassemble.Beam)  # -> Element, ElementIdentifier, AxisOfElement, CrossSection, Joints, Material, LocalCoordinateSystem, ElementIsActive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
b_forces = BeamForcesKaramba3D(AnalyzedModel=disassemble.Model, LCase=-1, MaximumDistanceBetweenResults_m=-1, NumberOfResultsPerBeamElement=2)  # -> AnalyzedModel, NormalForce_kN, ShearForceVz_kN, ShearForceVy_kN, BendingMomentMt_kNm, BendingMomentMy_kNm, BendingMomentMz_kNm

# ----
panel_5 = Panel("""xdir
ydir
zdir
Dia""")
hierarchy = Panel("""Column
Topchord
Bottomchord
Post
Diagonal""")

# ---- group: 2. Create Project
# KarambaIDEA
cp = CreateProject(
    Hierarchy=panel_5,
    Points=disassemble.Point,
    Lines=disassemble.Line,
    LCSRotations_Deg=disassemble_2.Alpha_deg,
    Groupnames=k3dbeamprops.BeamIds,
    Materials=k3dbeamprops.Material,
    CrossSectionNames=k3dbeamprops.CrosecNames,
    Shapes=k3dbeamprops.CrosecShapes,
    Heights=k3dbeamprops.Heights,
    Widths=k3dbeamprops.Widths,
    ThicknessFlanges=k3dbeamprops.TFlanges,
    ThicknessWebs=k3dbeamprops.TWebs,
    Radius=k3dbeamprops.FRads,
    N=b_forces.NormalForce_kN,
    Vz=b_forces.ShearForceVz_kN,
    Vy=b_forces.ShearForceVy_kN,
    Mt=b_forces.BendingMomentMt_kNm,
    My=b_forces.BendingMomentMy_kNm,
    Mz=b_forces.BendingMomentMz_kNm)

# ----
panel_6 = Panel("C:\SMARTconnection\BouwenmetStaal\KarambaIDEA\0_IDEA_Templates\")
concat = Concatenate(FragmentA=panel_6, FragmentB="trussCornerTemplate", FragmentC=".contemp")
data = Data(cp)
panel_7 = Panel("filelocation")

# ---- group: 5. IDEA Templates
template_bolted_endplate_connection = TemplateBoltedEndplateConnection(Project=data, ThicknessEndplate_mm=10)  # -> Project, Message, Brep; disabled
template_by_filepath = TemplateByFilepath(Project=data, BrandNames="014", TemplateFilePath=concat)  # -> Project, Message, Brep; disabled
template_weld_all_members = TemplateWeldAllMembers(Project=data)  # -> Project, Message; disabled

# ----
preview = CustomPreview(Geometry=template_by_filepath.Brep, Material=ColourSwatch(SwatchColor=RGB(63, 217, 209)))
data_2 = Data(data)

# ---- group: 6. IDEA utilities
data_3 = Data(data_2)
output_folderpath = Panel("C:\Data")
create_idea_file = CreateIDEAFile(
    Project=data_3,
    OutputFolder=output_folderpath,
    RunAllJoints=Toggle(False),
    ChooseJoint=Slider(0, range=0..100),
    RunIDEA=Button())

output_folderpath_2 = Panel("C:\Data")
data_4 = Data(data_2)
create_and_calculate_idea_file = CreateAndCalculateIDEAFile(Project=data_4, OutputFolder=output_folderpath_2, ChooseJoint=Slider(0, range=0..100), RunIDEA=Button())  # -> SelectedJoint, Analysis, Plates, Bolts, Welds, Buckling, Summary
cluster = Cluster(T=create_and_calculate_idea_file.Analysis)
cluster_2 = Cluster(T=create_and_calculate_idea_file.Plates)
cluster_3 = Cluster(T=create_and_calculate_idea_file.Bolts)
cluster_4 = Cluster(T=create_and_calculate_idea_file.Welds)
cluster_5 = Cluster(T=create_and_calculate_idea_file.Buckling)
cluster_6 = Cluster(T=create_and_calculate_idea_file.Summary)
summary_message = Panel(cluster_6)
ucbuckling = Panel(cluster_5)
analysis = Panel(cluster)
ucplates = Panel(cluster_2)
ucwelds = Panel(cluster_4)
ucbolts = Panel(cluster_3)

filepath_ideacon_file = Panel("C:\Data\testHidden.ideaCon")
calculate_idea_file = CalculateIDEAFile(FilePath=filepath_ideacon_file, RunIDEA=Button())  # -> Analysis, Plates, Bolts, Welds, Buckling, Summary
cluster_7 = Cluster(T=calculate_idea_file.Analysis)
cluster_8 = Cluster(T=calculate_idea_file.Plates)
cluster_9 = Cluster(T=calculate_idea_file.Bolts)
cluster_10 = Cluster(T=calculate_idea_file.Welds)
cluster_11 = Cluster(T=calculate_idea_file.Buckling)
cluster_12 = Cluster(T=calculate_idea_file.Summary)
summary_message_2 = Panel(cluster_12)
ucbuckling_2 = Panel(cluster_11)
analysis_2 = Panel(cluster_7)
ucplates_2 = Panel(cluster_8)
ucwelds_2 = Panel(cluster_10)
ucbolts_2 = Panel(cluster_9)

# ==== cluster Cluster
T = ClusterInput()
join = TextJoin(Text=T)
rec = DataRecorder(join, DataLimit=2, RecordData=True)
item = ListItem(List=flatten(rec), Index=0, Wrap=True)
i = ClusterOutput(item)
panel = Panel(item)
