# Grasshopper definition KarambaIDEA_testfile.gh (Grasshopper 1.0.7)
# Copyright: B+G Engineers
# plug-ins: KarambaIDEA

pt = ConstructPoint(XCoordinate=0, YCoordinate=0, ZCoordinate=0)
X = UnitX(Factor=Slider(2, range=0..10))
move = Move(Geometry=pt, Motion=X)  # -> Geometry, Transform
ln = Line(StartPoint=pt, EndPoint=move.Geometry)
move_2 = Move(Geometry=move.Geometry, Motion=X)  # -> Geometry, Transform
ln_2 = Line(StartPoint=move.Geometry, EndPoint=move_2.Geometry)
number_slider = Slider(2, range=0..10)
dup = DuplicateData(Data="1", Number=number_slider, Order=True)
panel = Panel(["Columns", "Triangles"])
panel_2 = Panel(["Columns", "Triangles"])
line = Line([ln, ln_2])
lng = ListLength(List=line)
dup_2 = DuplicateData(Data=number_slider, Number=lng, Order=True)
dup_3 = DuplicateData(Data=dup, Number=lng, Order=True)
panel_3 = Panel(dup_3)
partition = PartitionList(List=panel_3, Size=dup_2)
dup_4 = DuplicateData(Data="CHS 42.4x3.2", Number=lng, Order=True)
dup_5 = DuplicateData(Data=Slider(0, range=0..1000), Number=lng, Order=True)
dup_6 = DuplicateData(Data="S355", Number=lng, Order=True)
dup_7 = DuplicateData(Data="O", Number=lng, Order=True)
dup_8 = DuplicateData(Data=Slider(42.4, range=0..100), Number=lng, Order=True)
dup_9 = DuplicateData(Data=Slider(3.2, range=0..10), Number=lng, Order=True)
dup_10 = DuplicateData(Data=Slider(0, range=0..1000), Number=lng, Order=True)
dup_11 = DuplicateData(Data=Slider(0, range=0..20), Number=lng, Order=True)
panel_4 = Panel(partition)
panel_5 = Panel(dup_4)
panel_6 = Panel(dup_6)
pt_2 = Point([pt, move.Geometry, move_2.Geometry])
panel_7 = Panel(dup_11)
panel_8 = Panel(dup_9)
panel_9 = Panel(dup_7)
panel_10 = Panel(dup_5)
panel_11 = Panel(dup_8)
panel_12 = Panel(dup_10)
cp = CreateProject(
    Hierarchy=panel_2,
    Points=pt_2,
    Lines=line,
    LCSRotations_Deg=panel_12,
    Groupnames=panel,
    Materials=panel_6,
    CrossSectionNames=panel_5,
    Shapes=panel_9,
    Heights=panel_11,
    Widths=panel_10,
    ThicknessFlanges=panel_8,
    ThicknessWebs=panel_8,
    Radius=panel_7,
    N=panel_4,
    Vz=panel_4,
    Vy=panel_4,
    Mt=panel_4,
    My=panel_4,
    Mz=panel_4)
template_weld_all_members = TemplateWeldAllMembers(Project=cp, BrandNames="0011")  # -> Project, Message
data = Data(template_weld_all_members.Project)
user_feedback = BooleanToggle(True)
run_all_joints = BooleanToggle(False)

# ---- group: 6. IDEA utilities
user_feedback_2 = BooleanToggle(False)
run_all_joints_2 = BooleanToggle(False)
run_idea = Button()
data_2 = Data(data)
output_folderpath = Panel("C:\Data")
create_idea_file = CreateIDEAFile(
    Project=data_2,
    OutputFolder=output_folderpath,
    UserFeecback=user_feedback_2,
    CreateAllJoints=run_all_joints_2,
    ChooseJoint=Slider(8, range=0..100),
    RunIDEA=run_idea)

run_idea_2 = Button()
data_3 = Data(data)
output_folderpath_2 = Panel("C:\Data")
number_slider_2 = Slider(8, range=0..100)

# ----
create_and_calculate_idea_file = CreateAndCalculateIDEAFile(
    Project=data_3,
    OutputFolder=output_folderpath_2,
    UserFeecback=user_feedback,
    RunAllJoints=run_all_joints,
    ChooseJoint=number_slider_2,
    RunIDEA=run_idea_2)  # -> SelectedJoint, Analysis, Plates, Bolts, Welds, Buckling, Summary

# ---- group: 6. IDEA utilities (continued)
cluster = Cluster(T=create_and_calculate_idea_file.Analysis)
cluster_2 = Cluster(T=create_and_calculate_idea_file.Plates)
cluster_3 = Cluster(T=create_and_calculate_idea_file.Bolts)
cluster_4 = Cluster(T=create_and_calculate_idea_file.Welds)
cluster_5 = Cluster(T=create_and_calculate_idea_file.Buckling)
cluster_6 = Cluster(T=create_and_calculate_idea_file.Summary)
summary_message = Panel(cluster_6)
ucbuckling = Panel(cluster_5)
analysis = Panel(cluster)
ucplates = Panel(cluster_2)
ucwelds = Panel(cluster_4)
ucbolts = Panel(cluster_3)

# ==== cluster Cluster
T = ClusterInput()
join = TextJoin(Text=T)
rec = DataRecorder(join, DataLimit=2, RecordData=True)
item = ListItem(List=flatten(rec), Index=0, Wrap=True)
i = ClusterOutput(item)
panel = Panel(item)
