# Grasshopper definition OLD_KarambaIDEA_Example_SteelHall.gh (Grasshopper 1.0.7)
# Copyright: B+G Engineers
# plug-ins: karambaGH, KarambaIDEA

# ---- group: Parameters
# Segment location
# Windbracing in X
# Windbracing in Y
genes = GenePool(Decimals=2, Maximum=1, Minimum=0, Value=[0.3, 0.7])
genes_2 = GenePool(Decimals=2, Maximum=1, Minimum=0, Value=0.28)
genes_3 = GenePool(Decimals=2, Maximum=1, Minimum=0, Value=0.76)
truss_height = Slider(2.5, range=0..2.5)
length_x_m = Slider(30, range=0..100)
length_y_m = Slider(50, range=0..100)
height_z_m = Slider(7, range=0..10)
xcount = Slider(6, range=2..20)
ycount = Slider(8, range=4..20)
column_divisions = Slider(2, range=0..10)
truss_type = ValueList({"Pratt": 0, "Warren": 1, "Three": 2, "Four": 3}, selected="Pratt")
# KarambaIDEA Example Steel hall
# DISCLAIMER: The use of this Grasshopper example file is fully at your own risk. Bouwen met Staal cannot be held liable in any form for given damage caused by the use of this file.
pt = ConstructPoint(XCoordinate=0, YCoordinate=0, ZCoordinate=0)
truss_segmented = ValueList({"No": 0, "Yes": 1}, selected="No")

# ----
connection_truss_column = ValueList({"Moment": 0, "Hinge": 1}, selected="Hinge")

num = Number(genes)
num_2 = Number(truss_type)
num_3 = Number(connection_truss_column)
num_4 = Number(truss_height)
num_5 = Number(xcount)
num_6 = Number(ycount)
num_7 = Number(column_divisions)
pt_2 = Point(pt)
num_8 = Number(truss_segmented)
num_9 = Number(length_x_m)
num_10 = Number(length_y_m)
num_11 = Number(height_z_m)
num_12 = Number(genes_2)
num_13 = Number(genes_3)

c_script = CSharpScript(lenX=num_9, lenY=num_10, countX=num_5, countY=num_6)  # -> surface; inputs lenX: Double, lenY: Double, countX: Double, countY: Double
# ---------- c_script: C# ----------
    surface = (lenX / countX) * (lenY / countY);
# ---------- end c_script ----------
vec = VectorXYZ(XComponent=num_9, YComponent=num_10, ZComponent=num_11)  # -> Vector, Length

devec = DeconstructVector(Vector=vec.Vector)  # -> XComponent, YComponent, ZComponent
X = UnitX(Factor=devec.XComponent)
pt_3 = ConstructPoint(XCoordinate=0, YCoordinate=0, ZCoordinate=0)
Y = UnitY(Factor=devec.YComponent)
Z = UnitZ(Factor=devec.ZComponent)
move = Move(Geometry=pt_3, Motion=Y)  # -> Geometry, Transform
move_2 = Move(Geometry=move.Geometry, Motion=Z)  # -> Geometry, Transform
move_3 = Move(Geometry=pt_3, Motion=X)  # -> Geometry, Transform
xz = XZPlane(Origin=move.Geometry)
aligndim = AlignedDimension(Plane=xz, PointA=move.Geometry, PointB=move_2.Geometry, Offset="3", Text="{0:0.00}", Size=1)
aligndim_2 = AlignedDimension(Plane=PlaneXY(0, 0, 0), PointA=move_3.Geometry, PointB=pt_3, Offset="3", Text="{0:0.00}", Size=1)
aligndim_3 = AlignedDimension(Plane=PlaneXY(0, 0, 0), PointA=pt_3, PointB=move.Geometry, Offset="3", Text="{0:0.00}", Size=1)

panel = Panel(c_script)

filter = StreamFilter(Gate=num_8, Stream1=num)
sort = SortList(Keys=filter)  # -> Keys, ValuesA
merge = Merge(Data1=sort.Keys, Data2="1.01")
multiplication = Multiplication(A=merge, B=num_9)
pt_4 = ConstructPoint(XCoordinate=multiplication, YCoordinate=0, ZCoordinate=0)

Z_2 = UnitZ(Factor=num_11)
pt_5 = Point(pt_2)
num_14 = Number(num_9)
num_15 = Number(num_5)
X_2 = UnitX(Factor=num_14)
move_4 = Move(Geometry=pt_5, Motion=Z_2)  # -> Geometry, Transform
move_5 = Move(Geometry=move_4.Geometry, Motion=X_2)  # -> Geometry, Transform
ln = Line(StartPoint=move_4.Geometry, EndPoint=move_5.Geometry)
divide = DivideCurve(Curve=ln, Count=num_15, Kinks=False)  # -> Points, Tangents, Parameters

num_16 = Number(num_5)
num_17 = Number(num_6)

num_18 = Number(num_5)
num_19 = Number(num_6)

num_20 = Number(expr("x+1", num_16))
num_21 = Number(expr("x+1", num_17))
cluster = Cluster_3(num=num_20, num_2=num_21)
cluster_2 = Cluster(num=num_16)
cluster_3 = Cluster(num=num_17)
cluster_4 = Cluster_2(data=cluster, data_2=cluster_3, data_3=cluster_2)

num_22 = Number(num_5)
data = Data(num_12)
data_2 = Data(num_13)
num_23 = Number(num_6)

num_24 = Number(num_10)
num_25 = Number(num_6)
Y_2 = UnitY(Factor=num_24)
pt_6 = Point(divide.Points)
move_6 = Move(Geometry=pt_6, Motion=Y_2)  # -> Geometry, Transform
ln_2 = Line(StartPoint=pt_6, EndPoint=move_6.Geometry)
divide_2 = DivideCurve(Curve=ln_2, Count=graft(num_25), Kinks=False)  # -> Points, Tangents, Parameters

num_26 = Number(expr("x+1", num_18))
num_27 = Number(expr("x+1", num_19))
cluster_5 = Cluster_3(num=num_26, num_2=num_27)
cluster_6 = Cluster(num=num_19)
cluster_7 = Cluster_2(data=cluster_5, data_2=cluster_6)

num_28 = Number(expr("x-1", num_23))
num_29 = Number(expr("x-1", num_22))
cluster_8 = Cluster_3(num=num_23, num_2=num_22)
multiplication_2 = Multiplication(A=data, B=num_29)
multiplication_3 = Multiplication(A=num_28, B=data_2)
round = Round(Number=multiplication_2)  # -> Nearest, Floor, Ceiling
round_2 = Round(Number=multiplication_3)  # -> Nearest, Floor, Ceiling
dcon = DeleteConsecutive(Set=round.Nearest, Wrap=False)  # -> Set, Count
dcon_2 = DeleteConsecutive(Set=round_2.Nearest, Wrap=False)  # -> Set, Count
cluster_9 = Cluster_2(data=cluster_8, data_2=dcon.Set, data_3=dcon_2.Set)

pt_7 = Point(divide_2.Points)

pt_8 = Point(divide_2.Points)
flip = FlipMatrix(Data=pt_8)
pt_9 = Point(pt_8)
pt_10 = Point(flip)
lng = ListLength(List=pt_10)
lng_2 = ListLength(List=pt_9)
item = ListItem(List=pt_9, Index=0, Wrap=True)
item_2 = ListItem(List=pt_9, Index=expr("x-1", lng_2), Wrap=True)
item_3 = ListItem(List=pt_10, Index=0, Wrap=True)
item_4 = ListItem(List=pt_10, Index=expr("x-1", lng), Wrap=True)

cluster_10 = Cluster_4(pt=pt_7, F=num_4)  # -> pt_3, G
cluster_11 = Cluster_5(pt=cluster_10.pt_3)
cluster_12 = Cluster_5(pt=cluster_10.G)
pt_11 = Point(cluster_11)
pt_12 = Point(cluster_12)

data_3 = Data(num_2)

num_30 = Number(num_4)
num_31 = Number(num_7)
num_32 = Number(num_11)
cluster_13 = Cluster_11(num=num_30, num_3=num_32, pt=item, num_2=num_31)
cluster_14 = Cluster_11(num=num_30, num_3=num_32, pt=item_2, num_2=num_31)
cluster_15 = Cluster_11(num=num_30, num_3=num_32, pt=item_3, num_2=num_31)
cluster_16 = Cluster_11(num=num_30, num_3=num_32, pt=item_4, num_2=num_31)

cluster_17 = Cluster_13(pt=divide_2.Points)
cluster_18 = Cluster_12(pt=divide_2.Points)
data_4 = Data(cluster_9)
cull = CullPattern(List=cluster_18, CullPattern=data_4)
cull_2 = CullPattern(List=cluster_17, CullPattern=data_4)
line = Line([cull_2, cull])

pt_13 = Point(simplify(pt_11))
data_5 = Data(data_3)
pt_14 = Point(pt_12)
flip_2 = FlipMatrix(Data=pt_14)
flip_3 = FlipMatrix(Data=pt_13)
cluster_19 = Cluster_9(L_2=flip_3, L=flip_2)
cluster_20 = Cluster_7(pt=flip_3, pt_2=flip_2)
filter_2 = StreamFilter(Gate=data_5, Stream0=cluster_20, Stream1=cluster_19)

pt_15 = Point(pt_7)
cluster_21 = Cluster_10(data=pt_15)
flip_4 = FlipMatrix(Data=cluster_21)
pt_16 = Point(flip_4)
cluster_22 = Cluster_6(pt=pt_16)

pt_17 = Point(pt_7)
cull_3 = CullPattern(List=pt_17, CullPattern=cluster_7)
flip_5 = FlipMatrix(Data=cull_3)
cluster_23 = Cluster_6(pt=flip_5)

flip_6 = FlipMatrix(Data=pt_11)
flip_7 = FlipMatrix(Data=pt_12)
cluster_24 = Cluster_5(pt=flip_6)
cluster_25 = Cluster_5(pt=flip_7)
ln_3 = Line(StartPoint=cluster_24, EndPoint=cluster_25)

merge_2 = Merge(Data1=pt_11, Data2=pt_12)
data_6 = Data(num_13)
num_33 = Number(num_6)
num_34 = Number(num_5)

num_35 = Number(num_4)
equals = Equality(FirstNumber=num_35, SecondNumber="0")  # -> Equality, Inequality

pt_18 = Point(cluster_10.G)
data_7 = Data(num_3)
cluster_26 = Cluster_5(pt=pt_18)
flip_8 = FlipMatrix(Data=cluster_26)
cluster_27 = Cluster_5(pt=flip_8)
cluster_28 = Cluster_6(pt=flip_8)
cluster_29 = Cluster_6(pt=cluster_27)
filter_3 = StreamFilter(Gate=data_7, Stream0=cluster_28, Stream1=cluster_29)

cluster_30 = Cluster_13(pt=cluster_16)
cluster_31 = Cluster_12(pt=cluster_16)
cluster_32 = Cluster_14(num=num_33, num_2=num_31, data=data_6)
pt_19 = Point(cluster_16)
cluster_33 = Cluster_10(data=pt_19)
flip_9 = FlipMatrix(Data=cluster_33)
cull_4 = CullPattern(List=cluster_30, CullPattern=cluster_32)
cull_5 = CullPattern(List=cluster_31, CullPattern=cluster_32)
cluster_34 = Cluster_6(pt=flip_9)
cull_6 = CullPattern(List=cluster_34, CullPattern=cluster_32)
line_2 = Line([cull_4, cull_5])

cluster_35 = Cluster_13(pt=cluster_13)
cluster_36 = Cluster_12(pt=cluster_13)
cluster_37 = Cluster_14(num=num_34, num_2=num_31, data=num_12)
pt_20 = Point(cluster_13)
cluster_38 = Cluster_10(data=pt_20)
flip_10 = FlipMatrix(Data=cluster_38)
cull_7 = CullPattern(List=cluster_35, CullPattern=cluster_37)
cull_8 = CullPattern(List=cluster_36, CullPattern=cluster_37)
cluster_39 = Cluster_6(pt=flip_10)
cull_9 = CullPattern(List=cluster_39, CullPattern=cluster_37)
line_3 = Line([cull_7, cull_8])

cull_10 = CullPattern(List=divide_2.Points, CullPattern=cluster_4)
num_36 = Number(num_11)
cluster_40 = Cluster_4(pt=cull_10, F=num_36)  # -> pt_3, G

cluster_41 = Cluster_14(num=num_33, num_2=num_31, data=data_6)
cluster_42 = Cluster_13(pt=cluster_15)
cluster_43 = Cluster_12(pt=cluster_15)
pt_21 = Point(cluster_15)
cluster_44 = Cluster_10(data=pt_21)
flip_11 = FlipMatrix(Data=cluster_44)
cull_11 = CullPattern(List=cluster_42, CullPattern=cluster_41)
cull_12 = CullPattern(List=cluster_43, CullPattern=cluster_41)
cluster_45 = Cluster_6(pt=flip_11)
cull_13 = CullPattern(List=cluster_45, CullPattern=cluster_41)
line_4 = Line([cull_11, cull_12])

cluster_46 = Cluster_13(pt=cluster_14)
cluster_47 = Cluster_12(pt=cluster_14)
cluster_48 = Cluster_14(num=num_34, num_2=num_31, data=num_12)
pt_22 = Point(cluster_14)
cluster_49 = Cluster_10(data=pt_22)
flip_12 = FlipMatrix(Data=cluster_49)
cull_14 = CullPattern(List=cluster_46, CullPattern=cluster_48)
cull_15 = CullPattern(List=cluster_47, CullPattern=cluster_48)
cluster_50 = Cluster_6(pt=flip_12)
cull_16 = CullPattern(List=cluster_50, CullPattern=cluster_48)
line_5 = Line([cull_14, cull_15])

cluster_51 = Cluster_6(pt=cluster_15)
cluster_52 = Cluster_6(pt=cluster_16)
flip_13 = FlipMatrix(Data=cluster_14)
flip_14 = FlipMatrix(Data=cluster_13)
cluster_53 = Cluster_10(data=flip_13)
cluster_54 = Cluster_10(data=flip_14)
flip_15 = FlipMatrix(Data=cluster_53)
flip_16 = FlipMatrix(Data=cluster_54)
cluster_55 = Cluster_6(pt=flip_15)
cluster_56 = Cluster_6(pt=flip_16)
merge_3 = Merge(Data1=cluster_56, Data2=cluster_55, Data3=cluster_51, Data4=cluster_52)

filter_4 = StreamFilter(Gate=data_3, Stream0=ln_3)
cluster_57 = Cluster_6(pt=pt_7)

num_37 = Number(num_4)
equals_2 = Equality(FirstNumber=num_37, SecondNumber="0")  # -> Equality, Inequality
filter_5 = StreamFilter(Gate=equals_2.Inequality, Stream1=filter_3)

num_38 = Number(num_4)
equals_3 = Equality(FirstNumber=num_38, SecondNumber="0")  # -> Equality, Inequality
filter_6 = StreamFilter(Gate=equals_3.Inequality, Stream1=filter_2)

num_39 = Number(num_4)
equals_4 = Equality(FirstNumber=num_39, SecondNumber="0")  # -> Equality, Inequality
filter_7 = StreamFilter(Gate=equals_4.Inequality, Stream1=filter_4)

boolean_toggle = BooleanToggle(True)
merge_4 = Merge(Data1=line_3, Data2=line_5, Data3=line_4, Data4=line_2)
merge_5 = Merge(Data1=cull_9, Data2=cull_16, Data3=cull_13, Data4=cull_6)
line_6 = Line(line)
line_7 = Line(merge_4)
stream_filter = StreamFilter(Gate=boolean_toggle, Stream1=merge_5)
stream_filter_2 = StreamFilter(Gate=boolean_toggle, Stream1=line_6)
stream_filter_3 = StreamFilter(Gate=boolean_toggle, Stream1=line_7)

# ----
# Truss Roof Beams
line_8 = Line(cluster_22)

# ----
# Truss Verticals
line_9 = Line(filter_7)

# ----
# Truss Beams
line_10 = Line(filter_5)

# ----
# Supports
pt_23 = Point(cluster_40.G)

# ----
# Wall Bracing
line_11 = Line(stream_filter_3)

# ----
# Truss Roof Beams
# Truss Diagonals
# Truss Verticals
# Truss Beams
# Roof Spacers
# Truss Spacers
# Supports
# OuterColumns_South
# OuterColumns_North
# OuterColumns_West
# OuterColumns_East
# OuterColumns
# Wall Bracing
# WallBeams
line_12 = Line(stream_filter_2)

# ----
# Truss Diagonals
line_13 = Line(filter_6)

# ----
# Roof Spacers
line_14 = Line(cluster_57)

# ----
# OuterColumns_South
line_15 = Line(cluster_56)

# ----
# OuterColumns_North
line_16 = Line(cluster_55)

# ----
# OuterColumns_West
line_17 = Line(cluster_51)

# ----
# OuterColumns_East
line_18 = Line(cluster_52)

# ----
# OuterColumns
line_19 = Line(merge_3)

# ----
# WallBeams
line_20 = Line(stream_filter)

# ----
# Truss Roof Beams
line_21 = Line(cluster_23)

# ----
# Indexen startpunten
# Indexen eindpunten
data_8 = Data(line_8)
data_9 = Data(flatten(line_21))
data_10 = Data(flatten(data_8))
lng_3 = ListLength(List=data_8)  # -> flatten(Length)
lng_4 = ListLength(List=data_9)
lng_5 = ListLength(List=data_10)
series = Series(Start=lng_4, Step=1, Count=lng_5)
partition = PartitionList(List=series, Size=lng_3)
lng_6 = ListLength(List=partition)
item_5 = ListItem(List=partition, Index=expr("x-1", lng_6), Wrap=True)  # -> flatten(Item)
item_6 = ListItem(List=partition, Index="0", Wrap=True)  # -> flatten(Item)
num_40 = Number(item_6)
num_41 = Number(item_5)
beam_joints = BeamJointsKaramba(
    ElementIdentifiers=num_40,
    CtKNMAtStartingNode=Vector(0, 0, 0),
    CrKNmRadAtStartingNode=Vector(0, 0, 0),
    CtKNMAtEndNode=Vector(0, 0, 0),
    CrKNmRadAtEndNode=Vector(0, 0, 0),
    menu=[buttons(off, off, off, off, on, off), buttons(off, off, off, off, off, off)])
beam_joints_2 = BeamJointsKaramba(
    ElementIdentifiers=num_41,
    CtKNMAtStartingNode=Vector(0, 0, 0),
    CrKNmRadAtStartingNode=Vector(0, 0, 0),
    CtKNMAtEndNode=Vector(0, 0, 0),
    CrKNmRadAtEndNode=Vector(0, 0, 0),
    menu=[buttons(off, off, off, off, off, off), buttons(off, off, off, off, on, off)])
joint = JointKaramba3D([beam_joints, beam_joints_2])

# ---- group: 3. Project utilities
dom = ConstructDomain(DomainStart="0", DomainEnd="1")
range = Range(Domain=dom, Steps=Slider(10, range=0..100))

# ---- group: Karamba3D Structural analysis / Define Materials
matselect = MaterialSelectionKaramba3D(menu=[dropdown(1), dropdown(4)])

# ---- group: Karamba3D Structural analysis / Define Cross Sections
crosecrselect = CrossSectionRangeSelectorKaramba3D(MaximumHeight_cm=-1, MaximumWidth_cm=-1, Material=matselect, menu=[dropdown(1), dropdown(2), dropdown(0)])
crosecrselect_2 = CrossSectionRangeSelectorKaramba3D(MaximumHeight_cm=-1, MaximumWidth_cm=-1, Material=matselect, menu=[dropdown(0), dropdown(1), dropdown(3)])
crosecrselect_3 = CrossSectionRangeSelectorKaramba3D(MaximumHeight_cm=-1, MaximumWidth_cm=-1, Material=matselect, menu=[dropdown(2), dropdown(3), dropdown(1)])
panel_2 = Panel("2")
panel_3 = Panel("""RoofBeams
TrussRoofBeams
TrussBeams
OuterColumns
WallBeams""")
panel_4 = Panel("""WallBracing
RoofBracing""")
panel_5 = Panel("""TrussDiagonals
TrussVerticals
RoofSpacers
TrussSpacers""")
crosecselect = CrossSectionSelectorKaramba3D(CrossSections=crosecrselect_2, ElementsIdentifiers=panel_3)  # -> CrossSection, Info
crosecselect_2 = CrossSectionSelectorKaramba3D(CrossSections=crosecrselect_3, ElementsIdentifiers=panel_5)  # -> CrossSection, Info
crosecselect_3 = CrossSectionSelectorKaramba3D(CrossSections=crosecrselect, ElementsIdentifiers=panel_4)  # -> CrossSection, Info
entwine = Entwine(
    Branch00=crosecselect.CrossSection,
    Branch01=crosecselect_2.CrossSection,
    Branch02=crosecselect_3.CrossSection,
    FlattenInputs=True)
entwine_2 = Entwine(Branch00=crosecrselect_2, Branch01=crosecrselect_3, Branch02=crosecrselect, FlattenInputs=True)

# ----
panel_6 = Panel("""RoofBeams
TrussRoofBeams
TrussDiagonals
TrussVerticals
TrussBeams
RoofSpacers
TrussSpacers
WallBracing
RoofBracing
WallBeams""")

# ---- group: Karamba3D Structural analysis / Define Loads
load_multiplier = Slider(-5, range=-500..0)
load_multiplier_2 = Slider(1, range=1..2)
Y_3 = UnitY(Factor=load_multiplier_2)
Z_3 = UnitZ(Factor=load_multiplier)
loads = LoadsKaramba3D(Vector=Y_3, BeamIdentifiers="TrussRoofBeams", LCase="1", mode="Uniform Line", menu=[buttons(on, off, off)])
loads_2 = LoadsKaramba3D(Vector=Z_3, BeamIdentifiers="TrussRoofBeams", LCase=0, mode="Uniform Line", menu=[buttons(on, off, off)])

# ----
panel_7 = Panel("""016
01167910
01167
02566
2245661010
22466
224566
02566910
224566101010
224661010
34577
334577
3345577
09
00899""")

dom_2 = ConstructDomain(DomainStart="0", DomainEnd="1")
range_2 = Range(Domain=dom_2, Steps=Slider(5, range=0..100))

num_42 = Number(num_6)
num_43 = Number(num_5)

num_44 = Number(expr("x+1-2", num_43))
num_45 = Number(expr("x+1", num_42))

num_46 = Number(expr("x-1", num_45))
cluster_58 = Cluster_3(num=num_44, num_2=num_45)
merge_6 = Merge(Data1="0", Data2=num_46)
cluster_59 = Cluster_2(data=cluster_58, data_2=merge_6)

pt_24 = Point(cluster_10.G)
pt_25 = Point(cluster_10.pt_3)
flip_17 = FlipMatrix(Data=pt_24)
flip_18 = FlipMatrix(Data=pt_25)
cluster_60 = Cluster_10(data=flip_18)
cluster_61 = Cluster_10(data=flip_17)
pt_26 = Point(cluster_61)
pt_27 = Point(cluster_60)
flip_19 = FlipMatrix(Data=pt_26)
flip_20 = FlipMatrix(Data=pt_27)
p_n_c = PickNChoose(Pattern=cluster_59, Stream0=flip_19, Stream1=flip_20)
filter_8 = StreamFilter(Gate=equals.Inequality, Stream1=p_n_c)
cluster_62 = Cluster_6(pt=filter_8)

# ----
# Truss Spacers
line_22 = Line(cluster_62)

entwine_3 = Entwine(
    Branch00=line_21,
    Branch01=line_8,
    Branch02=line_13,
    Branch03=line_9,
    Branch04=line_10,
    Branch05=line_14,
    Branch06=line_22,
    Branch07=line_19,
    Branch08=line_11,
    Branch09=line_12,
    Branch010=line_20,
    FlattenInputs=True)
pt_28 = Point(flatten(pt_23))

# ---- group: Stream filter to control data speed
toggle = BooleanToggle(True)
filter_9 = StreamFilter(Gate=toggle, Stream1=pt_28)
filter_10 = StreamFilter(Gate=toggle, Stream1=entwine_3)

# ---- group: 3. Project utilities
pt_29 = Point(pt_4)
c_script_2 = CSharpScript(lines=line_8, points=pt_29)  # -> out, A, pbolt, vbolt; inputs lines: tree of Line, points: list of Point3d
# ---------- c_script_2: C# ----------
    DataTree<Line> linestree = new DataTree<Line>();




    GH_Path path = new GH_Path();
    GH_Path pointpath = new GH_Path();
    Point3d punt = new Point3d();
    DataTree<Point3d> plist = new DataTree<Point3d>();
    DataTree<Vector3d> vlist = new DataTree<Vector3d>();

    for (int b = 0; b < lines.BranchCount; b++)
    {
      int i = 0;
      foreach (Line line in lines.Branches[b])
      {
        //Ervoor
        pointpath = new GH_Path(b);
        path = new GH_Path(b, i);
        if (line.FromX <= points[i].X && line.ToX <= points[i].X)
        {
          linestree.Add(line, path);
        }
        //Ertussen
        if (line.FromX < points[i].X && line.ToX > points[i].X)
        {
          double stuk = points[i].X - line.FromX;
          double length = line.ToX - line.FromX;
          double percentage = stuk / length;
          double Xnew = percentage * line.Direction.X + line.FromX;
          double Ynew = percentage * line.Direction.Y + line.FromY;
          double Znew = percentage * line.Direction.Z + line.FromZ;
          Point3d cpoint = new Point3d(Xnew, Ynew, Znew);
          Line lineA = new Line(line.From, cpoint);

          linestree.Add(lineA, path);
          punt = cpoint;
          plist.Add(punt, pointpath);
          vlist.Add(line.Direction, pointpath);
          //volgende punt
          //volgende path
          i = i + 1;
          path = new GH_Path(b, i);
          foreach (Point3d point in points)
          {
            if (line.FromX < point.X && line.ToX > point.X)
            {

            }
          }
          if (line.ToX > points[i].X)
          {
            punt = cpoint;

          }
          else
          {
            Line lineB = new Line(cpoint, line.To);
            linestree.Add(lineB, path);
          }
        }
        //Erna (bestaat eigenlijk niet)
        if (line.FromX >= points[i].X && line.ToX >= points[i].X)
        {
          i = i + 1;
          path = new GH_Path(b, i);
          linestree.Add(line, path);
          //moet eindigen
        }
      }
    }

    A = linestree;
    pbolt = plist;
    vbolt = vlist;
# ---------- end c_script_2 ----------
c_script_3 = CSharpScript(lines=line_13, points=pt_29)  # -> out, A, pbolt, vbolt; inputs lines: tree of Line, points: list of Point3d; same code as c_script_2
c_script_4 = CSharpScript(lines=line_9, points=pt_29)  # -> out, A, pbolt, vbolt; inputs lines: tree of Line, points: list of Point3d; same code as c_script_2
c_script_5 = CSharpScript(lines=line_10, points=pt_29)  # -> out, A, pbolt, vbolt; inputs lines: tree of Line, points: list of Point3d; same code as c_script_2
merge_7 = Merge(Data1=c_script_2.pbolt, Data2=c_script_3.pbolt, Data3=c_script_4.pbolt, Data4=c_script_5.pbolt)
merge_8 = Merge(Data1=c_script_2.vbolt, Data2=c_script_3.vbolt, Data3=c_script_4.vbolt, Data4=c_script_5.vbolt)

c_script_6 = CSharpScript(lines=line_8, points=pt_29)  # -> out, A, pbolt, vbolt; inputs lines: tree of Line, points: list of Point3d
# ---------- c_script_6: C# ----------
    DataTree<Line> linestree = new DataTree<Line>();




    GH_Path path = new GH_Path();
    GH_Path pointpath = new GH_Path();
    Point3d punt = new Point3d();
    DataTree<Point3d> plist = new DataTree<Point3d>();
    DataTree<Vector3d> vlist = new DataTree<Vector3d>();

    for (int b = 0; b < lines.BranchCount; b++)
    {
      int i = 0;
      foreach (Line line in lines.Branches[b])
      {
        //Ervoor
        pointpath = new GH_Path(b);
        path = new GH_Path(b, i);
        if (line.FromX <= points[i].X && line.ToX <= points[i].X)
        {
          linestree.Add(line, path);
        }
        //Ertussen
        if (line.FromX < points[i].X && line.ToX > points[i].X)
        {
          Point3d Start = new Point3d(line.FromX, line.FromY, line.FromZ);
          Point3d cpoint = new Point3d();

          foreach (Point3d point in points)
          {
            if (line.FromX < point.X && line.ToX > point.X)
            {
              double stuk = points[i].X - line.FromX;
              double length = line.ToX - line.FromX;
              double percentage = stuk / length;
              double Xnew = percentage * line.Direction.X + line.FromX;
              double Ynew = percentage * line.Direction.Y + line.FromY;
              double Znew = percentage * line.Direction.Z + line.FromZ;
              cpoint = new Point3d(Xnew, Ynew, Znew);
              Line lineA = new Line(Start, cpoint);

              linestree.Add(lineA, path);
              punt = cpoint;
              plist.Add(punt, pointpath);
              vlist.Add(line.Direction, pointpath);
              //volgende punt
              //volgende path
              i = i + 1;
              path = new GH_Path(b, i);
            }
          }
          if (line.ToX > points[i].X)
          {
            punt = cpoint;

          }
          else
          {
            Line lineB = new Line(cpoint, line.To);
            linestree.Add(lineB, path);
          }
        }
        //Erna (bestaat eigenlijk niet)
        if (line.FromX >= points[i].X && line.ToX >= points[i].X)
        {
          i = i + 1;
          path = new GH_Path(b, i);
          linestree.Add(line, path);
          //moet eindigen
        }
      }
    }

    A = linestree;
    pbolt = plist;
    vbolt = vlist;
# ---------- end c_script_6 ----------

merge_9 = Merge(Data1=c_script_6.A, Data2=c_script_3.A, Data3=c_script_4.A, Data4=c_script_5.A)

pt_30 = Point(merge_7)
number_slider = Slider(0.165, range=0..1)
pl = PlaneNormal(Origin=pt_30, ZAxis=merge_8)
box = CenterBox(Base=pl, X=number_slider, Y=number_slider, Z=Slider(0.017, range=0..1))

# Visualisation by Color
entwine_4 = Entwine(
    Branch00=flatten(line_19),
    Branch01=flatten(line_21),
    Branch02=flatten(line_14),
    Branch03=flatten(line_22),
    Branch04=flatten(line_12),
    Branch05=flatten(line_11),
    Branch06=flatten(line_20),
    FlattenInputs=True)
lng_7 = ListLength(List=pt_29)
lng_8 = ListLength(List=merge_9)

lng_9 = ListLength(List=entwine_4)  # -> flatten(Length)
lng_10 = ListLength(List=lng_9)  # -> expr("x-1", Length)
dom_3 = ConstructDomain(DomainStart="0.15", DomainEnd="0.05")
range_3 = Range(Domain=dom_3, Steps=lng_10)
c_script_7 = CSharpScript(x=range_3, y=lng_9)  # -> out, A; inputs x: list of Double, y: list of Double
# ---------- c_script_7: C# ----------
    for (int i = 0; i < x.Count;i++)
    {
      for(int b = 0; b < y[i];b++)
      {
        Print(x[i].ToString());
      }
    }
# ---------- end c_script_7 ----------

data_11 = Data(range)
data_12 = Data(merge_9)
c_script_8 = CSharpScript(lengths=lng_8, x=lng_7, colorlist=data_11)  # -> out, A, B, C; inputs lengths: tree of Double, x: Double, colorlist: list of Double
# ---------- c_script_8: C# ----------
    DataTree<double> tree = new DataTree<double>();
    GH_Path path = new GH_Path();
    double links = lengths.BranchCount / x;
    int w = 0;

    for (int b = 0; b < links; b++)
    {
      //int i = 0;
      for (int i = 0; i < x;i++)
        //foreach (Line line in lines.Branches[b])
      {

        path = new GH_Path(b, i);
        //double num = lengths.Paths(b, i);
        //tree.Add(lengths.Branch(b, i)[0], path);
        for (int c = 0;c < lengths.Branch(b, i)[0];c++)
        {


          double num = colorlist[(w % colorlist.Count)];
          tree.Add(num, path);
          
          //moet eindigen

        }
        w = w + 1;


      }

    }
    A = tree;
    B = 20 % colorlist.Count;
    C = lengths.DataCount;
# ---------- end c_script_8 ----------
data_13 = Data(flatten(c_script_8.A))
# Transport Elements Generator
gradient = Gradient(
    LowerLimit=0,
    UpperLimit=1,
    Parameter=data_13,
    stops=[0: RGB(243, 57, 0), 0.1: RGB(236, 27, 60), 0.2: RGB(210, 0, 118), 0.3: RGB(103, 0, 120), 0.4: RGB(39, 72, 161), 0.5: RGB(1, 192, 229), 0.6: RGB(18, 178, 90), 0.7: RGB(79, 186, 8), 0.8: RGB(220, 237, 32), 0.9: RGB(247, 159, 20), 1: RGB(243, 57, 0)])
pipe = Pipe(Curve=data_12, Radius=Slider(0.1, range=0..0.1), Caps=0)  # -> flatten(Pipe)

pipe_2 = Pipe(Curve=flatten(entwine_4), Radius=c_script_7.out, Caps=0)  # -> flatten(Pipe)

# ----
toggle_2 = BooleanToggle(True)
colour = ColourPicker(PickedColour=RGB(143, 143, 143))
brep = Brep(pipe)
filter_11 = StreamFilter(Gate=toggle_2, Stream1=box)
filter_12 = StreamFilter(Gate=toggle_2, Stream1=brep)
filter_13 = StreamFilter(Gate=toggle_2, Stream1=pipe_2)
brep_2 = Brep(filter_11)
preview = CustomPreview(Geometry=filter_12, Material=gradient)
preview_2 = CustomPreview(Geometry=filter_13, Material=colour)

# ---- group: Karamba3D Structural analysis
# Karamba3D
pt_31 = Point(filter_9)
line_23 = Line(filter_10)
pt_32 = Point(pt_31)
merge_10 = Merge(Data1=panel_5, Data2="WallBeams", Data3=panel_4)
load = LoadKaramba3D([loads_2, loads])
crosec = CrossSectionKaramba3D(flatten(entwine_2))

# ---- group: Karamba3D Structural analysis / Define Elements
panel_8 = Panel("""RoofBeams
TrussRoofBeams
TrussDiagonals
TrussVerticals
TrussBeams
RoofSpacers
TrussSpacers
OuterColumns
WallBracing
RoofBracing
WallBeams""")
linetobeam = LineToBeamKaramba3D(Line=line_23, Identifier=graft(panel_8), New=True, Remove=True, LimitDistance_m=0.005)  # -> Element, Points, Info

# ---- group: Karamba3D Structural analysis / Define Hinges
panel_9 = Panel(merge_10)
beam_joints_3 = BeamJointsKaramba(
    ElementIdentifiers=panel_9,
    CtKNMAtStartingNode=Vector(0, 0, 0),
    CrKNmRadAtStartingNode=Vector(0, 0, 0),
    CtKNMAtEndNode=Vector(0, 0, 0),
    CrKNmRadAtEndNode=Vector(0, 0, 0),
    menu=[buttons(off, off, off, off, on, on), buttons(off, off, off, off, on, on)])

# ---- group: Karamba3D Structural analysis / Define Supports
supp = SupportKaramba(PosInd=pt_32, menu=[buttons(on, on, on, on, off, on)])

# ----
joint_2 = JointKaramba3D(beam_joints_3)

# ---- group: Karamba3D Structural analysis / Assemble Model
assemble = AssembleModelKaramba3D(
    Elem=flatten(linetobeam.Element),
    Support=flatten(supp),
    Load=flatten(load),
    CrossSection=flatten(entwine),
    Joint=flatten([joint_2, joint]),
    LimitDistance_m=0.005)  # -> Model, Info, Mass_kg, CenterOfGravity

# ---- group: Karamba3D Structural analysis (continued)
opticrosec = OptimizeCrossSectionKaramba3D(
    Model=assemble.Model,
    GroupIdentifiers=panel_8,
    CrossSections=crosec,
    MaximumUtilization=1,
    MaximumDisplacement_cm=-1,
    UltimateLimitStateIterations=5,
    DisplacementIterations=5,
    NumberOfSamplePoints=3,
    ElasticDesign=True,
    GammaM0=1,
    GammaM1=1)  # -> ModelWithOptimizedCrossSections, Info, Mass_kg, MaximumDisplacement_cm, ElasticEnergy_kNm

# ---- group: Karamba3D Structural analysis / Analyze Model
analyze = AnalyzeKaramba3D(Model=opticrosec.ModelWithOptimizedCrossSections)  # -> CalculatedModel, MaximumDisplacement_cm, ResultingForceOfGravity_kN, ElasticEnergy_kNm
panel_10 = Panel(analyze.MaximumDisplacement_cm)

# ---- group: Karamba3D Structural analysis / View Results
modelview = ModelViewKaramba3D(Model=opticrosec.ModelWithOptimizedCrossSections, LoadCaseFactorsForLinearSuperposition=1, IndexOfVisibleLoadcase=-1)  # -> Model, DeformedMesh, DeformedAxes, DeformedModel
beamview = BeamViewKaramba3D(Model=modelview.Model)  # -> Model, MeshesOfRenderedBeams, DeformedBeamAxes, LegendColors, LegendTags

# ---- group: 2. Create Project / Stream filter to control data speed
# KarambaIDEA
toggle_3 = BooleanToggle(True)
filter_14 = StreamFilter(Gate=toggle_3, Stream1=beamview.Model)

# ---- group: 2. Create Project / Data collect
disassemble = DisassembleModelKaramba3D(Model=filter_14)  # -> Model, Point, Beam, Shell, Support, Load, Line, Mesh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
k3dbeamprops = CSharpScript(
    Model=disassemble.Model,
    Reference=["C:\PROGRAM FILES\RHINO 7\PLUG-INS\KARAMBA\karambaCommon.dll", "C:\PROGRAM FILES\RHINO 7\PLUG-INS\KARAMBA\karamba.gha"])  # -> BeamIds, Material, CrosecNames, CrosecShapes, Heights, Widths, TFlanges, TWebs, FRads
# ---------- k3dbeamprops: C# usings ----------
using Karamba.Elements;
using Karamba.CrossSections;
# ---------- k3dbeamprops: C# ----------
    var model = Model as Karamba.Models.Model;
    if (model == null) {
      throw new ArgumentException ("The input is not of type model!");
    }

    var beam_ids = new List<string>();
    var cs_names = new List<string>();
    var cs_shapes = new List<string>();
    var cs_material = new List<string>();
    var heights = new List<double>();
    var widths = new List<double>();
    var tflanges = new List<double>();
    var twebs = new List<double>();
    var frads = new List<double>();

    foreach (var elem in model.elems)
    {
      var beam = elem as ModelElementStraightLine;
      if (beam != null) {
        beam_ids.Add(elem.id);
        cs_names.Add(elem.crosec.name);
        cs_shapes.Add(elem.crosec.shape());
        cs_material.Add(elem.crosec.materialName);

        // is it an I-profile?
        var crosec_i = beam.crosec as CroSec_I;
        if (crosec_i != null) {
          heights.Add(crosec_i.getHeight() * 1000);
          // use the upper flange thickness
          widths.Add(crosec_i.uf_width * 1000);
          tflanges.Add(crosec_i.uf_thick * 1000);
          twebs.Add(crosec_i.w_thick * 1000);
          // use the inner fillet radius
          frads.Add(crosec_i.fillet_r * 1000);
          // this would be the outer fillet radius
          // frads.Add(crosec.fillet_r1);
          continue;
        }

        // is it a CHS?
        var crosec_o = beam.crosec as CroSec_Circle;
        if (crosec_o != null) {
          heights.Add(crosec_o.getHeight() * 1000);
          // use the upper flange thickness
          widths.Add(0);
          tflanges.Add(crosec_o.thick * 1000);
          twebs.Add(crosec_o.thick * 1000);
          frads.Add(0);
          continue;
        }

        // options for Box, trapezoid and T-section are not implemented yet
        throw new Exception("Cross section encountered for which no export is implemented");
      }
    }

    BeamIds = beam_ids;
    CrosecNames = cs_names;
    CrosecShapes = cs_shapes;
    Material = cs_material;
    Heights = heights;
    Widths = widths;
    TFlanges = tflanges;
    TWebs = twebs;
    FRads = frads;
# ---------- end k3dbeamprops ----------
b_forces = BeamForcesKaramba3D(AnalyzedModel=disassemble.Model, LCase=-1, MaximumDistanceBetweenResults_m=-1, NumberOfResultsPerBeamElement=2)  # -> AnalyzedModel, NormalForce_kN, ShearForceVz_kN, ShearForceVy_kN, BendingMomentMt_kNm, BendingMomentMy_kNm, BendingMomentMz_kNm
disassemble_2 = DisassembleElementKaramba3D(Element=disassemble.Beam)  # -> Element, ElementIdentifier, AxisOfElement, CrossSection, Joints, Material, LocalCoordinateSystem, ElementIsActive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
vec_cm_to_mm = Vector(expr("x*10", disassemble_2.LocalEccentricity_cm))
hierarchy = Panel("""OuterColumns
RoofBeams
TrussRoofBeams
TrussBeams
TrussVerticals
TrussDiagonals
RoofSpacers
TrussSpacers
WallBeams
WallBracing
RoofBracing""")
cp = CreateProject(
    Hierarchy=hierarchy,
    Points=disassemble.Point,
    Lines=disassemble.Line,
    LCSRotations_Deg=disassemble_2.Alpha_deg,
    EccentricityVector=vec_cm_to_mm,
    Groupnames=k3dbeamprops.BeamIds,
    Materials=k3dbeamprops.Material,
    CrossSectionNames=k3dbeamprops.CrosecNames,
    Shapes=k3dbeamprops.CrosecShapes,
    Heights=k3dbeamprops.Heights,
    Widths=k3dbeamprops.Widths,
    ThicknessFlanges=k3dbeamprops.TFlanges,
    ThicknessWebs=k3dbeamprops.TWebs,
    Radius=k3dbeamprops.FRads,
    N=b_forces.NormalForce_kN,
    Vz=b_forces.ShearForceVz_kN,
    Vy=b_forces.ShearForceVy_kN,
    Mt=b_forces.BendingMomentMt_kNm,
    My=b_forces.BendingMomentMy_kNm,
    Mz=b_forces.BendingMomentMz_kNm)

# ----
data_14 = Data(cp)
data_15 = Data(data_14)
data_16 = Data(data_14)

# ---- group: 3. Project utilities
# Visualize joints
visualize_joints = VisualizeJoints(Project=data_15)  # -> JointTypes, Brandnames, Centerpoints
radius = Slider(0.2, range=0.2..0.5)
spread = Slider(41, range=0..100)
move_along_x = Slider(72, range=0..100)
textsize = Slider(0.4, range=0..1)
cluster_63 = Cluster_18(line=visualize_joints.JointTypes, num_2=spread, num=move_along_x, num_3=radius)  # -> P, R
cluster_64 = Cluster_17(G=visualize_joints.Centerpoints, data_3=spread, X=move_along_x)
preview_3 = CustomPreview(Geometry=cluster_63.P, Material=cluster_63.R)
xz_2 = XZPlane(Origin=flatten(cluster_64))
data_17 = Data(flatten(visualize_joints.Brandnames))
tag = TextTag3D(Location=xz_2, Text=data_17, Size=textsize, Colour=ColourSwatch(SwatchColor=RGB(0, 0, 0)), Justification=7)

# ----
data_18 = Data(data_14)

hierarchy_2 = Panel("""OuterColumns
RoofBeams
TrussRoofBeams
TrussBeams""")
transport_elements_generator = TransportElementsGenerator(Project=data_14, GroupNames=hierarchy_2, MaxLength=Slider(25, range=0..25), MaxAngle_rad=Slider(1, range=0..3))  # -> TransportElementLines, AllElementLines
lng_11 = ListLength(List=transport_elements_generator.TransportElementLines)
cluster_65 = Cluster_15(data=transport_elements_generator.AllElementLines)
data_19 = Data(flatten(cluster_65))
cluster_66 = Cluster_16(C=cluster_65)
lng_12 = ListLength(List=data_19)
total_elements = Panel(lng_12)
summary = Panel(cluster_66)

# ---- group: 4. Analytical templates
analytical_template_weld_all_members = AnalyticalTemplateWeldsAllMembers(Project=data_18, BrandNames=panel_7)  # -> Project, Message, ThroatsBeginOfElement, ThroatsEndOfElement
show_weldsizes = BooleanToggle(True)
position = Slider(0.2, range=0..1)
textsize_2 = Slider(0.02, range=0..0.15)
retrievelinespoints = RetrieveLinesPoints(Project=analytical_template_weld_all_members.Project)  # -> Lines, Points
num_47 = Number(position)
num_48 = Number(Slider(-12, range=-100..100))
expression = Expression(x=num_47, Expression="1-x")
cluster_67 = Cluster_19(C=retrievelinespoints.Lines, t=num_47, D=num_48)
cluster_68 = Cluster_19(C=retrievelinespoints.Lines, t=expression, D=num_48)
filter_15 = StreamFilter(Gate=show_weldsizes, Stream0=flatten("0"), Stream1=textsize_2)
swatch = ColourSwatch(SwatchColor=RGB(0, 0, 0))
txt = Text(analytical_template_weld_all_members.ThroatsBeginOfElement)
txt_2 = Text(analytical_template_weld_all_members.ThroatsEndOfElement)
tag_2 = TextTag3D(Location=cluster_67, Text=txt, Size=filter_15, Colour=swatch, Justification="5")
tag_3 = TextTag3D(Location=cluster_68, Text=txt_2, Size=filter_15, Colour=swatch, Justification="5")

# ----
data_20 = Data(data_16)
data_21 = Data(analytical_template_weld_all_members.Project)

# ---- group: 6. IDEA utilities
user_feedback = BooleanToggle(False)
run_all_joints = BooleanToggle(False)
run_idea = Button()
data_22 = Data(data_20)
output_folderpath = Panel("C:\Data")
create_idea_file = CreateIDEAFile(
    Project=data_22,
    OutputFolder=output_folderpath,
    UserFeecback=user_feedback,
    CreateAllJoints=run_all_joints,
    ChooseJoint=Slider(8, range=0..100),
    RunIDEA=run_idea)

user_feedback_2 = BooleanToggle(False)
run_all_joints_2 = BooleanToggle(False)
run_idea_2 = Button()
data_23 = Data(data_20)
output_folderpath_2 = Panel("C:\Data")
create_and_calculate_idea_file = CreateAndCalculateIDEAFile(
    Project=data_23,
    OutputFolder=output_folderpath_2,
    UserFeecback=user_feedback_2,
    RunAllJoints=run_all_joints_2,
    ChooseJoint=[Slider(8, range=0..30), Slider(0, range=0..30), Slider(3, range=0..30)],
    RunIDEA=run_idea_2)  # -> SelectedJoint, Analysis, Plates, Bolts, Welds, Buckling, Summary
rec = DataRecorder(create_and_calculate_idea_file.Plates, DataLimit=-10, RecordData=True)
rec_2 = DataRecorder(create_and_calculate_idea_file.Welds, DataLimit=-10, RecordData=True)
rec_3 = DataRecorder(create_and_calculate_idea_file.Buckling, DataLimit=-10, RecordData=True)
rec_4 = DataRecorder(create_and_calculate_idea_file.Analysis, DataLimit=-10, RecordData=True)
rec_5 = DataRecorder(create_and_calculate_idea_file.Bolts, DataLimit=-10, RecordData=True)
rec_6 = DataRecorder(create_and_calculate_idea_file.Summary, DataLimit=-10, RecordData=True)
summary_message = Panel(rec_6)
analysis = Panel(rec_4)
ucplates = Panel(rec)
ucbuckling = Panel(rec_3)
ucbolts = Panel(rec_5)
ucwelds = Panel(rec_2)

# ----
data_24 = Data(visualize_joints.Brandnames)
pshift = ShiftPaths(Data=data_24, Offset=-1)
item_7 = ListItem(List=pshift, Index=0, Wrap=True)  # -> flatten(Item)

data_25 = Data(flatten(transport_elements_generator.TransportElementLines))
data_26 = Data(flatten(lng_11))
data_27 = Data(range_2)
c_script_9 = CSharpScript(lengths=data_26, colorlist=data_27)  # -> out, A; inputs lengths: list of Double, colorlist: list of Double; same code as c_script
data_28 = Data(flatten(c_script_9.A))
gradient_2 = Gradient(
    LowerLimit=0,
    UpperLimit=1,
    Parameter=data_28,
    stops=[0: RGB(35, 99, 187), 0: RGB(234, 38, 0), 0: RGBA(255, 255, 255, 0), 0.25: RGB(234, 126, 0), 0.5: RGB(254, 244, 84), 0.75: RGB(173, 203, 249), 1: RGB(75, 107, 169)])
pipe_3 = Pipe(Curve=data_25, Radius=Slider(0.1, range=0..0.1), Caps=0)  # -> flatten(Pipe)
preview_4 = CustomPreview(Geometry=pipe_3, Material=gradient_2)

cluster_69 = Cluster_15(data=transport_elements_generator.AllElementLines)
linedim = LineDimension(Line=cluster_69, Text="{0:0.00}", Size=Slider(0.2, range=0..1))

unique_brand_names = Panel(item_7)

# ---- group: 7. Cost calculation
data_29 = Data(data_21)
boltprices_from_m12_up_till_m52 = Panel("""0.30
0.60
1.10
1.50
2.30
2.70
5.10
26.56
31.81
31.40""")
bolt_costs = BoltCosts(Project=data_29, Boltprices=boltprices_from_m12_up_till_m52)  # -> BoltCosts, Message
weld_volume_generator = WeldVolumeGenerator(Project=data_29)
total_weight = TotalWeight(Project=data_29)  # -> WeightElements_kg, WeightPlates_kg, Brep
retrievelinespoints_2 = RetrieveLinesPoints(Project=data_29)  # -> Lines, Points
price_welding = Panel("2.6")
price_steel = Panel("1")
applied_boltprices = Panel(bolt_costs.Message)
preview_5 = CustomPreview(Geometry=total_weight.Brep, Material=ColourSwatch(SwatchColor=RGBA(158, 138, 138, 138)))
costcalculator = CostCalculator(
    WeightElements_kg=total_weight.WeightElements_kg,
    WeightPlates_kg=total_weight.WeightPlates_kg,
    WeldingVolume_cm3=weld_volume_generator,
    BoltCosts=bolt_costs.BoltCosts,
    NumberOfElements=0,
    SteelPricePerKg=price_steel,
    WeldingPricePerCm3=price_welding,
    TransportPricePerElement=20)  # -> CostsOfBeamMaterial_, CostsPerJoint_, CostsPerJointDetailed_, TransportCost_
xz_3 = XZPlane(Origin=retrievelinespoints_2.Points)
Z_4 = UnitZ(Factor=Slider(0.23, range=0..1))
ma = MassAddition(Input=costcalculator.CostsPerJointDetailed_)  # -> flatten(Result), PartialResults
Y_4 = UnitY(Factor="0.2")
move_7 = Move(Geometry=xz_3, Motion=Z_4)  # -> Geometry, Transform
move_8 = Move(Geometry=move_7.Geometry, Motion=Y_4)  # -> Geometry, Transform
tag_4 = TextTag3D(Location=move_8.Geometry, Text=costcalculator.CostsPerJoint_, Size=Slider(0.1, range=0..0.1), Justification=7)

# ----
panel_11 = Panel(total_weight.WeightElements_kg)

# ==== cluster Cluster
num = ClusterInput()
num_2 = Number(num)
ins = InsertItems(List="0", Item=num_2, Indices="1", Wrap=True)
L = ClusterOutput(ins)

# ==== cluster Cluster_2
data = ClusterInput()
data_2 = ClusterInput()
data_3 = ClusterInput()

data_4 = Data(data)
data_5 = Data(data_2)
data_6 = Data(data_3)
flip = FlipMatrix(Data=data_4)
replace = ReplaceItems(List=data_4, Item="True", Indices=data_5, Wrap="True")
replace_2 = ReplaceItems(List=flip, Item="True", Indices=data_6, Wrap="True")
flip_2 = FlipMatrix(Data=replace_2)
or = GateOr(A=replace, B=flip_2)
data_7 = Data(or)

data_8 = ClusterOutput(data_7)

# ==== cluster Cluster_3
num = ClusterInput()
num_2 = ClusterInput()

num_3 = Number(num)
num_4 = Number(num_2)
dup = DuplicateData(Data="False", Number=num_3, Order=True)  # -> graft(Data)
dup_2 = DuplicateData(Data=dup, Number=num_4, Order=True)
data = Data(dup_2)

data_2 = ClusterOutput(data)

# ==== cluster Cluster_4
F = ClusterInput()
pt = ClusterInput()
Z = UnitZ(Factor=F)
neg = Negative(Value=Z)
pt_2 = Point(pt)
move = Move(Geometry=pt_2, Motion=neg)  # -> Geometry, Transform
pt_3 = ClusterOutput(pt_2)
G = ClusterOutput(move.Geometry)

# ==== cluster Cluster_5
pt = ClusterInput()
pt_2 = Point(pt)
cull_i = CullIndex(List=pt_2, Indices="0", Wrap=True)  # -> simplify(List)
lng = ListLength(List=cull_i)
culln = CullNth(List=cull_i, CullFrequency=lng)  # -> simplify(List)
L = ClusterOutput(culln)
panel = Panel(culln)

# ==== cluster Cluster_6
pt = ClusterInput()

pt_2 = Point(pt)
lng = ListLength(List=pt_2)
cull_i = CullIndex(List=pt_2, Indices="0", Wrap=True)  # -> simplify(List)
culln = CullNth(List=pt_2, CullFrequency=lng)  # -> simplify(List)
ln = Line(StartPoint=culln, EndPoint=cull_i)

L = ClusterOutput(ln)

# ==== cluster Cluster_7
pt = ClusterInput()
pt_2 = ClusterInput()
pt_3 = Point(pt)
pt_4 = Point(pt_2)
lng = ListLength(List=pt_3)
lng_2 = ListLength(List=pt_4)
lng_3 = ListLength(List=pt_3)
lng_4 = ListLength(List=pt_4)
split = SplitList(List=pt_3, Index=expr("(x/2)", lng))  # -> ListA, ListB
split_2 = SplitList(List=pt_4, Index=expr("x/2", lng_2))  # -> ListA, ListB
split_3 = SplitList(List=pt_3, Index=expr("(x/2)-1", lng_3))  # -> ListA, ListB
split_4 = SplitList(List=pt_4, Index=expr("(x/2)-1", lng_4))  # -> ListA, ListB
pt_5 = Point(split.ListA)
pt_6 = Point(split_2.ListA)
pt_7 = Point(split_3.ListB)
pt_8 = Point(split_4.ListB)
lng_5 = ListLength(List=pt_5)
lng_6 = ListLength(List=pt_8)
cull_i = CullIndex(List=pt_6, Indices="0", Wrap=True)
cull_i_2 = CullIndex(List=pt_7, Indices="0", Wrap=True)
culln = CullNth(List=pt_5, CullFrequency=lng_5)
culln_2 = CullNth(List=pt_8, CullFrequency=lng_6)
ln = Line(StartPoint=culln, EndPoint=cull_i)
ln_2 = Line(StartPoint=culln_2, EndPoint=cull_i_2)
merge = Merge(Data1=ln, Data2=ln_2)
R = ClusterOutput(merge)

# ==== cluster Cluster_9
panel = Panel("""True
False""")
L = ClusterInput()
L_2 = ClusterInput()
panel_2 = Panel("""0
1""")
cull = CullPattern(List=L, CullPattern=reverse(panel))
cull_2 = CullPattern(List=L_2, CullPattern=panel)
weave = Weave(Pattern=panel_2, Stream0=cull_2, Stream1=cull, NullGaps=False)
cluster = Cluster_8(pt=weave)
L_3 = ClusterOutput(cluster)

# ==== cluster Cluster_10
data = ClusterInput()
data_2 = Data(data)
lng = ListLength(List=data_2)
culln = CullNth(List=data_2, CullFrequency=lng)
panel = Panel(data_2)
cull_i = CullIndex(List=culln, Indices="0", Wrap=True)
L = ClusterOutput(cull_i)

# ==== cluster Cluster_11
pt = ClusterInput()
num = ClusterInput()
num_2 = ClusterInput()
num_3 = ClusterInput()
pt_2 = Point(pt)

num_4 = Number(num)
num_5 = Number(num_2)
num_6 = Number(num_3)
cluster = Cluster_4(pt=pt_2, F=num_6)  # -> pt_3, G
cluster_2 = Cluster_4(pt=pt_2, F=num_4)  # -> pt_3, G
pt_3 = Point(graft(cluster_2.pt_3))
ln = Line(StartPoint=cluster.pt_3, EndPoint=cluster.G)
ln_2 = Line(StartPoint=cluster.G, EndPoint=cluster_2.G)
divide = DivideCurve(Curve=ln_2, Count=num_5, Kinks=False)  # -> Points, Tangents, Parameters
merge = Merge(Data1=divide.Points, Data2=pt_3)

equals = Equality(FirstNumber=num_4, SecondNumber="0")  # -> Equality, Inequality

divide_2 = DivideCurve(Curve=ln, Count=num_5, Kinks=False)  # -> Points, Tangents, Parameters

filter = StreamFilter(Gate=equals.Inequality, Stream0=divide_2.Points, Stream1=merge)

data = Data(simplify(filter))
panel = Panel(data)
data_2 = ClusterOutput(data)

# ==== cluster Cluster_12
pt = ClusterInput()

pt_2 = Point(pt)
flip = FlipMatrix(Data=pt_2)
lng = ListLength(List=flip)  # -> expr("x-1", Length)
panel = Panel("0")
cull_i = CullIndex(List=pt_2, Indices="0", Wrap=True)
cull_i_2 = CullIndex(List=flip, Indices=lng, Wrap=True)
flip_2 = FlipMatrix(Data=cull_i)
flip_3 = FlipMatrix(Data=cull_i_2)
lng_2 = ListLength(List=flip_3)
culln = CullNth(List=flip_3, CullFrequency=lng_2)
cull_i_3 = CullIndex(List=flip_2, Indices="0", Wrap=True)
flip_4 = FlipMatrix(Data=culln)
ln = Line(StartPoint=cull_i_3, EndPoint=flip_4)

L = ClusterOutput(ln)

# ==== cluster Cluster_13
pt = ClusterInput()

pt_2 = Point(pt)
flip = FlipMatrix(Data=pt_2)
cull_i = CullIndex(List=pt_2, Indices="0", Wrap=True)
cull_i_2 = CullIndex(List=flip, Indices="0", Wrap=True)
flip_2 = FlipMatrix(Data=cull_i)
flip_3 = FlipMatrix(Data=cull_i_2)
lng = ListLength(List=flip_2)
lng_2 = ListLength(List=flip_3)
culln = CullNth(List=flip_2, CullFrequency=lng)
culln_2 = CullNth(List=flip_3, CullFrequency=lng_2)
flip_4 = FlipMatrix(Data=culln_2)
ln = Line(StartPoint=culln, EndPoint=flip_4)

L = ClusterOutput(ln)

# ==== cluster Cluster_14
num = ClusterInput()
data = ClusterInput()
num_2 = ClusterInput()

num_3 = Number(num)
data_2 = Data(data)
num_4 = Number(num_2)

num_5 = Number(expr("x-1", num_3))
cluster = Cluster_3(num=num_4, num_2=num_3)
multiplication = Multiplication(A=data_2, B=num_5)
round = Round(Number=multiplication)  # -> Nearest, Floor, Ceiling
dcon = DeleteConsecutive(Set=round.Nearest, Wrap=False)  # -> Set, Count
cluster_2 = Cluster_2(data=cluster, data_2=dcon.Set)

cull_pattern_matrix = ClusterOutput(cluster_2)

# ==== cluster Cluster_15
data = ClusterInput()
data_2 = Data(data)
lng = ListLength(List=data_2)
item = ListItem(List=data_2, Index=expr("x-1", lng), Wrap=True)
item_2 = ListItem(List=data_2, Index=0, Wrap=True)
end = EndPoints(Curve=item_2)  # -> Start, End
end_2 = EndPoints(Curve=item)  # -> Start, End
ln = Line(StartPoint=end.Start, EndPoint=end_2.End)
L = ClusterOutput(ln)

# ==== cluster Cluster_16
C = ClusterInput()
len = Length(Curve=C)  # -> flatten(Length)
sort = SortList(Keys=len, ValuesA=len)  # -> Keys, ValuesA
dcon = DeleteConsecutive(Set=sort.Keys, Wrap=False)  # -> Set, Count
data = Data(graft(dcon.Set))
data_2 = Data(sort.Keys)
equals = Equality(FirstNumber=data_2, SecondNumber=data)  # -> simplify(Equality), Inequality
cull = CullPattern(List=data_2, CullPattern=equals.Equality)
lng = ListLength(List=cull)  # -> flatten(Length)
data_3 = Data(dcon.Set)
expression = Expression(x=lng, y=data_3, Expression="Format(\"There are {0:0} lines of {1:0.00} m\", x,y)")
R = ClusterOutput(expression)

# ==== cluster Cluster_17
G = ClusterInput()
X = ClusterInput()
vec = VectorXYZ(XComponent=X, YComponent=0, ZComponent=0)  # -> Vector, Length
move = Move(Geometry=G, Motion=vec.Vector)  # -> Geometry, Transform
data = Data(move.Geometry)
tstat = TreeStatistics(Tree=data)  # -> Paths, Length, Count
dpath = DeconstructPath(Branch=tstat.Paths)
data_2 = Data(graft(tstat.Length))
flip = FlipMatrix(Data=dpath)
data_3 = ClusterInput()
bang = ExplodeTree(Data=flip)  # -> flatten(Branch0), flatten(Branch1)
data_4 = Data(data_3)
data_5 = Data(graft(bang.Branch0))
data_6 = Data(graft(bang.Branch1))
multiplication = Multiplication(A=bang.Branch0, B=data_4)
multiplication_2 = Multiplication(A=bang.Branch1, B=data_4)
path = ConstructPath(Indices=[data_5, data_6])  # -> flatten(Branch)
vec_2 = VectorXYZ(XComponent=multiplication, YComponent=multiplication_2, ZComponent=0)  # -> Vector, Length
unflatten = UnflattenTree(Tree=vec_2.Vector, Guide=path)  # -> graft(Tree)
data_7 = Data(flatten(data))
dup = DuplicateData(Data=unflatten, Number=data_2, Order=True)  # -> flatten(Data)
move_2 = Move(Geometry=data_7, Motion=dup)  # -> Geometry, Transform
G_2 = ClusterOutput(move_2.Geometry)
panel = Panel(move_2.Geometry)

# ==== cluster Cluster_18
num = ClusterInput()
num_2 = ClusterInput()
line = ClusterInput()
num_3 = ClusterInput()
num_4 = Number(num)
num_5 = Number(num_2)
line_2 = Line(line)
num_6 = Number(num_3)
cluster = Cluster_17(G=line_2, data_3=num_5, X=num_4)
line_3 = Line(cluster)
pipe = Pipe(Curve=line_3, Radius=num_6, Caps=0)  # -> flatten(Pipe)
dom = ConstructDomain(DomainStart="0", DomainEnd="1")
pshift = ShiftPaths(Data=line_2, Offset=-1)
P = ClusterOutput(pipe)
range = Range(Domain=dom, Steps=Slider(8, range=0..100))
lng = ListLength(List=pshift)
data = Data(flatten(lng))
data_2 = Data(range)
c_script = CSharpScript(lengths=data, colorlist=data_2)  # -> out, A; inputs lengths: list of Double, colorlist: list of Double
# ---------- c_script: C# ----------
    DataTree<double> tree = new DataTree<double>();
    GH_Path path = new GH_Path();
    int w = 0;


    for (int b = 0; b < lengths.Count; b++)
    {
      for (int c = 0;c < lengths[b];c++)
      {
        double num = colorlist[(w % colorlist.Count)];
        //tree.Add(num, path);
        tree.Add(num);
      }
      w = w + 1;

    }
    A = tree;
# ---------- end c_script ----------
data_3 = Data(flatten(c_script.A))
gradient = Gradient(
    LowerLimit=0,
    UpperLimit=1,
    Parameter=data_3,
    stops=[0: RGB(35, 99, 187), 0: RGB(234, 38, 0), 0: RGBA(255, 255, 255, 0), 0.25: RGB(234, 126, 0), 0.5: RGB(254, 244, 84), 0.75: RGB(173, 203, 249)])
lng_2 = ListLength(List=gradient)
dup = DuplicateData(Data=" (100)", Number=lng_2, Order=True)  # -> flatten(Data)
merge = Merge(Data1=graft(gradient), Data2=graft(dup))
join = TextJoin(Text=merge)  # -> flatten(Result)
R = ClusterOutput(join)

# ==== cluster Cluster_19
C = ClusterInput()
t = ClusterInput()
D = ClusterInput()
eval = EvaluateCurve(Curve=C, Parameter=t)  # -> Point, Tangent, Angle
rad = Radians(Degrees=D)
xz = XZPlane(Origin=eval.Point)
rotate = Rotate(Geometry=xz, Angle=rad, Plane=xz)  # -> Geometry, Transform
G = ClusterOutput(rotate.Geometry)

# ==== cluster Cluster_8
pt = ClusterInput()

pt_2 = Point(pt)
lng = ListLength(List=pt_2)
cull_i = CullIndex(List=pt_2, Indices="0", Wrap=True)
culln = CullNth(List=pt_2, CullFrequency=lng)
ln = Line(StartPoint=cull_i, EndPoint=culln)

L = ClusterOutput(ln)
