# Grasshopper definition OLD_KarambaIDEA_Example_Truss_Fragmented.gh (Grasshopper 1.0.7)
# Copyright: B+G Engineers
# plug-ins: karambaGH, KarambaIDEA

# ---- group: Parameters
connection_truss_column = ValueList({"Moment": 0, "Hinge": 1}, selected="Hinge")
# KarambaIDEA Example Truss
length = Slider(40, range=0..40)
structure_height = Slider(4, range=0..10)
truss_height = Slider(2.5, range=0..5)
truss_divisions = Slider(10, range=2..20)

# ----
panel = Panel("""Parameters
Geometry
Karamba3D
0. Utilities
1. Load conversions
2. Create Project
3. Project utilities
4. Analytical templates
5. IDEA templates
6. IDEA utilities
7. Cost calculation""")
merge = Merge(
    Data1=ColourSwatch(SwatchColor=RGB(106, 144, 173)),
    Data2=ColourSwatch(SwatchColor=RGB(123, 189, 179)),
    Data3=ColourSwatch(SwatchColor=RGB(227, 136, 118)),
    Data4=ColourSwatch(SwatchColor=RGB(237, 201, 69)),
    Data5=ColourSwatch(SwatchColor=RGB(237, 201, 69)),
    Data6=ColourSwatch(SwatchColor=RGB(237, 221, 161)),
    Data7=ColourSwatch(SwatchColor=RGBA(212, 61, 66, 118)),
    Data8=ColourSwatch(SwatchColor=RGB(186, 222, 214)),
    Data9=ColourSwatch(SwatchColor=RGB(250, 227, 217)),
    Data10=ColourSwatch(SwatchColor=RGBA(255, 111, 15, 97)),
    Data11=ColourSwatch(SwatchColor=RGBA(86, 212, 61, 63)))
group_color = SliderGroupColor(run=Button(), groupNames=panel, colors=merge, defaultColor=ColourSwatch(SwatchColor=RGB(232, 227, 227)))  # inputs run: Boolean, groupNames: list of String, colors: list of Color, defaultColor: Color
# ---------- group_color: C# usings ----------
using System.Drawing;
using Grasshopper.Kernel.Special;
# ---------- group_color: C# ----------
    // Created by Timo Harboe Nielsen - Bjarke Ingels Group.
    
    if(!run){
      return;
    }
    GH_Document doc = owner.OnPingDocument();
    foreach (var dobj in doc.Objects)
    {
      GH_Group _group = dobj as GH_Group;
      if( _group == null){
        continue;
      }
      for(int i = 0; i < Math.Min(groupNames.Count, colors.Count); i++){
        string groupName = _group.NickName.ToString();
        string compareName = groupNames[i];
        if(groupName.IndexOf(compareName, StringComparison.OrdinalIgnoreCase) >= 0){
          _group.Colour = colors[i];
          break;
        } else{
          _group.Colour = defaultColor;
        }
      }
    }
# ---------- end group_color ----------

# ---- group: Geometry
X = UnitX(Factor=length)
pt = ConstructPoint(XCoordinate=0, YCoordinate=0, ZCoordinate=0)
move = Move(Geometry=pt, Motion=X)  # -> Geometry, Transform
pt_2 = Point(move.Geometry)
pt_3 = Point(pt)
ln = Line(StartPoint=pt, EndPoint=pt_2)
subtraction = Subtraction(A=structure_height, B=truss_height)
aligndim = AlignedDimension(Plane=PlaneXY(0, 0, 0), PointA=pt, PointB=pt_2, Offset=-1, Text="{0:0.00}", Size=0.2)
Z = UnitZ(Factor=structure_height)
Z_2 = UnitZ(Factor=subtraction)
divide = DivideCurve(Curve=ln, Count=truss_divisions, Kinks=False)  # -> Points, Tangents, Parameters
move_2 = Move(Geometry=divide.Points, Motion=Z_2)  # -> Geometry, Transform
move_3 = Move(Geometry=divide.Points, Motion=Z)  # -> Geometry, Transform
pt_4 = Point([pt_3, pt_2])

# ----
genes = GenePool(Decimals=2, Maximum=1, Minimum=0, Value=[0.27, 0.69])

genes_2 = GenePool(Decimals=2, Maximum=1, Minimum=0, Value=[0.16, 0.26, 0.55])
line = Line(ln)
line_2 = Line(line)
end = EndPoints(Curve=line_2)  # -> Start, End
len = Length(Curve=line_2)
sort = SortList(Keys=genes_2)  # -> Keys, ValuesA
multiplication = Multiplication(A=len, B=sort.Keys)
pt_5 = ConstructPoint(XCoordinate=multiplication, YCoordinate=0, ZCoordinate=0)
equals = Equality(FirstNumber=end.Start, SecondNumber=pt_5)  # -> Equality, Inequality
equals_2 = Equality(FirstNumber=end.End, SecondNumber=pt_5)  # -> Equality, Inequality
or = GateOr(A=equals.Equality, B=equals_2.Equality)
cull = CullPattern(List=pt_5, CullPattern=invert(or))
pt_6 = Point(cull)

cluster = Cluster_3(pt=move_2.Geometry)
genes_3 = GenePool(Decimals=2, Maximum=1, Minimum=0, Value=0.54)
cluster_2 = Cluster(pt=cluster)  # -> flatten(L)
pt_7 = Point(pt_6)

# ---- group: Karamba3D / Define Materials
matselect = MaterialSelectionKaramba3D(menu=[dropdown(1), dropdown(4)])

# ---- group: Karamba3D / Define Cross Sections
crosecrselect = CrossSectionRangeSelectorKaramba3D(MaximumHeight_cm=-1, MaximumWidth_cm=-1, Material=matselect, menu=[dropdown(1), dropdown(1), dropdown(4)])
crosecselect = CrossSectionSelectorKaramba3D(CrossSections=crosecrselect, NameOrListIndexOfCrossSection="10")  # -> CrossSection, Info
crosecselect_2 = CrossSectionSelectorKaramba3D(CrossSections=crosecrselect, NameOrListIndexOfCrossSection="2")  # -> CrossSection, Info
crosecselect_3 = CrossSectionSelectorKaramba3D(CrossSections=crosecrselect, NameOrListIndexOfCrossSection="0")  # -> CrossSection, Info
entwine = Entwine(
    Branch00=crosecselect.CrossSection,
    Branch01=crosecselect_2.CrossSection,
    Branch02=crosecselect_3.CrossSection,
    Branch03=crosecselect_3.CrossSection,
    FlattenInputs=True)
crosec = CrossSectionKaramba3D(crosecrselect)

# ---- group: Karamba3D / Define Loads
load_multiplier = Slider(20, range=0..500)
Z_3 = UnitZ(Factor=load_multiplier)
loads = LoadsKaramba3D(Vector=Z_3, BeamIdentifiers="Topchord", LCase="1", mode="Uniform Line", menu=[buttons(on, off, off)])

load_multiplier_2 = Slider(-30, range=-100..0)
Z_4 = UnitZ(Factor=load_multiplier_2)
loads_2 = LoadsKaramba3D(Vector=Z_4, BeamIdentifiers="Topchord", LCase="0", mode="Uniform Line", menu=[buttons(on, off, off)])

# ---- group: Karamba3D / Define Supports
panel_2 = Panel("Diagonal")
beam_joints = BeamJointsKaramba(
    ElementIdentifiers=panel_2,
    CtKNMAtStartingNode=Vector(0, 0, 0),
    CrKNmRadAtStartingNode=Vector(0, 0, 0),
    CtKNMAtEndNode=Vector(0, 0, 0),
    CrKNmRadAtEndNode=Vector(0, 0, 0),
    menu=[buttons(off, off, off, off, off, off), buttons(off, off, off, off, off, off)])

# ----
panel_3 = Panel("""11
44
22""")
user_feedback = BooleanToggle(True)
run_all_joints = BooleanToggle(False)
Y = UnitY(Factor=1)
neg = Negative(Value=Y)
frgb = ColourRGBF(Alpha=1, Red=0, Green=0, Blue=0)

# ---- group: Geometry
cluster_3 = Cluster_2(pt=move_2.Geometry)
cluster_4 = Cluster_2(pt=move_3.Geometry)
pt_8 = Point(move_3.Geometry)
pt_9 = Point(move_2.Geometry)
cluster_5 = Cluster(pt=move_3.Geometry)  # -> flatten(L)
cluster_6 = Cluster(pt=move_2.Geometry)  # -> flatten(L)
pt_10 = Point(pt_4)
pt_11 = Point(pt_4)
pt_12 = Point(cluster_3)
pt_13 = Point(cluster_4)
ln_2 = Line(StartPoint=pt_8, EndPoint=pt_9)  # -> flatten(Line)
lng = ListLength(List=pt_8)
lng_2 = ListLength(List=pt_9)
lng_3 = ListLength(List=pt_8)
lng_4 = ListLength(List=pt_9)
entwine_2 = Entwine(Branch00=pt_13, Branch01=pt_12, Branch02=pt_11, FlattenInputs=True)
split = SplitList(List=pt_8, Index=expr("(x/2)", lng))  # -> ListA, ListB
split_2 = SplitList(List=pt_9, Index=expr("x/2", lng_2))  # -> ListA, ListB
split_3 = SplitList(List=pt_8, Index=expr("(x/2)-1", lng_3))  # -> ListA, ListB
split_4 = SplitList(List=pt_9, Index=expr("(x/2)-1", lng_4))  # -> ListA, ListB
flip = FlipMatrix(Data=entwine_2)
cull_i = CullIndex(List=ln_2, Indices="0", Wrap=True)
pt_14 = Point(split.ListA)
pt_15 = Point(split_2.ListA)
pt_16 = Point(split_3.ListB)
pt_17 = Point(split_4.ListB)
cluster_7 = Cluster(pt=flip)  # -> flatten(L)
lng_5 = ListLength(List=cull_i)
lng_6 = ListLength(List=pt_14)
lng_7 = ListLength(List=pt_17)
cull_i_2 = CullIndex(List=pt_15, Indices="0", Wrap=True)
culln = CullNth(List=cull_i, CullFrequency=lng_5)
cull_i_3 = CullIndex(List=pt_16, Indices="0", Wrap=True)
culln_2 = CullNth(List=pt_14, CullFrequency=lng_6)
culln_3 = CullNth(List=pt_17, CullFrequency=lng_7)
ln_3 = Line(StartPoint=culln_2, EndPoint=cull_i_2)  # -> flatten(Line)
ln_4 = Line(StartPoint=culln_3, EndPoint=cull_i_3)  # -> flatten(Line)
merge_2 = Merge(Data1=ln_3, Data2=ln_4)
pt_18 = Point(pt_10)

# ----
filter = StreamFilter(Gate=connection_truss_column, Stream0=cluster_6, Stream1=cluster_2)

# ---- group: Geometry (continued)
entwine_3 = Entwine(Branch00=cluster_7, Branch01=cluster_5, Branch02=filter, Branch03=culln, Branch04=merge_2, FlattenInputs=True)

# ----
line_3 = Line(filter)
line_4 = Line(culln)
line_5 = Line(merge_2)
line_6 = Line(cluster_5)
line_7 = Line(cluster_7)
pt_19 = Point(pt_18)
cluster_8 = Cluster_5(line=line_7, pt=pt_7)
diagonals_and_horizontals = DiagonalsAndHorizontals(line=line_6, pt=pt_7)
diagonals_and_horizontals_2 = DiagonalsAndHorizontals(line=line_3, pt=pt_7)
cluster_9 = Cluster_5(line=line_4, pt=pt_7)
diagonals_and_horizontals_3 = DiagonalsAndHorizontals(line=line_5, pt=pt_7)
panel_4 = Panel(diagonals_and_horizontals_2)
entwine_4 = Entwine(
    Branch0X=cluster_8,
    Branch1X=diagonals_and_horizontals,
    Branch2X=diagonals_and_horizontals_2,
    Branch3X=cluster_9,
    Branch4X=diagonals_and_horizontals_3,
    FlattenInputs=False)
merge_3 = Merge(
    Data1=cluster_8,
    Data2=diagonals_and_horizontals,
    Data3=diagonals_and_horizontals_2,
    Data4=cluster_9,
    Data5=diagonals_and_horizontals_3)
pshift = ShiftPaths(Data=entwine_4, Offset=-1)

# ---- group: Karamba3D
pt_20 = Point(pt_19)
line_8 = Line(pshift)
joint = JointKaramba3D(beam_joints)
load = LoadKaramba3D(loads_2)

# ----
graft = GraftTree(Tree=entwine_4, IncludeEmptyLists=True, IncludeNullItems=True)
tstat = TreeStatistics(Tree=graft)  # -> Paths, Length, Count
dpath = DeconstructPath(Branch=tstat.Paths)
item = ListItem(List=dpath, Index="1", Wrap=True)

# ---- group: Karamba3D / Define Elements
panel_5 = Panel("""Column
Topchord
Bottomchord
Post
Diagonal""")
linetobeam = LineToBeamKaramba3D(Line=line_8, Identifier=graft(panel_5), CrossSection=entwine, New=True, Remove=True, LimitDistance_m=0.005)  # -> Element, Points, Info

# ---- group: Karamba3D / Define Supports
pt_21 = Point(pt_20)
supp = SupportKaramba(PosInd=pt_21, menu=[buttons(on, on, on, on, on, on)])

# ---- group: Karamba3D
load_2 = LoadKaramba3D(load)
element = ElementKaramba3D(linetobeam.Element)
support = SupportKaramba3D(supp)
joint_2 = JointKaramba3D(joint)

# ---- group: Karamba3D / Assemble Model
assemble = AssembleModelKaramba3D(Elem=flatten(element), Support=flatten(support), Load=flatten(load_2), Joint=flatten(joint_2), LimitDistance_m=0.005)  # -> Model, Info, Mass_kg, CenterOfGravity

# ---- group: Karamba3D / Optimize Crosssections
panel_6 = Panel("""Column
Topchord
Bottomchord
Post
Diagonal""")
crosec_2 = CrossSectionKaramba3D(crosec)
opticrosec = OptimizeCrossSectionKaramba3D(
    Model=assemble.Model,
    GroupIdentifiers=panel_6,
    CrossSections=crosec_2,
    MaximumUtilization=Slider(0.7, range=0..1),
    MaximumDisplacement_cm=-1,
    UltimateLimitStateIterations=5,
    DisplacementIterations=5,
    NumberOfSamplePoints=3,
    ElasticDesign=True,
    GammaM0=1,
    GammaM1=1)  # -> ModelWithOptimizedCrossSections, Info, Mass_kg, MaximumDisplacement_cm, ElasticEnergy_kNm

# ---- group: Karamba3D / Analyze Model
analyze = AnalyzeKaramba3D(Model=assemble.Model)  # -> CalculatedModel, MaximumDisplacement_cm, ResultingForceOfGravity_kN, ElasticEnergy_kNm

# ---- group: Karamba3D / View Results
modelview = ModelViewKaramba3D(
    Model=opticrosec.ModelWithOptimizedCrossSections,
    LoadCaseFactorsForLinearSuperposition=1,
    IndexOfVisibleLoadcase=Slider(0, range=0..100))  # -> Model, DeformedMesh, DeformedAxes, DeformedModel
beamview = BeamViewKaramba3D(Model=modelview.Model)  # -> Model, MeshesOfRenderedBeams, DeformedBeamAxes, LegendColors, LegendTags

# ---- group: 2. Create Project / Stream filter to control data speed
# KarambaIDEA
toggle = BooleanToggle(True)
filter_2 = StreamFilter(Gate=toggle, Stream1=beamview.Model)

# ---- group: 2. Create Project / Data collect
disassemble = DisassembleModelKaramba3D(Model=filter_2)  # -> Model, Point, Beam, Shell, Support, Load, Line, Mesh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
k3dbeamprops = CSharpScript(
    Model=disassemble.Model,
    Reference=["C:\PROGRAM FILES\RHINO 7\PLUG-INS\KARAMBA\karambaCommon.dll", "C:\PROGRAM FILES\RHINO 7\PLUG-INS\KARAMBA\karamba.gha"])  # -> BeamIds, Material, CrosecNames, CrosecShapes, Heights, Widths, TFlanges, TWebs, FRads
# ---------- k3dbeamprops: C# usings ----------
using Karamba.Elements;
using Karamba.CrossSections;
# ---------- k3dbeamprops: C# ----------
    var model = Model as Karamba.Models.Model;
    if (model == null) {
      throw new ArgumentException ("The input is not of type model!");
    }

    var beam_ids = new List<string>();
    var cs_names = new List<string>();
    var cs_shapes = new List<string>();
    var cs_material = new List<string>();
    var heights = new List<double>();
    var widths = new List<double>();
    var tflanges = new List<double>();
    var twebs = new List<double>();
    var frads = new List<double>();

    foreach (var elem in model.elems)
    {
      var beam = elem as ModelElementStraightLine;
      if (beam != null) {
        beam_ids.Add(elem.id);
        cs_names.Add(elem.crosec.name);
        cs_shapes.Add(elem.crosec.shape());
        cs_material.Add(elem.crosec.materialName);

        // is it an I-profile?
        var crosec_i = beam.crosec as CroSec_I;
        if (crosec_i != null) {
          heights.Add(crosec_i.getHeight() * 1000);
          // use the upper flange thickness
          widths.Add(crosec_i.uf_width * 1000);
          tflanges.Add(crosec_i.uf_thick * 1000);
          twebs.Add(crosec_i.w_thick * 1000);
          // use the inner fillet radius
          frads.Add(crosec_i.fillet_r * 1000);
          // this would be the outer fillet radius
          // frads.Add(crosec.fillet_r1);
          continue;
        }

        // is it a CHS?
        var crosec_o = beam.crosec as CroSec_Circle;
        if (crosec_o != null) {
          heights.Add(crosec_o.getHeight() * 1000);
          // use the upper flange thickness
          widths.Add(0);
          tflanges.Add(crosec_o.thick * 1000);
          twebs.Add(crosec_o.thick * 1000);
          frads.Add(0);
          continue;
        }

        // options for Box, trapezoid and T-section are not implemented yet
        throw new Exception("Cross section encountered for which no export is implemented");
      }
    }

    BeamIds = beam_ids;
    CrosecNames = cs_names;
    CrosecShapes = cs_shapes;
    Material = cs_material;
    Heights = heights;
    Widths = widths;
    TFlanges = tflanges;
    TWebs = twebs;
    FRads = frads;
# ---------- end k3dbeamprops ----------
b_forces = BeamForcesKaramba3D(AnalyzedModel=disassemble.Model, LCase=-1, MaximumDistanceBetweenResults_m=-1, NumberOfResultsPerBeamElement=2)  # -> AnalyzedModel, NormalForce_kN, ShearForceVz_kN, ShearForceVy_kN, BendingMomentMt_kNm, BendingMomentMy_kNm, BendingMomentMz_kNm
disassemble_2 = DisassembleElementKaramba3D(Element=disassemble.Beam)  # -> Element, ElementIdentifier, AxisOfElement, CrossSection, Joints, Material, LocalCoordinateSystem, ElementIsActive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
vec_cm_to_mm = Vector(expr("x*10", disassemble_2.LocalEccentricity_cm))
hierarchy = Panel("""Column
Topchord
Bottomchord
Post
Diagonal""")
cp = CreateProject(
    Hierarchy=hierarchy,
    Points=disassemble.Point,
    Lines=disassemble.Line,
    LCSRotations_Deg=disassemble_2.Alpha_deg,
    EccentricityVector=vec_cm_to_mm,
    Groupnames=k3dbeamprops.BeamIds,
    Materials=k3dbeamprops.Material,
    CrossSectionNames=k3dbeamprops.CrosecNames,
    Shapes=k3dbeamprops.CrosecShapes,
    Heights=k3dbeamprops.Heights,
    Widths=k3dbeamprops.Widths,
    ThicknessFlanges=k3dbeamprops.TFlanges,
    ThicknessWebs=k3dbeamprops.TWebs,
    Radius=k3dbeamprops.FRads,
    N=b_forces.NormalForce_kN,
    Vz=b_forces.ShearForceVz_kN,
    Vy=b_forces.ShearForceVy_kN,
    Mt=b_forces.BendingMomentMt_kNm,
    My=b_forces.BendingMomentMy_kNm,
    Mz=b_forces.BendingMomentMz_kNm)

# ----
data = Data(cp)
data_2 = Data(data)

# ---- group: 3. Project utilities
# Visualize joints
visualize_joints = VisualizeJoints(Project=data_2)  # -> JointTypes, Brandnames, Centerpoints
radius = Slider(0.2, range=0.2..0.5)
move_along_x = Slider(60, range=0..100)
textsize = Slider(0.4, range=0..1)
spread = Slider(10, range=0..100)
cluster_10 = Cluster_7(line=visualize_joints.JointTypes, num_2=spread, num=move_along_x, num_3=radius)  # -> P, R
cluster_11 = Cluster_6(G=visualize_joints.Centerpoints, data_3=spread, X=move_along_x)
preview = CustomPreview(Geometry=cluster_10.P, Material=cluster_10.R)
xz = XZPlane(Origin=flatten(cluster_11))
data_3 = Data(flatten(visualize_joints.Brandnames))
tag = TextTag3D(Location=xz, Text=data_3, Size=textsize, Colour=ColourSwatch(SwatchColor=RGB(0, 0, 0)), Justification=7)

# ----
template_bolted_endplate_optimizer = TemplateBoltedEndplateOptimizer(
    Project=data,
    BrandNames=panel_3,
    ThicknessEndplate_mm=Slider(15, range=0..100),
    FactorPryingForces=Slider(0.5, range=0..1),
    Stiffeners=Toggle(True))  # -> Project, Message, Brep
panel_7 = Panel(template_bolted_endplate_optimizer.Message)
cluster_12 = Cluster_8(
    brep=template_bolted_endplate_optimizer.Brep,
    D=ColourSwatch(SwatchColor=RGB(71, 255, 169)),
    D_2=ColourSwatch(SwatchColor=RGB(255, 176, 18)))  # -> brep_4, R
preview_2 = CustomPreview(Geometry=cluster_12.brep_4, Material=cluster_12.R)
data_4 = Data(template_bolted_endplate_optimizer.Project)
data_5 = Data(data_4)

# ---- group: 6. IDEA utilities
user_feedback_2 = BooleanToggle(False)
run_all_joints_2 = BooleanToggle(False)
run_idea = Button()
data_6 = Data(data_5)
output_folderpath = Panel("C:\Data")
create_idea_file = CreateIDEAFile(
    Project=data_6,
    OutputFolder=output_folderpath,
    UserFeecback=user_feedback_2,
    CreateAllJoints=run_all_joints_2,
    ChooseJoint=Slider(8, range=0..100),
    RunIDEA=run_idea)

# ----
path = ConstructPath(Indices=item)  # -> flatten(Branch)

# ---- group: 7. Cost calculation
data_7 = Data(template_bolted_endplate_optimizer.Project)
weld_volume_generator = WeldVolumeGenerator(Project=data_7)
retrievelinespoints = RetrieveLinesPoints(Project=data_7)  # -> Lines, Points
total_weight = TotalWeight(Project=data_7)  # -> WeightElements_kg, WeightPlates_kg, Brep
price_welding = Panel("2.6")
price_steel = Panel("1")
costcalculator = CostCalculator(
    WeightElements_kg=total_weight.WeightElements_kg,
    WeightPlates_kg=total_weight.WeightPlates_kg,
    WeldingVolume_cm3=weld_volume_generator,
    NumberOfElements=0,
    SteelPricePerKg=price_steel,
    WeldingPricePerCm3=price_welding,
    TransportPricePerElement=20)  # -> CostsOfBeamMaterial_, CostsPerJoint_, TransportCost_
xz_2 = XZPlane(Origin=retrievelinespoints.Points)

# ----
brep = Brep(simplify(graft(total_weight.Brep)))
tstat_2 = TreeStatistics(Tree=brep)  # -> Paths, Length, Count
replace = ReplacePaths(Data=brep, Search=tstat_2.Paths, Replace=path)

flip_2 = FlipMatrix(Data=replace)
Y_2 = UnitY(Factor=Slider(10, range=0..10))
Y_3 = UnitY(Factor=Slider(5, range=0..10))
index = ItemIndex(List=flip_2, Item=flip_2)
multiplication_2 = Multiplication(A=Y_3, B=index)
addition = Addition(A=Y_2, B=multiplication_2)
move_4 = Move(Geometry=flip_2, Motion=addition)  # -> Geometry, Transform

move_5 = Move(Geometry=xz_2, Motion=neg)  # -> Geometry, Transform

# ---- group: 7. Cost calculation (continued)
tag_2 = TextTag3D(Location=move_5.Geometry, Text=costcalculator.CostsPerJoint_, Size=Slider(0.2, range=0..1), Justification=7)

# ----
data_8 = Data(replace)
debrep = DeconstructBrep(Brep=data_8)  # -> Faces, Edges, Vertices

ma = MassAddition(Input=flatten(weld_volume_generator))  # -> Result, PartialResults
ma_2 = MassAddition(Input=flatten(total_weight.WeightPlates_kg))  # -> Result, PartialResults
multiplication_3 = Multiplication(A=ma.Result, B=price_welding)
multiplication_4 = Multiplication(A=ma_2.Result, B=price_steel)
addition_2 = Addition(A=multiplication_4, B=multiplication_3)
panel_8 = Panel(addition_2)
panel_9 = Panel(costcalculator.CostsOfBeamMaterial_)
addition_3 = Addition(A=panel_9, B=panel_8)
division = Division(A=panel_9, B=addition_3)
division_2 = Division(A=panel_8, B=addition_3)
round = Round(Number=panel_9)  # -> Nearest, Floor, Ceiling
round_2 = Round(Number=panel_8)  # -> Nearest, Floor, Ceiling
round_3 = Round(Number=addition_3)  # -> Nearest, Floor, Ceiling
num = Number(expr("x*100", division))
num_2 = Number(expr("x*100", division_2))
beamcosts = Panel(round.Nearest)
totalcosts = Panel(round_3.Nearest)
jointcosts = Panel(round_2.Nearest)

brep_2 = Brep(graft(replace))
cluster_13 = Cluster_4(T=brep_2)

c_script = CSharpScript(x=cluster_13)  # -> Max, Min; inputs x: list of Double
# ---------- c_script: C# ----------
    double a = x[0];
    double b = x[0];
    foreach (double t in x)
    {
      if(t > a)
      {
        a = t;
      }
      if(t < b)
      {
        b = t;
      }
    }
    Max = a;
    Min = b;
# ---------- end c_script ----------
division_3 = Division(A=cluster_13, B=c_script.Max)
gradient = Gradient(
    LowerLimit=0,
    UpperLimit=1,
    Parameter=division_3,
    stops=[0: RGB(234, 38, 0), 0.25: RGB(234, 126, 0), 0.5: RGB(254, 244, 84), 0.75: RGB(173, 203, 249), 1: RGB(75, 107, 169)])

split_5 = TextSplit(Text=gradient, Separators=",")
item_2 = ListItem(List=split_5, Index=0, Wrap=True)  # -> Item, Item1, Item2
rgb = ColourRGB(Alpha=Slider(255, range=0..255), Red=item_2.Item, Green=item_2.Item1, Blue=item_2.Item2)  # -> flatten(Colour)
preview_3 = CustomPreview(Geometry=flatten(brep_2), Material=rgb)
panel_10 = Panel(rgb)

expression = Expression(x=jointcosts, y=num_2, Expression="Format(\"Joints:  €{0:0},- ({1:0.0}%)\", x, y)")
expression_2 = Expression(x=beamcosts, y=num, Expression="Format(\"Beams: €{0:0},- ({1:0.0}%)\", x, y)")
expression_3 = Expression(x=totalcosts, Expression="Format(\"Total:   €{0:0},- \", x)")
merge_4 = Merge(Data1=flatten(expression_2), Data2=flatten(expression), Data3=flatten(expression_3))
txt = Text(merge_4)
lng_8 = ListLength(List=txt)
vec = Vector("3,0,-4")
series = Series(Start=-1, Step=Slider(0.9, range=0..2), Count=lng_8)
panel_11 = Panel("0.4")
neg_2 = Negative(Value=series)
xz_3 = XZPlane(Origin=vec)
Z_5 = UnitZ(Factor=neg_2)
move_6 = Move(Geometry=xz_3, Motion=Z_5)  # -> Geometry, Transform
tag_3 = TextTag3D(Location=move_6.Geometry, Text=txt, Size=Slider(0.6, range=0..1), Justification=4)

# ---- group: 6. IDEA utilities
run_idea_2 = Button()
data_9 = Data(data_5)
output_folderpath_2 = Panel("C:\Data")
number_slider = Slider(8, range=0..100)

# ----
create_and_calculate_idea_file = CreateAndCalculateIDEAFile(
    Project=data_9,
    OutputFolder=output_folderpath_2,
    UserFeecback=user_feedback,
    RunAllJoints=run_all_joints,
    ChooseJoint=number_slider,
    RunIDEA=run_idea_2)  # -> SelectedJoint, Analysis, Plates, Bolts, Welds, Buckling, Summary

# ---- group: 6. IDEA utilities (continued)
cluster_14 = Cluster_9(T=create_and_calculate_idea_file.Analysis)
cluster_15 = Cluster_9(T=create_and_calculate_idea_file.Plates)
cluster_16 = Cluster_9(T=create_and_calculate_idea_file.Bolts)
cluster_17 = Cluster_9(T=create_and_calculate_idea_file.Welds)
cluster_18 = Cluster_9(T=create_and_calculate_idea_file.Buckling)
cluster_19 = Cluster_9(T=create_and_calculate_idea_file.Summary)
# Calculate ideaCon file
summary_message = Panel(cluster_19)
analysis = Panel(cluster_14)
ucplates = Panel(cluster_15)
ucwelds = Panel(cluster_17)
ucbuckling = Panel(cluster_18)
ucbolts = Panel(cluster_16)

# ==== cluster Cluster
pt = ClusterInput()

pt_2 = Point(pt)
lng = ListLength(List=pt_2)
cull_i = CullIndex(List=pt_2, Indices="0", Wrap=True)
culln = CullNth(List=pt_2, CullFrequency=lng)
ln = Line(StartPoint=culln, EndPoint=cull_i)

L = ClusterOutput(ln)

# ==== cluster Cluster_2
pt = ClusterInput()
pt_2 = Point(pt)
lng = ListLength(List=pt_2)
item = ListItem(List=pt_2, Index=expr("x-1", lng), Wrap=True)
item_2 = ListItem(List=pt_2, Index="0", Wrap=True)
merge = Merge(Data1=item_2, Data2=item)
R = ClusterOutput(merge)

# ==== cluster Cluster_3
pt = ClusterInput()
pt_2 = Point(pt)
cull_i = CullIndex(List=pt_2, Indices="0", Wrap=True)  # -> simplify(List)
lng = ListLength(List=cull_i)
culln = CullNth(List=cull_i, CullFrequency=lng)  # -> simplify(List)
L = ClusterOutput(culln)
panel = Panel(culln)

# ==== cluster Cluster_4
T = ClusterInput()
tstat = TreeStatistics(Tree=simplify(T))  # -> simplify(Paths), Length, Count
dpath = DeconstructPath(Branch=tstat.Paths)
item = ListItem(List=dpath, Index=0, Wrap=True)  # -> flatten(Item)
i = ClusterOutput(item)

# ==== cluster DiagonalsAndHorizontals
pt = ClusterInput()
line = ClusterInput()

pt_2 = Point(pt)
line_2 = Line(graft(line))
yz = YZPlane(Origin=pt_2)
pcx = CurvePlane(Curve=line_2, Plane=yz)  # -> simplify(Points), ParamsC, ParamsP
line_3 = Line(line_2)
pshift = ShiftPaths(Data=pcx.Points, Offset=-1)
line_4 = Line(simplify(line_3))
end = EndPoints(Curve=line_4)  # -> Start, End

pt_3 = Point(flatten(pcx.Points))
lng = ListLength(List=pt_3)
panel = Panel(lng)
equals = Equality(FirstNumber=lng, SecondNumber="1")  # -> Equality, Inequality
filter = StreamFilter(Gate=equals.Equality, Stream0=pshift, Stream1=pcx.Points)

pt_4 = Point(filter)
merge = Merge(Data1=end.Start, Data2=pt_4)
merge_2 = Merge(Data1=pt_4, Data2=end.End)
ln = Line(StartPoint=merge, EndPoint=merge_2)

line_5 = Line(ln)
line_6 = Line(graft(line_5))
tstat = TreeStatistics(Tree=line_6)  # -> simplify(Paths), Length, Count
dpath = DeconstructPath(Branch=tstat.Paths)  # -> reverse(Indices)
item = ListItem(List=dpath, Index=0, Wrap=True)  # -> simplify(Item)
line_7 = Line(line_5)

larger = LargerThan(FirstNumber=item, SecondNumber="1")  # -> LargerThan, OrEqualTo
p_n_c = PickNChoose(Pattern=larger.LargerThan, Stream0=item, Stream1="1")

ma = MassAddition(Input=flatten(p_n_c))  # -> Result, graft(PartialResults)
line_8 = Line(flatten(line_7))
line_9 = Line(graft(line_8))
path = ConstructPath(Indices=ma.PartialResults)  # -> simplify(flatten(Branch))
viewer = ParamViewer(line_9)
replace = ReplacePaths(Data=line_9, Search=viewer, Replace=path)

D = ClusterOutput(replace)

# ==== cluster Cluster_5
pt = ClusterInput()
line = ClusterInput()

pt_2 = Point(pt)
line_2 = Line(line)
midpt = CurveMiddle(Curve=line_2)
pdecon = Deconstruct(Point=pt_2)  # -> XComponent, YComponent, ZComponent
pdecon_2 = Deconstruct(Point=midpt)  # -> XComponent, YComponent, ZComponent
num = Number(graft(pdecon.XComponent))
larger = LargerThan(FirstNumber=pdecon_2.XComponent, SecondNumber=num)  # -> simplify(LargerThan), OrEqualTo
flip = FlipMatrix(Data=larger.LargerThan)
line_3 = Line(flatten(line_2))
ma = MassAddition(Input=flip)  # -> Result, PartialResults
line_4 = Line(graft(line_3))
path = ConstructPath(Indices=ma.Result)  # -> simplify(flatten(Branch))
viewer = ParamViewer(line_4)
replace = ReplacePaths(Data=line_4, Search=viewer, Replace=path)

D = ClusterOutput(replace)

# ==== cluster Cluster_6
G = ClusterInput()
X = ClusterInput()
vec = VectorXYZ(XComponent=X, YComponent=0, ZComponent=0)  # -> Vector, Length
move = Move(Geometry=G, Motion=vec.Vector)  # -> Geometry, Transform
data = Data(move.Geometry)
tstat = TreeStatistics(Tree=data)  # -> Paths, Length, Count
dpath = DeconstructPath(Branch=tstat.Paths)
data_2 = Data(graft(tstat.Length))
flip = FlipMatrix(Data=dpath)
data_3 = ClusterInput()
bang = ExplodeTree(Data=flip)  # -> flatten(Branch0), flatten(Branch1)
data_4 = Data(data_3)
data_5 = Data(graft(bang.Branch0))
data_6 = Data(graft(bang.Branch1))
multiplication = Multiplication(A=bang.Branch0, B=data_4)
multiplication_2 = Multiplication(A=bang.Branch1, B=data_4)
path = ConstructPath(Indices=[data_5, data_6])  # -> flatten(Branch)
vec_2 = VectorXYZ(XComponent=multiplication, YComponent=multiplication_2, ZComponent=0)  # -> Vector, Length
unflatten = UnflattenTree(Tree=vec_2.Vector, Guide=path)  # -> graft(Tree)
data_7 = Data(flatten(data))
dup = DuplicateData(Data=unflatten, Number=data_2, Order=True)  # -> flatten(Data)
move_2 = Move(Geometry=data_7, Motion=dup)  # -> Geometry, Transform
G_2 = ClusterOutput(move_2.Geometry)
panel = Panel(move_2.Geometry)

# ==== cluster Cluster_7
num = ClusterInput()
num_2 = ClusterInput()
line = ClusterInput()
num_3 = ClusterInput()
num_4 = Number(num)
num_5 = Number(num_2)
line_2 = Line(line)
num_6 = Number(num_3)
cluster = Cluster_6(G=line_2, data_3=num_5, X=num_4)
line_3 = Line(cluster)
pipe = Pipe(Curve=line_3, Radius=num_6, Caps=0)  # -> flatten(Pipe)
dom = ConstructDomain(DomainStart="0", DomainEnd="1")
pshift = ShiftPaths(Data=line_2, Offset=-1)
P = ClusterOutput(pipe)
range = Range(Domain=dom, Steps=Slider(8, range=0..100))
lng = ListLength(List=pshift)
data = Data(flatten(lng))
data_2 = Data(range)
c_script = CSharpScript(lengths=data, colorlist=data_2)  # -> out, A; inputs lengths: list of Double, colorlist: list of Double
# ---------- c_script: C# ----------
    DataTree<double> tree = new DataTree<double>();
    GH_Path path = new GH_Path();
    int w = 0;


    for (int b = 0; b < lengths.Count; b++)
    {
      for (int c = 0;c < lengths[b];c++)
      {
        double num = colorlist[(w % colorlist.Count)];
        //tree.Add(num, path);
        tree.Add(num);
      }
      w = w + 1;

    }
    A = tree;
# ---------- end c_script ----------
data_3 = Data(flatten(c_script.A))
gradient = Gradient(
    LowerLimit=0,
    UpperLimit=1,
    Parameter=data_3,
    stops=[0: RGB(35, 99, 187), 0: RGB(234, 38, 0), 0: RGBA(255, 255, 255, 0), 0.25: RGB(234, 126, 0), 0.5: RGB(254, 244, 84), 0.75: RGB(173, 203, 249)])
lng_2 = ListLength(List=gradient)
dup = DuplicateData(Data=" (100)", Number=lng_2, Order=True)  # -> flatten(Data)
merge = Merge(Data1=graft(gradient), Data2=graft(dup))
join = TextJoin(Text=merge)  # -> flatten(Result)
R = ClusterOutput(join)

# ==== cluster Cluster_8
brep = ClusterInput()
brep_2 = Brep(graft(brep))
tstat = TreeStatistics(Tree=brep_2)  # -> Paths, Length, Count
brep_3 = Brep(flatten(brep_2))
dpath = DeconstructPath(Branch=tstat.Paths)
brep_4 = ClusterOutput(brep_3)
item = ListItem(List=dpath, Index="-2", Wrap=True)  # -> flatten(Item)
D = ClusterInput()
D_2 = ClusterInput()
lng = ListLength(List=item)
dup = DuplicateData(Data=D, Number=lng, Order=True)
dup_2 = DuplicateData(Data=D_2, Number=lng, Order=True)
p_n_c = PickNChoose(Pattern=item, Stream0=dup, Stream1=dup_2)
R = ClusterOutput(p_n_c)

# ==== cluster Cluster_9
T = ClusterInput()
join = TextJoin(Text=T)
rec = DataRecorder(join, DataLimit=2, RecordData=True)
item = ListItem(List=flatten(rec), Index=0, Wrap=True)
i = ClusterOutput(item)
panel = Panel(item)
