# Grasshopper definition KarambaIDEA_Example_Tensile connection.gh (Grasshopper 1.0.7)
# Copyright: B+G Engineers
# plug-ins: Karamba3D, KarambaIDEA, Bifocals

panel = Panel("""Parameters
Geometry
Karamba3D
0. Utilities
1. Load conversions
2. Create Project
3. Project utilities
4. Analytical templates
5. IDEA templates
6. IDEA utilities
7. Cost calculation""")
merge = Merge(
    Data1=ColourSwatch(SwatchColor=RGB(106, 144, 173)),
    Data2=ColourSwatch(SwatchColor=RGB(123, 189, 179)),
    Data3=ColourSwatch(SwatchColor=RGB(227, 136, 118)),
    Data4=ColourSwatch(SwatchColor=RGB(237, 201, 69)),
    Data5=ColourSwatch(SwatchColor=RGB(237, 201, 69)),
    Data6=ColourSwatch(SwatchColor=RGB(237, 221, 161)),
    Data7=ColourSwatch(SwatchColor=RGBA(212, 61, 66, 118)),
    Data8=ColourSwatch(SwatchColor=RGB(186, 222, 214)),
    Data9=ColourSwatch(SwatchColor=RGB(250, 227, 217)),
    Data10=ColourSwatch(SwatchColor=RGBA(255, 111, 15, 97)),
    Data11=ColourSwatch(SwatchColor=RGBA(86, 212, 61, 63)))
group_color = SliderGroupColor(run=Button(), groupNames=panel, colors=merge, defaultColor=ColourSwatch(SwatchColor=RGB(232, 227, 227)))  # inputs run: Boolean, groupNames: list of String, colors: list of Color, defaultColor: Color
# ---------- group_color: C# usings ----------
using System.Drawing;
using Grasshopper.Kernel.Special;
# ---------- group_color: C# ----------
    // Created by Timo Harboe Nielsen - Bjarke Ingels Group.
    
    if(!run){
      return;
    }
    GH_Document doc = owner.OnPingDocument();
    foreach (var dobj in doc.Objects)
    {
      GH_Group _group = dobj as GH_Group;
      if( _group == null){
        continue;
      }
      for(int i = 0; i < Math.Min(groupNames.Count, colors.Count); i++){
        string groupName = _group.NickName.ToString();
        string compareName = groupNames[i];
        if(groupName.IndexOf(compareName, StringComparison.OrdinalIgnoreCase) >= 0){
          _group.Colour = colors[i];
          break;
        } else{
          _group.Colour = defaultColor;
        }
      }
    }
# ---------- end group_color ----------

# ---- group: Parameters
crosssection = ValueList({"I-section": 0, "SHS cold": 1, "SHS hot": 2, "CHS welded": 3, "CHS seamless": 4}, selected="I-section")
steelgrade = ValueList({"S235": 0, "S275": 1, "S355": 2}, selected="S235")
# KarambaIDEA Tensile connection
number_slider = Slider(3, range=-5..5)
number_slider_2 = Slider(0, range=-5..5)
number_slider_3 = Slider(0, range=-5..5)

# ---- group: Geometry
pt = ConstructPoint(XCoordinate=0, YCoordinate=0, ZCoordinate=0)
vec = VectorXYZ(XComponent=number_slider, YComponent=number_slider_2, ZComponent=number_slider_3)  # -> Vector, Length
move = Move(Geometry=pt, Motion=vec.Vector)  # -> Geometry, Transform
ln = Line(StartPoint=pt, EndPoint=move.Geometry)
divide = DivideCurve(Curve=ln, Count="2", Kinks=False)  # -> Points, Tangents, Parameters
merge_2 = Merge(Data1=pt, Data2=move.Geometry)
cluster = Cluster(pt=divide.Points)
pt_2 = Point(move.Geometry)

# ----
line = Line(cluster)
pt_3 = Point(merge_2)

# ---- group: Karamba3D / Define Materials
material_selection_karamba3d = MaterialSelectionKaramba3D(menu=[dropdown(1), dropdown(4)])

# ----
pt_4 = Point(pt_2)

# ---- group: Karamba3D / Define Cross Sections
cross_section_range_selector_karamba3d = CrossSectionRangeSelectorKaramba3D(
    MaximumHeight_cm=-1,
    MaximumWidth_cm=-1,
    Material=material_selection_karamba3d,
    menu=[dropdown(1), dropdown(1), dropdown(4)])
cross_section_selector_karamba3d = CrossSectionSelectorKaramba3D(CrossSections=cross_section_range_selector_karamba3d, NameOrListIndexOfCrossSection="HEB400")  # -> CrossSection, Info
cross_section_karamba3d = CrossSectionKaramba3D(cross_section_selector_karamba3d.CrossSection)

# ---- group: Parameters
beam_utilization = Slider(0.39, range=0..1)
n_kn = Slider(1000, range=0..10000)

# ---- group: Karamba3D / Define Loads
X = UnitX(Factor=n_kn)

# ---- group: Karamba3D / Define Loads / Loads (Karamba3D)
loads = LoadsKaramba3D(ForceVector=X, Local=False, PosInd=pt_4, LCase="0", mode="Point")

# ---- group: Karamba3D
line_2 = Line(line)
point = Point(pt_3)
load_karamba3d = LoadKaramba3D(loads)

# ---- group: Karamba3D / Define Elements
panel_2 = Panel("Beam")
line_to_beam_karamba3d = LineToBeamKaramba3D(
    Line=line_2,
    Identifier=graft(panel_2),
    CrossSection=cross_section_karamba3d,
    New=True,
    Remove=True,
    LimitDistance_m=0.005,
    Bending=True,
    SetBucklingLength=True,
    ToPolylineMaxAngle=0.03,
    ToPolylineTolerance=0.01,
    ToPolylineMinEdgeLength=0.25)  # -> Element, Points, Info

# ---- group: Karamba3D / Define Supports
point_2 = Point(point)
item = ListItem(List=point_2, Index=0, Wrap=True)  # -> Item, Item1
support_karamba3d = SupportKaramba3D(PosInd=item.Item, menu=[buttons(on, on, on, on, off, off)])
support_karamba3d_2 = SupportKaramba3D(PosInd=item.Item1, menu=[buttons(off, on, on, off, off, off)])

# ---- group: Karamba3D
element_karamba3d = ElementKaramba3D(line_to_beam_karamba3d.Element)
support_karamba3d_3 = SupportKaramba3D([support_karamba3d, support_karamba3d_2])
load_karamba3d_2 = LoadKaramba3D(load_karamba3d)

# ---- group: Karamba3D / Assemble Model
assemble_model_karamba3d = AssembleModelKaramba3D(
    Elem=flatten(element_karamba3d),
    Support=flatten(support_karamba3d_3),
    Load=flatten(load_karamba3d_2),
    LimitDistance_m=0.005)  # -> Model, Info, Mass_kg, CenterOfGravity, LoadCaseNames

# ---- group: Karamba3D / Analyze Model
analyze_karamba3d = AnalyzeKaramba3D(Model=assemble_model_karamba3d.Model)  # -> CalculatedModel, MaximumDisplacement_cm, ResultingForceOfGravity_kN, ElasticEnergy_kNm

# ---- group: Karamba3D / View Results
model_view_karamba3d = ModelViewKaramba3D(Model=analyze_karamba3d.CalculatedModel, ResultFactors=1, ResultCase=-1)  # -> Model, DeformedMesh, DeformedAxes, DeformedModel
beam_view_karamba3d = BeamViewKaramba3D(Model=model_view_karamba3d.Model)  # -> Model, MeshesOfRenderedBeams, DeformedBeamAxes, LegendColors, LegendTags

# ----
expression = Expression(x=beam_utilization, Expression="Format(\"BeamUC:        {0:0.00}\", x)")
expression_2 = Expression(x=n_kn, Expression="Format(\"Tensile Load: {0:0} kN\", x)")
merge_3 = Merge(Data1=flatten(expression_2), Data2=flatten(expression))
txt = Text(merge_3)
lng = ListLength(List=txt)
vec_2 = Vector("0,0,-1.5")
series = Series(Start=-1, Step=Slider(0.144, range=0..2), Count=lng)
panel_3 = Panel("0.4")
neg = Negative(Value=series)
xz = XZPlane(Origin=vec_2)
Z = UnitZ(Factor=neg)
move_2 = Move(Geometry=xz, Motion=Z)  # -> Geometry, Transform
tag = TextTag3D(Location=move_2.Geometry, Text=txt, Size=Slider(0.1, range=0..1), Justification=4)

# ---- group: 2. Create Project / Stream filter to control data speed
# KarambaIDEA
toggle = BooleanToggle(True)
filter = StreamFilter(Gate=toggle, Stream1=beam_view_karamba3d.Model)

# ---- group: 2. Create Project / Data collect / Disassemble Model (Karamba3D)
disassemble = DisassembleModelKaramba3D(Model=filter)  # -> Model, Point, Beam, Shell, Support, Load, Line, Mesh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

# ---- group: 2. Create Project / Data collect
k3dbeamprops = CSharpScript(
    Model=disassemble.Model,
    Reference=["C:\PROGRAM FILES\RHINO 7\PLUG-INS\KARAMBA\karambaCommon.dll", "C:\PROGRAM FILES\RHINO 7\PLUG-INS\KARAMBA\karamba.gha"])  # -> BeamIds, Material, CrosecNames, CrosecShapes, Heights, Widths, TFlanges, TWebs, FRads
# ---------- k3dbeamprops: C# usings ----------
using Karamba.Elements;
using Karamba.CrossSections;
# ---------- k3dbeamprops: C# ----------
    var model = Model as Karamba.Models.Model;
    if (model == null) {
      throw new ArgumentException ("The input is not of type model!");
    }

    var beam_ids = new List<string>();
    var cs_names = new List<string>();
    var cs_shapes = new List<string>();
    var cs_material = new List<string>();
    var heights = new List<double>();
    var widths = new List<double>();
    var tflanges = new List<double>();
    var twebs = new List<double>();
    var frads = new List<double>();

    foreach (var elem in model.elems)
    {
      var beam = elem as ModelElementStraightLine;
      if (beam != null) {
        beam_ids.Add(elem.id);
        cs_names.Add(elem.crosec.name);
        cs_shapes.Add(elem.crosec.shape());
        cs_material.Add(elem.crosec.materialName);

        // is it an I-profile?
        var crosec_i = beam.crosec as CroSec_I;
        if (crosec_i != null) {
          heights.Add(crosec_i.getHeight() * 1000);
          // use the upper flange thickness
          widths.Add(crosec_i.uf_width * 1000);
          tflanges.Add(crosec_i.uf_thick * 1000);
          twebs.Add(crosec_i.w_thick * 1000);
          // use the inner fillet radius
          frads.Add(crosec_i.fillet_r * 1000);
          // this would be the outer fillet radius
          // frads.Add(crosec.fillet_r1);
          continue;
        }

        // is it a CHS?
        var crosec_o = beam.crosec as CroSec_Circle;
        if (crosec_o != null) {
          heights.Add(crosec_o.getHeight() * 1000);
          // use the upper flange thickness
          widths.Add(0);
          tflanges.Add(crosec_o.thick * 1000);
          twebs.Add(crosec_o.thick * 1000);
          frads.Add(0);
          continue;
        }

        // options for Box, trapezoid and T-section are not implemented yet
        throw new Exception("Cross section encountered for which no export is implemented");
      }
    }

    BeamIds = beam_ids;
    CrosecNames = cs_names;
    CrosecShapes = cs_shapes;
    Material = cs_material;
    Heights = heights;
    Widths = widths;
    TFlanges = tflanges;
    TWebs = twebs;
    FRads = frads;
# ---------- end k3dbeamprops ----------
b_forces = BeamForcesKaramba3D(AnalyzedModel=disassemble.Model, LCase=-1, MaximumDistanceBetweenResults_m=-1, NumberOfResultsPerBeamElement=2)  # -> AnalyzedModel, NormalForce_kN, ShearForceVz_kN, ShearForceVy_kN, BendingMomentMt_kNm, BendingMomentMy_kNm, BendingMomentMz_kNm
disassemble_2 = DisassembleElementKaramba3D(Element=disassemble.Beam)  # -> Element, ElementIdentifier, AxisOfElement, CrossSection, Joints, Material, LocalCoordinateSystem, ElementIsActive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
vec_cm_to_mm = Vector(expr("x*10", disassemble_2.LocalEccentricity_cm))
hierarchy = Panel("Beam")
cp = CreateProject(
    Hierarchy=hierarchy,
    Points=disassemble.Point,
    Lines=disassemble.Line,
    LCSRotations_Deg=disassemble_2.Alpha_deg,
    EccentricityVector=vec_cm_to_mm,
    Groupnames=k3dbeamprops.BeamIds,
    Materials=k3dbeamprops.Material,
    CrossSectionNames=k3dbeamprops.CrosecNames,
    Shapes=k3dbeamprops.CrosecShapes,
    Heights=k3dbeamprops.Heights,
    Widths=k3dbeamprops.Widths,
    ThicknessFlanges=k3dbeamprops.TFlanges,
    ThicknessWebs=k3dbeamprops.TWebs,
    Radius=k3dbeamprops.FRads,
    N=b_forces.NormalForce_kN,
    Vz=b_forces.ShearForceVz_kN,
    Vy=b_forces.ShearForceVy_kN,
    Mt=b_forces.BendingMomentMt_kNm,
    My=b_forces.BendingMomentMy_kNm,
    Mz=b_forces.BendingMomentMz_kNm)

# ----
deconstruct_project = DeconstructProject(Project=cp)  # -> Joints, BrandNames
folderpath = Panel("C:\Data\Tensile")
list_item = ListItem(List=deconstruct_project.Joints, Index="1", Wrap=True)
deconstruct_joint = DeconstructJoint(Joint=deconstruct_project.Joints)  # -> Id, Name, MemberIds, BearingId, ConnectionData, graft(Brand)

# ----
# Joint Display
point_3 = Point(deconstruct_project.Joints)
panel_4 = Panel("""0.2
-0.2""")
unit_z = UnitZ(Factor=panel_4)
move_3 = Move(Geometry=graft(point_3), Motion=unit_z)  # -> Geometry, Transform
list_item_2 = ListItem(List=move_3.Geometry, Index=0, Wrap=True)  # -> Item1, Item
text_tag = TextTag(Location=list_item_2.Item, Text=graft(deconstruct_joint.Id))
text_tag_2 = TextTag(Location=list_item_2.Item1, Text=deconstruct_joint.Brand)

# ----
# Local Coordinate System Display
data = Data()
local_coordinate_system = LocalCoordinateSystem(Project=data)  # -> LineOfElements, LocalXVectors, LocalYVectors, LocalZVectors
length = Slider(0.149, range=0..2)
radius = Slider(0.01, range=0..0.01)
point_on_curve = PointOnCurve(local_coordinate_system.LineOfElements, parameter=0.182)
cluster_2 = Cluster_2(
    num=length,
    num_2=radius,
    pt=point_on_curve,
    vec_2=local_coordinate_system.LocalXVectors,
    vec=local_coordinate_system.LocalYVectors,
    vec_3=local_coordinate_system.LocalZVectors)  # -> D, C
custom_preview = CustomPreview(Geometry=cluster_2.D, Material=cluster_2.C)

# ---- group: Assign template with parameters
c_script = CSharpScript(filetype="bolted_endplate.contemp")  # -> filepath; inputs filetype: String
# ---------- c_script: C# usings ----------
using System.IO;
# ---------- c_script: C# ----------
    string path = this.Component.OnPingDocument().FilePath;

    string directory = Path.GetDirectoryName(path);

    string[] files = Directory.GetFiles(directory, string.Concat('*', filetype));

    filepath = files;
# ---------- end c_script ----------
import_idea_template = ImportIDEATemplate(Path=c_script)
deconstruct_idea_template = DeconstructIDEATemplate(Template=import_idea_template)
idea_template_full = IDEATemplateFull(IDEATemplate=import_idea_template)
panel_5 = Panel(deconstruct_idea_template)

# ----
modify_joint = ModifyJoint(Joint=list_item, Name="TensileConnection", TemplateAssigns=idea_template_full)
concatenate = Concatenate(FragmentA=folderpath, JoinSeparator="\")  # -> graft(Result)
panel_6 = Panel(modify_joint)
create_idea_file = CreateIDEAFile(Joints=modify_joint, OutputFolder=concatenate, RunIDEA=Toggle(True))

# ---- group: Modify parameters
deconstruct_connection = DeconstructConnection(Connection=create_idea_file)  # -> Name, LoadEffects, Parameters, CodeSetup, Filepath
set_param_value = SetParamValue(Parameter=deconstruct_connection.Parameters, Value="0.010")
code_setup = CodeSetup(CodeSetup=deconstruct_connection.CodeSetup, Key="stopAtLimitStrain", Value=Toggle(True))
modify_con_parameters = ModifyConParameters(Parameters=set_param_value)
panel_7 = Panel(set_param_value)

# ----
panel_8 = Panel(create_idea_file)
calculate_connection = CalculateConnection(Connection=graft(create_idea_file), Modifications=modify_con_parameters, RunIDEA=Toggle(False))
connection_results = ConnectionResults(Connection=calculate_connection)  # -> Name, SummaryResults, PlateResults, WeldResults, BoltResults, AnchorResults, ConcreteBlockResults
panel_9 = Panel(connection_results.SummaryResults)
connection_costs = ConnectionCosts(Connection=calculate_connection)  # -> Name, TotalEstCost, SteelCosts, WeldCosts, BoltCosts, HoleDrillingCost, Messages
deconstruct_item_result = DeconstructItemResult(ItemResult=connection_results.SummaryResults)  # -> Name, CheckStatus, UnityCheck, PlMaxStress, PlMaxStrain, Items, ItemId, CheckMsg
deconstruct_item_result_2 = DeconstructItemResult(ItemResult=connection_results.WeldResults)  # -> Name, CheckStatus, UnityCheck, PlMaxStress, PlMaxStrain, Items, ItemId, CheckMsg
deconstruct_cost_item = DeconstructCostItem(CostItem=connection_costs.WeldCosts)  # -> Name, Id, UnitCost, Cost, TotalWeight, Grade, PlateThk, WeldType, WeldLegThk, WeldThroatThk
panel_10 = Panel(deconstruct_item_result.Name)
panel_11 = Panel(deconstruct_item_result.CheckStatus)
panel_12 = Panel(deconstruct_item_result_2.Name)
panel_13 = Panel(deconstruct_item_result_2.CheckStatus)
panel_14 = Panel(deconstruct_item_result_2.UnityCheck)

# ==== cluster Cluster
pt = ClusterInput()

pt_2 = Point(pt)
lng = ListLength(List=pt_2)
cull_i = CullIndex(List=pt_2, Indices="0", Wrap=True)  # -> simplify(List)
culln = CullNth(List=pt_2, CullFrequency=lng)  # -> simplify(List)
ln = Line(StartPoint=culln, EndPoint=cull_i)

L = ClusterOutput(ln)

# ==== cluster Cluster_2
vec = ClusterInput()
vec_2 = ClusterInput()
pt = ClusterInput()
vec_3 = ClusterInput()
num = ClusterInput()
num_2 = ClusterInput()
vec_4 = Vector(vec)
vec_5 = Vector(vec_2)
pt_2 = Point(pt)
vec_6 = Vector(vec_3)
num_3 = Number(num)
num_4 = Number(num_2)
line = LineSDL(Start=pt_2, Direction=vec_5, Length=num_3)
line_2 = LineSDL(Start=pt_2, Direction=vec_4, Length=num_3)
line_3 = LineSDL(Start=pt_2, Direction=vec_6, Length=num_3)
panel = Panel("""255
0
0""")
entwine = Entwine(Branch00=line, Branch01=line_2, Branch02=line_3, FlattenInputs=True)  # -> simplify(Result)
panel_2 = Panel("""0
255
0""")
panel_3 = Panel("""0
0
255""")
rgb = ColourRGB(Alpha=255, Red=panel, Green=panel_2, Blue=panel_3)  # -> graft(Colour)
pipe = Pipe(Curve=entwine, Radius=num_4, Caps=0)
pshift = ShiftPaths(Data=pipe, Offset=-1)
C = ClusterOutput(rgb)
D = ClusterOutput(pshift)
