# Grasshopper definition PortalFrame_bruteforce.gh (Grasshopper 1.0.7)
# Copyright: B+G Engineers
# plug-ins: karambaGH, KarambaIDEA, Colibri

# ---- group: Parameters
width = Slider(7, range=0..20)
bays = Slider(2, range=2..10)
height = Slider(4, range=0..10)
floors = Slider(4, range=2..10)

# ----
panel = Panel("""Parameters
Geometry
Karamba3D
0. Utilities
1. Load conversions
2. Create Project
3. Project utilities
4. Analytical templates
5. IDEA templates
6. IDEA utilities
7. Cost calculation""")
merge = Merge(
    Data1=ColourSwatch(SwatchColor=RGB(106, 144, 173)),
    Data2=ColourSwatch(SwatchColor=RGB(123, 189, 179)),
    Data3=ColourSwatch(SwatchColor=RGB(227, 136, 118)),
    Data4=ColourSwatch(SwatchColor=RGB(237, 201, 69)),
    Data5=ColourSwatch(SwatchColor=RGB(237, 201, 69)),
    Data6=ColourSwatch(SwatchColor=RGB(237, 221, 161)),
    Data7=ColourSwatch(SwatchColor=RGBA(212, 61, 66, 118)),
    Data8=ColourSwatch(SwatchColor=RGB(186, 222, 214)),
    Data9=ColourSwatch(SwatchColor=RGB(250, 227, 217)),
    Data10=ColourSwatch(SwatchColor=RGBA(255, 111, 15, 97)),
    Data11=ColourSwatch(SwatchColor=RGBA(86, 212, 61, 63)))
group_color = SliderGroupColor(run=Button(), groupNames=panel, colors=merge, defaultColor=ColourSwatch(SwatchColor=RGB(232, 227, 227)))  # inputs run: Boolean, groupNames: list of String, colors: list of Color, defaultColor: Color
# ---------- group_color: C# usings ----------
using System.Drawing;
using Grasshopper.Kernel.Special;
# ---------- group_color: C# ----------
    // Created by Timo Harboe Nielsen - Bjarke Ingels Group.
    
    if(!run){
      return;
    }
    GH_Document doc = owner.OnPingDocument();
    foreach (var dobj in doc.Objects)
    {
      GH_Group _group = dobj as GH_Group;
      if( _group == null){
        continue;
      }
      for(int i = 0; i < Math.Min(groupNames.Count, colors.Count); i++){
        string groupName = _group.NickName.ToString();
        string compareName = groupNames[i];
        if(groupName.IndexOf(compareName, StringComparison.OrdinalIgnoreCase) >= 0){
          _group.Colour = colors[i];
          break;
        } else{
          _group.Colour = defaultColor;
        }
      }
    }
# ---------- end group_color ----------

# ---- group: Geometry
X = UnitX(Factor=width)
# Optimizing a Steel Frame
pt = ConstructPoint(XCoordinate=0, YCoordinate=0, ZCoordinate=0)
Z = UnitZ(Factor=height)
arrlinear = LinearArray(Geometry=pt, Direction=X, Count=bays)  # -> Geometry, Transform
num = Number(floors)
arrlinear_2 = LinearArray(Geometry=arrlinear.Geometry, Direction=Z, Count=num)  # -> Geometry, Transform
num_2 = Number(expr("x-1", num))
data = Data(arrlinear_2.Geometry)
shift = ShiftList(List=data, Shift=1, Wrap=True)
pt_2 = Point(arrlinear.Geometry)
cluster = Cluster_2(data=arrlinear_2.Geometry)
cluster_2 = Cluster(data=data)
flip = FlipMatrix(Data=arrlinear_2.Geometry)
cluster_3 = Cluster(data=shift)
item = ListItem(List=flip, Index=0, Wrap=True)  # -> flatten(Item)
flip_2 = FlipMatrix(Data=cluster)
data_2 = Data(flip_2)
ln = Line(StartPoint=cluster_2, EndPoint=cluster_3)
cull_i = CullIndex(List=item, Indices="0", Wrap=True)
shift_2 = ShiftList(List=data_2, Shift=1, Wrap=True)
cluster_4 = Cluster(data=data_2)
split = SplitList(List=flatten(ln), Index=num_2)  # -> ListA, ListB
cluster_5 = Cluster(data=shift_2)
line = Line(split.ListA)
line_2 = Line(split.ListB)
ln_2 = Line(StartPoint=cluster_4, EndPoint=cluster_5)
pt_3 = Point(pt_2)
merge_2 = Merge(Data1=cull_i, Data2=pt_3)
divide = DivideCurve(Curve=ln_2, Count="2", Kinks=False)  # -> Points, Tangents, Parameters
cluster_6 = Cluster_3(pt=divide.Points)
item_2 = ListItem(List=cluster_6, Index=0, Wrap=True)
item_3 = ListItem(List=cluster_6, Index="1", Wrap=True)
entwine = Entwine(Branch00=[line, line_2], Branch01=[item_2, item_3], FlattenInputs=True)

# ----
colum_index_css = Slider(16, range=0..23)
beam_index_css = Slider(20, range=0..23)

# ---- group: Karamba3D / Define Materials
matselect = MaterialSelectionKaramba3D(menu=[dropdown(1), dropdown(4)])

# ---- group: Karamba3D / Define Cross Sections
crosecrselect = CrossSectionRangeSelectorKaramba3D(MaximumHeight_cm=-1, MaximumWidth_cm=-1, Material=matselect, menu=[dropdown(0), dropdown(1), dropdown(4)])
crosecrselect_2 = CrossSectionRangeSelectorKaramba3D(MaximumHeight_cm=-1, MaximumWidth_cm=-1, Material=matselect, menu=[dropdown(0), dropdown(0), dropdown(3)])
crosecselect = CrossSectionSelectorKaramba3D(CrossSections=crosecrselect, NameOrListIndexOfCrossSection=colum_index_css)  # -> CrossSection, Info
crosecselect_2 = CrossSectionSelectorKaramba3D(CrossSections=crosecrselect_2, NameOrListIndexOfCrossSection=beam_index_css)  # -> CrossSection, Info
entwine_2 = Entwine(Branch00=crosecselect.CrossSection, Branch01=crosecselect_2.CrossSection, FlattenInputs=True)

# ---- group: Karamba3D / Define Loads
load_multiplier = Slider(0, range=0..20)
series = Series(Start=0, Step=1, Count=expr("x-1", floors))
X_2 = UnitX(Factor=load_multiplier)
loads = LoadsKaramba3D(Vector=X_2, BeamIdentifiers=series, LCase=0, mode="Uniform Line", menu=[buttons(off, on, off)])

# ---- group: Define Loads
load_multiplier_2 = Slider(10.9, range=0..50)
neg = Negative(Value=load_multiplier_2)
Z_2 = UnitZ(Factor=neg)
loads_2 = LoadsKaramba3D(Vector=Z_2, BeamIdentifiers="Beam", LCase=0, mode="Uniform Line", menu=[buttons(off, on, off)])

# ----
relay = Relay([loads_2, loads])
height_haunch_mm = Slider(324, range=0..1000)
stiffeners = Slider(1, range=0..1)
panel_2 = Panel("""001
01""")
panel_3 = Panel("01")
column = Panel("Column")
panel_4 = Panel("Front")
panel_5 = Panel("800")
panel_6 = Panel("900")
panel_7 = Panel("1000")
panel_8 = Panel("700")

# ---- group: Karamba3D
pt_4 = Point(pt_3)
line_3 = Line(entwine)
pt_5 = Point(pt_4)
load = LoadKaramba3D(flatten(relay))

# ---- group: Karamba3D / Define Elements
panel_9 = Panel("""Column
Beam""")
linetobeam = LineToBeamKaramba3D(Line=line_3, Identifier=graft(panel_9), CrossSection=entwine_2, New=True, Remove=True, LimitDistance_m=0.005)  # -> Element, Points, Info

# ---- group: Karamba3D / Define Supports
supp = SupportKaramba(PosInd=pt_5, menu=[buttons(on, on, on, on, off, off)])

# ---- group: Karamba3D (continued)
element = ElementKaramba3D(flatten(linetobeam.Element))
support = SupportKaramba3D(flatten(supp))

# ---- group: Karamba3D / Assemble Model
assemble = AssembleModelKaramba3D(Elem=element, Support=support, Load=load, LimitDistance_m=0.005)  # -> Model, Info, Mass_kg, CenterOfGravity

# ----
element_2 = ElementKaramba3D(flatten(element))
support_2 = SupportKaramba3D(flatten(support))
load_2 = LoadKaramba3D(flatten(load))

# ---- group: Karamba3D / Analyze Model
analyze = AnalyzeKaramba3D(Model=assemble.Model)  # -> CalculatedModel, MaximumDisplacement_cm, ResultingForceOfGravity_kN, ElasticEnergy_kNm

# ---- group: Karamba3D / View Results
modelview = ModelViewKaramba3D(Model=analyze.CalculatedModel, LoadCaseFactorsForLinearSuperposition=1, IndexOfVisibleLoadcase=-1)  # -> Model, DeformedMesh, DeformedAxes, DeformedModel
beamview = BeamViewKaramba3D(Model=modelview.Model)  # -> Model, MeshesOfRenderedBeams, DeformedBeamAxes, LegendColors, LegendTags

# ---- group: 2. Create Project / Stream filter to control data speed
# KarambaIDEA
toggle = BooleanToggle(True)
filter = StreamFilter(Gate=toggle, Stream1=beamview.Model)

# ---- group: 2. Create Project / Data collect
disassemble = DisassembleModelKaramba3D(Model=filter)  # -> Model, Point, Beam, Shell, Support, Load, Line, Mesh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
k3dbeamprops = CSharpScript(
    Model=disassemble.Model,
    Reference=["C:\PROGRAM FILES\RHINO 7\PLUG-INS\KARAMBA\karambaCommon.dll", "C:\PROGRAM FILES\RHINO 7\PLUG-INS\KARAMBA\karamba.gha"])  # -> BeamIds, Material, CrosecNames, CrosecShapes, Heights, Widths, TFlanges, TWebs, FRads
# ---------- k3dbeamprops: C# usings ----------
using Karamba.Elements;
using Karamba.CrossSections;
# ---------- k3dbeamprops: C# ----------
    var model = Model as Karamba.Models.Model;
    if (model == null) {
      throw new ArgumentException ("The input is not of type model!");
    }

    var beam_ids = new List<string>();
    var cs_names = new List<string>();
    var cs_shapes = new List<string>();
    var cs_material = new List<string>();
    var heights = new List<double>();
    var widths = new List<double>();
    var tflanges = new List<double>();
    var twebs = new List<double>();
    var frads = new List<double>();

    foreach (var elem in model.elems)
    {
      var beam = elem as ModelElementStraightLine;
      if (beam != null) {
        beam_ids.Add(elem.id);
        cs_names.Add(elem.crosec.name);
        cs_shapes.Add(elem.crosec.shape());
        cs_material.Add(elem.crosec.materialName);

        // is it an I-profile?
        var crosec_i = beam.crosec as CroSec_I;
        if (crosec_i != null) {
          heights.Add(crosec_i.getHeight() * 1000);
          // use the upper flange thickness
          widths.Add(crosec_i.uf_width * 1000);
          tflanges.Add(crosec_i.uf_thick * 1000);
          twebs.Add(crosec_i.w_thick * 1000);
          // use the inner fillet radius
          frads.Add(crosec_i.fillet_r * 1000);
          // this would be the outer fillet radius
          // frads.Add(crosec.fillet_r1);
          continue;
        }

        // is it a CHS?
        var crosec_o = beam.crosec as CroSec_Circle;
        if (crosec_o != null) {
          heights.Add(crosec_o.getHeight() * 1000);
          // use the upper flange thickness
          widths.Add(0);
          tflanges.Add(crosec_o.thick * 1000);
          twebs.Add(crosec_o.thick * 1000);
          frads.Add(0);
          continue;
        }

        // options for Box, trapezoid and T-section are not implemented yet
        throw new Exception("Cross section encountered for which no export is implemented");
      }
    }

    BeamIds = beam_ids;
    CrosecNames = cs_names;
    CrosecShapes = cs_shapes;
    Material = cs_material;
    Heights = heights;
    Widths = widths;
    TFlanges = tflanges;
    TWebs = twebs;
    FRads = frads;
# ---------- end k3dbeamprops ----------
b_forces = BeamForcesKaramba3D(AnalyzedModel=disassemble.Model, LCase=-1, MaximumDistanceBetweenResults_m=-1, NumberOfResultsPerBeamElement=2)  # -> AnalyzedModel, NormalForce_kN, ShearForceVz_kN, ShearForceVy_kN, BendingMomentMt_kNm, BendingMomentMy_kNm, BendingMomentMz_kNm
disassemble_2 = DisassembleElementKaramba3D(Element=disassemble.Beam)  # -> Element, ElementIdentifier, AxisOfElement, CrossSection, Joints, Material, LocalCoordinateSystem, ElementIsActive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
vec_cm_to_mm = Vector(expr("x*10", disassemble_2.LocalEccentricity_cm))
hierarchy = Panel("""Column
Beam""")
cp = CreateProject(
    Hierarchy=hierarchy,
    Points=disassemble.Point,
    Lines=disassemble.Line,
    LCSRotations_Deg=disassemble_2.Alpha_deg,
    EccentricityVector=vec_cm_to_mm,
    Groupnames=k3dbeamprops.BeamIds,
    Materials=k3dbeamprops.Material,
    CrossSectionNames=k3dbeamprops.CrosecNames,
    Shapes=k3dbeamprops.CrosecShapes,
    Heights=k3dbeamprops.Heights,
    Widths=k3dbeamprops.Widths,
    ThicknessFlanges=k3dbeamprops.TFlanges,
    ThicknessWebs=k3dbeamprops.TWebs,
    Radius=k3dbeamprops.FRads,
    N=b_forces.NormalForce_kN,
    Vz=b_forces.ShearForceVz_kN,
    Vy=b_forces.ShearForceVy_kN,
    Mt=b_forces.BendingMomentMt_kNm,
    My=b_forces.BendingMomentMy_kNm,
    Mz=b_forces.BendingMomentMz_kNm)

# ----
data_3 = Data(cp)
analytical_template_moment_resisting_con = AnalyticalTemplateMomentResistingConnection(Project=data_3, BrandNames=panel_2, HeightHaunch_mm=height_haunch_mm, Stiffeners=stiffeners, UnbracedStructure=False)  # -> Project, Message, Brep; disabled
atemplate_finplateconnection = ATemplate_FinplateConnection(Project=data_3, BrandNames=panel_2)  # -> Project, Message, Brep
data_4 = Data(data_3)

# ---- group: 3. Project utilities
# Visualize joints
visualize_joints = VisualizeJoints(Project=data_4)  # -> JointTypes, Brandnames, Centerpoints
move_along_x = Slider(94, range=0..100)
radius = Slider(0.2, range=0.2..0.5)
spread = Slider(14, range=0..100)
textsize = Slider(0.4, range=0..1)
cluster_7 = Cluster_6(line=visualize_joints.JointTypes, num_2=spread, num=move_along_x, num_3=radius)  # -> P, R
cluster_8 = Cluster_5(G=visualize_joints.Centerpoints, data_3=spread, X=move_along_x)
preview = CustomPreview(Geometry=cluster_7.P, Material=cluster_7.R)
xz = XZPlane(Origin=flatten(cluster_8))
data_5 = Data(flatten(visualize_joints.Brandnames))
tag = TextTag3D(Location=xz, Text=data_5, Size=textsize, Colour=ColourSwatch(SwatchColor=RGB(0, 0, 0)), Justification=7)

# ----
preview_2 = CustomPreview(Geometry=atemplate_finplateconnection.Brep, Material=ColourSwatch(SwatchColor=RGB(31, 242, 77)))
retrieveconnectionproperties = RetrieveConnectionProperties(Project=atemplate_finplateconnection.Project)  # -> Message, StartSj, EndSj, StartMjRd, EndMjRd
panel_10 = Panel(atemplate_finplateconnection.Message)

vec = VectorXYZ(XComponent=0, YComponent=flatten(retrieveconnectionproperties.StartSj), ZComponent=0)  # -> Vector, Length
vec_2 = VectorXYZ(XComponent=0, YComponent=flatten(retrieveconnectionproperties.EndSj), ZComponent=0)  # -> Vector, Length
data_6 = Data(flatten(entwine))
lng = ListLength(List=data_6)
series_2 = Series(Start=0, Step=1, Count=lng)
beam_joints = BeamJointsKaramba(
    ElementIdentifiers=graft(series_2),
    CtKNMAtStartingNode=Vector(0, 0, 0),
    CrKNmRadAtStartingNode=vec.Vector,
    CtKNMAtEndNode=Vector(0, 0, 0),
    CrKNmRadAtEndNode=vec_2.Vector,
    menu=[buttons(off, off, off, off, on, off), buttons(off, off, off, off, on, off)])

element_3 = ElementKaramba3D(flatten(element_2))
support_3 = SupportKaramba3D(flatten(support_2))
load_3 = LoadKaramba3D(flatten(load_2))
joint = JointKaramba3D(flatten(beam_joints))

# ---- group: Karamba3D / Assemble Model
assemble_2 = AssembleModelKaramba3D(Elem=element_3, Support=support_3, Load=load_3, Joint=joint, LimitDistance_m=0.005)  # -> Model, Info, Mass_kg, CenterOfGravity

# ---- group: Karamba3D / Analyze Model
analyze_2 = AnalyzeKaramba3D(Model=assemble_2.Model)  # -> CalculatedModel, MaximumDisplacement_cm, ResultingForceOfGravity_kN, ElasticEnergy_kNm

# ---- group: Karamba3D / View Results
modelview_2 = ModelViewKaramba3D(Model=analyze_2.CalculatedModel, LoadCaseFactorsForLinearSuperposition=1, IndexOfVisibleLoadcase=-1)  # -> Model, DeformedMesh, DeformedAxes, DeformedModel
beamview_2 = BeamViewKaramba3D(Model=modelview_2.Model)  # -> Model, MeshesOfRenderedBeams, DeformedBeamAxes, LegendColors, LegendTags

# ----
data_7 = Data(atemplate_finplateconnection.Project)
data_8 = Data(beamview_2.Model)

# ---- group: 7. Cost calculation
data_9 = Data(data_7)
boltprices_from_m12_up_till_m52 = Panel("""0.30
0.60
1.10
1.50
2.30
2.70
5.10
26.56
31.81
31.40""")
bolt_costs = BoltCosts(Project=data_9, Boltprices=boltprices_from_m12_up_till_m52)  # -> BoltCosts, Message
weld_volume_generator = WeldVolumeGenerator(Project=data_9)
total_weight = TotalWeight(Project=data_9)  # -> WeightElements_kg, WeightPlates_kg, Brep
retrievelinespoints = RetrieveLinesPoints(Project=data_9)  # -> Lines, Points
price_welding = Panel("2.6")
price_steel = Panel("1")
applied_boltprices = Panel(bolt_costs.Message)
preview_3 = CustomPreview(Geometry=total_weight.Brep, Material=ColourSwatch(SwatchColor=RGBA(158, 138, 138, 138)))
costcalculator = CostCalculator(
    WeightElements_kg=total_weight.WeightElements_kg,
    WeightPlates_kg=total_weight.WeightPlates_kg,
    WeldingVolume_cm3=weld_volume_generator,
    BoltCosts=bolt_costs.BoltCosts,
    NumberOfElements=0,
    SteelPricePerKg=price_steel,
    WeldingPricePerCm3=price_welding,
    TransportPricePerElement=20)  # -> CostsOfBeamMaterial_, CostsPerJoint_, CostsPerJointDetailed_, TransportCost_
xz_2 = XZPlane(Origin=retrievelinespoints.Points)
Z_3 = UnitZ(Factor=Slider(0.23, range=0..1))
ma = MassAddition(Input=flatten(costcalculator.CostsPerJointDetailed_))  # -> flatten(Result), PartialResults
Y = UnitY(Factor="0.2")
move = Move(Geometry=xz_2, Motion=Z_3)  # -> Geometry, Transform
move_2 = Move(Geometry=move.Geometry, Motion=Y)  # -> Geometry, Transform
addition = Addition(A=costcalculator.CostsOfBeamMaterial_, B=ma.Result)
tag_2 = TextTag3D(Location=move_2.Geometry, Text=costcalculator.CostsPerJoint_, Size=Slider(0.4, range=0..2), Justification=7)
division = Division(A=ma.Result, B=addition)
division_2 = Division(A=costcalculator.CostsOfBeamMaterial_, B=addition)
num_3 = Number(expr("x*100", division))
num_4 = Number(expr("x*100", division_2))
beamcosts = Panel(costcalculator.CostsOfBeamMaterial_)
totalcosts = Panel(addition)
jointcosts = Panel(ma.Result)

# ----
retrieveconnectionproperties_2 = RetrieveConnectionProperties(Project=data_7)  # -> Message, StartSj, EndSj, StartMjRd, EndMjRd
b_forces_2 = BeamForcesKaramba3D(AnalyzedModel=data_8, LCase=-1, MaximumDistanceBetweenResults_m=-1, NumberOfResultsPerBeamElement=2)  # -> AnalyzedModel, NormalForce_kN, ShearForceVz_kN, ShearForceVy_kN, BendingMomentMt_kNm, BendingMomentMy_kNm, BendingMomentMz_kNm
item_4 = ListItem(List=reverse(b_forces_2.BendingMomentMy_kNm), Index=0, Wrap=True)  # -> flatten(Item)
item_5 = ListItem(List=b_forces_2.BendingMomentMy_kNm, Index=0, Wrap=True)  # -> flatten(Item)
cluster_9 = Cluster_4(num_2=item_4, num=retrieveconnectionproperties_2.EndMjRd)
cluster_10 = Cluster_4(num_2=item_5, num=retrieveconnectionproperties_2.StartMjRd)
c_script = CSharpScript(x=flatten([cluster_10, cluster_9]))  # -> Max, Min; inputs x: list of Double; same code as c_script
uc_mjrd = Panel(c_script.Max)

retrieveconnectionproperties_3 = RetrieveConnectionProperties(Project=data_7)  # -> Message, StartSj, EndSj, StartMjRd, EndMjRd
sort = SortList(Keys=retrieveconnectionproperties_3.StartSj, ValuesA=retrieveconnectionproperties_3.StartSj)  # -> reverse(Keys), ValuesA
item_6 = ListItem(List=sort.Keys, Index=0, Wrap=True)
round = Round(Number=item_6)  # -> Nearest, Floor, Ceiling
jointstiffness_knm_rad = Panel(round.Nearest)

preview_4 = CustomPreview(Geometry=total_weight.Brep, Material=ColourSwatch(SwatchColor=RGBA(0, 187, 255, 133)))

k3dbeamprops_2 = CSharpScript(
    Model=data_8,
    Reference=["C:\PROGRAM FILES\RHINO 7\PLUG-INS\KARAMBA\karambaCommon.dll", "C:\PROGRAM FILES\RHINO 7\PLUG-INS\KARAMBA\karamba.gha"])  # -> CrosecNames
# ---------- k3dbeamprops_2: C# ----------
    var model = Model as Karamba.Models.Model;
    if (model == null) {
      throw new ArgumentException ("The input is not of type model!");
    }

    var cs_names = new List<string>();
  

    foreach (var elem in model.elems)
    {
      var beam = elem as ModelElementStraightLine;
      if (beam != null) {
        cs_names.Add(elem.crosec.name);
  
      }
    }

    
    CrosecNames = cs_names;
# ---------- end k3dbeamprops_2 ----------
data_10 = Data(k3dbeamprops_2)
item_7 = ListItem(List=reverse(data_10), Index=0, Wrap=True)
item_8 = ListItem(List=data_10, Index=0, Wrap=True)
column_2 = Panel(item_8)
beam = Panel(item_7)

panel_11 = Panel(bolt_costs.BoltCosts)
disassemble_3 = DisassembleModelKaramba3D(Model=data_8)  # -> Model, Point, Beam, Shell, Support, Load, Line, Mesh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
utilization = UtilizationOfElementsKaramba3D(
    AnalyzedModel=disassemble_3.Model,
    ResultCase=-1,
    NumberOfSamplePoints=3,
    ElasticDesign=True,
    GammaM0=1,
    GammaM1=1,
    WithDetails=False,
    mode="Beams")  # -> AnalyzedModel, Utilization, SigMax_kN_cm2, SigMin_kN_cm2, TauMax_kN_cm2, UtilN, UtilVy, UtilVz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
c_script_2 = CSharpScript(x=flatten(utilization.Utilization))  # -> Max, Min; inputs x: list of Double; same code as c_script
uc_beam = Panel(c_script_2.Max)

nodedisp = NodalDisplacementsKaramba3D(AnalyzedModel=data_8, ResultCase=0)  # -> AnalyzedModel, NodalTranslations_m, NodalRotations_rad
devec = DeconstructVector(Vector=nodedisp.NodalTranslations_m)  # -> XComponent, YComponent, ZComponent

data_11 = Data(devec.ZComponent)
sort_2 = SortList(Keys=data_11, ValuesA=reverse(data_11))  # -> Keys, ValuesA
item_9 = ListItem(List=sort_2.Keys, Index=0, Wrap=True)
num_5 = Number(expr("x*1000", item_9))

data_12 = Data(devec.XComponent)
sort_3 = SortList(Keys=data_12, ValuesA=reverse(data_12))  # -> reverse(Keys), ValuesA
item_10 = ListItem(List=sort_3.Keys, Index=0, Wrap=True)
num_6 = Number(expr("x*1000", item_10))

max_vert_disp_mm = Panel(num_5)
max_horz_disp_mm = Panel(num_6)

expression = Expression(x=ma.Result, y=num_3, Expression="Format(\"Joints:  €{0:0},- ({1:0.0}%)\", x, y)")
expression_2 = Expression(x=costcalculator.CostsOfBeamMaterial_, y=num_4, Expression="Format(\"Beams: €{0:0},- ({1:0.0}%)\", x, y)")
expression_3 = Expression(x=num_5, Expression="Format(\"uz max: {0:0.00} mm\", x)")
expression_4 = Expression(x=num_6, Expression="Format(\"ux max: {0:0.00} mm\", x)")
expression_5 = Expression(x=addition, y=num_3, Expression="Format(\"Total:   €{0:0},- \", x)")
merge_3 = Merge(
    Data1=flatten(expression_4),
    Data2=flatten(expression_3),
    Data3=flatten(expression_2),
    Data4=flatten(expression),
    Data5=flatten(expression_5))
txt = Text(merge_3)
lng_2 = ListLength(List=txt)
vec_3 = Vector("3,0,-4")
series_3 = Series(Start=-1, Step=Slider(0.9, range=0..2), Count=lng_2)
panel_12 = Panel("0.4")
neg_2 = Negative(Value=series_3)
xz_3 = XZPlane(Origin=vec_3)
Z_4 = UnitZ(Factor=neg_2)
move_3 = Move(Geometry=xz_3, Motion=Z_4)  # -> Geometry, Transform
tag_3 = TextTag3D(Location=move_3.Geometry, Text=txt, Size=Slider(0.6, range=0..1), Justification=4)

parameters = ColibriParameters(
    Column=flatten(column_2),
    Beam=flatten(beam),
    Max_Horz_disp_mm=flatten(max_horz_disp_mm),
    Max_Vert_Disp_mm=flatten(max_vert_disp_mm),
    UC_MjRd=flatten(uc_mjrd),
    UC_Beam=flatten(uc_beam),
    Costs_of_beam_material=flatten(costcalculator.CostsOfBeamMaterial_),
    JointCosts=flatten(jointcosts),
    TotalCosts=flatten(totalcosts),
    JointStiffness_kNm_rad=flatten(jointstiffness_knm_rad))

panel_13 = Panel("""0
0
5
0""")
selection = IterationSelection(Divisions=panel_13)
iterator = ColibriIterator(
    Colum_index_CSS=colum_index_css,
    Beam_index_CSS=beam_index_css,
    Height_haunch_mm=height_haunch_mm,
    Stiffeners=stiffeners,
    Selection=selection,
    RemoteFly=False,
    ignoreAllWarningMsg=False)  # -> Colum_index_CSS, Beam_index_CSS, Height_haunch_mm, Stiffeners, Value_N, Genome
addition_2 = Addition(A="100000", B=iterator.Height_haunch_mm)
concat = Concatenate(
    FragmentH=column,
    FragmentG=iterator.Colum_index_CSS,
    FragmentD="Beam",
    FragmentA=iterator.Beam_index_CSS,
    FragmentE="HeightHaunch",
    FragmentB=addition_2,
    FragmentF="Stiffeners",
    FragmentC=iterator.Stiffeners)
panel_14 = Panel("Y:\Constructies\personen\ABT Delft\Rayaan\Grasshopper\FrameOptimization_11")
panel_15 = Panel(concat)
panel_16 = Panel("""Front
Perspective""")
img_setting = ImageSetting(ImageSaveAsName=panel_15, Width="1200", Height="1200")
aggregator = ColibriAggregator(
    Folder=panel_14,
    IterationGenomeID=iterator.Genome,
    IterationPhenomeResults=parameters,
    ImgSetting=img_setting,
    Write=Toggle(False),
    recordingMode=0)

panel_17 = Panel(aggregator)

# ==== cluster Cluster
data = ClusterInput()
data_2 = Data(data)
lng = ListLength(List=data_2)
culln = CullNth(List=data_2, CullFrequency=lng)
data_3 = Data(culln)
data_4 = ClusterOutput(data_3)

# ==== cluster Cluster_2
data = ClusterInput()
data_2 = Data(data)
cull_i = CullIndex(List=data_2, Indices="0", Wrap=True)
data_3 = Data(cull_i)
data_4 = ClusterOutput(data_3)

# ==== cluster Cluster_3
pt = ClusterInput()

pt_2 = Point(pt)
lng = ListLength(List=pt_2)
cull_i = CullIndex(List=pt_2, Indices="0", Wrap=True)  # -> simplify(List)
culln = CullNth(List=pt_2, CullFrequency=lng)  # -> simplify(List)
ln = Line(StartPoint=culln, EndPoint=cull_i)

L = ClusterOutput(ln)

# ==== cluster Cluster_4
num = ClusterInput()
num_2 = ClusterInput()
num_3 = Number(num)
num_4 = Number(num_2)
larger = LargerThan(FirstNumber=num_3, SecondNumber="0")  # -> LargerThan, OrEqualTo
cull = CullPattern(List=num_3, CullPattern=larger.LargerThan)
cull_2 = CullPattern(List=num_4, CullPattern=larger.LargerThan)
abs = Absolute(Value=cull_2)
division = Division(A=abs, B=cull)
c_script = CSharpScript(x=division)  # -> Max, Min; inputs x: list of Double
# ---------- c_script: C# ----------
    double a = x[0];
    double b = x[0];
    foreach (double t in x)
    {
      if(t > a)
      {
        a = t;
      }
      if(t < b)
      {
        b = t;
      }
    }
    Max = a;
    Min = b;
# ---------- end c_script ----------
max = ClusterOutput(c_script.Max)

# ==== cluster Cluster_5
G = ClusterInput()
X = ClusterInput()
vec = VectorXYZ(XComponent=X, YComponent=0, ZComponent=0)  # -> Vector, Length
move = Move(Geometry=G, Motion=vec.Vector)  # -> Geometry, Transform
data = Data(move.Geometry)
tstat = TreeStatistics(Tree=data)  # -> Paths, Length, Count
dpath = DeconstructPath(Branch=tstat.Paths)
data_2 = Data(graft(tstat.Length))
flip = FlipMatrix(Data=dpath)
data_3 = ClusterInput()
bang = ExplodeTree(Data=flip)  # -> flatten(Branch0), flatten(Branch1)
data_4 = Data(data_3)
data_5 = Data(graft(bang.Branch0))
data_6 = Data(graft(bang.Branch1))
multiplication = Multiplication(A=bang.Branch0, B=data_4)
multiplication_2 = Multiplication(A=bang.Branch1, B=data_4)
path = ConstructPath(Indices=[data_5, data_6])  # -> flatten(Branch)
vec_2 = VectorXYZ(XComponent=multiplication, YComponent=multiplication_2, ZComponent=0)  # -> Vector, Length
unflatten = UnflattenTree(Tree=vec_2.Vector, Guide=path)  # -> graft(Tree)
data_7 = Data(flatten(data))
dup = DuplicateData(Data=unflatten, Number=data_2, Order=True)  # -> flatten(Data)
move_2 = Move(Geometry=data_7, Motion=dup)  # -> Geometry, Transform
G_2 = ClusterOutput(move_2.Geometry)
panel = Panel(move_2.Geometry)

# ==== cluster Cluster_6
num = ClusterInput()
num_2 = ClusterInput()
line = ClusterInput()
num_3 = ClusterInput()
num_4 = Number(num)
num_5 = Number(num_2)
line_2 = Line(line)
num_6 = Number(num_3)
cluster = Cluster_5(G=line_2, data_3=num_5, X=num_4)
line_3 = Line(cluster)
pipe = Pipe(Curve=line_3, Radius=num_6, Caps=0)  # -> flatten(Pipe)
dom = ConstructDomain(DomainStart="0", DomainEnd="1")
pshift = ShiftPaths(Data=line_2, Offset=-1)
P = ClusterOutput(pipe)
range = Range(Domain=dom, Steps=Slider(8, range=0..100))
lng = ListLength(List=pshift)
data = Data(flatten(lng))
data_2 = Data(range)
c_script = CSharpScript(lengths=data, colorlist=data_2)  # -> out, A; inputs lengths: list of Double, colorlist: list of Double
# ---------- c_script: C# ----------
    DataTree<double> tree = new DataTree<double>();
    GH_Path path = new GH_Path();
    int w = 0;


    for (int b = 0; b < lengths.Count; b++)
    {
      for (int c = 0;c < lengths[b];c++)
      {
        double num = colorlist[(w % colorlist.Count)];
        //tree.Add(num, path);
        tree.Add(num);
      }
      w = w + 1;

    }
    A = tree;
# ---------- end c_script ----------
data_3 = Data(flatten(c_script.A))
gradient = Gradient(
    LowerLimit=0,
    UpperLimit=1,
    Parameter=data_3,
    stops=[0: RGB(35, 99, 187), 0: RGB(234, 38, 0), 0: RGBA(255, 255, 255, 0), 0.25: RGB(234, 126, 0), 0.5: RGB(254, 244, 84), 0.75: RGB(173, 203, 249)])
lng_2 = ListLength(List=gradient)
dup = DuplicateData(Data=" (100)", Number=lng_2, Order=True)  # -> flatten(Data)
merge = Merge(Data1=graft(gradient), Data2=graft(dup))
join = TextJoin(Text=merge)  # -> flatten(Result)
R = ClusterOutput(join)
