# Grasshopper definition SCIA_link.gh (Grasshopper 1.0.7)
# Copyright: B+G Engineers
# plug-ins: TT Toolbox, KarambaIDEA

# ---- group: FilePath
panel = Panel("C:\Users\r.ajouz\source\repos\KarambaIDEA\0_Grasshopper_Files\")

# ---- group: FileName Excel output file
panel_2 = Panel("SCIA_output_3D_truss.xlsx")

# ---- group: Construct Filepath of Datalist
merge = Merge(Data1=panel, Data2=panel_2)
join = TextJoin(Text=merge)

# ----
# KarambaIDEA SCIA Example
# Requirements SCIA-model:
# 1. No polylines,
# -Between each node a beam should be drawn.
# 2. No governing combinations,
# -The results in IDEA Statica connection should make equilibrium
panel_3 = Panel(join)
toggle = BooleanToggle(True)

# ----
# Excel Export
panel_4 = Panel("Internal forces on member")
readxl = ReadExcelSheet(Run=toggle, FilePath=panel_3, Worksheet="1D member", Listen=False)  # -> UserMessages, Columns, Rows
readxl_2 = ReadExcelSheet(Run=toggle, FilePath=panel_3, Worksheet="Node", Listen=False)  # -> UserMessages, Columns, Rows
readxl_3 = ReadExcelSheet(Run=toggle, FilePath=join, Worksheet=panel_4, Listen=False)  # -> UserMessages, Columns, Rows
split = SplitList(List=readxl.Columns, Index="1")  # -> ListA, ListB
split_2 = SplitList(List=readxl_3.Columns, Index="1")  # -> ListA, ListB
flip = FlipMatrix(Data=split.ListB)

item = ListItem(List=flip, Index="2", Wrap=True)  # -> flatten(Item)
item_2 = ListItem(List=flip, Index="3", Wrap=True)  # -> flatten(Item)
item_3 = ListItem(List=flip, Index="0", Wrap=True)  # -> flatten(Item)
item_4 = ListItem(List=flip, Index="5", Wrap=True)  # -> flatten(Item)
item_5 = ListItem(List=flip, Index="6", Wrap=True)  # -> flatten(Item)
item_6 = ListItem(List=flip, Index="4", Wrap=True)  # -> flatten(Item)
item_7 = ListItem(List=flip, Index="7", Wrap=True)  # -> flatten(Item)

# ----
# Export nodes
panel_5 = Panel("1")
split_3 = SplitList(List=readxl_2.Columns, Index=panel_5)  # -> ListA, ListB
flip_2 = FlipMatrix(Data=split_3.ListB)
item_8 = ListItem(List=flip_2, Index="1", Wrap=True)  # -> flatten(Item)
item_9 = ListItem(List=flip_2, Index="2", Wrap=True)  # -> flatten(Item)
item_10 = ListItem(List=flip_2, Index="3", Wrap=True)  # -> flatten(Item)
item_11 = ListItem(List=flip_2, Index="0", Wrap=True)  # -> flatten(Item)
pt = ConstructPoint(XCoordinate=item_8, YCoordinate=item_9, ZCoordinate=item_10)

flip_3 = FlipMatrix(Data=split_2.ListB)
item_12 = ListItem(List=flip_3, Index="9", Wrap=True)  # -> flatten(Item)
item_13 = ListItem(List=flip_3, Index="4", Wrap=True)  # -> flatten(Item)
item_14 = ListItem(List=flip_3, Index="5", Wrap=True)  # -> flatten(Item)
item_15 = ListItem(List=flip_3, Index="8", Wrap=True)  # -> flatten(Item)
item_16 = ListItem(List=flip_3, Index="7", Wrap=True)  # -> flatten(Item)
item_17 = ListItem(List=flip_3, Index="0", Wrap=True)  # -> flatten(Item)
item_18 = ListItem(List=flip_3, Index="6", Wrap=True)  # -> flatten(Item)
item_19 = ListItem(List=flip_3, Index="2", Wrap=True)  # -> flatten(Item)
item_20 = ListItem(List=flip_3, Index="3", Wrap=True)  # -> flatten(Item)

split_4 = TextSplit(Text=item_6, Separators=" ")
item_21 = ListItem(List=split_4, Index="2", Wrap=True)  # -> flatten(Item)

# ----
# Element ID's
data = Data(item_3)

# ----
# Create lines based on PointNames
data_2 = Data(item)
data_3 = Data(item_11)
pt_2 = Point(pt)
data_4 = Data(item_2)
linesfromnodes = LinesFromNodes(NamePoint=data_3, Point=pt_2, NameStartPoint=data_2, NameEndPoint=data_4)

pt_3 = Point(pt)

num = Number(item_4)
num_2 = Number("3")
eval = Evaluate(F="Round(x,y)", x=num, y=num_2)

cluster = Cluster_2(T=item_21)
# LCS tranformations to other FEM packages can be found at:
# https://github.com/BouwenmetStaal/KarambaIDEA/blob/master/0_Documentation/LCS_transformations.pdf
cel = ConvertExcelLoads(
    ElementIDs=data,
    ElementLength=eval,
    EntryElementID=item_17,
    EntryLoadcase=item_20,
    EntryLength=item_19,
    EntryN=item_13,
    EntryVz=item_18,
    EntryVy=item_14,
    EntryMt=item_16,
    EntryMy=item_15,
    EntryMz=item_12)  # -> LoadcasesFound, LoadcaseNames, N, Vz, Vy, Mt, My, Mz

# ----
# Local Coordinate System Transformation
panel_6 = Panel("-1")
multiplication = Multiplication(A=cel.Vz, B=panel_6)

multiplication_2 = Multiplication(A=cel.Vy, B="-1")

multiplication_3 = Multiplication(A=cel.My, B="-1")

# ----
# Points
data_5 = Data(pt_3)

# ----
# Lines
data_6 = Data(linesfromnodes)

# ----
# Groupnames
data_7 = Data(item_5)

# ----
# CrosSecName
data_8 = Data(item_21)

# ----
# Shape
data_9 = Data(cluster)

# ----
# LCS rotation
data_10 = Data(item_7)

cluster_2 = Cluster_7(data=data_9, D="S355")
cluster_3 = Cluster_7(data=data_9, D="CHS_TEST")
cluster_4 = Cluster_7(data=data_9, D="O")
cluster_5 = Cluster_7(data=data_9, D="1")
cluster_6 = Cluster_7(data=data_9, D="300")
cluster_7 = Cluster_7(data=data_9, D="10")

# ---- group: 2. Create Project
# KarambaIDEA
pt_4 = Point(data_5)
line = Line(data_6)
lcs_rotations = Data(data_10)
groupnames = Data(data_7)
crosecnames = Data(cluster_3)
shapes = Data(cluster_4)
cross_section_properties = Data(cluster_5)
cross_section_properties_2 = Data(cross_section_properties)

# ----
materials = Data(cluster_2)

# ---- group: 2. Create Project / Data collect
hierarchy = Panel("""Majorbeams
Minorbeams""")
cp = CreateProject(
    Hierarchy=hierarchy,
    Points=pt_4,
    Lines=line,
    LCSRotations_Deg=lcs_rotations,
    Groupnames=groupnames,
    Materials=materials,
    CrossSectionNames=crosecnames,
    Shapes=shapes,
    Heights=cross_section_properties_2,
    Widths=cross_section_properties_2,
    ThicknessFlanges=cross_section_properties_2,
    ThicknessWebs=cross_section_properties_2,
    Radius=cross_section_properties_2,
    N=cel.N,
    Vz=multiplication,
    Vy=multiplication_2,
    Mt=cel.Mt,
    My=multiplication_3,
    Mz=cel.Mz)

# ----
data_11 = Data(cp)
data_12 = Data(data_11)

# ---- group: 3. Project utilities
# Visualize joints
visualize_joints = VisualizeJoints(Project=data_12)  # -> JointTypes, Brandnames, Centerpoints
radius = Slider(0.2, range=0.2..0.5)
move_along_x = Slider(27, range=0..100)
textsize = Slider(0.4, range=0..1)
spread = Slider(10, range=0..100)
cluster_8 = Cluster_4(line=visualize_joints.JointTypes, num_2=spread, num=move_along_x, num_3=radius)  # -> P, R
cluster_9 = Cluster_3(G=visualize_joints.Centerpoints, data_3=spread, X=move_along_x)
preview = CustomPreview(Geometry=cluster_8.P, Material=cluster_8.R)
xz = XZPlane(Origin=flatten(cluster_9))
data_13 = Data(flatten(visualize_joints.Brandnames))
tag = TextTag3D(Location=xz, Text=data_13, Size=textsize, Colour=ColourSwatch(SwatchColor=RGB(0, 0, 0)), Justification=7)

# ----
panel_7 = Panel("""001111
0111""")
data_14 = Data(data_11)
template_weld_all_members = TemplateWeldAllMembers(Project=data_14, BrandNames=panel_7)  # -> Project, Message
panel_8 = Panel(template_weld_all_members.Message)
data_15 = Data(template_weld_all_members.Project)
user_feedback = BooleanToggle(False)
run_all_joints = BooleanToggle(False)

# ---- group: 6. IDEA utilities
user_feedback_2 = BooleanToggle(False)
run_all_joints_2 = BooleanToggle(False)
run_idea = Button()
data_16 = Data(data_15)
output_folderpath = Panel("C:\Data")
create_idea_file = CreateIDEAFile(
    Project=data_16,
    OutputFolder=output_folderpath,
    UserFeecback=user_feedback_2,
    CreateAllJoints=run_all_joints_2,
    ChooseJoint=Slider(15, range=0..100),
    RunIDEA=run_idea)

# ---- group: 3. Project utilities
# Local coordinate system
lcs = LocalCoordinateSystem(Project=data_12)  # -> LineOfElements, LocalXVectors, LocalYVectors, LocalZVectors
length = Slider(0.149, range=0..2)
radius_2 = Slider(0.01, range=0..0.01)
curvepoint = PointOnCurve(lcs.LineOfElements, parameter=0.182)

# ----
cluster_10 = Cluster_6(num=length, num_2=radius_2, pt=curvepoint, vec_2=lcs.LocalXVectors, vec=lcs.LocalYVectors, vec_3=lcs.LocalZVectors)  # -> D, C

# ---- group: 3. Project utilities (continued)
preview_2 = CustomPreview(Geometry=cluster_10.D, Material=cluster_10.C)

# ---- group: 6. IDEA utilities
run_idea_2 = Button()
data_17 = Data(data_15)
output_folderpath_2 = Panel("C:\Data")
number_slider = Slider(8, range=0..100)

# ----
create_and_calculate_idea_file = CreateAndCalculateIDEAFile(
    Project=data_17,
    OutputFolder=output_folderpath_2,
    UserFeecback=user_feedback,
    RunAllJoints=run_all_joints,
    ChooseJoint=number_slider,
    RunIDEA=run_idea_2)  # -> SelectedJoint, Analysis, Plates, Bolts, Welds, Buckling, Summary

# ---- group: 6. IDEA utilities (continued)
cluster_11 = Cluster_5(T=create_and_calculate_idea_file.Analysis)
cluster_12 = Cluster_5(T=create_and_calculate_idea_file.Plates)
cluster_13 = Cluster_5(T=create_and_calculate_idea_file.Bolts)
cluster_14 = Cluster_5(T=create_and_calculate_idea_file.Welds)
cluster_15 = Cluster_5(T=create_and_calculate_idea_file.Buckling)
cluster_16 = Cluster_5(T=create_and_calculate_idea_file.Summary)
summary_message = Panel(cluster_16)
ucbuckling = Panel(cluster_15)
analysis = Panel(cluster_11)
ucplates = Panel(cluster_12)
ucwelds = Panel(cluster_14)
ucbolts = Panel(cluster_13)

# ==== cluster Cluster_2
T = ClusterInput()
panel = Panel("""HE
SH
FL
HF
IP""")
panel_2 = Panel("""I
[]
[x]
L
I""")
fragment = TextFragment(Text=T, Start="0", Count="2")
item = ListItem(List=panel, Index="0", Wrap=True)
item_2 = ListItem(List=panel_2, Index="0", Wrap=True)
item_3 = ListItem(List=panel, Index="1", Wrap=True)
item_4 = ListItem(List=panel, Index="2", Wrap=True)
item_5 = ListItem(List=panel, Index="3", Wrap=True)
item_6 = ListItem(List=panel_2, Index="1", Wrap=True)
item_7 = ListItem(List=panel_2, Index="2", Wrap=True)
item_8 = ListItem(List=panel_2, Index="3", Wrap=True)
item_9 = ListItem(List=panel, Index="4", Wrap=True)
item_10 = ListItem(List=panel_2, Index="4", Wrap=True)
cluster = Cluster(data=fragment, x=item, D=item_2)
cluster_2 = Cluster(data=cluster, x=item_3, D=item_6)
cluster_3 = Cluster(data=cluster_2, x=item_4, D=item_7)
cluster_4 = Cluster(data=cluster_3, x=item_5, D=item_8)
cluster_5 = Cluster(data=cluster_4, x=item_9, D=item_10)
datar = ClusterOutput(cluster_5)

# ==== cluster Cluster_3
G = ClusterInput()
X = ClusterInput()
vec = VectorXYZ(XComponent=X, YComponent=0, ZComponent=0)  # -> Vector, Length
move = Move(Geometry=G, Motion=vec.Vector)  # -> Geometry, Transform
data = Data(move.Geometry)
tstat = TreeStatistics(Tree=data)  # -> Paths, Length, Count
dpath = DeconstructPath(Branch=tstat.Paths)
data_2 = Data(graft(tstat.Length))
flip = FlipMatrix(Data=dpath)
data_3 = ClusterInput()
bang = ExplodeTree(Data=flip)  # -> flatten(Branch0), flatten(Branch1)
data_4 = Data(data_3)
data_5 = Data(graft(bang.Branch0))
data_6 = Data(graft(bang.Branch1))
multiplication = Multiplication(A=bang.Branch0, B=data_4)
multiplication_2 = Multiplication(A=bang.Branch1, B=data_4)
path = ConstructPath(Indices=[data_5, data_6])  # -> flatten(Branch)
vec_2 = VectorXYZ(XComponent=multiplication, YComponent=multiplication_2, ZComponent=0)  # -> Vector, Length
unflatten = UnflattenTree(Tree=vec_2.Vector, Guide=path)  # -> graft(Tree)
data_7 = Data(flatten(data))
dup = DuplicateData(Data=unflatten, Number=data_2, Order=True)  # -> flatten(Data)
move_2 = Move(Geometry=data_7, Motion=dup)  # -> Geometry, Transform
G_2 = ClusterOutput(move_2.Geometry)
panel = Panel(move_2.Geometry)

# ==== cluster Cluster_4
num = ClusterInput()
num_2 = ClusterInput()
line = ClusterInput()
num_3 = ClusterInput()
num_4 = Number(num)
num_5 = Number(num_2)
line_2 = Line(line)
num_6 = Number(num_3)
cluster = Cluster_3(G=line_2, data_3=num_5, X=num_4)
line_3 = Line(cluster)
pipe = Pipe(Curve=line_3, Radius=num_6, Caps=0)  # -> flatten(Pipe)
dom = ConstructDomain(DomainStart="0", DomainEnd="1")
pshift = ShiftPaths(Data=line_2, Offset=-1)
P = ClusterOutput(pipe)
range = Range(Domain=dom, Steps=Slider(8, range=0..100))
lng = ListLength(List=pshift)
data = Data(flatten(lng))
data_2 = Data(range)
c_script = CSharpScript(lengths=data, colorlist=data_2)  # -> out, A; inputs lengths: list of Double, colorlist: list of Double
# ---------- c_script: C# ----------
    DataTree<double> tree = new DataTree<double>();
    GH_Path path = new GH_Path();
    int w = 0;


    for (int b = 0; b < lengths.Count; b++)
    {
      for (int c = 0;c < lengths[b];c++)
      {
        double num = colorlist[(w % colorlist.Count)];
        //tree.Add(num, path);
        tree.Add(num);
      }
      w = w + 1;

    }
    A = tree;
# ---------- end c_script ----------
data_3 = Data(flatten(c_script.A))
gradient = Gradient(
    LowerLimit=0,
    UpperLimit=1,
    Parameter=data_3,
    stops=[0: RGB(35, 99, 187), 0: RGB(234, 38, 0), 0: RGBA(255, 255, 255, 0), 0.25: RGB(234, 126, 0), 0.5: RGB(254, 244, 84), 0.75: RGB(173, 203, 249)])
lng_2 = ListLength(List=gradient)
dup = DuplicateData(Data=" (100)", Number=lng_2, Order=True)  # -> flatten(Data)
merge = Merge(Data1=graft(gradient), Data2=graft(dup))
join = TextJoin(Text=merge)  # -> flatten(Result)
R = ClusterOutput(join)

# ==== cluster Cluster_5
T = ClusterInput()
join = TextJoin(Text=T)
rec = DataRecorder(join, DataLimit=2, RecordData=True)
item = ListItem(List=flatten(rec), Index=0, Wrap=True)
i = ClusterOutput(item)
panel = Panel(item)

# ==== cluster Cluster_6
vec = ClusterInput()
vec_2 = ClusterInput()
pt = ClusterInput()
vec_3 = ClusterInput()
num = ClusterInput()
num_2 = ClusterInput()
vec_4 = Vector(vec)
vec_5 = Vector(vec_2)
pt_2 = Point(pt)
vec_6 = Vector(vec_3)
num_3 = Number(num)
num_4 = Number(num_2)
line = LineSDL(Start=pt_2, Direction=vec_5, Length=num_3)
line_2 = LineSDL(Start=pt_2, Direction=vec_4, Length=num_3)
line_3 = LineSDL(Start=pt_2, Direction=vec_6, Length=num_3)
panel = Panel("""255
0
0""")
entwine = Entwine(Branch00=line, Branch01=line_2, Branch02=line_3, FlattenInputs=True)  # -> simplify(Result)
panel_2 = Panel("""0
255
0""")
panel_3 = Panel("""0
0
255""")
rgb = ColourRGB(Alpha=255, Red=panel, Green=panel_2, Blue=panel_3)  # -> graft(Colour)
pipe = Pipe(Curve=entwine, Radius=num_4, Caps=0)
pshift = ShiftPaths(Data=pipe, Offset=-1)
C = ClusterOutput(rgb)
D = ClusterOutput(pshift)

# ==== cluster Cluster_7
data = ClusterInput()
data_2 = Data(data)
D = ClusterInput()
lng = ListLength(List=data_2)
dup = DuplicateData(Data=D, Number=lng, Order=True)
D_2 = ClusterOutput(dup)

# ==== cluster Cluster
data = ClusterInput()
x = ClusterInput()
data_2 = Data(data)
expression = Expression(x=x, y=graft(data_2), Expression="contains(x,y)")  # -> flatten(R)
D = ClusterInput()
data_3 = Data(expression)
lng = ListLength(List=data_3)
dup = DuplicateData(Data=D, Number=lng, Order=True)
p_n_c = PickNChoose(Pattern=data_3, Stream0=data_2, Stream1=dup)
R = ClusterOutput(p_n_c)
