# Grasshopper definition afmetingen_torenkraan.gh (Grasshopper 1.0.7)

panel = Panel("""0
14""")
pt = Point([Point(38453.16832, 55066.44709, 0), Point(91940.54738, 46881.75762, 0)])
xy = XYPlane(Origin=pt)
number_slider = Slider(5000, range=0..5000)
rotate = Rotate(Geometry=xy, Angle=degrees(panel), Plane=pt)  # -> Geometry, Transform
box = CenterBox(Base=rotate.Geometry, X=number_slider, Y=number_slider, Z=number_slider)
