# Grasshopper definition KarambaIDEA_Example_RotatingTower.gh (Grasshopper 1.0.7)
# Copyright: B+G Engineers
# plug-ins: KarambaIDEA, karambaGH

# ---- group: Parameters
degrees = Slider(180, range=0..180)
# KarambaIDEA Example Rotating Tower
height = Slider(25, range=10..40)
number_of_triangles = Slider(10, range=0..20)

radius_top = Slider(1, range=1..10)
radius_mid = Slider(3.1, range=1..10)
radius_base = Slider(4, range=1..10)

# ----
rgb = ColourRGB(Alpha=255, Red=0, Green=0, Blue=0)

panel = Panel("""Parameters
Geometry
Karamba3D
KarambaIDEA
3. Project utilities
4. IDEA utilities
5. IDEA templates""")
merge = Merge(
    Data1=ColourSwatch(SwatchColor=RGB(106, 144, 173)),
    Data2=ColourSwatch(SwatchColor=RGB(123, 189, 179)),
    Data3=ColourSwatch(SwatchColor=RGB(227, 136, 118)),
    Data4=ColourSwatch(SwatchColor=RGB(237, 221, 161)),
    Data5=ColourSwatch(SwatchColor=RGB(186, 222, 214)),
    Data6=ColourSwatch(SwatchColor=RGB(250, 227, 217)),
    Data7=ColourSwatch(SwatchColor=RGB(255, 181, 184)))
group_color = SliderGroupColor(run=Button(), groupNames=panel, colors=merge, defaultColor=ColourSwatch(SwatchColor=RGB(232, 227, 227)))  # inputs run: Boolean, groupNames: list of String, colors: list of Color, defaultColor: Color
# ---------- group_color: C# usings ----------
using System.Drawing;
using Grasshopper.Kernel.Special;
# ---------- group_color: C# ----------
    // Created by Timo Harboe Nielsen - Bjarke Ingels Group.
    
    if(!run){
      return;
    }
    GH_Document doc = owner.OnPingDocument();
    foreach (var dobj in doc.Objects)
    {
      GH_Group _group = dobj as GH_Group;
      if( _group == null){
        continue;
      }
      for(int i = 0; i < Math.Min(groupNames.Count, colors.Count); i++){
        string groupName = _group.NickName.ToString();
        string compareName = groupNames[i];
        if(groupName.IndexOf(compareName, StringComparison.OrdinalIgnoreCase) >= 0){
          _group.Colour = colors[i];
          break;
        } else{
          _group.Colour = defaultColor;
        }
      }
    }
# ---------- end group_color ----------

# ---- group: Geometry
Z = UnitZ(Factor=height)
pt = ConstructPoint(XCoordinate=0, YCoordinate=0, ZCoordinate=0)
move = Move(Geometry=pt, Motion=Z)  # -> Geometry, Transform
ln = Line(StartPoint=pt, EndPoint=move.Geometry)

num = Number(expr("x/2", height))
merge_2 = Merge(Data1="0", Data2=num, Data3=height)
Z_2 = UnitZ(Factor=merge_2)

num_2 = Number(expr("x/2", degrees))
merge_3 = Merge(Data1="0", Data2=num_2, Data3=degrees)

merge_4 = Merge(Data1=radius_base, Data2=radius_mid, Data3=radius_top)
rad = Radians(Degrees=merge_3)
polygon = Polygon(Plane=Z_2, Radius=merge_4, Segments="3", FilletRadius=0)  # -> Polygon, Length
rotate = Rotate(Geometry=polygon.Polygon, Angle=rad, Plane=PlaneXY(0, 0, 0))  # -> Geometry, Transform
explode = Explode(Curve=rotate.Geometry, Recursive=Toggle(False))  # -> Segments, Vertices
flip = FlipMatrix(Data=explode.Vertices)
intcrv = Interpolate(Vertices=flip, Degree=3, Periodic=False, KnotStyle=1)  # -> flatten(Curve), Length, Domain

# ----
divide = DivideCurve(Curve=ln, Count=number_of_triangles, Kinks=False)  # -> Points, Tangents, Parameters

# ---- group: Geometry
division = Division(A="1", B=number_of_triangles)
series = Series(Start=0, Step=division, Count=expr("x+1", number_of_triangles))
pframe = PerpFrame(Curve=ln, Parameter=divide.Parameters)  # -> graft(Frame)

pt_2 = Point(pframe)
crv = Curve(intcrv.Curve)
lng = ListLength(List=crv)
culln = CullNth(List=crv, CullFrequency=lng)
pcx = CurvePlane(Curve=culln, Plane=pt_2)  # -> Points, ParamsC, ParamsP
pt_3 = Point(simplify(flatten(pcx.Points)))
lng_2 = ListLength(List=culln)
partition = PartitionList(List=pt_3, Size=lng_2)
shift = ShiftList(List=partition, Shift=1, Wrap=True)
flip_2 = FlipMatrix(Data=partition)
ln_2 = Line(StartPoint=partition, EndPoint=shift)
pt_4 = Point(flip_2)
line = Line(ln_2)

pt_5 = Point(pt_4)
lng_3 = ListLength(List=pt_5)
cull_i = CullIndex(List=pt_5, Indices="0", Wrap=True)
culln_2 = CullNth(List=pt_5, CullFrequency=lng_3)
ln_3 = Line(StartPoint=cull_i, EndPoint=culln_2)

# ----
pt_6 = Point(pt_4)

# ----
# Columns
line_2 = Line(ln_3)

# ----
# Triangles
line_3 = Line(line)

pt_7 = Point(pt_6)
pt_8 = Point(pt_6)

# ---- group: Geometry
vec = Vector(line_2)
vec_2 = VectorXYZ(XComponent=0, YComponent=0, ZComponent=0)  # -> Vector, Length
lng_4 = ListLength(List=vec)
ins = InsertItems(List=vec, Item=vec_2.Vector, Indices=lng_4, Wrap=True)
ins_2 = InsertItems(List=vec, Item=vec_2.Vector, Indices="0", Wrap=True)
devec = DeconstructVector(Vector=ins_2)  # -> XComponent, YComponent, ZComponent
devec_2 = DeconstructVector(Vector=ins)  # -> XComponent, YComponent, ZComponent
expression = Expression(x=devec.XComponent, y=devec_2.XComponent, Expression="(x+y)/2")
expression_2 = Expression(x=devec.ZComponent, y=devec_2.ZComponent, Expression="(x+y)/2")
expression_3 = Expression(x=devec.YComponent, y=devec_2.YComponent, Expression="(x+y)/2")
vec_3 = VectorXYZ(XComponent=expression, YComponent=expression_3, ZComponent=expression_2)  # -> Vector, Length

# ----
number_slider = Slider(0, range=0..1)
pt_9 = Point(pt_8)
rev = Reverse(Vector=vec_3.Vector)

# ---- group: Geometry
line_4 = LineSDL(Start=pt_9, Direction=vec_3.Vector, Length=number_slider)
move_2 = Move(Geometry=pt_9, Motion=line_4)  # -> Geometry, Transform
cull_i_2 = CullIndex(List=move_2.Geometry, Indices="0", Wrap=True)
pt_10 = Point(cull_i_2)

line_5 = LineSDL(Start=pt_9, Direction=rev, Length=number_slider)
move_3 = Move(Geometry=pt_9, Motion=line_5)  # -> Geometry, Transform
lng_5 = ListLength(List=move_3.Geometry)
culln_3 = CullNth(List=move_3.Geometry, CullFrequency=lng_5)
pt_11 = Point(culln_3)

# ----
pt_12 = Point(pt_9)
panel_2 = Panel("""0
1
2""")
weave = Weave(Pattern=panel_2, Stream0=pt_12, Stream1=pt_11, Stream2=pt_10, NullGaps=False)

# ---- group: Geometry
pt_13 = Point(weave)
lng_6 = ListLength(List=pt_13)
culln_4 = CullNth(List=pt_13, CullFrequency=lng_6)
cull_i_3 = CullIndex(List=pt_13, Indices="0", Wrap=True)
ln_4 = Line(StartPoint=culln_4, EndPoint=cull_i_3)

# ----
line_6 = Line(flatten(ln_4))
pt_14 = Point(pt_7)
line_7 = Line(line_3)
item = ListItem(List=pt_14, Index=0, Wrap=True)
matprops = MaterialPropertiesKaramba3D(
    FamilyOfMaterial="Steel",
    Name="S235",
    YoungsModulus_kN_cm2=21000,
    InPlaneShearModulus_kN_cm2=8076,
    TransverseShearModulus_kN_cm2=8076,
    SpecificWeight_kN_m3=78.5,
    CoefficientOfThermalExpansion_1_C=1e-05,
    YieldStrength_kN_cm2=23.5,
    mode="Isotrop")
matselect = MaterialSelectionKaramba3D(menu=[dropdown(1), dropdown(2)])
panel_3 = Panel("""Columns
Triangles""")

# ---- group: Relevant nodes
pt_15 = Point(flatten(pt_14))

# ----
hierarchy = Panel("""Columns
Triangles""")

# ---- group: 5. IDEA Templates
bolted_endplate_connection = BoltedEndplateConnection(ThicknessEndplate_mm=10)  # -> TemplateBoltedEndplateConnection, Message, Brep

weld_all_members = WeldAllMembers()  # -> TemplateWeldAllMembers, Message

# ----
groupnames = Panel("Columns")

# ---- group: 4. IDEA utilities
# Calculate ideaCon file
button = Button()
filepath_ideacon_file = Panel("C:\Data\testHidden.ideaCon")
calculate_idea_file = CalculateIDEAFile(FilePath=filepath_ideacon_file, RunIDEA=button)  # -> Analysis, Plates, Welds, Buckling, Summary, Summary_2
cluster = Cluster_3(T=calculate_idea_file.Analysis)
cluster_2 = Cluster_3(T=calculate_idea_file.Plates)
cluster_3 = Cluster_3(T=calculate_idea_file.Welds)
cluster_4 = Cluster_3(T=calculate_idea_file.Buckling)
cluster_5 = Cluster_3(T=calculate_idea_file.Summary)
summary_message = Panel(cluster_5)
analysis = Panel(cluster)
ucplates = Panel(cluster_2)
ucbuckling = Panel(cluster_4)
ucwelds = Panel(cluster_3)

# ---- group: 3. Project utilities
dom = ConstructDomain(DomainStart="0", DomainEnd="1")
range = Range(Domain=dom, Steps=Slider(5, range=0..100))

# ---- group: Karamba3D
pt_16 = Point(item)
number_slider_2 = Slider(10, range=0..50)
line_8 = Line(line_7)
line_9 = Line(line_6)
panel_4 = Panel("Columns")
X = UnitX(Factor=number_slider_2)
linetobeam = LineToBeamKaramba3D(Line=line_9, Identifier="Columns", New=True, Remove=True, LimitDistance_m=0.005)  # -> Element, Points, Info
supp = SupportKaramba3D(PosInd=pt_16, menu=[buttons(on, on, on, off, off, off)])
linetobeam_2 = LineToBeamKaramba3D(Line=line_8, Identifier="Triangles", New=True, Remove=True, LimitDistance_m=0.005)  # -> flatten(Element), Points, Info
readcstable = ReadCrossSectionTableFromFileKaramba3D()  # -> CrossSection, Info
crosecrselect = CrossSectionRangeSelectorKaramba3D(
    CrossSections=readcstable.CrossSection,
    MaximumHeight_cm=-1,
    MaximumWidth_cm=-1,
    ElementsIdentifiers="Triangles",
    Material=matselect,
    menu=[dropdown(1), dropdown(1), dropdown(1)])
crosecrselect_2 = CrossSectionRangeSelectorKaramba3D(
    CrossSections=readcstable.CrossSection,
    MaximumHeight_cm=-1,
    MaximumWidth_cm=-1,
    ElementsIdentifiers="Columns",
    Material=matselect,
    menu=[dropdown(1), dropdown(1), dropdown(4)])
panel_5 = Panel("HEA300")
item_2 = ListItem(List=crosecrselect_2, Index=Slider(100, range=0..100), Wrap=True)
item_3 = ListItem(List=crosecrselect, Index=Slider(42, range=0..100), Wrap=True)

# ----
Y = UnitY(Factor=number_slider_2)
loads = LoadsKaramba3D(Vector=Y, BeamIdentifiers=panel_4, LCase=0, mode="Uniform Line", menu=[buttons(off, on, off)])
merge_5 = Merge(Data1=linetobeam.Element, Data2=linetobeam_2.Element)
element = ElementKaramba3D(merge_5)
crosec = CrossSectionKaramba3D([item_2, item_3])

# ---- group: Karamba3D (continued)
assemble = AssembleModelKaramba3D(
    Elem=flatten(element),
    Support=flatten(supp),
    Load=loads,
    CrossSection=flatten(crosec),
    Material=matselect,
    LimitDistance_m=0.005)  # -> Model, Info, Mass_kg, CenterOfGravity
analyze = AnalyzeKaramba3D(Model=assemble.Model)  # -> CalculatedModel, MaximumDisplacement_cm, ResultingForceOfGravity_kN, ElasticEnergy_kNm

# ----
opticrosec = OptimizeCrossSectionKaramba3D(
    Model=assemble.Model,
    GroupIdentifiers=panel_3,
    CrossSections=[crosecrselect_2, crosecrselect],
    MaximumUtilization=1,
    MaximumDisplacement_cm=-1,
    UltimateLimitStateIterations=5,
    DisplacementIterations=5,
    NumberOfSamplePoints=3,
    ElasticDesign=True,
    GammaM0=1,
    GammaM1=1)  # -> ModelWithOptimizedCrossSections, Info, Mass_kg, MaximumDisplacement_cm, ElasticEnergy_kNm

# ---- group: Karamba3D (continued)
modelview = ModelViewKaramba3D(Model=opticrosec.ModelWithOptimizedCrossSections, LoadCaseFactorsForLinearSuperposition=1, IndexOfVisibleLoadcase=-1)  # -> Model, DeformedMesh, DeformedAxes, DeformedModel
beamview = BeamViewKaramba3D(Model=modelview.Model)  # -> Model, MeshesOfRenderedBeams, DeformedBeamAxes, LegendColors, LegendTags

# ---- group: KarambaIDEA data transfer / Stream filter to control data speed
filter = StreamFilter(Gate=Toggle(True), Stream1=beamview.Model)

# ---- group: KarambaIDEA data transfer / Data collect
disassemble = DisassembleModelKaramba3D(Model=filter)  # -> Model, Point, Beam, Shell, Support, Load, Line, Mesh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
k3dbeamprops = CSharpScript(
    Model=disassemble.Model,
    Reference=["C:\Program Files\Rhino 6\Plug-ins\karambaCommon.dll", "C:\Program Files\Rhino 6\Plug-ins\karamba.gha"])  # -> BeamIds, Material, CrosecNames, CrosecShapes, Heights, Widths, TFlanges, TWebs, FRads
# ---------- k3dbeamprops: C# usings ----------
using Karamba.Elements;
using Karamba.CrossSections;
# ---------- k3dbeamprops: C# ----------
    var model = Model as Karamba.Models.Model;
    if (model == null) {
      throw new ArgumentException ("The input is not of type model!");
    }

    var beam_ids = new List<string>();
    var cs_names = new List<string>();
    var cs_shapes = new List<string>();
    var cs_material = new List<string>();
    var heights = new List<double>();
    var widths = new List<double>();
    var tflanges = new List<double>();
    var twebs = new List<double>();
    var frads = new List<double>();

    foreach (var elem in model.elems)
    {
      var beam = elem as ModelElementStraightLine;
      if (beam != null) {
        beam_ids.Add(elem.id);
        cs_names.Add(elem.crosec.name);
        cs_shapes.Add(elem.crosec.shape());
        cs_material.Add(elem.crosec.materialName);

        // is it an I-profile?
        var crosec_i = beam.crosec as CroSec_I;
        if (crosec_i != null) {
          heights.Add(crosec_i.getHeight() * 1000);
          // use the upper flange thickness
          widths.Add(crosec_i.uf_width * 1000);
          tflanges.Add(crosec_i.uf_thick * 1000);
          twebs.Add(crosec_i.w_thick * 1000);
          // use the inner fillet radius
          frads.Add(crosec_i.fillet_r * 1000);
          // this would be the outer fillet radius
          // frads.Add(crosec.fillet_r1);
          continue;
        }

        // is it a CHS?
        var crosec_o = beam.crosec as CroSec_Circle;
        if (crosec_o != null) {
          heights.Add(crosec_o.getHeight() * 1000);
          // use the upper flange thickness
          widths.Add(0);
          tflanges.Add(crosec_o.thick * 1000);
          twebs.Add(crosec_o.thick * 1000);
          frads.Add(0);
          continue;
        }

        // options for Box, trapezoid and T-section are not implemented yet
        throw new Exception("Cross section encountered for which no export is implemented");
      }
    }

    BeamIds = beam_ids;
    CrosecNames = cs_names;
    CrosecShapes = cs_shapes;
    Material = cs_material;
    Heights = heights;
    Widths = widths;
    TFlanges = tflanges;
    TWebs = twebs;
    FRads = frads;
# ---------- end k3dbeamprops ----------
disassemble_2 = DisassembleElementKaramba3D(Element=disassemble.Beam)  # -> Element, ElementIdentifier, AxisOfElement, CrossSection, Joints, Material, LocalCoordinateSystem, ElementIsActive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
b_forces = BeamForcesKaramba3D(AnalyzedModel=disassemble.Model, LCase=-1, MaximumDistanceBetweenResults_m=-1, NumberOfResultsPerBeamElement=2)  # -> AnalyzedModel, NormalForce_kN, ShearForceVz_kN, ShearForceVy_kN, BendingMomentMt_kNm, BendingMomentMy_kNm, BendingMomentMz_kNm

# ---- group: KarambaIDEA data transfer
# KarambaIDEA
cp = CreateProject(
    Hierarchy=hierarchy,
    Points=pt_15,
    Lines=disassemble.Line,
    LCSRotations_Deg=disassemble_2.Alpha_deg,
    Groupnames=k3dbeamprops.BeamIds,
    Materials=k3dbeamprops.Material,
    CrossSectionNames=k3dbeamprops.CrosecNames,
    Shapes=k3dbeamprops.CrosecShapes,
    Heights=k3dbeamprops.Heights,
    Widths=k3dbeamprops.Widths,
    ThicknessFlanges=k3dbeamprops.TFlanges,
    ThicknessWebs=k3dbeamprops.TWebs,
    Radius=k3dbeamprops.FRads,
    N=b_forces.NormalForce_kN,
    Vz=b_forces.ShearForceVz_kN,
    Vy=b_forces.ShearForceVy_kN,
    Mt=b_forces.BendingMomentMt_kNm,
    My=b_forces.BendingMomentMy_kNm,
    Mz=b_forces.BendingMomentMz_kNm)

# ---- group: 6. IDEA utilities
output_folderpath = Panel("C:\Data")
create_idea_file = CreateIDEAFile(
    Project=cp,
    OutputFolder=output_folderpath,
    RunAllJoints=Toggle(False),
    ChooseJoint=Slider(9, range=0..100),
    RunIDEA=Button())

# ---- group: 3. Project utilities
# Weld volume generator
line_10 = Line(disassemble.Line)
show_weldsizes = BooleanToggle(True)
position = Slider(0.2, range=0..1)
textsize = Slider(0.02, range=0..0.15)
weld_volume_generator = WeldVolumeGenerator(Project=cp)
expression_4 = Expression(x=position, Expression="1-x")
eval = EvaluateCurve(Curve=line_10, Parameter=position)  # -> Point, Tangent, Angle
eval_2 = EvaluateCurve(Curve=line_10, Parameter=expression_4)  # -> Point, Tangent, Angle
filter_2 = StreamFilter(Gate=show_weldsizes, Stream0=flatten("0"), Stream1=textsize)
rad_2 = Radians(Degrees=Slider(-12, range=-100..100))
xz = XZPlane(Origin=eval.Point)
xz_2 = XZPlane(Origin=eval_2.Point)
rotate_2 = Rotate(Geometry=xz_2, Angle=rad_2, Plane=xz_2)  # -> Geometry, Transform
rotate_3 = Rotate(Geometry=xz, Angle=rad_2, Plane=xz)  # -> Geometry, Transform
txt = Text()
txt_2 = Text()
cmyk = ColourCMYK(Cyan="1", Magenta="1", Yellow="1", Key="1")
tag = TextTag3D(Location=rotate_3.Geometry, Text=txt, Size=filter_2, Colour=cmyk, Justification="5")
tag_2 = TextTag3D(Location=rotate_2.Geometry, Text=txt_2, Size=filter_2, Colour=cmyk, Justification="5")

# Joint equilibrium
loadcase = Slider(1, range=0..100)
joint_equilibrium = JointEquilibrium(Project=cp)  # -> XKN, YKN, ZKN, MtKN, MyKN, MzKN, Equilibrium
pt_17 = Point(disassemble.Point)
cluster_6 = Cluster_2(
    int=loadcase,
    data=joint_equilibrium.XKN,
    data_2=joint_equilibrium.YKN,
    data_3=joint_equilibrium.ZKN,
    data_4=joint_equilibrium.MtKN,
    data_5=joint_equilibrium.MyKN,
    data_6=joint_equilibrium.MzKN)  # -> flatten(R)
yz = YZPlane(Origin=pt_17)
tag_3 = TextTag3D(Location=yz, Text=cluster_6, Size=Slider(0.05, range=0..0.1), Justification=7)

# Local coordinate system
lcs = LocalCoordinateSystem(Project=cp)  # -> LineOfElements, LocalXVectors, LocalYVectors, LocalZVectors
length = Slider(0.149, range=0..2)
curvepoint = PointOnCurve(lcs.LineOfElements, parameter=0.182)
num_3 = Number(length)
line_11 = LineSDL(Start=curvepoint, Direction=lcs.LocalXVectors, Length=num_3)
line_12 = LineSDL(Start=curvepoint, Direction=lcs.LocalYVectors, Length=num_3)
line_13 = LineSDL(Start=curvepoint, Direction=lcs.LocalZVectors, Length=num_3)
panel_6 = Panel("""255
0
0""")
entwine = Entwine(Branch00=line_11, Branch01=line_12, Branch02=line_13, FlattenInputs=True)  # -> simplify(Result)
panel_7 = Panel("""0
255
0""")
panel_8 = Panel("""0
0
255""")
rgb_2 = ColourRGB(Alpha=255, Red=panel_6, Green=panel_7, Blue=panel_8)  # -> graft(Colour)
pipe = Pipe(Curve=entwine, Radius=Slider(0.01, range=0..0.01), Caps=0)
pshift = ShiftPaths(Data=pipe, Offset=-1)
preview = CustomPreview(Geometry=pshift, Material=rgb_2)

# Visualize joints
toggle = BooleanToggle(True)
data = Data(cp)
spread = Slider(10, range=0..100)
move_along_x = Slider(26, range=0..100)
textsize_2 = Slider(0.4, range=0..1)
filter_3 = StreamFilter(Gate=toggle, Stream1=data)
visualize_joints = VisualizeJoints(Project=filter_3)  # -> JointTypes, Brandnames, Centerpoints
cluster_7 = Cluster(G=visualize_joints.JointTypes, data_3=spread, X=move_along_x)
cluster_8 = Cluster(G=visualize_joints.Centerpoints, data_3=spread, X=move_along_x)
pt_18 = Point(cluster_8)
line_14 = Line(cluster_7)
data_2 = Data(flatten(visualize_joints.Brandnames))
data_3 = Data(flatten(pt_18))
pipe_2 = Pipe(Curve=line_14, Radius="0.2", Caps=0)
xz_3 = XZPlane(Origin=data_3)
tag_4 = TextTag3D(Location=xz_3, Text=data_2, Size=textsize_2, Colour=ColourSwatch(SwatchColor=RGB(0, 0, 0)), Justification=7)

# ---- group: 4. IDEA utilities
# Create ideaCon file
toggle_2 = BooleanToggle(False)
button_2 = Button()
output_folderpath_2 = Panel("C:\Data")
create_idea_file_2 = CreateIDEAFile(
    Project=cp,
    OutputFolder=output_folderpath_2,
    Template=weld_all_members.TemplateWeldAllMembers,
    RunAllJoints=toggle_2,
    ChooseJoint=Slider(2, range=0..100))

# ---- group: 3. Project utilities
# Transport Elements Generator
number_slider_3 = Slider(15, range=0..15)
transport_elements_generator = TransportElementsGenerator(Project=cp, GroupNames=groupnames, MaxLength=number_slider_3, MaxAngle_rad=Slider(1, range=0..3))  # -> TransportElementLines, AllElementLines
lng_7 = ListLength(List=transport_elements_generator.TransportElementLines)

data_4 = Data(flatten(lng_7))
data_5 = Data(range)
data_6 = Data(flatten(transport_elements_generator.TransportElementLines))
c_script = CSharpScript(lengths=data_4, colorlist=data_5)  # -> out, A; inputs lengths: list of Double, colorlist: list of Double
# ---------- c_script: C# ----------
    DataTree<double> tree = new DataTree<double>();
    GH_Path path = new GH_Path();
    int w = 0;


    for (int b = 0; b < lengths.Count; b++)
    {
      for (int c = 0;c < lengths[b];c++)
      {
        double num = colorlist[(w % colorlist.Count)];
        //tree.Add(num, path);
        tree.Add(num);
      }
      w = w + 1;

    }
    A = tree;
# ---------- end c_script ----------
data_7 = Data(flatten(c_script.A))
gradient = Gradient(
    LowerLimit=0,
    UpperLimit=1,
    Parameter=data_7,
    stops=[0: RGB(35, 99, 187), 0: RGB(234, 38, 0), 0: RGBA(255, 255, 255, 0), 0.25: RGB(234, 126, 0), 0.5: RGB(254, 244, 84), 0.75: RGB(173, 203, 249), 1: RGB(75, 107, 169)])
pipe_3 = Pipe(Curve=data_6, Radius=Slider(0.23, range=0..1), Caps=0)  # -> flatten(Pipe)
preview_2 = CustomPreview(Geometry=pipe_3, Material=gradient)

# ----
cluster_9 = Cluster_4(data=transport_elements_generator.AllElementLines)

# ---- group: 3. Project utilities
cluster_10 = Cluster_4(data=transport_elements_generator.TransportElementLines)
linedim = LineDimension(Line=cluster_10, Text="{0:0.00}", Size=Slider(0.2, range=0..1))

# ----
line_15 = Line(flatten(cluster_10))
item_4 = ListItem(List=line_15, Index=0, Wrap=True)

# ---- group: 3. Project utilities (continued)
cluster_11 = Cluster_5(C=cluster_9)
panel_9 = Panel(cluster_11)

# ----
panel_10 = Panel(item_4)

# ==== cluster Cluster
G = ClusterInput()
X = ClusterInput()
vec = VectorXYZ(XComponent=X, YComponent=0, ZComponent=0)  # -> Vector, Length
move = Move(Geometry=G, Motion=vec.Vector)  # -> Geometry, Transform
data = Data(move.Geometry)
tstat = TreeStatistics(Tree=data)  # -> Paths, Length, Count
dpath = DeconstructPath(Branch=tstat.Paths)
data_2 = Data(graft(tstat.Length))
flip = FlipMatrix(Data=dpath)
data_3 = ClusterInput()
bang = ExplodeTree(Data=flip)  # -> flatten(Branch0), flatten(Branch1)
data_4 = Data(data_3)
data_5 = Data(graft(bang.Branch0))
data_6 = Data(graft(bang.Branch1))
multiplication = Multiplication(A=bang.Branch0, B=data_4)
multiplication_2 = Multiplication(A=bang.Branch1, B=data_4)
path = ConstructPath(Indices=[data_5, data_6])  # -> flatten(Branch)
vec_2 = VectorXYZ(XComponent=multiplication, YComponent=multiplication_2, ZComponent=0)  # -> Vector, Length
unflatten = UnflattenTree(Tree=vec_2.Vector, Guide=path)  # -> graft(Tree)
data_7 = Data(flatten(data))
dup = DuplicateData(Data=unflatten, Number=data_2, Order=True)  # -> flatten(Data)
move_2 = Move(Geometry=data_7, Motion=dup)  # -> Geometry, Transform
G_2 = ClusterOutput(move_2.Geometry)
panel = Panel(move_2.Geometry)

# ==== cluster Cluster_2
data = ClusterInput()
data_2 = ClusterInput()
data_3 = ClusterInput()
data_4 = ClusterInput()
data_5 = ClusterInput()
data_6 = ClusterInput()
int = ClusterInput()
data_7 = Data(data)
data_8 = Data(data_2)
data_9 = Data(data_3)
data_10 = Data(data_4)
data_11 = Data(data_5)
data_12 = Data(data_6)
int_2 = Integer(int)
item = ListItem(List=data_7, Index=int_2, Wrap=True)
item_2 = ListItem(List=data_8, Index=int_2, Wrap=True)
item_3 = ListItem(List=data_9, Index=int_2, Wrap=True)
item_4 = ListItem(List=data_10, Index=int_2, Wrap=True)
item_5 = ListItem(List=data_11, Index=int_2, Wrap=True)
item_6 = ListItem(List=data_12, Index=int_2, Wrap=True)
lng = ListLength(List=item)
dup = DuplicateData(Data=", Mx kNm:", Number=lng, Order=True)  # -> simplify(Data)
dup_2 = DuplicateData(Data=", My kNm:", Number=lng, Order=True)  # -> simplify(Data)
dup_3 = DuplicateData(Data=", Mz kNm:", Number=lng, Order=True)  # -> simplify(Data)
dup_4 = DuplicateData(Data="X kN:", Number=lng, Order=True)  # -> simplify(Data)
dup_5 = DuplicateData(Data=", Y kN:", Number=lng, Order=True)  # -> simplify(Data)
dup_6 = DuplicateData(Data=", Z kN:", Number=lng, Order=True)  # -> simplify(Data)
merge = Merge(
    Data1=dup_4,
    Data2=item,
    Data3=dup_5,
    Data4=item_2,
    Data5=dup_6,
    Data6=item_3,
    Data7=dup,
    Data8=item_4,
    Data9=dup_2,
    Data10=item_5,
    Data11=dup_3,
    Data12=item_6)
join = TextJoin(Text=merge)
R = ClusterOutput(join)

# ==== cluster Cluster_3
T = ClusterInput()
join = TextJoin(Text=T)
rec = DataRecorder(join, DataLimit=2, RecordData=True)
item = ListItem(List=rec, Index=0, Wrap=True)
i = ClusterOutput(item)

# ==== cluster Cluster_4
data = ClusterInput()
data_2 = Data(data)
lng = ListLength(List=data_2)
item = ListItem(List=data_2, Index=expr("x-1", lng), Wrap=True)
item_2 = ListItem(List=data_2, Index=0, Wrap=True)
end = EndPoints(Curve=item_2)  # -> Start, End
end_2 = EndPoints(Curve=item)  # -> Start, End
ln = Line(StartPoint=end.Start, EndPoint=end_2.End)
L = ClusterOutput(ln)

# ==== cluster Cluster_5
C = ClusterInput()
len = Length(Curve=C)  # -> flatten(Length)
sort = SortList(Keys=len, ValuesA=len)  # -> Keys, ValuesA
dcon = DeleteConsecutive(Set=sort.Keys, Wrap=False)  # -> Set, Count
data = Data(graft(dcon.Set))
data_2 = Data(sort.Keys)
equals = Equality(FirstNumber=data_2, SecondNumber=data)  # -> simplify(Equality), Inequality
cull = CullPattern(List=data_2, CullPattern=equals.Equality)
lng = ListLength(List=cull)  # -> flatten(Length)
data_3 = Data(dcon.Set)
expression = Expression(x=lng, y=data_3, Expression="Format(\"There are {0:0} lines of {1:0.00} m\", x,y)")
R = ClusterOutput(expression)
