# Grasshopper definition Meeting8_Tensile connection.gh (Grasshopper 1.0.7)
# Copyright: B+G Engineers
# plug-ins: KarambaIDEA, Colibri, karambaGH

# ---- group: Parameters
number_slider = Slider(3, range=-5..5)
number_slider_2 = Slider(0, range=-5..5)
number_slider_3 = Slider(0, range=-5..5)
crosssection = ValueList({"I-section": 0, "SHS cold": 1, "SHS hot": 2, "CHS welded": 3, "CHS seamless": 4}, selected="I-section")
steelgrade = ValueList({"I-section": 0, "SHS cold": 1, "SHS hot": 2, "CHS welded": 3, "CHS seamless": 4}, selected="I-section")
n_kn = Slider(350, range=0..10000)

# ----
panel = Panel("""Parameters
Geometry
Karamba3D
0. Utilities
1. Load conversions
2. Create Project
3. Project utilities
4. Analytical templates
5. IDEA templates
6. IDEA utilities
7. Cost calculation""")
merge = Merge(
    Data1=ColourSwatch(SwatchColor=RGB(106, 144, 173)),
    Data2=ColourSwatch(SwatchColor=RGB(123, 189, 179)),
    Data3=ColourSwatch(SwatchColor=RGB(227, 136, 118)),
    Data4=ColourSwatch(SwatchColor=RGB(237, 201, 69)),
    Data5=ColourSwatch(SwatchColor=RGB(237, 201, 69)),
    Data6=ColourSwatch(SwatchColor=RGB(237, 221, 161)),
    Data7=ColourSwatch(SwatchColor=RGBA(212, 61, 66, 118)),
    Data8=ColourSwatch(SwatchColor=RGB(186, 222, 214)),
    Data9=ColourSwatch(SwatchColor=RGB(250, 227, 217)),
    Data10=ColourSwatch(SwatchColor=RGBA(255, 111, 15, 97)),
    Data11=ColourSwatch(SwatchColor=RGBA(86, 212, 61, 63)))
group_color = SliderGroupColor(run=Button(), groupNames=panel, colors=merge, defaultColor=ColourSwatch(SwatchColor=RGB(232, 227, 227)))  # inputs run: Boolean, groupNames: list of String, colors: list of Color, defaultColor: Color
# ---------- group_color: C# usings ----------
using System.Drawing;
using Grasshopper.Kernel.Special;
# ---------- group_color: C# ----------
    // Created by Timo Harboe Nielsen - Bjarke Ingels Group.
    
    if(!run){
      return;
    }
    GH_Document doc = owner.OnPingDocument();
    foreach (var dobj in doc.Objects)
    {
      GH_Group _group = dobj as GH_Group;
      if( _group == null){
        continue;
      }
      for(int i = 0; i < Math.Min(groupNames.Count, colors.Count); i++){
        string groupName = _group.NickName.ToString();
        string compareName = groupNames[i];
        if(groupName.IndexOf(compareName, StringComparison.OrdinalIgnoreCase) >= 0){
          _group.Colour = colors[i];
          break;
        } else{
          _group.Colour = defaultColor;
        }
      }
    }
# ---------- end group_color ----------

# ---- group: Geometry
# KarambaIDEA Tensile connection
pt = ConstructPoint(XCoordinate=0, YCoordinate=0, ZCoordinate=0)
vec = VectorXYZ(XComponent=number_slider, YComponent=number_slider_2, ZComponent=number_slider_3)  # -> Vector, Length
move = Move(Geometry=pt, Motion=vec.Vector)  # -> Geometry, Transform
ln = Line(StartPoint=pt, EndPoint=move.Geometry)
divide = DivideCurve(Curve=ln, Count="2", Kinks=False)  # -> Points, Tangents, Parameters
merge_2 = Merge(Data1=pt, Data2=move.Geometry)
cluster = Cluster(pt=divide.Points)
pt_2 = Point(move.Geometry)

# ---- group: Karamba3D
pt_3 = Point(merge_2)
line = Line(cluster)

# ---- group: Karamba3D / Define Materials
matselect = MaterialSelectionKaramba3D(menu=[dropdown(1), dropdown(4)])

# ---- group: Karamba3D / Define Cross Sections
crosecrselect = CrossSectionRangeSelectorKaramba3D(MaximumHeight_cm=-1, MaximumWidth_cm=-1, Material=matselect, menu=[dropdown(1), dropdown(1), dropdown(4)])
crosecrselect_2 = CrossSectionRangeSelectorKaramba3D(MaximumHeight_cm=-1, MaximumWidth_cm=-1, Material=matselect, menu=[dropdown(1), dropdown(2), dropdown(1)])
crosecrselect_3 = CrossSectionRangeSelectorKaramba3D(MaximumHeight_cm=-1, MaximumWidth_cm=-1, Material=matselect, menu=[dropdown(1), dropdown(3), dropdown(1)])

# ----
filter = StreamFilter(Gate=crosssection, Stream0=crosecrselect, Stream1=crosecrselect_3, Stream2=crosecrselect_2)
item = ListItem(List=flatten(filter), Index=0, Wrap=True)
pt_4 = Point(pt_3)
readcstable = ReadCrossSectionTableFromFileKaramba()  # -> CrossSection, Info

# ---- group: Karamba3D / Define Elements
panel_2 = Panel("Dak")
linetobeam = LineToBeamKaramba3D(Line=line, Identifier=graft(panel_2), CrossSection=item, New=True, Remove=True, LimitDistance_m=0.005)  # -> Element, Points, Info

# ---- group: Karamba3D / Define Loads
X = UnitX(Factor=n_kn)
loads = LoadsKaramba3D(ForceVector=X, Local=False, PosInd=pt_2, LCase=0, mode="Point")

# ----
item_2 = ListItem(List=pt_4, Index="0", Wrap=True)
item_3 = ListItem(List=pt_4, Index="1", Wrap=True)

# ---- group: Karamba3D / Define Supports
supp = SupportKaramba(PosInd=item_2, menu=[buttons(on, on, on, off, off, off)])
supp_2 = SupportKaramba(PosInd=item_3, menu=[buttons(off, on, on, off, off, off)])

# ---- group: Karamba3D / Assemble Model
assemble = AssembleModelKaramba3D(Elem=flatten(linetobeam.Element), Support=[supp, supp_2], Load=loads, LimitDistance_m=0.005)  # -> Model, Info, Mass_kg, CenterOfGravity

# ----
opticrosec = OptimizeCrossSectionKaramba3D(
    Model=assemble.Model,
    CrossSections=filter,
    MaximumUtilization=Slider(0.12, range=0..1),
    MaximumDisplacement_cm=-1,
    UltimateLimitStateIterations=5,
    DisplacementIterations=5,
    NumberOfSamplePoints=3,
    ElasticDesign=True,
    GammaM0=1,
    GammaM1=1)  # -> ModelWithOptimizedCrossSections, Info, Mass_kg, MaximumDisplacement_cm, ElasticEnergy_kNm

# ---- group: Karamba3D / View Results
modelview = ModelViewKaramba3D(Model=opticrosec.ModelWithOptimizedCrossSections, LoadCaseFactorsForLinearSuperposition=1, IndexOfVisibleLoadcase=-1)  # -> Model, DeformedMesh, DeformedAxes, DeformedModel
beamview = BeamViewKaramba3D(Model=modelview.Model)  # -> Model, MeshesOfRenderedBeams, DeformedBeamAxes, LegendColors, LegendTags

# ---- group: 2. Create Project / Stream filter to control data speed
filter_2 = StreamFilter(Gate=Toggle(True), Stream1=beamview.Model)

# ---- group: 2. Create Project / Data collect
disassemble = DisassembleModelKaramba3D(Model=filter_2)  # -> Model, Point, Beam, Shell, Support, Load, Line, Mesh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
k3dbeamprops = CSharpScript(
    Model=disassemble.Model,
    Reference=["C:\Program Files\Rhino 6\Plug-ins\karambaCommon.dll", "C:\Program Files\Rhino 6\Plug-ins\karamba.gha"])  # -> BeamIds, Material, CrosecNames, CrosecShapes, Heights, Widths, TFlanges, TWebs, FRads
# ---------- k3dbeamprops: C# usings ----------
using Karamba.Elements;
using Karamba.CrossSections;
# ---------- k3dbeamprops: C# ----------
    var model = Model as Karamba.Models.Model;
    if (model == null) {
      throw new ArgumentException ("The input is not of type model!");
    }

    var beam_ids = new List<string>();
    var cs_names = new List<string>();
    var cs_shapes = new List<string>();
    var cs_material = new List<string>();
    var heights = new List<double>();
    var widths = new List<double>();
    var tflanges = new List<double>();
    var twebs = new List<double>();
    var frads = new List<double>();

    foreach (var elem in model.elems)
    {
      var beam = elem as ModelElementStraightLine;
      if (beam != null) {
        beam_ids.Add(elem.id);
        cs_names.Add(elem.crosec.name);
        cs_shapes.Add(elem.crosec.shape());
        cs_material.Add(elem.crosec.materialName);

        // is it an I-profile?
        var crosec_i = beam.crosec as CroSec_I;
        if (crosec_i != null) {
          heights.Add(crosec_i.getHeight() * 1000);
          // use the upper flange thickness
          widths.Add(crosec_i.uf_width * 1000);
          tflanges.Add(crosec_i.uf_thick * 1000);
          twebs.Add(crosec_i.w_thick * 1000);
          // use the inner fillet radius
          frads.Add(crosec_i.fillet_r * 1000);
          // this would be the outer fillet radius
          // frads.Add(crosec.fillet_r1);
          continue;
        }

        // is it a CHS?
        var crosec_o = beam.crosec as CroSec_Circle;
        if (crosec_o != null) {
          heights.Add(crosec_o.getHeight() * 1000);
          // use the upper flange thickness
          widths.Add(0);
          tflanges.Add(crosec_o.thick * 1000);
          twebs.Add(crosec_o.thick * 1000);
          frads.Add(0);
          continue;
        }

        // options for Box, trapezoid and T-section are not implemented yet
        throw new Exception("Cross section encountered for which no export is implemented");
      }
    }

    BeamIds = beam_ids;
    CrosecNames = cs_names;
    CrosecShapes = cs_shapes;
    Material = cs_material;
    Heights = heights;
    Widths = widths;
    TFlanges = tflanges;
    TWebs = twebs;
    FRads = frads;
# ---------- end k3dbeamprops ----------
disassemble_2 = DisassembleElementKaramba3D(Element=disassemble.Beam)  # -> Element, ElementIdentifier, AxisOfElement, CrossSection, Joints, Material, LocalCoordinateSystem, ElementIsActive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
b_forces = BeamForcesKaramba3D(AnalyzedModel=disassemble.Model, LCase=-1, MaximumDistanceBetweenResults_m=-1, NumberOfResultsPerBeamElement=2)  # -> AnalyzedModel, NormalForce_kN, ShearForceVz_kN, ShearForceVy_kN, BendingMomentMt_kNm, BendingMomentMy_kNm, BendingMomentMz_kNm

# ---- group: 2. Create Project
# KarambaIDEA
cp = CreateProject(
    Hierarchy="Dak",
    Points=disassemble.Point,
    Lines=disassemble.Line,
    LCSRotations_Deg=disassemble_2.Alpha_deg,
    Groupnames=k3dbeamprops.BeamIds,
    Materials=k3dbeamprops.Material,
    CrossSectionNames=k3dbeamprops.CrosecNames,
    Shapes=k3dbeamprops.CrosecShapes,
    Heights=k3dbeamprops.Heights,
    Widths=k3dbeamprops.Widths,
    ThicknessFlanges=k3dbeamprops.TFlanges,
    ThicknessWebs=k3dbeamprops.TWebs,
    Radius=k3dbeamprops.FRads,
    N=b_forces.NormalForce_kN,
    Vz=b_forces.ShearForceVz_kN,
    Vy=b_forces.ShearForceVy_kN,
    Mt=b_forces.BendingMomentMt_kNm,
    My=b_forces.BendingMomentMy_kNm,
    Mz=b_forces.BendingMomentMz_kNm)

# ----
data = Data(cp)
number_slider_4 = Slider(7, range=0..100)

# ---- group: Parameters
gate = Slider(0, range=0..1)
thickness_endplate = Slider(20, range=5..20)
filter_3 = StreamFilter(Gate=gate, Stream0=Toggle(False), Stream1=Toggle(True))

# ----
data_2 = Data(data)

# ---- group: 5. IDEA Templates
template_bolted_endplate_connection = TemplateBoltedEndplateConnection(Project=data, BrandNames="00", ThicknessEndplate_mm=thickness_endplate)  # -> Project, Message, Brep

# ---- group: 3. Project utilities
# Visualize joints
visualize_joints = VisualizeJoints(Project=data_2)  # -> JointTypes, Brandnames, Centerpoints
radius = Slider(0.2, range=0.2..0.5)
move_along_x = Slider(26, range=0..100)
textsize = Slider(0.4, range=0..1)
spread = Slider(10, range=0..100)
cluster_2 = Cluster_4(line=visualize_joints.JointTypes, num_2=spread, num=move_along_x, num_3=radius)  # -> P, R
cluster_3 = Cluster_3(G=visualize_joints.Centerpoints, data_3=spread, X=move_along_x)
preview = CustomPreview(Geometry=cluster_2.P, Material=cluster_2.R)
xz = XZPlane(Origin=flatten(cluster_3))
data_3 = Data(flatten(visualize_joints.Brandnames))
tag = TextTag3D(Location=xz, Text=data_3, Size=textsize, Colour=ColourSwatch(SwatchColor=RGB(0, 0, 0)), Justification=7)

# ----
panel_3 = Panel(template_bolted_endplate_connection.Message)
preview_2 = CustomPreview(Geometry=template_bolted_endplate_connection.Brep, Material=ColourSwatch(SwatchColor=RGB(55, 158, 0)))
edges = BrepEdges(Brep=template_bolted_endplate_connection.Brep)  # -> Naked, Interior, NonManifold

# ---- group: 6. IDEA utilities
# Create and Calculate ideaCon file
button = Button()
output_folderpath = Panel("C:\Data")
relay = Relay()
create_and_calculate_idea_file = CreateAndCalculateIDEAFile(
    Project=template_bolted_endplate_connection.Project,
    OutputFolder=output_folderpath,
    ChooseJoint=Slider(1, range=0..100),
    RunIDEA=button)  # -> SelectedJoint, Analysis, Plates, Bolts, Welds, Buckling, Summary
cluster_4 = Cluster_2(T=create_and_calculate_idea_file.Analysis)
cluster_5 = Cluster_2(T=create_and_calculate_idea_file.Plates)
cluster_6 = Cluster_2(T=create_and_calculate_idea_file.Bolts)
cluster_7 = Cluster_2(T=create_and_calculate_idea_file.Welds)
cluster_8 = Cluster_2(T=create_and_calculate_idea_file.Buckling)
cluster_9 = Cluster_2(T=create_and_calculate_idea_file.Summary)
summary_message = Panel(cluster_9)
analysis = Panel(cluster_4)
ucplates = Panel(cluster_5)
ucwelds = Panel(cluster_7)
ucbuckling = Panel(cluster_8)
ucbolts = Panel(cluster_6)

# ----
data_4 = Data(template_bolted_endplate_connection.Project)

# ---- group: 7. Cost calculation
weld_volume_generator = WeldVolumeGenerator(Project=data_4)
total_weight = TotalWeight(Project=data_4)  # -> WeightElements_kg, WeightPlates_kg, Brep
price_welding = Panel("2.6")
price_steel = Panel("1")
costcalculator = CostCalculator(
    WeightElements_kg=total_weight.WeightElements_kg,
    WeightPlates_kg=total_weight.WeightPlates_kg,
    WeldingVolume_cm3=weld_volume_generator,
    NumberOfElements=0,
    SteelPricePerKg=price_steel,
    WeldingPricePerCm3=price_welding,
    TransportPricePerElement=20)  # -> CostsOfBeamMaterial_, CostsPerJoint_, TransportCost_

# ----
retrievelinespoints = RetrieveLinesPoints(Project=data_4)  # -> Lines, Points
panel_4 = Panel(weld_volume_generator)
panel_5 = Panel(total_weight.WeightPlates_kg)
edges_2 = BrepEdges(Brep=total_weight.Brep)  # -> Naked, Interior, NonManifold
xz_2 = XZPlane(Origin=retrievelinespoints.Points)
Z = UnitZ(Factor=Slider(0.23, range=0..1))
move_2 = Move(Geometry=xz_2, Motion=Z)  # -> Geometry, Transform
preview_3 = CustomPreview(Geometry=total_weight.Brep, Material=ColourSwatch(SwatchColor=RGBA(158, 138, 138, 138)))
tag_2 = TextTag3D(Location=move_2.Geometry, Text=costcalculator.CostsPerJoint_, Size=Slider(0.1, range=0..0.1), Justification=7)
ma = MassAddition(Input=flatten(total_weight.WeightPlates_kg))  # -> Result, PartialResults
ma_2 = MassAddition(Input=flatten(weld_volume_generator))  # -> Result, PartialResults
multiplication = Multiplication(A=ma.Result, B=price_steel)
multiplication_2 = Multiplication(A=ma_2.Result, B=price_welding)
addition = Addition(A=multiplication, B=multiplication_2)
round = Round(Number=addition)  # -> Nearest, Floor, Ceiling
price = Panel(round.Ceiling)

# ---- group: 6. IDEA utilities
# Create ideaCon file
toggle = BooleanToggle(False)
output_folderpath_2 = Panel("C:\Data")
create_idea_file = CreateIDEAFile(OutputFolder=output_folderpath_2, RunAllJoints=toggle, ChooseJoint=Slider(1, range=0..100), RunIDEA=Button())

# Calculate ideaCon file
button_2 = Button()
filepath_ideacon_file = Panel("C:\Data\testHidden.ideaCon")
calculate_idea_file = CalculateIDEAFile(FilePath=filepath_ideacon_file, RunIDEA=button_2)  # -> Analysis, Plates, Bolts, Welds, Buckling, Summary
cluster_10 = Cluster_2(T=calculate_idea_file.Analysis)
cluster_11 = Cluster_2(T=calculate_idea_file.Plates)
cluster_12 = Cluster_2(T=calculate_idea_file.Bolts)
cluster_13 = Cluster_2(T=calculate_idea_file.Welds)
cluster_14 = Cluster_2(T=calculate_idea_file.Buckling)
cluster_15 = Cluster_2(T=calculate_idea_file.Summary)
summary_message_2 = Panel(cluster_15)
ucbuckling_2 = Panel(cluster_14)
analysis_2 = Panel(cluster_10)
ucplates_2 = Panel(cluster_11)
ucwelds_2 = Panel(cluster_13)
ucbolts_2 = Panel(cluster_12)

# ----
panel_6 = Panel("Y:\Constructies\personen\ABT Delft\Rayaan\Grasshopper\IDEA_plaatdikte_optimalisatie11")
iterator = ColibriIterator(Gate=gate, Thickness_endplate=thickness_endplate, RemoteFly=False, ignoreAllWarningMsg=False)  # -> Gate, Thickness_endplate, Value_N, Genome
parameters = ColibriParameters(
    Analysis_=flatten(analysis),
    UCplates_=flatten(ucplates),
    UCbolts_=flatten(ucbolts),
    UCwelds_=flatten(ucwelds),
    UCbuckling_=flatten(ucbuckling),
    SummaryMessage=flatten(summary_message),
    Analysis=flatten(create_and_calculate_idea_file.Analysis),
    Plates=flatten(create_and_calculate_idea_file.Plates),
    Bolts=flatten(create_and_calculate_idea_file.Bolts),
    Welds=flatten(create_and_calculate_idea_file.Welds),
    Buckling=flatten(create_and_calculate_idea_file.Buckling),
    Summary=flatten(create_and_calculate_idea_file.Summary),
    Price=flatten(price))
concat = Concatenate(FragmentD="Thickness", FragmentA=iterator.Thickness_endplate, FragmentE="Bool", FragmentB=iterator.Gate)
panel_7 = Panel(concat)

img_setting = ImageSetting(ImageSaveAsName=panel_7, Width="1200", Height="600")

aggregator = ColibriAggregator(
    Folder=panel_6,
    IterationGenomeID=iterator.Genome,
    IterationPhenomeResults=parameters,
    ImgSetting=img_setting,
    Write=Toggle(False),
    recordingMode=0)

# ==== cluster Cluster
pt = ClusterInput()

pt_2 = Point(pt)
lng = ListLength(List=pt_2)
cull_i = CullIndex(List=pt_2, Indices="0", Wrap=True)  # -> simplify(List)
culln = CullNth(List=pt_2, CullFrequency=lng)  # -> simplify(List)
ln = Line(StartPoint=culln, EndPoint=cull_i)

L = ClusterOutput(ln)

# ==== cluster Cluster_2
T = ClusterInput()
join = TextJoin(Text=T)
rec = DataRecorder(join, DataLimit=2, RecordData=True)
item = ListItem(List=flatten(rec), Index=0, Wrap=True)
i = ClusterOutput(item)
panel = Panel(item)

# ==== cluster Cluster_3
G = ClusterInput()
X = ClusterInput()
vec = VectorXYZ(XComponent=X, YComponent=0, ZComponent=0)  # -> Vector, Length
move = Move(Geometry=G, Motion=vec.Vector)  # -> Geometry, Transform
data = Data(move.Geometry)
tstat = TreeStatistics(Tree=data)  # -> Paths, Length, Count
dpath = DeconstructPath(Branch=tstat.Paths)
data_2 = Data(graft(tstat.Length))
flip = FlipMatrix(Data=dpath)
data_3 = ClusterInput()
bang = ExplodeTree(Data=flip)  # -> flatten(Branch0), flatten(Branch1)
data_4 = Data(data_3)
data_5 = Data(graft(bang.Branch0))
data_6 = Data(graft(bang.Branch1))
multiplication = Multiplication(A=bang.Branch0, B=data_4)
multiplication_2 = Multiplication(A=bang.Branch1, B=data_4)
path = ConstructPath(Indices=[data_5, data_6])  # -> flatten(Branch)
vec_2 = VectorXYZ(XComponent=multiplication, YComponent=multiplication_2, ZComponent=0)  # -> Vector, Length
unflatten = UnflattenTree(Tree=vec_2.Vector, Guide=path)  # -> graft(Tree)
data_7 = Data(flatten(data))
dup = DuplicateData(Data=unflatten, Number=data_2, Order=True)  # -> flatten(Data)
move_2 = Move(Geometry=data_7, Motion=dup)  # -> Geometry, Transform
G_2 = ClusterOutput(move_2.Geometry)
panel = Panel(move_2.Geometry)

# ==== cluster Cluster_4
num = ClusterInput()
num_2 = ClusterInput()
line = ClusterInput()
num_3 = ClusterInput()
num_4 = Number(num)
num_5 = Number(num_2)
line_2 = Line(line)
num_6 = Number(num_3)
cluster = Cluster_3(G=line_2, data_3=num_5, X=num_4)
line_3 = Line(cluster)
pipe = Pipe(Curve=line_3, Radius=num_6, Caps=0)  # -> flatten(Pipe)
dom = ConstructDomain(DomainStart="0", DomainEnd="1")
pshift = ShiftPaths(Data=line_2, Offset=-1)
P = ClusterOutput(pipe)
range = Range(Domain=dom, Steps=Slider(8, range=0..100))
lng = ListLength(List=pshift)
data = Data(flatten(lng))
data_2 = Data(range)
c_script = CSharpScript(lengths=data, colorlist=data_2)  # -> out, A; inputs lengths: list of Double, colorlist: list of Double
# ---------- c_script: C# ----------
    DataTree<double> tree = new DataTree<double>();
    GH_Path path = new GH_Path();
    int w = 0;


    for (int b = 0; b < lengths.Count; b++)
    {
      for (int c = 0;c < lengths[b];c++)
      {
        double num = colorlist[(w % colorlist.Count)];
        //tree.Add(num, path);
        tree.Add(num);
      }
      w = w + 1;

    }
    A = tree;
# ---------- end c_script ----------
data_3 = Data(flatten(c_script.A))
gradient = Gradient(
    LowerLimit=0,
    UpperLimit=1,
    Parameter=data_3,
    stops=[0: RGB(35, 99, 187), 0: RGB(234, 38, 0), 0: RGBA(255, 255, 255, 0), 0.25: RGB(234, 126, 0), 0.5: RGB(254, 244, 84), 0.75: RGB(173, 203, 249)])
lng_2 = ListLength(List=gradient)
dup = DuplicateData(Data=" (100)", Number=lng_2, Order=True)  # -> flatten(Data)
merge = Merge(Data1=graft(gradient), Data2=graft(dup))
join = TextJoin(Text=merge)  # -> flatten(Result)
R = ClusterOutput(join)
