# Grasshopper definition PortalFrame_bruteforce.gh (Grasshopper 1.0.7)
# Copyright: B+G Engineers
# plug-ins: KarambaIDEA, Colibri, karambaGH

# ---- group: Parameters
width = Slider(7, range=0..20)
bays = Slider(2, range=2..10)
height = Slider(4, range=0..10)
floors = Slider(4, range=2..10)

# ----
panel = Panel("""Parameters
Geometry
Karamba3D
0. Utilities
1. Load conversions
2. Create Project
3. Project utilities
4. Analytical templates
5. IDEA templates
6. IDEA utilities
7. Cost calculation""")
merge = Merge(
    Data1=ColourSwatch(SwatchColor=RGB(106, 144, 173)),
    Data2=ColourSwatch(SwatchColor=RGB(123, 189, 179)),
    Data3=ColourSwatch(SwatchColor=RGB(227, 136, 118)),
    Data4=ColourSwatch(SwatchColor=RGB(237, 201, 69)),
    Data5=ColourSwatch(SwatchColor=RGB(237, 201, 69)),
    Data6=ColourSwatch(SwatchColor=RGB(237, 221, 161)),
    Data7=ColourSwatch(SwatchColor=RGBA(212, 61, 66, 118)),
    Data8=ColourSwatch(SwatchColor=RGB(186, 222, 214)),
    Data9=ColourSwatch(SwatchColor=RGB(250, 227, 217)),
    Data10=ColourSwatch(SwatchColor=RGBA(255, 111, 15, 97)),
    Data11=ColourSwatch(SwatchColor=RGBA(86, 212, 61, 63)))
group_color = SliderGroupColor(run=Button(), groupNames=panel, colors=merge, defaultColor=ColourSwatch(SwatchColor=RGB(232, 227, 227)))  # inputs run: Boolean, groupNames: list of String, colors: list of Color, defaultColor: Color
# ---------- group_color: C# usings ----------
using System.Drawing;
using Grasshopper.Kernel.Special;
# ---------- group_color: C# ----------
    // Created by Timo Harboe Nielsen - Bjarke Ingels Group.
    
    if(!run){
      return;
    }
    GH_Document doc = owner.OnPingDocument();
    foreach (var dobj in doc.Objects)
    {
      GH_Group _group = dobj as GH_Group;
      if( _group == null){
        continue;
      }
      for(int i = 0; i < Math.Min(groupNames.Count, colors.Count); i++){
        string groupName = _group.NickName.ToString();
        string compareName = groupNames[i];
        if(groupName.IndexOf(compareName, StringComparison.OrdinalIgnoreCase) >= 0){
          _group.Colour = colors[i];
          break;
        } else{
          _group.Colour = defaultColor;
        }
      }
    }
# ---------- end group_color ----------

# ---- group: Geometry
X = UnitX(Factor=width)
# Optimizing a Steel Frame
pt = ConstructPoint(XCoordinate=0, YCoordinate=0, ZCoordinate=0)
Z = UnitZ(Factor=height)
arrlinear = LinearArray(Geometry=pt, Direction=X, Count=bays)  # -> Geometry, Transform
num = Number(floors)
arrlinear_2 = LinearArray(Geometry=arrlinear.Geometry, Direction=Z, Count=num)  # -> Geometry, Transform
num_2 = Number(expr("x-1", num))
data = Data(arrlinear_2.Geometry)
shift = ShiftList(List=data, Shift=1, Wrap=True)
pt_2 = Point(arrlinear.Geometry)
cluster = Cluster_2(data=arrlinear_2.Geometry)
cluster_2 = Cluster(data=data)
flip = FlipMatrix(Data=arrlinear_2.Geometry)
cluster_3 = Cluster(data=shift)
item = ListItem(List=flip, Index=0, Wrap=True)  # -> flatten(Item)
flip_2 = FlipMatrix(Data=cluster)
data_2 = Data(flip_2)
ln = Line(StartPoint=cluster_2, EndPoint=cluster_3)
cull_i = CullIndex(List=item, Indices="0", Wrap=True)
shift_2 = ShiftList(List=data_2, Shift=1, Wrap=True)
cluster_4 = Cluster(data=data_2)
split = SplitList(List=flatten(ln), Index=num_2)  # -> ListA, ListB
cluster_5 = Cluster(data=shift_2)
line = Line(split.ListA)
line_2 = Line(split.ListB)
ln_2 = Line(StartPoint=cluster_4, EndPoint=cluster_5)
pt_3 = Point(pt_2)
merge_2 = Merge(Data1=cull_i, Data2=pt_3)
divide = DivideCurve(Curve=ln_2, Count="2", Kinks=False)  # -> Points, Tangents, Parameters
cluster_6 = Cluster_3(pt=divide.Points)
item_2 = ListItem(List=cluster_6, Index=0, Wrap=True)
item_3 = ListItem(List=cluster_6, Index="1", Wrap=True)
entwine = Entwine(Branch00=[line, line_2], Branch01=[item_2, item_3], FlattenInputs=True)

# ----
colum_index_css = Slider(13, range=0..23)
beam_index_css = Slider(17, range=0..23)

# ---- group: Karamba3D / Define Materials
matselect = MaterialSelectionKaramba3D(menu=[dropdown(1), dropdown(4)])

# ---- group: Karamba3D / Define Cross Sections
crosecrselect = CrossSectionRangeSelectorKaramba3D(MaximumHeight_cm=-1, MaximumWidth_cm=-1, Material=matselect, menu=[dropdown(0), dropdown(1), dropdown(4)])
crosecrselect_2 = CrossSectionRangeSelectorKaramba3D(MaximumHeight_cm=-1, MaximumWidth_cm=-1, Material=matselect, menu=[dropdown(0), dropdown(0), dropdown(3)])
crosecselect = CrossSectionSelectorKaramba3D(CrossSections=crosecrselect, NameOrListIndexOfCrossSection=colum_index_css)  # -> CrossSection, Info
crosecselect_2 = CrossSectionSelectorKaramba3D(CrossSections=crosecrselect_2, NameOrListIndexOfCrossSection=beam_index_css)  # -> CrossSection, Info
entwine_2 = Entwine(Branch00=crosecselect.CrossSection, Branch01=crosecselect_2.CrossSection, FlattenInputs=True)

# ---- group: Karamba3D / Define Loads
load_multiplier = Slider(5, range=0..20)
series = Series(Start=0, Step=1, Count=expr("x-1", floors))
X_2 = UnitX(Factor=load_multiplier)
loads = LoadsKaramba3D(Vector=X_2, BeamIdentifiers=series, LCase=0, mode="Uniform Line", menu=[buttons(off, on, off)])

# ---- group: Define Loads
load_multiplier_2 = Slider(12.5, range=0..50)
neg = Negative(Value=load_multiplier_2)
Z_2 = UnitZ(Factor=neg)
loads_2 = LoadsKaramba3D(Vector=Z_2, BeamIdentifiers="Beam", LCase=0, mode="Uniform Line", menu=[buttons(off, on, off)])

# ----
relay = Relay([loads_2, loads])
panel_2 = Panel("""Column
Beam""")
height_haunch_mm = Slider(0, range=0..1000)
stiffeners = Slider(0, range=0..1)
panel_3 = Panel("""001
01""")
galapagos = Galapagos(fitness=num_8, gene=[colum_index_css, beam_index_css])
panel_4 = Panel("""0
0
1
1""")
panel_5 = Panel("""0
1
1
1""")
column = Panel("Column")
panel_6 = Panel("Front")
number_slider = Slider(600, range=0..1000)
panel_7 = Panel("600")
panel_8 = Panel("Front_mod")
panel_9 = Panel("800")
panel_10 = Panel("900")
panel_11 = Panel("1000")
panel_12 = Panel("700")

# ---- group: Karamba3D
pt_4 = Point(pt_3)
line_3 = Line(entwine)
pt_5 = Point(pt_4)
load = LoadKaramba3D(flatten(relay))

# ---- group: Karamba3D / Define Elements
panel_13 = Panel("""Column
Beam""")
linetobeam = LineToBeamKaramba3D(Line=line_3, Identifier=graft(panel_13), CrossSection=entwine_2, New=True, Remove=True, LimitDistance_m=0.005)  # -> Element, Points, Info

# ---- group: Karamba3D / Define Supports
supp = SupportKaramba(PosInd=pt_5, menu=[buttons(on, on, on, on, off, off)])

# ---- group: Karamba3D (continued)
element = ElementKaramba3D(flatten(linetobeam.Element))
support = SupportKaramba3D(flatten(supp))

# ---- group: Karamba3D / Assemble Model
assemble = AssembleModelKaramba3D(Elem=element, Support=support, Load=load, LimitDistance_m=0.005)  # -> Model, Info, Mass_kg, CenterOfGravity

# ----
element_2 = ElementKaramba3D(flatten(element))
support_2 = SupportKaramba3D(flatten(support))
load_2 = LoadKaramba3D(flatten(load))

# ---- group: Karamba3D / Analyze Model
analyze = AnalyzeKaramba3D(Model=assemble.Model)  # -> CalculatedModel, MaximumDisplacement_cm, ResultingForceOfGravity_kN, ElasticEnergy_kNm

# ---- group: Karamba3D / View Results
modelview = ModelViewKaramba3D(Model=analyze.CalculatedModel, LoadCaseFactorsForLinearSuperposition=1, IndexOfVisibleLoadcase=-1)  # -> Model, DeformedMesh, DeformedAxes, DeformedModel
beamview = BeamViewKaramba3D(Model=modelview.Model)  # -> Model, MeshesOfRenderedBeams, DeformedBeamAxes, LegendColors, LegendTags

# ---- group: 2. Create Project / Stream filter to control data speed
filter = StreamFilter(Gate=Toggle(True), Stream1=beamview.Model)

# ---- group: 2. Create Project / Data collect
disassemble = DisassembleModelKaramba3D(Model=filter)  # -> Model, Point, Beam, Shell, Support, Load, Line, Mesh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
k3dbeamprops = CSharpScript(
    Model=disassemble.Model,
    Reference=["C:\Program Files\Rhino 6\Plug-ins\karambaCommon.dll", "C:\Program Files\Rhino 6\Plug-ins\karamba.gha"])  # -> BeamIds, Material, CrosecNames, CrosecShapes, Heights, Widths, TFlanges, TWebs, FRads
# ---------- k3dbeamprops: C# usings ----------
using Karamba.Elements;
using Karamba.CrossSections;
# ---------- k3dbeamprops: C# ----------
    var model = Model as Karamba.Models.Model;
    if (model == null) {
      throw new ArgumentException ("The input is not of type model!");
    }

    var beam_ids = new List<string>();
    var cs_names = new List<string>();
    var cs_shapes = new List<string>();
    var cs_material = new List<string>();
    var heights = new List<double>();
    var widths = new List<double>();
    var tflanges = new List<double>();
    var twebs = new List<double>();
    var frads = new List<double>();

    foreach (var elem in model.elems)
    {
      var beam = elem as ModelElementStraightLine;
      if (beam != null) {
        beam_ids.Add(elem.id);
        cs_names.Add(elem.crosec.name);
        cs_shapes.Add(elem.crosec.shape());
        cs_material.Add(elem.crosec.materialName);

        // is it an I-profile?
        var crosec_i = beam.crosec as CroSec_I;
        if (crosec_i != null) {
          heights.Add(crosec_i.getHeight() * 1000);
          // use the upper flange thickness
          widths.Add(crosec_i.uf_width * 1000);
          tflanges.Add(crosec_i.uf_thick * 1000);
          twebs.Add(crosec_i.w_thick * 1000);
          // use the inner fillet radius
          frads.Add(crosec_i.fillet_r * 1000);
          // this would be the outer fillet radius
          // frads.Add(crosec.fillet_r1);
          continue;
        }

        // is it a CHS?
        var crosec_o = beam.crosec as CroSec_Circle;
        if (crosec_o != null) {
          heights.Add(crosec_o.getHeight() * 1000);
          // use the upper flange thickness
          widths.Add(0);
          tflanges.Add(crosec_o.thick * 1000);
          twebs.Add(crosec_o.thick * 1000);
          frads.Add(0);
          continue;
        }

        // options for Box, trapezoid and T-section are not implemented yet
        throw new Exception("Cross section encountered for which no export is implemented");
      }
    }

    BeamIds = beam_ids;
    CrosecNames = cs_names;
    CrosecShapes = cs_shapes;
    Material = cs_material;
    Heights = heights;
    Widths = widths;
    TFlanges = tflanges;
    TWebs = twebs;
    FRads = frads;
# ---------- end k3dbeamprops ----------
b_forces = BeamForcesKaramba3D(AnalyzedModel=disassemble.Model, LCase=-1, MaximumDistanceBetweenResults_m=-1, NumberOfResultsPerBeamElement=2)  # -> AnalyzedModel, NormalForce_kN, ShearForceVz_kN, ShearForceVy_kN, BendingMomentMt_kNm, BendingMomentMy_kNm, BendingMomentMz_kNm
disassemble_2 = DisassembleElementKaramba3D(Element=disassemble.Beam)  # -> Element, ElementIdentifier, AxisOfElement, CrossSection, Joints, Material, LocalCoordinateSystem, ElementIsActive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

# ---- group: 2. Create Project
cp = CreateProject(
    Hierarchy=panel_2,
    Points=disassemble.Point,
    Lines=disassemble.Line,
    LCSRotations_Deg=disassemble_2.Alpha_deg,
    Groupnames=k3dbeamprops.BeamIds,
    Materials=k3dbeamprops.Material,
    CrossSectionNames=k3dbeamprops.CrosecNames,
    Shapes=k3dbeamprops.CrosecShapes,
    Heights=k3dbeamprops.Heights,
    Widths=k3dbeamprops.Widths,
    ThicknessFlanges=k3dbeamprops.TFlanges,
    ThicknessWebs=k3dbeamprops.TWebs,
    Radius=k3dbeamprops.FRads,
    N=b_forces.NormalForce_kN,
    Vz=b_forces.ShearForceVz_kN,
    Vy=b_forces.ShearForceVy_kN,
    Mt=b_forces.BendingMomentMt_kNm,
    My=b_forces.BendingMomentMy_kNm,
    Mz=b_forces.BendingMomentMz_kNm)

# ----
atemplate_finplateconnection = ATemplate_FinplateConnection(Project=cp, BrandNames=panel_3)  # -> Project, Message, Brep; disabled
analytical_template_moment_resisting_con = AnalyticalTemplateMomentResistingConnection(Project=cp, BrandNames=panel_3, HeightHaunch_mm=height_haunch_mm, Stiffeners=stiffeners, UnbracedStructure=False)  # -> Project, Message, Brep
retrieveconnectionproperties = RetrieveConnectionProperties(Project=analytical_template_moment_resisting_con.Project)  # -> Message, StartSj, EndSj, StartMjRd, EndMjRd
panel_14 = Panel(retrieveconnectionproperties.StartSj)

vec = VectorXYZ(XComponent=0, YComponent=flatten(retrieveconnectionproperties.StartSj), ZComponent=0)  # -> Vector, Length
vec_2 = VectorXYZ(XComponent=0, YComponent=flatten(retrieveconnectionproperties.EndSj), ZComponent=0)  # -> Vector, Length
data_3 = Data(flatten(entwine))
lng = ListLength(List=data_3)
series_2 = Series(Start=0, Step=1, Count=lng)
beam_joints = BeamJointsKaramba(
    ElementIdentifiers=graft(series_2),
    CtKNMAtStartingNode=Vector(0, 0, 0),
    CrKNmRadAtStartingNode=vec.Vector,
    CtKNMAtEndNode=Vector(0, 0, 0),
    CrKNmRadAtEndNode=vec_2.Vector,
    menu=[buttons(off, off, off, off, on, off), buttons(off, off, off, off, on, off)])

preview = CustomPreview(Geometry=analytical_template_moment_resisting_con.Brep, Material=ColourSwatch(SwatchColor=RGB(31, 242, 77)))
element_3 = ElementKaramba3D(flatten(element_2))
support_3 = SupportKaramba3D(flatten(support_2))
load_3 = LoadKaramba3D(flatten(load_2))
joint = JointKaramba3D(flatten(beam_joints))

# ---- group: Karamba3D / Assemble Model
assemble_2 = AssembleModelKaramba3D(Elem=element_3, Support=support_3, Load=load_3, Joint=joint, LimitDistance_m=0.005)  # -> Model, Info, Mass_kg, CenterOfGravity

# ---- group: Karamba3D / Analyze Model
analyze_2 = AnalyzeKaramba3D(Model=assemble_2.Model)  # -> CalculatedModel, MaximumDisplacement_cm, ResultingForceOfGravity_kN, ElasticEnergy_kNm

# ---- group: Karamba3D / View Results
modelview_2 = ModelViewKaramba3D(Model=analyze_2.CalculatedModel, LoadCaseFactorsForLinearSuperposition=1, IndexOfVisibleLoadcase=-1)  # -> Model, DeformedMesh, DeformedAxes, DeformedModel
beamview_2 = BeamViewKaramba3D(Model=modelview_2.Model)  # -> Model, MeshesOfRenderedBeams, DeformedBeamAxes, LegendColors, LegendTags

# ----
data_4 = Data(analytical_template_moment_resisting_con.Project)
data_5 = Data(beamview_2.Model)

# ---- group: 7. Cost calculation
weld_volume_generator = WeldVolumeGenerator(Project=data_4)
total_weight = TotalWeight(Project=data_4)  # -> WeightElements_kg, WeightPlates_kg, Brep
retrievelinespoints = RetrieveLinesPoints(Project=data_4)  # -> Lines, Points
price_steel = Panel("1")
price_welding = Panel("2.6")
costcalculator = CostCalculator(
    WeightElements_kg=total_weight.WeightElements_kg,
    WeightPlates_kg=total_weight.WeightPlates_kg,
    WeldingVolume_cm3=weld_volume_generator,
    NumberOfElements=0,
    SteelPricePerKg=price_steel,
    WeldingPricePerCm3=price_welding,
    TransportPricePerElement=20)  # -> CostsOfBeamMaterial_, CostsPerJoint_, TransportCost_
xz = XZPlane(Origin=retrievelinespoints.Points)
tag = TextTag3D(Location=xz, Text=costcalculator.CostsPerJoint_, Size=1, Justification=7)

# ----
line_4 = Line()
preview_2 = CustomPreview(Geometry=total_weight.Brep, Material=ColourSwatch(SwatchColor=RGBA(0, 187, 255, 133)))
cmyk = ColourCMYK(Cyan=Slider(1, range=0..1), Magenta=Slider(0, range=0..1), Yellow=Slider(0, range=0..1), Key=Slider(0, range=0..1))

edges = BrepEdges(Brep=total_weight.Brep)  # -> Naked, Interior, NonManifold

retrieveconnectionproperties_2 = RetrieveConnectionProperties(Project=data_4)  # -> Message, StartSj, EndSj, StartMjRd, EndMjRd
b_forces_2 = BeamForcesKaramba3D(AnalyzedModel=data_5, LCase=-1, MaximumDistanceBetweenResults_m=-1, NumberOfResultsPerBeamElement=2)  # -> AnalyzedModel, NormalForce_kN, ShearForceVz_kN, ShearForceVy_kN, BendingMomentMt_kNm, BendingMomentMy_kNm, BendingMomentMz_kNm
item_4 = ListItem(List=reverse(b_forces_2.BendingMomentMy_kNm), Index=0, Wrap=True)  # -> flatten(Item)
item_5 = ListItem(List=b_forces_2.BendingMomentMy_kNm, Index=0, Wrap=True)  # -> flatten(Item)
cluster_7 = Cluster_4(num_2=item_4, num=retrieveconnectionproperties_2.EndMjRd)
cluster_8 = Cluster_4(num_2=item_5, num=retrieveconnectionproperties_2.StartMjRd)
c_script = CSharpScript(x=flatten([cluster_8, cluster_7]))  # -> Max, Min; inputs x: list of Double; same code as c_script
uc_mjrd = Panel(c_script.Max)

ma = MassAddition(Input=flatten(weld_volume_generator))  # -> Result, PartialResults
ma_2 = MassAddition(Input=flatten(total_weight.WeightPlates_kg))  # -> Result, PartialResults
multiplication = Multiplication(A=ma.Result, B=price_welding)
multiplication_2 = Multiplication(A=ma_2.Result, B=price_steel)
addition = Addition(A=multiplication_2, B=multiplication)
panel_15 = Panel(addition)
panel_16 = Panel(costcalculator.CostsOfBeamMaterial_)
addition_2 = Addition(A=panel_16, B=panel_15)
division = Division(A=panel_16, B=addition_2)
division_2 = Division(A=panel_15, B=addition_2)
round = Round(Number=panel_16)  # -> Nearest, Floor, Ceiling
round_2 = Round(Number=panel_15)  # -> Nearest, Floor, Ceiling
round_3 = Round(Number=addition_2)  # -> Nearest, Floor, Ceiling
num_3 = Number(expr("x*100", division))
num_4 = Number(expr("x*100", division_2))
beamcosts = Panel(round.Nearest)
jointcosts = Panel(round_2.Nearest)
totalcosts = Panel(round_3.Nearest)

k3dbeamprops_2 = CSharpScript(
    Model=data_5,
    Reference=["C:\Program Files\Rhino 6\Plug-ins\karambaCommon.dll", "C:\Program Files\Rhino 6\Plug-ins\karamba.gha"])  # -> CrosecNames
# ---------- k3dbeamprops_2: C# ----------
    var model = Model as Karamba.Models.Model;
    if (model == null) {
      throw new ArgumentException ("The input is not of type model!");
    }

    var cs_names = new List<string>();
  

    foreach (var elem in model.elems)
    {
      var beam = elem as ModelElementStraightLine;
      if (beam != null) {
        cs_names.Add(elem.crosec.name);
  
      }
    }

    
    CrosecNames = cs_names;
# ---------- end k3dbeamprops_2 ----------
data_6 = Data(k3dbeamprops_2)
item_6 = ListItem(List=reverse(data_6), Index=0, Wrap=True)
item_7 = ListItem(List=data_6, Index=0, Wrap=True)
column_2 = Panel(item_7)
beam = Panel(item_6)

retrieveconnectionproperties_3 = RetrieveConnectionProperties(Project=data_4)  # -> Message, StartSj, EndSj, StartMjRd, EndMjRd
sort = SortList(Keys=retrieveconnectionproperties_3.StartSj, ValuesA=retrieveconnectionproperties_3.StartSj)  # -> reverse(Keys), ValuesA
item_8 = ListItem(List=sort.Keys, Index=0, Wrap=True)
round_4 = Round(Number=item_8)  # -> Nearest, Floor, Ceiling
jointstiffness_knm_rad = Panel(round_4.Nearest)

disassemble_3 = DisassembleModelKaramba3D(Model=data_5)  # -> Model, Point, Beam, Shell, Support, Load, Line, Mesh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
utilization = UtilizationOfElementsKaramba3D(
    AnalyzedModel=disassemble_3.Model,
    ResultCase=-1,
    NumberOfSamplePoints=3,
    ElasticDesign=True,
    GammaM0=1,
    GammaM1=1,
    WithDetails=False,
    mode="Beams")  # -> AnalyzedModel, Utilization, SigMax_kN_cm2, SigMin_kN_cm2, TauMax_kN_cm2, UtilN, UtilVy, UtilVz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
c_script_2 = CSharpScript(x=flatten(utilization.Utilization))  # -> Max, Min; inputs x: list of Double; same code as c_script
uc_beam = Panel(c_script_2.Max)
larger = LargerThan(FirstNumber=uc_mjrd, SecondNumber="1")  # -> LargerThan, OrEqualTo
larger_2 = LargerThan(FirstNumber=uc_beam, SecondNumber="1")  # -> LargerThan, OrEqualTo
num_5 = Number(totalcosts)
multiplication_3 = Multiplication(A=num_5, B="20")

nodedisp = NodalDisplacementsKaramba3D(AnalyzedModel=data_5, ResultCase=0)  # -> AnalyzedModel, NodalTranslations_m, NodalRotations_rad
devec = DeconstructVector(Vector=nodedisp.NodalTranslations_m)  # -> XComponent, YComponent, ZComponent

data_7 = Data(devec.ZComponent)
sort_2 = SortList(Keys=data_7, ValuesA=reverse(data_7))  # -> Keys, ValuesA
item_9 = ListItem(List=sort_2.Keys, Index=0, Wrap=True)
num_6 = Number(expr("x*1000", item_9))

data_8 = Data(devec.XComponent)
sort_3 = SortList(Keys=data_8, ValuesA=reverse(data_8))  # -> reverse(Keys), ValuesA
item_10 = ListItem(List=sort_3.Keys, Index=0, Wrap=True)
num_7 = Number(expr("x*1000", item_10))

max_vert_disp_mm = Panel(num_6)
max_horz_disp_mm = Panel(num_7)

larger_3 = LargerThan(FirstNumber=max_horz_disp_mm, SecondNumber="24")  # -> LargerThan, OrEqualTo
larger_4 = LargerThan(FirstNumber="-28", SecondNumber=max_vert_disp_mm)  # -> LargerThan, OrEqualTo
or = GateOr(A=larger_3.LargerThan, B=larger_4.LargerThan, C=larger.LargerThan, D=larger_2.LargerThan)
filter_2 = StreamFilter(Gate=or, Stream0=num_5, Stream1=multiplication_3)
num_8 = Number(filter_2)
panel_17 = Panel(filter_2)
parameters = ColibriParameters(
    Column=flatten(column_2),
    Beam=flatten(beam),
    Max_Horz_disp_mm=flatten(max_horz_disp_mm),
    Max_Vert_Disp_mm=flatten(max_vert_disp_mm),
    UC_MjRd=flatten(uc_mjrd),
    UC_Beam=flatten(uc_beam),
    BeamCosts=flatten(beamcosts),
    JointCosts=flatten(jointcosts),
    TotalCosts=flatten(totalcosts),
    JointStiffness_kNm_rad=flatten(jointstiffness_knm_rad))

panel_18 = Panel("""0
0
5
0""")
selection = IterationSelection(Divisions=panel_18)
iterator = ColibriIterator(
    Colum_index_CSS=colum_index_css,
    Beam_index_CSS=beam_index_css,
    Height_haunch_mm=height_haunch_mm,
    Stiffeners=stiffeners,
    Selection=selection,
    RemoteFly=False,
    ignoreAllWarningMsg=False)  # -> Colum_index_CSS, Beam_index_CSS, Height_haunch_mm, Stiffeners, Value_N, Genome
addition_3 = Addition(A="100000", B=iterator.Height_haunch_mm)
concat = Concatenate(
    FragmentH=column,
    FragmentG=iterator.Colum_index_CSS,
    FragmentD="Beam",
    FragmentA=iterator.Beam_index_CSS,
    FragmentE="HeightHaunch",
    FragmentB=addition_3,
    FragmentF="Stiffeners",
    FragmentC=iterator.Stiffeners)
panel_19 = Panel("Y:\Constructies\personen\ABT Delft\Rayaan\Grasshopper\FrameOptimization_10")
panel_20 = Panel(concat)
panel_21 = Panel("""Front
Perspective""")
img_setting = ImageSetting(ImageSaveAsName=panel_20, Width="1200", Height="1200")
aggregator = ColibriAggregator(
    Folder=panel_19,
    IterationGenomeID=iterator.Genome,
    IterationPhenomeResults=parameters,
    ImgSetting=img_setting,
    Write=Toggle(False),
    recordingMode=0)

panel_22 = Panel(aggregator)

expression = Expression(x=round_2.Nearest, y=num_4, Expression="Format(\"Joints:  €{0:0},- ({1:0.0}%)\", x, y)")
expression_2 = Expression(x=round.Nearest, y=num_3, Expression="Format(\"Beams: €{0:0},- ({1:0.0}%)\", x, y)")
expression_3 = Expression(x=num_6, Expression="Format(\"uz max: {0:0} mm\", x)")
expression_4 = Expression(x=num_7, Expression="Format(\"ux max: {0:0} mm\", x)")
expression_5 = Expression(x=round_3.Nearest, y=num_4, Expression="Format(\"Total:   €{0:0},- \", x)")
merge_3 = Merge(
    Data1=flatten(expression_4),
    Data2=flatten(expression_3),
    Data3=flatten(expression_2),
    Data4=flatten(expression),
    Data5=flatten(expression_5))
txt = Text(merge_3)
lng_2 = ListLength(List=txt)
vec_3 = Vector("3,0,-4")
series_3 = Series(Start=-1, Step=Slider(0.9, range=0..2), Count=lng_2)
panel_23 = Panel("0.4")
neg_2 = Negative(Value=series_3)
xz_2 = XZPlane(Origin=vec_3)
Z_3 = UnitZ(Factor=neg_2)
move = Move(Geometry=xz_2, Motion=Z_3)  # -> Geometry, Transform
tag_2 = TextTag3D(Location=move.Geometry, Text=txt, Size=Slider(0.6, range=0..1), Justification=4)

# ==== cluster Cluster
data = ClusterInput()
data_2 = Data(data)
lng = ListLength(List=data_2)
culln = CullNth(List=data_2, CullFrequency=lng)
data_3 = Data(culln)
data_4 = ClusterOutput(data_3)

# ==== cluster Cluster_2
data = ClusterInput()
data_2 = Data(data)
cull_i = CullIndex(List=data_2, Indices="0", Wrap=True)
data_3 = Data(cull_i)
data_4 = ClusterOutput(data_3)

# ==== cluster Cluster_3
pt = ClusterInput()

pt_2 = Point(pt)
lng = ListLength(List=pt_2)
cull_i = CullIndex(List=pt_2, Indices="0", Wrap=True)  # -> simplify(List)
culln = CullNth(List=pt_2, CullFrequency=lng)  # -> simplify(List)
ln = Line(StartPoint=culln, EndPoint=cull_i)

L = ClusterOutput(ln)

# ==== cluster Cluster_4
num = ClusterInput()
num_2 = ClusterInput()
num_3 = Number(num)
num_4 = Number(num_2)
larger = LargerThan(FirstNumber=num_3, SecondNumber="0")  # -> LargerThan, OrEqualTo
cull = CullPattern(List=num_3, CullPattern=larger.LargerThan)
cull_2 = CullPattern(List=num_4, CullPattern=larger.LargerThan)
abs = Absolute(Value=cull_2)
division = Division(A=abs, B=cull)
c_script = CSharpScript(x=division)  # -> Max, Min; inputs x: list of Double
# ---------- c_script: C# ----------
    double a = x[0];
    double b = x[0];
    foreach (double t in x)
    {
      if(t > a)
      {
        a = t;
      }
      if(t < b)
      {
        b = t;
      }
    }
    Max = a;
    Min = b;
# ---------- end c_script ----------
max = ClusterOutput(c_script.Max)
