# Grasshopper definition SteelHall_V006.gh (Grasshopper 1.0.7)
# Copyright: B+G Engineers
# plug-ins: KarambaIDEA, Colibri, karambaGH

# ---- group: Parameters
# Segment location
# Windbracing in X
# Windbracing in Y
length_y_m = Slider(50, range=0..100)
xcount = Slider(6, range=2..20)
column_divisions = Slider(2, range=0..10)
genes = GenePool(Decimals=2, Maximum=1, Minimum=0, Value=[0.3, 0.7])
genes_2 = GenePool(Decimals=2, Maximum=1, Minimum=0, Value=0.28)
genes_3 = GenePool(Decimals=2, Maximum=1, Minimum=0, Value=0.76)
truss_height = Slider(2.5, range=0..2.5)
length_x_m = Slider(30, range=0..100)
height_z_m = Slider(7, range=0..10)
ycount = Slider(8, range=4..20)
truss_type = ValueList({"Pratt": 0, "Warren": 1, "Three": 2, "Four": 3}, selected="Pratt")
# Steel Hall by Rayaan Ajouz
pt = ConstructPoint(XCoordinate=0, YCoordinate=0, ZCoordinate=0)
truss_segmented = ValueList({"No": 0, "Yes": 1}, selected="No")

# ----
connection_truss_column = ValueList({"Moment": 0, "Hinge": 1}, selected="Hinge")

pt_2 = Point(pt)
num = Number(truss_segmented)
num_2 = Number(genes)
num_3 = Number(truss_type)
num_4 = Number(connection_truss_column)
num_5 = Number(truss_height)
num_6 = Number(length_x_m)
num_7 = Number(length_y_m)
num_8 = Number(height_z_m)
num_9 = Number(xcount)
num_10 = Number(ycount)
num_11 = Number(column_divisions)
num_12 = Number(genes_2)
num_13 = Number(genes_3)

c_script = CSharpScript(lenX=num_6, lenY=num_7, countX=num_9, countY=num_10)  # -> surface; inputs lenX: Double, lenY: Double, countX: Double, countY: Double
# ---------- c_script: C# ----------
    surface = (lenX / countX) * (lenY / countY);
# ---------- end c_script ----------
vec = VectorXYZ(XComponent=num_6, YComponent=num_7, ZComponent=num_8)  # -> Vector, Length

devec = DeconstructVector(Vector=vec.Vector)  # -> XComponent, YComponent, ZComponent
X = UnitX(Factor=devec.XComponent)
pt_3 = ConstructPoint(XCoordinate=0, YCoordinate=0, ZCoordinate=0)
Y = UnitY(Factor=devec.YComponent)
Z = UnitZ(Factor=devec.ZComponent)
move = Move(Geometry=pt_3, Motion=Y)  # -> Geometry, Transform
move_2 = Move(Geometry=move.Geometry, Motion=Z)  # -> Geometry, Transform
move_3 = Move(Geometry=pt_3, Motion=X)  # -> Geometry, Transform
xz = XZPlane(Origin=move.Geometry)
aligndim = AlignedDimension(Plane=xz, PointA=move.Geometry, PointB=move_2.Geometry, Offset="3", Text="{0:0.00}", Size=1)
aligndim_2 = AlignedDimension(Plane=PlaneXY(0, 0, 0), PointA=move_3.Geometry, PointB=pt_3, Offset="3", Text="{0:0.00}", Size=1)
aligndim_3 = AlignedDimension(Plane=PlaneXY(0, 0, 0), PointA=pt_3, PointB=move.Geometry, Offset="3", Text="{0:0.00}", Size=1)

panel = Panel(c_script)
panel_2 = Panel("""0
40
80""")

# ---- group: Parameters
ycount_2 = Slider(20, range=4..20)
xcount_2 = Slider(20, range=2..20)
pt_4 = ConstructPoint(XCoordinate=panel_2, YCoordinate=0, ZCoordinate=0)

# ----
filter = StreamFilter(Gate=num, Stream1=num_2)
sort = SortList(Keys=filter)  # -> Keys, ValuesA
merge = Merge(Data1=sort.Keys, Data2="1.01")
multiplication = Multiplication(A=merge, B=num_6)
pt_5 = ConstructPoint(XCoordinate=multiplication, YCoordinate=0, ZCoordinate=0)

pt_6 = ConstructPoint(XCoordinate=0, YCoordinate=0, ZCoordinate=0)
panel_3 = Panel("""2
4
10""")
X_2 = UnitX(Factor=panel_2)

Z_2 = UnitZ(Factor=num_8)
pt_7 = Point(pt_2)
num_14 = Number(num_6)
num_15 = Number(num_9)
X_3 = UnitX(Factor=num_14)
move_4 = Move(Geometry=pt_7, Motion=Z_2)  # -> Geometry, Transform
move_5 = Move(Geometry=move_4.Geometry, Motion=X_3)  # -> Geometry, Transform
ln = Line(StartPoint=move_4.Geometry, EndPoint=move_5.Geometry)
divide = DivideCurve(Curve=ln, Count=num_15, Kinks=False)  # -> Points, Tangents, Parameters

panel_4 = Panel("""4
6
10""")
move_6 = Move(Geometry=pt_6, Motion=X_2)  # -> graft(Geometry), Transform
Y_2 = UnitY(Factor=panel_2)
multiplication_2 = Multiplication(A=Y_2, B="2")
dup = DuplicateData(Data=panel_4, Number="3", Order=True)
dup_2 = DuplicateData(Data=graft(panel_3), Number="3", Order=True)  # -> flatten(Data)
panel_5 = Panel("4")
pt_8 = ConstructPoint(XCoordinate=Slider(50, range=0..100), YCoordinate=0, ZCoordinate=0)

num_16 = Number(num_9)
num_17 = Number(num_10)

move_7 = Move(Geometry=move_6.Geometry, Motion=multiplication_2)  # -> flatten(Geometry), Transform
scale = Slider(1, range=0..1)

# ----
# DISCLAIMER: The use of this Grasshopper example file is fully at your own risk. Bouwen met Staal cannot be held liable in any form for given damage caused by the use of this file.
num_18 = Number(num_9)
num_19 = Number(num_10)

num_20 = Number(expr("x+1", num_16))
num_21 = Number(expr("x+1", num_17))
cluster = Cluster_3(num=num_20, num_2=num_21)
cluster_2 = Cluster(num=num_16)
cluster_3 = Cluster(num=num_17)
cluster_4 = Cluster_2(data=cluster, data_2=cluster_3, data_3=cluster_2)

num_22 = Number(num_9)
num_23 = Number(num_10)
data = Data(num_12)
data_2 = Data(num_13)

num_24 = Number(num_7)
num_25 = Number(num_10)
Y_3 = UnitY(Factor=num_24)
pt_9 = Point(divide.Points)
move_8 = Move(Geometry=pt_9, Motion=Y_3)  # -> Geometry, Transform
ln_2 = Line(StartPoint=pt_9, EndPoint=move_8.Geometry)
divide_2 = DivideCurve(Curve=ln_2, Count=graft(num_25), Kinks=False)  # -> Points, Tangents, Parameters

num_26 = Number(expr("x+1", num_18))
num_27 = Number(expr("x+1", num_19))
cluster_5 = Cluster_3(num=num_26, num_2=num_27)
cluster_6 = Cluster(num=num_19)
cluster_7 = Cluster_2(data=cluster_5, data_2=cluster_6)

num_28 = Number(expr("x-1", num_23))
num_29 = Number(expr("x-1", num_22))
cluster_8 = Cluster_3(num=num_23, num_2=num_22)
multiplication_3 = Multiplication(A=data, B=num_29)
multiplication_4 = Multiplication(A=num_28, B=data_2)
round = Round(Number=multiplication_3)  # -> Nearest, Floor, Ceiling
round_2 = Round(Number=multiplication_4)  # -> Nearest, Floor, Ceiling
dcon = DeleteConsecutive(Set=round.Nearest, Wrap=False)  # -> Set, Count
dcon_2 = DeleteConsecutive(Set=round_2.Nearest, Wrap=False)  # -> Set, Count
cluster_9 = Cluster_2(data=cluster_8, data_2=dcon.Set, data_3=dcon_2.Set)

length_x_m_2 = Slider(30, range=0..100)
length_y_m_2 = Slider(60, range=0..100)
height_z_m_2 = Slider(6, range=0..10)
column_divisions_2 = Slider(2, range=0..10)
genes_4 = GenePool(Decimals=2, Maximum=1, Minimum=0, Value=[0.3, 0.7])
genes_5 = GenePool(Decimals=2, Maximum=1, Minimum=0, Value=0.28)
genes_6 = GenePool(Decimals=2, Maximum=1, Minimum=0, Value=[0.76, 0.24])
truss_height_2 = Slider(2.5, range=0..2.5)
truss_type_2 = ValueList({"Pratt": 0, "Warren": 1, "Three": 2, "Four": 3}, selected="Pratt")
truss_segmented_2 = ValueList({"No": 0, "Yes": 1}, selected="No")
connection_truss_column_2 = ValueList({"Moment": 0, "Hinge": 1}, selected="Hinge")
pt_10 = Point(divide_2.Points)
num_30 = Number(scale)

num_31 = Number(genes_4)
num_32 = Number(truss_type_2)
num_33 = Number(connection_truss_column_2)
num_34 = Number(truss_height_2)
num_35 = Number(dup)
num_36 = Number(column_divisions_2)
pt_11 = Point(move_7.Geometry)
num_37 = Number(truss_segmented_2)
num_38 = Number(length_x_m_2)
num_39 = Number(length_y_m_2)
num_40 = Number(dup_2)
num_41 = Number(genes_5)
num_42 = Number(genes_6)
num_43 = Number(height_z_m_2)

pt_12 = Point(divide_2.Points)
flip = FlipMatrix(Data=pt_12)
pt_13 = Point(pt_12)
pt_14 = Point(flip)
lng = ListLength(List=pt_14)
lng_2 = ListLength(List=pt_13)
item = ListItem(List=pt_13, Index=0, Wrap=True)
item_2 = ListItem(List=pt_13, Index=expr("x-1", lng_2), Wrap=True)
item_3 = ListItem(List=pt_14, Index=0, Wrap=True)
item_4 = ListItem(List=pt_14, Index=expr("x-1", lng), Wrap=True)

num_44 = Number(num_30)
multiplication_5 = Multiplication(A=num_34, B=num_44)
multiplication_6 = Multiplication(A=num_38, B=num_44)
multiplication_7 = Multiplication(A=num_39, B=num_44)
multiplication_8 = Multiplication(A=num_43, B=num_44)

cluster_10 = Cluster_4(pt=pt_10, F=num_5)  # -> pt_3, G
cluster_11 = Cluster_5(pt=cluster_10.pt_3)
cluster_12 = Cluster_5(pt=cluster_10.G)
pt_15 = Point(cluster_11)
pt_16 = Point(cluster_12)

data_3 = Data(num_3)

num_45 = Number(num_5)
num_46 = Number(num_11)
num_47 = Number(num_8)
cluster_13 = Cluster_12(num=num_45, num_3=num_47, pt=item, num_2=num_46)
cluster_14 = Cluster_12(num=num_45, num_3=num_47, pt=item_2, num_2=num_46)
cluster_15 = Cluster_12(num=num_45, num_3=num_47, pt=item_3, num_2=num_46)
cluster_16 = Cluster_12(num=num_45, num_3=num_47, pt=item_4, num_2=num_46)

cluster_17 = Cluster_14(pt=divide_2.Points)
cluster_18 = Cluster_13(pt=divide_2.Points)
data_4 = Data(cluster_9)
cull = CullPattern(List=cluster_18, CullPattern=data_4)
cull_2 = CullPattern(List=cluster_17, CullPattern=data_4)
line = Line([cull_2, cull])

filter_2 = StreamFilter(Gate=num_37, Stream1=num_31)
sort_2 = SortList(Keys=filter_2)  # -> Keys, ValuesA
merge_2 = Merge(Data1=sort_2.Keys, Data2="1.01")
multiplication_9 = Multiplication(A=merge_2, B=multiplication_6)
pt_17 = ConstructPoint(XCoordinate=multiplication_9, YCoordinate=0, ZCoordinate=0)

pt_18 = Point(simplify(pt_15))
data_5 = Data(data_3)
pt_19 = Point(pt_16)
flip_2 = FlipMatrix(Data=pt_19)
flip_3 = FlipMatrix(Data=pt_18)
cluster_19 = Cluster_10(L_2=flip_3, L=flip_2)
cluster_20 = Cluster_8(pt=flip_3, pt_2=flip_2)
filter_3 = StreamFilter(Gate=data_5, Stream0=cluster_20, Stream1=cluster_19)

pt_20 = Point(pt_10)
cluster_21 = Cluster_11(data=pt_20)
flip_4 = FlipMatrix(Data=cluster_21)
pt_21 = Point(flip_4)
cluster_22 = Cluster_7(pt=pt_21)

pt_22 = Point(pt_10)
cull_3 = CullPattern(List=pt_22, CullPattern=cluster_7)
flip_5 = FlipMatrix(Data=cull_3)
cluster_23 = Cluster_7(pt=flip_5)

flip_6 = FlipMatrix(Data=pt_15)
flip_7 = FlipMatrix(Data=pt_16)
cluster_24 = Cluster_5(pt=flip_6)
cluster_25 = Cluster_5(pt=flip_7)
ln_3 = Line(StartPoint=cluster_24, EndPoint=cluster_25)

merge_3 = Merge(Data1=pt_15, Data2=pt_16)
data_6 = Data(num_13)
num_48 = Number(num_10)

Z_3 = UnitZ(Factor=multiplication_8)
pt_23 = Point(pt_11)
num_49 = Number(multiplication_6)
num_50 = Number(num_35)
X_4 = UnitX(Factor=num_49)
move_9 = Move(Geometry=pt_23, Motion=Z_3)  # -> Geometry, Transform
move_10 = Move(Geometry=move_9.Geometry, Motion=X_4)  # -> Geometry, Transform
ln_4 = Line(StartPoint=move_9.Geometry, EndPoint=move_10.Geometry)
divide_3 = DivideCurve(Curve=ln_4, Count=num_50, Kinks=False)  # -> Points, Tangents, Parameters

num_51 = Number(num_9)

num_52 = Number(num_5)
equals = Equality(FirstNumber=num_52, SecondNumber="0")  # -> Equality, Inequality

num_53 = Number(num_35)
num_54 = Number(num_40)

pt_24 = Point(cluster_10.G)
data_7 = Data(num_4)
cluster_26 = Cluster_5(pt=pt_24)
flip_8 = FlipMatrix(Data=cluster_26)
cluster_27 = Cluster_5(pt=flip_8)
cluster_28 = Cluster_7(pt=flip_8)
cluster_29 = Cluster_7(pt=cluster_27)
filter_4 = StreamFilter(Gate=data_7, Stream0=cluster_28, Stream1=cluster_29)

num_55 = Number(num_35)
num_56 = Number(num_40)

cluster_30 = Cluster_14(pt=cluster_16)
cluster_31 = Cluster_13(pt=cluster_16)
cluster_32 = Cluster_15(num=num_48, num_2=num_46, data=data_6)
pt_25 = Point(cluster_16)
cluster_33 = Cluster_11(data=pt_25)
flip_9 = FlipMatrix(Data=cluster_33)
cull_4 = CullPattern(List=cluster_30, CullPattern=cluster_32)
cull_5 = CullPattern(List=cluster_31, CullPattern=cluster_32)
cluster_34 = Cluster_7(pt=flip_9)
cull_6 = CullPattern(List=cluster_34, CullPattern=cluster_32)
line_2 = Line([cull_4, cull_5])

cluster_35 = Cluster_14(pt=cluster_13)
cluster_36 = Cluster_13(pt=cluster_13)
cluster_37 = Cluster_15(num=num_51, num_2=num_46, data=num_12)
pt_26 = Point(cluster_13)
cluster_38 = Cluster_11(data=pt_26)
flip_10 = FlipMatrix(Data=cluster_38)
cull_7 = CullPattern(List=cluster_35, CullPattern=cluster_37)
cull_8 = CullPattern(List=cluster_36, CullPattern=cluster_37)
cluster_39 = Cluster_7(pt=flip_10)
cull_9 = CullPattern(List=cluster_39, CullPattern=cluster_37)
line_3 = Line([cull_7, cull_8])

cull_10 = CullPattern(List=divide_2.Points, CullPattern=cluster_4)
num_57 = Number(num_8)
cluster_40 = Cluster_4(pt=cull_10, F=num_57)  # -> pt_3, G

cluster_41 = Cluster_15(num=num_48, num_2=num_46, data=data_6)
cluster_42 = Cluster_14(pt=cluster_15)
cluster_43 = Cluster_13(pt=cluster_15)
pt_27 = Point(cluster_15)
cluster_44 = Cluster_11(data=pt_27)
flip_11 = FlipMatrix(Data=cluster_44)
cull_11 = CullPattern(List=cluster_42, CullPattern=cluster_41)
cull_12 = CullPattern(List=cluster_43, CullPattern=cluster_41)
cluster_45 = Cluster_7(pt=flip_11)
cull_13 = CullPattern(List=cluster_45, CullPattern=cluster_41)
line_4 = Line([cull_11, cull_12])

num_58 = Number(expr("x+1", num_53))
num_59 = Number(expr("x+1", num_54))
cluster_46 = Cluster_19(num=num_58, num_2=num_59)
cluster_47 = Cluster(num=num_53)
cluster_48 = Cluster(num=num_54)
cluster_49 = Cluster_18(data=cluster_46, data_2=cluster_48, data_3=cluster_47)

cluster_50 = Cluster_14(pt=cluster_14)
cluster_51 = Cluster_13(pt=cluster_14)
cluster_52 = Cluster_15(num=num_51, num_2=num_46, data=num_12)
pt_28 = Point(cluster_14)
cluster_53 = Cluster_11(data=pt_28)
flip_12 = FlipMatrix(Data=cluster_53)
cull_14 = CullPattern(List=cluster_50, CullPattern=cluster_52)
cull_15 = CullPattern(List=cluster_51, CullPattern=cluster_52)
cluster_54 = Cluster_7(pt=flip_12)
cull_16 = CullPattern(List=cluster_54, CullPattern=cluster_52)
line_5 = Line([cull_14, cull_15])

data_8 = Data(num_41)
num_60 = Number(num_35)
num_61 = Number(num_40)
data_9 = Data(num_42)

cluster_55 = Cluster_7(pt=cluster_15)
cluster_56 = Cluster_7(pt=cluster_16)
flip_13 = FlipMatrix(Data=cluster_14)
flip_14 = FlipMatrix(Data=cluster_13)
cluster_57 = Cluster_11(data=flip_13)
cluster_58 = Cluster_11(data=flip_14)
flip_15 = FlipMatrix(Data=cluster_57)
flip_16 = FlipMatrix(Data=cluster_58)
cluster_59 = Cluster_7(pt=flip_15)
cluster_60 = Cluster_7(pt=flip_16)
merge_4 = Merge(Data1=cluster_60, Data2=cluster_59, Data3=cluster_55, Data4=cluster_56)

filter_5 = StreamFilter(Gate=data_3, Stream0=ln_3)
num_62 = Number(num_56)
cluster_61 = Cluster_7(pt=pt_10)

num_63 = Number(multiplication_7)
num_64 = Number(num_40)
Y_4 = UnitY(Factor=num_63)
pt_29 = Point(divide_3.Points)
move_11 = Move(Geometry=pt_29, Motion=Y_4)  # -> Geometry, Transform
ln_5 = Line(StartPoint=pt_29, EndPoint=move_11.Geometry)
divide_4 = DivideCurve(Curve=ln_5, Count=graft(num_64), Kinks=False)  # -> simplify(Points), Tangents, Parameters

dup_3 = DuplicateData(Data=graft(num_62), Number=expr("x+1", graft(num_55)), Order=True)  # -> flatten(Data)

num_65 = Number(expr("x-1", num_61))
num_66 = Number(expr("x-1", num_60))
cluster_62 = Cluster_19(num=num_61, num_2=num_60)
multiplication_10 = Multiplication(A=data_8, B=num_66)
multiplication_11 = Multiplication(A=num_65, B=data_9)
round_3 = Round(Number=multiplication_10)  # -> Nearest, Floor, Ceiling
round_4 = Round(Number=multiplication_11)  # -> Nearest, Floor, Ceiling
dcon_3 = DeleteConsecutive(Set=round_3.Nearest, Wrap=False)  # -> Set, Count
dcon_4 = DeleteConsecutive(Set=round_4.Nearest, Wrap=False)  # -> Set, Count
cluster_63 = Cluster_18(data=cluster_62, data_2=dcon_3.Set, data_3=dcon_4.Set)

num_67 = Number(graft(dup_3))

num_68 = Number(expr("x+1", num_55))
num_69 = Number(expr("x+1", num_56))
cluster_64 = Cluster_19(num=num_68, num_2=num_69)
cluster_65 = Cluster(num=num_67)  # -> simplify(L)
cluster_66 = Cluster_18(data=cluster_64, data_2=cluster_65)

num_70 = Number(num_5)
equals_2 = Equality(FirstNumber=num_70, SecondNumber="0")  # -> Equality, Inequality
filter_6 = StreamFilter(Gate=equals_2.Inequality, Stream1=filter_4)

num_71 = Number(num_5)
equals_3 = Equality(FirstNumber=num_71, SecondNumber="0")  # -> Equality, Inequality
filter_7 = StreamFilter(Gate=equals_3.Inequality, Stream1=filter_3)

num_72 = Number(num_5)
equals_4 = Equality(FirstNumber=num_72, SecondNumber="0")  # -> Equality, Inequality
filter_8 = StreamFilter(Gate=equals_4.Inequality, Stream1=filter_5)

pt_30 = Point(divide_4.Points)
boolean_toggle = BooleanToggle(True)
merge_5 = Merge(Data1=line_3, Data2=line_5, Data3=line_4, Data4=line_2)
merge_6 = Merge(Data1=cull_9, Data2=cull_16, Data3=cull_13, Data4=cull_6)

cluster_67 = Cluster_4(pt=pt_30, F=multiplication_5)  # -> pt_3, G
cluster_68 = Cluster_5(pt=cluster_67.pt_3)
cluster_69 = Cluster_5(pt=cluster_67.G)
pt_31 = Point(cluster_68)
pt_32 = Point(cluster_69)

line_6 = Line(line)
line_7 = Line(merge_5)
data_10 = Data(num_32)
stream_filter = StreamFilter(Gate=boolean_toggle, Stream1=merge_6)
stream_filter_2 = StreamFilter(Gate=boolean_toggle, Stream1=line_6)
stream_filter_3 = StreamFilter(Gate=boolean_toggle, Stream1=line_7)

# ----
# Truss Roof Beams
line_8 = Line(cluster_22)

# ----
# Truss Diagonals
line_9 = Line(filter_7)

# ----
# Truss Verticals
line_10 = Line(filter_8)

# ----
# Truss Beams
line_11 = Line(filter_6)

# ----
# Roof Spacers
line_12 = Line(cluster_61)

# ----
# Supports
pt_33 = Point(cluster_40.G)

# ----
# OuterColumns_South
line_13 = Line(cluster_60)

# ----
# OuterColumns_North
line_14 = Line(cluster_59)

# ----
# OuterColumns_West
line_15 = Line(cluster_55)

# ----
# OuterColumns_East
line_16 = Line(cluster_56)

# ----
# OuterColumns
line_17 = Line(merge_4)

# ----
# Wall Bracing
line_18 = Line(stream_filter_3)

# ----
# WallBeams
line_19 = Line(stream_filter)

line_20 = Line(stream_filter_2)
line_21 = Line(flatten(line_8))

# ----
# Truss Roof Beams
line_22 = Line(cluster_23)

cluster_70 = Cluster_21(pt=divide_4.Points)
cluster_71 = Cluster_20(pt=divide_4.Points)
data_11 = Data(cluster_63)
cull_17 = CullPattern(List=cluster_71, CullPattern=data_11)
cull_18 = CullPattern(List=cluster_70, CullPattern=data_11)
line_23 = Line([cull_18, cull_17])

cluster_72 = Cluster_17(data=pt_31)
cluster_73 = Cluster_17(data=pt_32)
cluster_74 = Cluster_5(pt=cluster_72)
cluster_75 = Cluster_5(pt=cluster_73)
ln_6 = Line(StartPoint=cluster_74, EndPoint=cluster_75)

item_5 = ListItem(List=line_21, Index=Slider(0, range=0..100), Wrap=True)
c_script_2 = CSharpScript(lines=line_21)  # -> out, A, B; inputs lines: list of Line
# ---------- c_script_2: C# ----------
    GH_Path path = new GH_Path();

    DataTree<Line> linestree = new DataTree<Line>();
    Line lineA = lines[0];
    lines.RemoveAt(0);
    int i = 0;
    List<Line> templist = new List<Line>();

    foreach(Line lineB in lines)
    {
      if(lineA.To == lineB.From)
      {
        //lines.Remove(line);
        path = new GH_Path(i);
        linestree.Add(lineA, path);
        lineA = lineB;
        //lines.Remove(line);

      }
      else
      {
        //templist.Add(lineB);
      }


    }

    A = linestree;
    B = lines;
# ---------- end c_script_2 ----------
c_script_3 = CSharpScript(lines=line_21)  # -> out, A, B; inputs lines: list of Line
# ---------- c_script_3: C# ----------
    GH_Path path = new GH_Path();

    DataTree<Line> linestree = new DataTree<Line>();
    //Line lineA = lines[0];
    //lines.RemoveAt(0);
    int i = 0;
    List<Line> templist = new List<Line>();
    templist = lines;
    foreach(Line lineA in lines)
    {
      Line lineC = lineA;
      foreach(Line lineB in lines)
      {
        if(lineC.To == lineB.From)
        {
          //templist.Remove(LineC);
          //lines.Remove(line);
          path = new GH_Path(i);
          linestree.Add(lineC, path);
          lineC = lineB;
          //lines.Remove(line);

        }
        else
        {
          //templist.Add(lineB);
        }
      }
      i = i + 1;

    }





    A = linestree;
    B = lines;
# ---------- end c_script_3 ----------
merge_7 = Merge(Data1=pt_31, Data2=pt_32)
num_73 = Number(num_40)
data_12 = Data(num_42)
line_24 = Line(c_script_2.B)
line_25 = Line(c_script_2.A)
num_74 = Number(num_35)

num_75 = Number(multiplication_5)
equals_5 = Equality(FirstNumber=num_75, SecondNumber="0")  # -> Equality, Inequality

panel_7 = Panel(c_script_2.out)
panel_8 = Panel(c_script_3.A)

cull_19 = CullPattern(List=divide_4.Points, CullPattern=cluster_49)
num_76 = Number(multiplication_8)
cluster_76 = Cluster_4(pt=cull_19, F=num_76)  # -> pt_3, G

filter_9 = StreamFilter(Gate=data_10, Stream0=ln_6)
cluster_77 = Cluster_7(pt=pt_30)

# ----
# Indexen startpunten
# Indexen eindpunten
data_13 = Data(line_8)
data_14 = Data(flatten(line_22))
data_15 = Data(flatten(data_13))
lng_3 = ListLength(List=data_13)  # -> flatten(Length)
lng_4 = ListLength(List=data_14)
lng_5 = ListLength(List=data_15)
series = Series(Start=lng_4, Step=1, Count=lng_5)
partition = PartitionList(List=series, Size=lng_3)
lng_6 = ListLength(List=partition)
item_6 = ListItem(List=partition, Index=expr("x-1", lng_6), Wrap=True)  # -> flatten(Item)
item_7 = ListItem(List=partition, Index="0", Wrap=True)  # -> flatten(Item)
num_77 = Number(item_7)
num_78 = Number(item_6)
beam_joints = BeamJointsKaramba(
    ElementIdentifiers=num_77,
    CtKNMAtStartingNode=Vector(0, 0, 0),
    CrKNmRadAtStartingNode=Vector(0, 0, 0),
    CtKNMAtEndNode=Vector(0, 0, 0),
    CrKNmRadAtEndNode=Vector(0, 0, 0),
    menu=[buttons(off, off, off, off, on, off), buttons(off, off, off, off, off, off)])
beam_joints_2 = BeamJointsKaramba(
    ElementIdentifiers=num_78,
    CtKNMAtStartingNode=Vector(0, 0, 0),
    CrKNmRadAtStartingNode=Vector(0, 0, 0),
    CtKNMAtEndNode=Vector(0, 0, 0),
    CrKNmRadAtEndNode=Vector(0, 0, 0),
    menu=[buttons(off, off, off, off, off, off), buttons(off, off, off, off, on, off)])
joint = JointKaramba3D([beam_joints, beam_joints_2])

num_79 = Number(multiplication_5)
equals_6 = Equality(FirstNumber=num_79, SecondNumber="0")  # -> Equality, Inequality
filter_10 = StreamFilter(Gate=equals_6.Inequality, Stream1=filter_9)

boolean_toggle_2 = BooleanToggle(False)
line_26 = Line(line_23)
stream_filter_4 = StreamFilter(Gate=boolean_toggle_2, Stream1=line_26)

# ----
# Truss Verticals
line_27 = Line(filter_10)

line_28 = Line(stream_filter_4)

# ----
# Roof Spacers
line_29 = Line(cluster_77)

# ----
# Supports
pt_34 = Point(cluster_76.G)

# ---- group: 3. Project utilities
dom = ConstructDomain(DomainStart="0", DomainEnd="1")
range = Range(Domain=dom, Steps=Slider(10, range=0..100))

# ---- group: Karamba3D Structural analysis / Define Materials
matselect = MaterialSelectionKaramba3D(menu=[dropdown(1), dropdown(4)])

# ---- group: Karamba3D Structural analysis / Define Cross Sections
crosecrselect = CrossSectionRangeSelectorKaramba3D(MaximumHeight_cm=-1, MaximumWidth_cm=-1, Material=matselect, menu=[dropdown(1), dropdown(2), dropdown(0)])
crosecrselect_2 = CrossSectionRangeSelectorKaramba3D(MaximumHeight_cm=-1, MaximumWidth_cm=-1, Material=matselect, menu=[dropdown(0), dropdown(1), dropdown(3)])
crosecrselect_3 = CrossSectionRangeSelectorKaramba3D(MaximumHeight_cm=-1, MaximumWidth_cm=-1, Material=matselect, menu=[dropdown(2), dropdown(3), dropdown(1)])
panel_9 = Panel("2")
panel_10 = Panel("""RoofBeams
TrussRoofBeams
TrussBeams
OuterColumns
WallBeams""")
panel_11 = Panel("""WallBracing
RoofBracing""")
panel_12 = Panel("""TrussDiagonals
TrussVerticals
RoofSpacers
TrussSpacers""")
crosecselect = CrossSectionSelectorKaramba3D(CrossSections=crosecrselect_2, ElementsIdentifiers=panel_10)  # -> CrossSection, Info
crosecselect_2 = CrossSectionSelectorKaramba3D(CrossSections=crosecrselect_3, ElementsIdentifiers=panel_12)  # -> CrossSection, Info
crosecselect_3 = CrossSectionSelectorKaramba3D(CrossSections=crosecrselect, ElementsIdentifiers=panel_11)  # -> CrossSection, Info
entwine = Entwine(
    Branch00=crosecselect.CrossSection,
    Branch01=crosecselect_2.CrossSection,
    Branch02=crosecselect_3.CrossSection,
    FlattenInputs=True)
entwine_2 = Entwine(Branch00=crosecrselect_2, Branch01=crosecrselect_3, Branch02=crosecrselect, FlattenInputs=True)

# ----
panel_13 = Panel("""RoofBeams
TrussRoofBeams
TrussDiagonals
TrussVerticals
TrussBeams
RoofSpacers
TrussSpacers
WallBracing
RoofBracing
WallBeams""")
point = Point(divide_2.Points)
number = Number(c_script)

# ---- group: Karamba3D Structural analysis / Define Loads
load_multiplier = Slider(-5, range=-500..0)
load_multiplier_2 = Slider(1, range=1..2)
Y_5 = UnitY(Factor=load_multiplier_2)
Z_4 = UnitZ(Factor=load_multiplier)
loads = LoadsKaramba3D(Vector=Y_5, BeamIdentifiers="TrussRoofBeams", LCase="0", mode="Uniform Line", menu=[buttons(on, off, off)])
loads_2 = LoadsKaramba3D(Vector=Z_4, BeamIdentifiers="TrussRoofBeams", LCase=0, mode="Uniform Line", menu=[buttons(on, off, off)])

# ----
multiplication_12 = Multiplication(A=load_multiplier, B=number)
panel_14 = Panel("RoofBracing")
# KOALA
# SCIA Engineer plugin
panel_15 = Panel("016")
rad = Radians(Degrees=Slider(-12, range=-100..100))
hierarchy = Panel("""OuterColumns
RoofBeams
TrussRoofBeams
TrussBeams""")

dom_2 = ConstructDomain(DomainStart="0", DomainEnd="1")
range_2 = Range(Domain=dom_2, Steps=Slider(5, range=0..100))

Y_6 = UnitY(Factor=1)

panel_16 = Panel("Y:\Constructies\personen\ABT Delft\Rayaan\Grasshopper\CaseStudy5")
colibri_iterator = ColibriIterator(Xcount=xcount, Ycount=ycount, RemoteFly=False, ignoreAllWarningMsg=False)  # -> Xcount, Ycount, Value_N, Iteration_Genome

num_80 = Number(num_10)
num_81 = Number(num_9)

num_82 = Number(expr("x+1-2", num_81))
num_83 = Number(expr("x+1", num_80))

num_84 = Number(expr("x-1", num_83))
cluster_78 = Cluster_3(num=num_82, num_2=num_83)
merge_8 = Merge(Data1="0", Data2=num_84)
cluster_79 = Cluster_2(data=cluster_78, data_2=merge_8)

pt_35 = Point(cluster_10.G)
pt_36 = Point(cluster_10.pt_3)
flip_17 = FlipMatrix(Data=pt_35)
flip_18 = FlipMatrix(Data=pt_36)
cluster_80 = Cluster_11(data=flip_18)
cluster_81 = Cluster_11(data=flip_17)
pt_37 = Point(cluster_81)
pt_38 = Point(cluster_80)
flip_19 = FlipMatrix(Data=pt_37)
flip_20 = FlipMatrix(Data=pt_38)
p_n_c = PickNChoose(Pattern=cluster_79, Stream0=flip_19, Stream1=flip_20)
filter_11 = StreamFilter(Gate=equals.Inequality, Stream1=p_n_c)
cluster_82 = Cluster_7(pt=filter_11)

# ----
# Truss Spacers
line_30 = Line(cluster_82)

entwine_3 = Entwine(
    Branch00=line_22,
    Branch01=line_8,
    Branch02=line_9,
    Branch03=line_10,
    Branch04=line_11,
    Branch05=line_12,
    Branch06=line_30,
    Branch07=line_17,
    Branch08=line_18,
    Branch09=line_20,
    Branch010=line_19,
    FlattenInputs=True)
pt_39 = Point(flatten(pt_33))

# ---- group: Stream filter to control data speed
toggle = BooleanToggle(True)
# Transport Elements Generator
filter_12 = StreamFilter(Gate=toggle, Stream1=pt_39)
filter_13 = StreamFilter(Gate=toggle, Stream1=entwine_3)

# ----
pt_40 = Point(divide_4.Points)
pt_41 = Point(pt_40)
lng_7 = ListLength(List=pt_41)
item_8 = ListItem(List=pt_41, Index=0, Wrap=True)
item_9 = ListItem(List=pt_41, Index=expr("x-1", lng_7), Wrap=True)

cluster_83 = Cluster_17(data=pt_40)

pt_42 = Point(cluster_83)
lng_8 = ListLength(List=pt_42)
item_10 = ListItem(List=pt_42, Index=0, Wrap=True)
item_11 = ListItem(List=pt_42, Index=expr("x-1", lng_8), Wrap=True)

num_85 = Number(multiplication_5)
num_86 = Number(num_36)
num_87 = Number(multiplication_8)
cluster_84 = Cluster_12(num=num_85, num_3=num_87, pt=item_8, num_2=num_86)
cluster_85 = Cluster_12(num=num_85, num_3=num_87, pt=item_9, num_2=num_86)
cluster_86 = Cluster_12(num=num_85, num_3=num_87, pt=item_10, num_2=num_86)
cluster_87 = Cluster_12(num=num_85, num_3=num_87, pt=item_11, num_2=num_86)

panel_17 = Panel(num_87)
cluster_88 = Cluster_17(data=cluster_84)
cluster_89 = Cluster_17(data=cluster_85)

cluster_90 = Cluster_21(pt=cluster_87)
cluster_91 = Cluster_20(pt=cluster_87)
cluster_92 = Cluster_15(num=num_73, num_2=num_86, data=data_12)
pt_43 = Point(cluster_87)
cluster_93 = Cluster_11(data=pt_43)
flip_21 = FlipMatrix(Data=cluster_93)
cull_20 = CullPattern(List=cluster_90, CullPattern=cluster_92)
cull_21 = CullPattern(List=cluster_91, CullPattern=cluster_92)
cluster_94 = Cluster_7(pt=flip_21)
cull_22 = CullPattern(List=cluster_94, CullPattern=cluster_92)
line_31 = Line([cull_20, cull_21])

cluster_95 = Cluster_15(num=num_73, num_2=num_86, data=data_12)
cluster_96 = Cluster_21(pt=cluster_86)
cluster_97 = Cluster_20(pt=cluster_86)
pt_44 = Point(cluster_86)
cluster_98 = Cluster_11(data=pt_44)
flip_22 = FlipMatrix(Data=cluster_98)
cull_23 = CullPattern(List=cluster_96, CullPattern=cluster_95)
cull_24 = CullPattern(List=cluster_97, CullPattern=cluster_95)
cluster_99 = Cluster_7(pt=flip_22)
cull_25 = CullPattern(List=cluster_99, CullPattern=cluster_95)
line_32 = Line([cull_23, cull_24])

cluster_100 = Cluster_21(pt=cluster_85)
cluster_101 = Cluster_20(pt=cluster_85)
cluster_102 = Cluster_15(num=num_74, num_2=num_86, data=num_41)
pt_45 = Point(cluster_85)
cluster_103 = Cluster_11(data=pt_45)
flip_23 = FlipMatrix(Data=cluster_103)
cull_26 = CullPattern(List=cluster_100, CullPattern=cluster_102)
cull_27 = CullPattern(List=cluster_101, CullPattern=cluster_102)
cluster_104 = Cluster_7(pt=flip_23)
cull_28 = CullPattern(List=cluster_104, CullPattern=cluster_102)
line_33 = Line([cull_26, cull_27])

pt_46 = Point(pt_30)
cluster_105 = Cluster_11(data=pt_46)  # -> simplify(L)

cluster_106 = Cluster_17(data=cluster_105)

pt_47 = Point(cluster_106)
cluster_107 = Cluster_7(pt=pt_47)

# ----
# Truss Roof Beams
line_34 = Line(cluster_107)

pt_48 = Point(simplify(pt_30))
cull_29 = CullPattern(List=pt_48, CullPattern=cluster_66)

cluster_108 = Cluster_17(data=cull_29)

cluster_109 = Cluster_7(pt=cluster_108)

line_35 = Line(cluster_109)

data_16 = Data(data_10)
pt_49 = Point(pt_31)
pt_50 = Point(pt_32)

cluster_110 = Cluster_17(data=pt_49)
cluster_111 = Cluster_17(data=pt_50)

cluster_112 = Cluster_10(L_2=cluster_110, L=cluster_111)
cluster_113 = Cluster_8(pt=cluster_110, pt_2=cluster_111)
filter_14 = StreamFilter(Gate=data_16, Stream0=cluster_113, Stream1=cluster_112)

num_88 = Number(multiplication_5)
equals_7 = Equality(FirstNumber=num_88, SecondNumber="0")  # -> Equality, Inequality
filter_15 = StreamFilter(Gate=equals_7.Inequality, Stream1=filter_14)

# ----
# Truss Diagonals
line_36 = Line(filter_15)

pt_51 = Point(cluster_67.pt_3)
pt_52 = Point(cluster_67.G)

cluster_114 = Cluster_17(data=pt_52)
cluster_115 = Cluster_17(data=pt_51)

num_89 = Number(num_40)
num_90 = Number(num_35)

num_91 = Number(expr("x+1-2", num_90))
num_92 = Number(expr("x+1", num_89))

num_93 = Number(num_89)
dup_4 = DuplicateData(Data=graft(num_93), Number=expr("x+1", graft(num_93)), Order=True)  # -> flatten(Data)
num_94 = Number(graft(dup_4))
cluster_116 = Cluster(num=num_94)  # -> simplify(L)

num_95 = Number(expr("x-1", graft(num_92)))
cluster_117 = Cluster_19(num=num_91, num_2=num_92)
merge_9 = Merge(Data1="0", Data2=num_95)
cluster_118 = Cluster_18(data=cluster_117, data_2=cluster_116)

panel_18 = Panel(cluster_118)
panel_19 = Panel(cluster_117)

pt_53 = Point(cluster_67.G)
data_17 = Data(num_33)
cluster_119 = Cluster_5(pt=pt_53)
cluster_120 = Cluster_7()

cluster_121 = Cluster_17(data=cluster_119)

cluster_122 = Cluster_5(pt=cluster_121)
cluster_123 = Cluster_7(pt=cluster_122)
filter_16 = StreamFilter(Gate=data_17, Stream0=cluster_120, Stream1=cluster_123)

num_96 = Number(multiplication_5)
equals_8 = Equality(FirstNumber=num_96, SecondNumber="0")  # -> Equality, Inequality
filter_17 = StreamFilter(Gate=equals_8.Inequality, Stream1=filter_16)

# ----
# Truss Beams
line_37 = Line(filter_17)

cluster_124 = Cluster_11(data=cluster_114)
cluster_125 = Cluster_11(data=cluster_115)
pt_54 = Point(cluster_124)
pt_55 = Point(cluster_125)

cluster_126 = Cluster_17(data=pt_54)
cluster_127 = Cluster_17(data=pt_55)

p_n_c_2 = PickNChoose(Pattern=cluster_118, Stream0=cluster_126, Stream1=cluster_127)
filter_18 = StreamFilter(Gate=equals_5.Inequality, Stream1=p_n_c_2)
cluster_128 = Cluster_7(pt=filter_18)

# ----
# Truss Spacers
line_38 = Line(cluster_128)

cluster_129 = Cluster_11(data=cluster_89)
cluster_130 = Cluster_11(data=cluster_88)
cluster_131 = Cluster_7(pt=cluster_86)
cluster_132 = Cluster_7(pt=cluster_87)

cluster_133 = Cluster_17(data=cluster_129)
cluster_134 = Cluster_17(data=cluster_130)

cluster_135 = Cluster_7(pt=cluster_134)
cluster_136 = Cluster_7(pt=cluster_133)
merge_10 = Merge(Data1=cluster_135, Data2=cluster_136, Data3=cluster_131, Data4=cluster_132)

# ----
# OuterColumns_South
line_39 = Line(cluster_135)

# ----
# OuterColumns_North
line_40 = Line(cluster_136)

# ----
# OuterColumns_West
line_41 = Line(cluster_131)

# ----
# OuterColumns_East
line_42 = Line(cluster_132)

# ----
# OuterColumns
line_43 = Line(merge_10)

cluster_137 = Cluster_20(pt=cluster_84)
cluster_138 = Cluster_15(num=num_74, num_2=num_86, data=num_41)
cluster_139 = Cluster_21(pt=cluster_84)
pt_56 = Point(cluster_84)
cluster_140 = Cluster_11(data=pt_56)
flip_24 = FlipMatrix(Data=cluster_140)
cull_30 = CullPattern(List=cluster_139, CullPattern=cluster_138)
cull_31 = CullPattern(List=cluster_137, CullPattern=cluster_138)
line_44 = Line([cull_30, cull_31])

cluster_141 = Cluster_17(data=cluster_140)

cluster_142 = Cluster_7(pt=cluster_141)
cull_32 = CullPattern(List=cluster_142, CullPattern=cluster_138)

merge_11 = Merge(Data1=line_44, Data2=line_33, Data3=line_32, Data4=line_31)
merge_12 = Merge(Data1=cull_32, Data2=cull_28, Data3=cull_25, Data4=cull_22)
line_45 = Line(merge_11)
stream_filter_5 = StreamFilter(Gate=boolean_toggle_2, Stream1=merge_12)
stream_filter_6 = StreamFilter(Gate=boolean_toggle_2, Stream1=line_45)

# ----
# Wall Bracing
line_46 = Line(stream_filter_6)

# ----
# WallBeams
line_47 = Line(stream_filter_5)

pt_57 = Point(flatten(pt_34))
entwine_4 = Entwine(
    Branch00=line_35,
    Branch01=line_34,
    Branch02=line_36,
    Branch03=line_27,
    Branch04=line_37,
    Branch05=line_29,
    Branch06=line_38,
    Branch07=line_43,
    Branch08=line_46,
    Branch09=line_28,
    Branch010=line_47,
    FlattenInputs=True)

line_48 = Line(entwine_4)

# ---- group: 3. Project utilities
# Visualisation by Color
x_0 = Slider(4, range=0..10)
_0_x = Slider(1, range=0..10)
entwine_5 = Entwine(
    Branch00=flatten(line_17),
    Branch01=flatten(line_22),
    Branch02=flatten(line_12),
    Branch03=flatten(line_30),
    Branch04=flatten(line_20),
    Branch05=flatten(line_18),
    Branch06=flatten(line_19),
    FlattenInputs=True)
cluster_143 = Cluster_6(B=x_0, B_2=_0_x)

lng_9 = ListLength(List=entwine_5)  # -> flatten(Length)
lng_10 = ListLength(List=lng_9)  # -> expr("x-1", Length)
dom_3 = ConstructDomain(DomainStart="0.15", DomainEnd="0.05")
range_3 = Range(Domain=dom_3, Steps=lng_10)
c_script_4 = CSharpScript(x=range_3, y=lng_9)  # -> out, A; inputs x: list of Double, y: list of Double
# ---------- c_script_4: C# ----------
    for (int i = 0; i < x.Count;i++)
    {
      for(int b = 0; b < y[i];b++)
      {
        Print(x[i].ToString());
      }
    }
# ---------- end c_script_4 ----------

pt_58 = Point(pt_5)
c_script_5 = CSharpScript(lines=line_8, points=pt_58)  # -> out, A, pbolt, vbolt; inputs lines: tree of Line, points: list of Point3d; same code as c_script
c_script_6 = CSharpScript(lines=line_9, points=pt_58)  # -> out, A, pbolt, vbolt; inputs lines: tree of Line, points: list of Point3d; same code as c_script
c_script_7 = CSharpScript(lines=line_10, points=pt_58)  # -> out, A, pbolt, vbolt; inputs lines: tree of Line, points: list of Point3d; same code as c_script
c_script_8 = CSharpScript(lines=line_11, points=pt_58)  # -> out, A, pbolt, vbolt; inputs lines: tree of Line, points: list of Point3d; same code as c_script
merge_13 = Merge(Data1=c_script_5.pbolt, Data2=c_script_6.pbolt, Data3=c_script_7.pbolt, Data4=c_script_8.pbolt)
merge_14 = Merge(Data1=c_script_5.vbolt, Data2=c_script_6.vbolt, Data3=c_script_7.vbolt, Data4=c_script_8.vbolt)

c_script_9 = CSharpScript(lines=line_8, points=pt_58)  # -> out, A, pbolt, vbolt; inputs lines: tree of Line, points: list of Point3d
# ---------- c_script_9: C# ----------
    DataTree<Line> linestree = new DataTree<Line>();




    GH_Path path = new GH_Path();
    GH_Path pointpath = new GH_Path();
    Point3d punt = new Point3d();
    DataTree<Point3d> plist = new DataTree<Point3d>();
    DataTree<Vector3d> vlist = new DataTree<Vector3d>();

    for (int b = 0; b < lines.BranchCount; b++)
    {
      int i = 0;
      foreach (Line line in lines.Branches[b])
      {
        //Ervoor
        pointpath = new GH_Path(b);
        path = new GH_Path(b, i);
        if (line.FromX <= points[i].X && line.ToX <= points[i].X)
        {
          linestree.Add(line, path);
        }
        //Ertussen
        if (line.FromX < points[i].X && line.ToX > points[i].X)
        {
          Point3d Start = new Point3d(line.FromX, line.FromY, line.FromZ);
          Point3d cpoint = new Point3d();

          foreach (Point3d point in points)
          {
            if (line.FromX < point.X && line.ToX > point.X)
            {
              double stuk = points[i].X - line.FromX;
              double length = line.ToX - line.FromX;
              double percentage = stuk / length;
              double Xnew = percentage * line.Direction.X + line.FromX;
              double Ynew = percentage * line.Direction.Y + line.FromY;
              double Znew = percentage * line.Direction.Z + line.FromZ;
              cpoint = new Point3d(Xnew, Ynew, Znew);
              Line lineA = new Line(Start, cpoint);

              linestree.Add(lineA, path);
              punt = cpoint;
              plist.Add(punt, pointpath);
              vlist.Add(line.Direction, pointpath);
              //volgende punt
              //volgende path
              i = i + 1;
              path = new GH_Path(b, i);
            }
          }
          if (line.ToX > points[i].X)
          {
            punt = cpoint;

          }
          else
          {
            Line lineB = new Line(cpoint, line.To);
            linestree.Add(lineB, path);
          }
        }
        //Erna (bestaat eigenlijk niet)
        if (line.FromX >= points[i].X && line.ToX >= points[i].X)
        {
          i = i + 1;
          path = new GH_Path(b, i);
          linestree.Add(line, path);
          //moet eindigen
        }
      }
    }

    A = linestree;
    pbolt = plist;
    vbolt = vlist;
# ---------- end c_script_9 ----------

merge_15 = Merge(Data1=c_script_9.A, Data2=c_script_6.A, Data3=c_script_7.A, Data4=c_script_8.A)

pt_59 = Point(merge_13)
number_slider = Slider(0.165, range=0..1)
pl = PlaneNormal(Origin=pt_59, ZAxis=merge_14)
# Transport Elements Generator
box = CenterBox(Base=pl, X=number_slider, Y=number_slider, Z=Slider(0.017, range=0..1))

branch = TreeBranch(Tree=merge_15, Path=cluster_143, MaintainPaths=True)
lng_11 = ListLength(List=pt_58)
lng_12 = ListLength(List=merge_15)
pdecon = Deconstruct(Point=pt_59)  # -> XComponent, YComponent, ZComponent
pipe = Pipe(Curve=flatten(entwine_5), Radius=c_script_4.out, Caps=0)  # -> flatten(Pipe)

data_18 = Data(range)
data_19 = Data(merge_15)
c_script_10 = CSharpScript(lengths=lng_12, x=lng_11, colorlist=data_18)  # -> out, A, B, C; inputs lengths: tree of Double, x: Double, colorlist: list of Double
# ---------- c_script_10: C# ----------
    DataTree<double> tree = new DataTree<double>();
    GH_Path path = new GH_Path();
    double links = lengths.BranchCount / x;
    int w = 0;

    for (int b = 0; b < links; b++)
    {
      //int i = 0;
      for (int i = 0; i < x;i++)
        //foreach (Line line in lines.Branches[b])
      {

        path = new GH_Path(b, i);
        //double num = lengths.Paths(b, i);
        //tree.Add(lengths.Branch(b, i)[0], path);
        for (int c = 0;c < lengths.Branch(b, i)[0];c++)
        {


          double num = colorlist[(w % colorlist.Count)];
          tree.Add(num, path);
          
          //moet eindigen

        }
        w = w + 1;


      }

    }
    A = tree;
    B = 20 % colorlist.Count;
    C = lengths.DataCount;
# ---------- end c_script_10 ----------
data_20 = Data(flatten(c_script_10.A))
gradient = Gradient(
    LowerLimit=0,
    UpperLimit=1,
    Parameter=data_20,
    stops=[0: RGB(243, 57, 0), 0.1: RGB(236, 27, 60), 0.2: RGB(210, 0, 118), 0.3: RGB(103, 0, 120), 0.4: RGB(39, 72, 161), 0.5: RGB(1, 192, 229), 0.6: RGB(18, 178, 90), 0.7: RGB(79, 186, 8), 0.8: RGB(220, 237, 32), 0.9: RGB(247, 159, 20), 1: RGB(243, 57, 0)])
pipe_2 = Pipe(Curve=data_19, Radius=Slider(0.1, range=0..0.1), Caps=0)  # -> flatten(Pipe)

# ----
toggle_2 = BooleanToggle(True)
colour = ColourPicker(PickedColour=RGB(143, 143, 143))
brep = Brep(pipe_2)
filter_19 = StreamFilter(Gate=toggle_2, Stream1=box)
filter_20 = StreamFilter(Gate=toggle_2, Stream1=brep)
filter_21 = StreamFilter(Gate=toggle_2, Stream1=pipe)
brep_2 = Brep(filter_19)
preview = CustomPreview(Geometry=filter_20, Material=gradient)
preview_2 = CustomPreview(Geometry=filter_21, Material=colour)

# ---- group: Karamba3D Structural analysis
# Karamba3D
pt_60 = Point(filter_12)
line_49 = Line(filter_13)
pt_61 = Point(pt_60)
merge_16 = Merge(Data1=panel_12, Data2="WallBeams", Data3=panel_11)
load = LoadKaramba3D(loads_2)
crosec = CrossSectionKaramba3D(flatten(entwine_2))

# ---- group: Karamba3D Structural analysis / Define Elements
panel_20 = Panel("""RoofBeams
TrussRoofBeams
TrussDiagonals
TrussVerticals
TrussBeams
RoofSpacers
TrussSpacers
OuterColumns
WallBracing
RoofBracing
WallBeams""")
linetobeam = LineToBeamKaramba3D(Line=line_49, Identifier=graft(panel_20), New=True, Remove=True, LimitDistance_m=0.005)  # -> Element, Points, Info

# ---- group: Karamba3D Structural analysis / Define Hinges
panel_21 = Panel(merge_16)
beam_joints_3 = BeamJointsKaramba(
    ElementIdentifiers=panel_21,
    CtKNMAtStartingNode=Vector(0, 0, 0),
    CrKNmRadAtStartingNode=Vector(0, 0, 0),
    CtKNMAtEndNode=Vector(0, 0, 0),
    CrKNmRadAtEndNode=Vector(0, 0, 0),
    menu=[buttons(off, off, off, off, on, on), buttons(off, off, off, off, on, on)])

# ---- group: Karamba3D Structural analysis / Define Supports
supp = SupportKaramba(PosInd=pt_61, menu=[buttons(on, on, on, on, off, on)])

# ----
joint_2 = JointKaramba3D(beam_joints_3)

# ---- group: Karamba3D Structural analysis / Assemble Model
assemble = AssembleModelKaramba3D(
    Elem=flatten(linetobeam.Element),
    Support=flatten(supp),
    Load=flatten(load),
    CrossSection=flatten(entwine),
    Joint=flatten([joint_2, joint]),
    LimitDistance_m=0.005)  # -> Model, Info, Mass_kg, CenterOfGravity

# ---- group: Karamba3D Structural analysis (continued)
opticrosec = OptimizeCrossSectionKaramba3D(
    Model=assemble.Model,
    GroupIdentifiers=panel_20,
    CrossSections=crosec,
    MaximumUtilization=1,
    MaximumDisplacement_cm=-1,
    UltimateLimitStateIterations=5,
    DisplacementIterations=5,
    NumberOfSamplePoints=3,
    ElasticDesign=True,
    GammaM0=1,
    GammaM1=1)  # -> ModelWithOptimizedCrossSections, Info, Mass_kg, MaximumDisplacement_cm, ElasticEnergy_kNm

# ---- group: Karamba3D Structural analysis / Analyze Model
analyze = AnalyzeKaramba3D(Model=opticrosec.ModelWithOptimizedCrossSections)  # -> CalculatedModel, MaximumDisplacement_cm, ResultingForceOfGravity_kN, ElasticEnergy_kNm
panel_22 = Panel(analyze.MaximumDisplacement_cm)

# ----
c_script_11 = CSharpScript(
    Model_in=assemble.Model,
    CroSecs_in=crosec,
    niter="10",
    lcind="0",
    Reference=["C:\Program Files\Rhino 6\Plug-ins\karambaCommon.dll", "C:\Program Files\Rhino 6\Plug-ins\karamba.gha"])  # -> out, Model_out, Disp_out; inputs CroSecs_in: list, niter: Int32, lcind: Int32
# ---------- c_script_11: C# usings ----------
using Karamba.Models;
using Karamba.CrossSections;
using Karamba.Elements;
using Karamba.Results;
# ---------- c_script_11: C# ----------
    var model = Model_in as Model;
    if (model == null) {
      throw new ArgumentException("The input in 'Model_in' is not of type Karamba.Models.Model!");
    }

    var crosecs = new List<CroSec_Beam>(CroSecs_in.Count);
    foreach (var item in CroSecs_in) {
      var crosec = item as CroSec_Beam;
      if (crosec == null) {
        throw new ArgumentException("The input in 'CroSecs_in' contains objects which are not of type Karamba.CrossSections.CroSec_Beam!");
      }
      crosecs.Add(crosec);
    }

    var k3d = new KarambaCommon.Toolkit();
    List<double> max_disp;
    List<double> out_g;
    List<double> out_comp;
    string message;
    List<List<double>> N;
    List<List<double>> V;
    List<List<double>> M;

    // avoid side effects
    model = model.Clone();
    model.cloneElements();

    for (int i = 0; i < niter; ++i) {
      model = k3d.Algorithms.AnalyzeThI(model, out max_disp, out out_g, out out_comp, out message);

      for (int elem_ind = 0; elem_ind < model.elems.Count; ++elem_ind) {
        var beam = model.elems[elem_ind] as ModelBeam;
        if (beam == null) continue;

        // avoid side effects
        beam = (ModelBeam) beam.Clone();
        model.elems[elem_ind] = beam;

        BeamResultantForces.solve(model, new List<string> {"" + elem_ind}, lcind, 100, 1,
          out N, out V, out M);

        for (int crosec_ind = 0; crosec_ind < crosecs.Count; ++crosec_ind) {
          var crosec = crosecs[crosec_ind];
          beam.crosec = crosec;
          var max_sigma = Math.Abs(N[lcind][0]) / crosec.A + M[lcind][0] / crosec.Wely_z_pos;
          if (max_sigma < crosec.material.fy()) break;
        }
      }

      model.initMaterialCroSecLists();
      model.febmodel = model.buildFEModel();
    }

    model = k3d.Algorithms.AnalyzeThI(model, out max_disp, out out_g, out out_comp, out message);

    Disp_out = new GH_Number(max_disp[lcind]);

    Model_out = new Karamba.GHopper.Models.GH_Model(model);
# ---------- end c_script_11 ----------
panel_23 = Panel(opticrosec.Info)
characters = Characters(Text=opticrosec.Info)  # -> Result, Unicode
list_length = ListLength(List=characters.Result)

# ---- group: Karamba3D Structural analysis / View Results
modelview = ModelViewKaramba3D(Model=opticrosec.ModelWithOptimizedCrossSections, LoadCaseFactorsForLinearSuperposition=1, IndexOfVisibleLoadcase=-1)  # -> Model, DeformedMesh, DeformedAxes, DeformedModel
beamview = BeamViewKaramba3D(Model=modelview.Model)  # -> Model, MeshesOfRenderedBeams, DeformedBeamAxes, LegendColors, LegendTags

# ----
equality = Equality(FirstNumber=list_length, SecondNumber="0")  # -> Equality, Inequality

# ---- group: Structure to Joint data transfer / Stream filter to control data speed
filter_22 = StreamFilter(Gate=Toggle(True), Stream1=beamview.Model)

# ---- group: Structure to Joint data transfer / Data collect
disassemble = DisassembleModelKaramba3D(Model=filter_22)  # -> Model, Point, Beam, Shell, Support, Load, Line, Mesh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
k3dbeamprops = CSharpScript(
    Model=disassemble.Model,
    Reference=["C:\Program Files\Rhino 6\Plug-ins\karambaCommon.dll", "C:\Program Files\Rhino 6\Plug-ins\karamba.gha"])  # -> BeamIds, Material, CrosecNames, CrosecShapes, Heights, Widths, TFlanges, TWebs, FRads
# ---------- k3dbeamprops: C# usings ----------
using Karamba.Elements;
using Karamba.CrossSections;
# ---------- k3dbeamprops: C# ----------
    var model = Model as Karamba.Models.Model;
    if (model == null) {
      throw new ArgumentException ("The input is not of type model!");
    }

    var beam_ids = new List<string>();
    var cs_names = new List<string>();
    var cs_shapes = new List<string>();
    var cs_material = new List<string>();
    var heights = new List<double>();
    var widths = new List<double>();
    var tflanges = new List<double>();
    var twebs = new List<double>();
    var frads = new List<double>();

    foreach (var elem in model.elems)
    {
      var beam = elem as ModelElementStraightLine;
      if (beam != null) {
        beam_ids.Add(elem.id);
        cs_names.Add(elem.crosec.name);
        cs_shapes.Add(elem.crosec.shape());
        cs_material.Add(elem.crosec.materialName);

        // is it an I-profile?
        var crosec_i = beam.crosec as CroSec_I;
        if (crosec_i != null) {
          heights.Add(crosec_i.getHeight() * 1000);
          // use the upper flange thickness
          widths.Add(crosec_i.uf_width * 1000);
          tflanges.Add(crosec_i.uf_thick * 1000);
          twebs.Add(crosec_i.w_thick * 1000);
          // use the inner fillet radius
          frads.Add(crosec_i.fillet_r * 1000);
          // this would be the outer fillet radius
          // frads.Add(crosec.fillet_r1);
          continue;
        }

        // is it a CHS?
        var crosec_o = beam.crosec as CroSec_Circle;
        if (crosec_o != null) {
          heights.Add(crosec_o.getHeight() * 1000);
          // use the upper flange thickness
          widths.Add(0);
          tflanges.Add(crosec_o.thick * 1000);
          twebs.Add(crosec_o.thick * 1000);
          frads.Add(0);
          continue;
        }

        // options for Box, trapezoid and T-section are not implemented yet
        throw new Exception("Cross section encountered for which no export is implemented");
      }
    }

    BeamIds = beam_ids;
    CrosecNames = cs_names;
    CrosecShapes = cs_shapes;
    Material = cs_material;
    Heights = heights;
    Widths = widths;
    TFlanges = tflanges;
    TWebs = twebs;
    FRads = frads;
# ---------- end k3dbeamprops ----------
disassemble_2 = DisassembleElementKaramba3D(Element=disassemble.Beam)  # -> Element, ElementIdentifier, AxisOfElement, CrossSection, Joints, Material, LocalCoordinateSystem, ElementIsActive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
b_forces = BeamForcesKaramba3D(AnalyzedModel=disassemble.Model, LCase=-1, MaximumDistanceBetweenResults_m=-1, NumberOfResultsPerBeamElement=2)  # -> AnalyzedModel, NormalForce_kN, ShearForceVz_kN, ShearForceVy_kN, BendingMomentMt_kNm, BendingMomentMy_kNm, BendingMomentMz_kNm

# ----
k3dbeamprops_2 = CSharpScript(
    Model=disassemble.Model,
    Reference=["C:\Program Files\Rhino 6\Plug-ins\karambaCommon.dll", "C:\Program Files\Rhino 6\Plug-ins\karamba.gha"])  # -> BeamIds, Material, CrosecNames, CrosecShapes, Heights, Widths, TFlanges, TWebs, FRads, Family
# ---------- k3dbeamprops_2: C# ----------
    var model = Model as Karamba.Models.Model;
    if (model == null) {
      throw new ArgumentException ("The input is not of type model!");
    }

    var beam_ids = new List<string>();
    var cs_names = new List<string>();
    var cs_shapes = new List<string>();
    var cs_material = new List<string>();
    var heights = new List<double>();
    var widths = new List<double>();
    var tflanges = new List<double>();
    var twebs = new List<double>();
    var frads = new List<double>();
    var family = new List<string>();

    foreach (var elem in model.elems)
    {
      var beam = elem as ModelElementStraightLine;
      if (beam != null) {
        beam_ids.Add(elem.id);
        cs_names.Add(elem.crosec.name);
        cs_shapes.Add(elem.crosec.shape());
        cs_material.Add(elem.crosec.materialName);
        family.Add(elem.crosec.family);

        // is it an I-profile?
        var crosec_i = beam.crosec as CroSec_I;
        if (crosec_i != null) {
          heights.Add(crosec_i.getHeight() * 1000);
          // use the upper flange thickness
          widths.Add(crosec_i.uf_width * 1000);
          tflanges.Add(crosec_i.uf_thick * 1000);
          twebs.Add(crosec_i.w_thick * 1000);
          // use the inner fillet radius
          frads.Add(crosec_i.fillet_r * 1000);
          // this would be the outer fillet radius
          // frads.Add(crosec.fillet_r1);
          continue;
        }

        // is it a CHS?
        var crosec_o = beam.crosec as CroSec_Circle;
        if (crosec_o != null) {
          heights.Add(crosec_o.getHeight() * 1000);
          // use the upper flange thickness
          widths.Add(0);
          tflanges.Add(crosec_o.thick * 1000);
          twebs.Add(crosec_o.thick * 1000);
          frads.Add(0);
          continue;
        }

        // options for Box, trapezoid and T-section are not implemented yet
        throw new Exception("Cross section encountered for which no export is implemented");
      }
    }

    BeamIds = beam_ids;
    CrosecNames = cs_names;
    CrosecShapes = cs_shapes;
    Material = cs_material;
    Heights = heights;
    Widths = widths;
    TFlanges = tflanges;
    TWebs = twebs;
    FRads = frads;
    Family = family;
# ---------- end k3dbeamprops_2 ----------

# ----
# Input to add for material cost calculation: e.g hotformed vs coldformed
k3dbeamprops_3 = CSharpScript(
    Model=disassemble.Model,
    Reference=["C:\Program Files\Rhino 6\Plug-ins\karambaCommon.dll", "C:\Program Files\Rhino 6\Plug-ins\karamba.gha"])  # -> Family
# ---------- k3dbeamprops_3: C# ----------
    var model = Model as Karamba.Models.Model;
    if (model == null) {
      throw new ArgumentException ("The input is not of type model!");
    }


    var family = new List<string>();

    foreach (var elem in model.elems)
    {
      var beam = elem as ModelElementStraightLine;
      if (beam != null) {

        family.Add(elem.crosec.family);

      }
    }


    Family = family;
# ---------- end k3dbeamprops_3 ----------

# ---- group: Structure to Joint data transfer
# KarambaIDEA
hierarchy_2 = Panel("""OuterColumns
RoofBeams
TrussRoofBeams
TrussBeams
TrussVerticals
TrussDiagonals
RoofSpacers
TrussSpacers
WallBeams
WallBracing
RoofBracing""")
cp = CreateProject(
    Hierarchy=hierarchy_2,
    Points=disassemble.Point,
    Lines=disassemble.Line,
    LCSRotations_Deg=disassemble_2.Alpha_deg,
    Groupnames=k3dbeamprops.BeamIds,
    Materials=k3dbeamprops.Material,
    CrossSectionNames=k3dbeamprops.CrosecNames,
    Shapes=k3dbeamprops.CrosecShapes,
    Heights=k3dbeamprops.Heights,
    Widths=k3dbeamprops.Widths,
    ThicknessFlanges=k3dbeamprops.TFlanges,
    ThicknessWebs=k3dbeamprops.TWebs,
    Radius=k3dbeamprops.FRads,
    N=b_forces.NormalForce_kN,
    Vz=b_forces.ShearForceVz_kN,
    Vy=b_forces.ShearForceVy_kN,
    Mt=b_forces.BendingMomentMt_kNm,
    My=b_forces.BendingMomentMy_kNm,
    Mz=b_forces.BendingMomentMz_kNm)

# ----
loadcase = Slider(1, range=0..100)
joint_equilibrium = JointEquilibrium(Project=cp)  # -> XKN, YKN, ZKN, MtKN, MyKN, MzKN, Equilibrium
cluster_144 = Cluster_22(
    int=loadcase,
    data=joint_equilibrium.XKN,
    data_2=joint_equilibrium.YKN,
    data_3=joint_equilibrium.ZKN,
    data_4=joint_equilibrium.MtKN,
    data_5=joint_equilibrium.MyKN,
    data_6=joint_equilibrium.MzKN)  # -> flatten(R)

pt_62 = Point(disassemble.Point)
points = PointList(Points=pt_62)
tag = TextTag(Location=pt_62, Text=cluster_144)
weld_volume_generator = WeldVolumeGenerator(Joints=cp)
panel_24 = Panel(joint_equilibrium.Equilibrium)
ma = MassAddition(Input=weld_volume_generator)  # -> Result, PartialResults

textsize = Slider(0.15, range=0..0.15)
position = Slider(0.2, range=0..1)
line_50 = Line(disassemble.Line)
show_weldsizes = BooleanToggle(False)
txt = Text()
txt_2 = Text()

data_21 = Data(cp)
atemplate_finplateconnection = ATemplate_FinplateConnection(Project=cp, BrandNames=panel_15)  # -> Project, Message, Brep
data_22 = Data(atemplate_finplateconnection.Project)

# ---- group: 3. Project utilities
# Visualize joints
visualize_joints = VisualizeJoints(Project=data_21)  # -> JointTypes, Brandnames, Centerpoints
move_along_x = Slider(86, range=0..100)
radius = Slider(0.2, range=0.2..0.5)
spread = Slider(20, range=0..100)
textsize_2 = Slider(0.4, range=0..1)
cluster_145 = Cluster_26(line=visualize_joints.JointTypes, num_2=spread, num=move_along_x, num_3=radius)  # -> P, R
cluster_146 = Cluster_25(G=visualize_joints.Centerpoints, data_3=spread, X=move_along_x)
preview_3 = CustomPreview(Geometry=cluster_145.P, Material=cluster_145.R)
xz_2 = XZPlane(Origin=flatten(cluster_146))
data_23 = Data(flatten(visualize_joints.Brandnames))
tag_2 = TextTag3D(Location=xz_2, Text=data_23, Size=textsize_2, Colour=ColourSwatch(SwatchColor=RGB(0, 0, 0)), Justification=7)

# ---- group: 7. Cost calculation
total_weight = TotalWeight(Project=data_22)  # -> WeightElements_kg, WeightPlates_kg, Brep

# ----
weld_volume_generator_2 = WeldVolumeGenerator(Project=data_22)
retrievelinespoints = RetrieveLinesPoints(Project=data_22)  # -> Lines, Points
volume = Volume(Geometry=total_weight.Brep)  # -> Volume, Centroid
costcalculator = CostCalculator(
    WeightElements_kg=total_weight.WeightElements_kg,
    WeightPlates_kg=total_weight.WeightPlates_kg,
    WeldingVolume_cm3=weld_volume_generator_2,
    NumberOfElements=0,
    SteelPricePerKg=1,
    WeldingPricePerCm3=2.6,
    TransportPricePerElement=20)  # -> CostsOfBeamMaterial_, CostsPerJoint_, TransportCost_
multiplication_13 = Multiplication(A=volume.Volume, B=Slider(7850, range=0..10000))
ma_2 = MassAddition(Input=multiplication_13)  # -> Result, PartialResults
xz_3 = XZPlane(Origin=retrievelinespoints.Points)
panel_25 = Panel(multiplication_13)

number_slider_2 = Slider(7, range=0..15)
transport_elements_generator = TransportElementsGenerator(Project=cp, GroupNames=hierarchy, MaxLength=Slider(25, range=0..25), MaxAngle_rad=Slider(1, range=0..3))  # -> TransportElementLines, AllElementLines
lng_13 = ListLength(List=transport_elements_generator.TransportElementLines)
cluster_147 = Cluster_23(data=transport_elements_generator.AllElementLines)
data_24 = Data(flatten(cluster_147))
cluster_148 = Cluster_24(C=cluster_147)
lng_14 = ListLength(List=data_24)
# Roof Beams
# Truss Roof Beams
# Truss Diagonals
# Truss Verticals
# Truss Beams
# Make definition start at {0,0,0}
# Roof Spacers
# Truss Spacers
# Supports
# OuterColumns_South
# OuterColumns_North
# OuterColumns_West
# OuterColumns_East
# OuterColumns
# Wall Bracing
# WallBeams
total_elements = Panel(lng_14)
summary = Panel(cluster_148)

tag_3 = TextTag3D(Location=xz_3, Text=costcalculator.CostsPerJoint_, Size=1, Justification=7)
line_51 = Line(disassemble.Line)

data_25 = Data(flatten(transport_elements_generator.TransportElementLines))
data_26 = Data(flatten(lng_13))
data_27 = Data(range_2)
c_script_12 = CSharpScript(lengths=data_26, colorlist=data_27)  # -> out, A; inputs lengths: list of Double, colorlist: list of Double; same code as c_script
data_28 = Data(flatten(c_script_12.A))
gradient_2 = Gradient(
    LowerLimit=0,
    UpperLimit=1,
    Parameter=data_28,
    stops=[0: RGB(35, 99, 187), 0: RGB(234, 38, 0), 0: RGBA(255, 255, 255, 0), 0.25: RGB(234, 126, 0), 0.5: RGB(254, 244, 84), 0.75: RGB(173, 203, 249), 1: RGB(75, 107, 169)])
pipe_3 = Pipe(Curve=data_25, Radius=Slider(0.1, range=0..0.1), Caps=0)  # -> flatten(Pipe)
preview_4 = CustomPreview(Geometry=pipe_3, Material=gradient_2)

cluster_149 = Cluster_23(data=transport_elements_generator.AllElementLines)
linedim = LineDimension(Line=cluster_149, Text="{0:0.00}", Size=Slider(0.2, range=0..1))

len = Length(Curve=flatten(line_51))
len_2 = Length(Curve=flatten(cluster_149))
ma_3 = MassAddition(Input=len)  # -> Result, PartialResults
ma_4 = MassAddition(Input=len_2)  # -> Result, PartialResults
move_12 = Move(Geometry=cluster_149, Motion=Y_6)  # -> Geometry, Transform
panel_26 = Panel(ma_3.Result)
panel_27 = Panel(ma_4.Result)
equals_9 = Equality(FirstNumber=panel_27, SecondNumber=panel_26)  # -> Equality, Inequality
length_equal = Panel(equals_9.Equality)

weight = Panel(opticrosec.Mass_kg)
isvalid = Panel(equality.Equality)
length_equal_2 = Panel(length_equal)
total_elements_2 = Panel(total_elements)
weldvolume = Panel(ma.Result)
merge_17 = Merge(
    Data1="CountX_",
    Data2=colibri_iterator.Xcount,
    Data3="_CountY_",
    Data4=colibri_iterator.Ycount,
    Data5="_",
    Data6=flatten(isvalid))
join = TextJoin(Text=merge_17)
img_setting = ImageSetting(ImageSaveAsName=join, RhinoViewNames="Perspective", Width="3600", Height="1800")
panel_28 = Panel(join)

number_2 = Number(weldvolume)
number_3 = Number(weight)

colibri_parameters = ColibriParameters(
    WeldVolume=flatten(number_2),
    Weight=flatten(number_3),
    IsValid=flatten(isvalid),
    Total_elements=flatten(total_elements_2),
    Length_equal=flatten(length_equal_2))
aggregator = ColibriAggregator(
    Folder=panel_16,
    IterationGenomeID=colibri_iterator.Iteration_Genome,
    IterationPhenomeResults=colibri_parameters,
    ImgSetting=img_setting,
    Write=Toggle(False),
    recordingMode=3)

# ----
# Display WeldThroats
panel_29 = Panel("1")
cmyk = ColourCMYK(Cyan=panel_29, Magenta=panel_29, Yellow=panel_29, Key=panel_29)
eval = EvaluateCurve(Curve=line_50, Parameter=position)  # -> Point, Tangent, Angle
filter_23 = StreamFilter(Gate=show_weldsizes, Stream0=flatten("0"), Stream1=textsize)
eval_2 = EvaluateCurve(Curve=line_50, Parameter=expr("1-x", position))  # -> Point, Tangent, Angle
xz_4 = XZPlane(Origin=eval.Point)
xz_5 = XZPlane(Origin=eval_2.Point)

rotate = Rotate(Geometry=xz_4, Angle=rad, Plane=xz_4)  # -> Geometry, Transform
rotate_2 = Rotate(Geometry=xz_5, Angle=rad, Plane=xz_5)  # -> Geometry, Transform

tag_4 = TextTag3D(Location=rotate.Geometry, Text=txt, Size=filter_23, Colour=cmyk, Justification="5")
tag_5 = TextTag3D(Location=rotate_2.Geometry, Text=txt_2, Size=filter_23, Colour=cmyk, Justification="5")

# ==== cluster Cluster
num = ClusterInput()
num_2 = Number(num)
ins = InsertItems(List="0", Item=num_2, Indices="1", Wrap=True)
L = ClusterOutput(ins)

# ==== cluster Cluster_2
data = ClusterInput()
data_2 = ClusterInput()
data_3 = ClusterInput()

data_4 = Data(data)
data_5 = Data(data_2)
data_6 = Data(data_3)
flip = FlipMatrix(Data=data_4)
replace = ReplaceItems(List=data_4, Item="True", Indices=data_5, Wrap="True")
replace_2 = ReplaceItems(List=flip, Item="True", Indices=data_6, Wrap="True")
flip_2 = FlipMatrix(Data=replace_2)
or = GateOr(A=replace, B=flip_2)
data_7 = Data(or)

data_8 = ClusterOutput(data_7)

# ==== cluster Cluster_3
num = ClusterInput()
num_2 = ClusterInput()

num_3 = Number(num)
num_4 = Number(num_2)
dup = DuplicateData(Data="False", Number=num_3, Order=True)  # -> graft(Data)
dup_2 = DuplicateData(Data=dup, Number=num_4, Order=True)
data = Data(dup_2)

data_2 = ClusterOutput(data)

# ==== cluster Cluster_4
F = ClusterInput()
pt = ClusterInput()
Z = UnitZ(Factor=F)
neg = Negative(Value=Z)
pt_2 = Point(pt)
move = Move(Geometry=pt_2, Motion=neg)  # -> Geometry, Transform
pt_3 = ClusterOutput(pt_2)
G = ClusterOutput(move.Geometry)

# ==== cluster Cluster_5
pt = ClusterInput()
pt_2 = Point(pt)
cull_i = CullIndex(List=pt_2, Indices="0", Wrap=True)  # -> simplify(List)
lng = ListLength(List=cull_i)
culln = CullNth(List=cull_i, CullFrequency=lng)  # -> simplify(List)
L = ClusterOutput(culln)
panel = Panel(culln)

# ==== cluster Cluster_6
B = ClusterInput()
concat = Concatenate(FragmentA="{", FragmentB=B)
B_2 = ClusterInput()
concat_2 = Concatenate(FragmentA=concat, FragmentB=";")
concat_3 = Concatenate(FragmentA=concat_2, FragmentB=B_2)
concat_4 = Concatenate(FragmentA=concat_3, FragmentB="}")
R = ClusterOutput(concat_4)

# ==== cluster Cluster_7
pt = ClusterInput()

pt_2 = Point(pt)
lng = ListLength(List=pt_2)
cull_i = CullIndex(List=pt_2, Indices="0", Wrap=True)  # -> simplify(List)
culln = CullNth(List=pt_2, CullFrequency=lng)  # -> simplify(List)
ln = Line(StartPoint=culln, EndPoint=cull_i)

L = ClusterOutput(ln)

# ==== cluster Cluster_8
pt = ClusterInput()
pt_2 = ClusterInput()
pt_3 = Point(pt)
pt_4 = Point(pt_2)
lng = ListLength(List=pt_3)
lng_2 = ListLength(List=pt_4)
lng_3 = ListLength(List=pt_3)
lng_4 = ListLength(List=pt_4)
split = SplitList(List=pt_3, Index=expr("(x/2)", lng))  # -> ListA, ListB
split_2 = SplitList(List=pt_4, Index=expr("x/2", lng_2))  # -> ListA, ListB
split_3 = SplitList(List=pt_3, Index=expr("(x/2)-1", lng_3))  # -> ListA, ListB
split_4 = SplitList(List=pt_4, Index=expr("(x/2)-1", lng_4))  # -> ListA, ListB
pt_5 = Point(split.ListA)
pt_6 = Point(split_2.ListA)
pt_7 = Point(split_3.ListB)
pt_8 = Point(split_4.ListB)
lng_5 = ListLength(List=pt_5)
lng_6 = ListLength(List=pt_8)
cull_i = CullIndex(List=pt_6, Indices="0", Wrap=True)
cull_i_2 = CullIndex(List=pt_7, Indices="0", Wrap=True)
culln = CullNth(List=pt_5, CullFrequency=lng_5)
culln_2 = CullNth(List=pt_8, CullFrequency=lng_6)
ln = Line(StartPoint=culln, EndPoint=cull_i)
ln_2 = Line(StartPoint=culln_2, EndPoint=cull_i_2)
merge = Merge(Data1=ln, Data2=ln_2)
R = ClusterOutput(merge)

# ==== cluster Cluster_10
panel = Panel("""True
False""")
L = ClusterInput()
L_2 = ClusterInput()
panel_2 = Panel("""0
1""")
cull = CullPattern(List=L, CullPattern=reverse(panel))
cull_2 = CullPattern(List=L_2, CullPattern=panel)
weave = Weave(Pattern=panel_2, Stream0=cull_2, Stream1=cull, NullGaps=False)
cluster = Cluster_9(pt=weave)
L_3 = ClusterOutput(cluster)

# ==== cluster Cluster_11
data = ClusterInput()
data_2 = Data(data)
lng = ListLength(List=data_2)
culln = CullNth(List=data_2, CullFrequency=lng)
panel = Panel(data_2)
cull_i = CullIndex(List=culln, Indices="0", Wrap=True)
L = ClusterOutput(cull_i)

# ==== cluster Cluster_12
pt = ClusterInput()
num = ClusterInput()
num_2 = ClusterInput()
num_3 = ClusterInput()
pt_2 = Point(pt)

num_4 = Number(num)
num_5 = Number(num_2)
num_6 = Number(num_3)
cluster = Cluster_4(pt=pt_2, F=num_6)  # -> pt_3, G
cluster_2 = Cluster_4(pt=pt_2, F=num_4)  # -> pt_3, G
pt_3 = Point(graft(cluster_2.pt_3))
ln = Line(StartPoint=cluster.pt_3, EndPoint=cluster.G)
ln_2 = Line(StartPoint=cluster.G, EndPoint=cluster_2.G)
divide = DivideCurve(Curve=ln_2, Count=num_5, Kinks=False)  # -> Points, Tangents, Parameters
merge = Merge(Data1=divide.Points, Data2=pt_3)

equals = Equality(FirstNumber=num_4, SecondNumber="0")  # -> Equality, Inequality

divide_2 = DivideCurve(Curve=ln, Count=num_5, Kinks=False)  # -> Points, Tangents, Parameters

filter = StreamFilter(Gate=equals.Inequality, Stream0=divide_2.Points, Stream1=merge)

data = Data(simplify(filter))
panel = Panel(data)
data_2 = ClusterOutput(data)

# ==== cluster Cluster_13
pt = ClusterInput()

pt_2 = Point(pt)
flip = FlipMatrix(Data=pt_2)
lng = ListLength(List=flip)  # -> expr("x-1", Length)
panel = Panel("0")
cull_i = CullIndex(List=pt_2, Indices="0", Wrap=True)
cull_i_2 = CullIndex(List=flip, Indices=lng, Wrap=True)
flip_2 = FlipMatrix(Data=cull_i)
flip_3 = FlipMatrix(Data=cull_i_2)
lng_2 = ListLength(List=flip_3)
culln = CullNth(List=flip_3, CullFrequency=lng_2)
cull_i_3 = CullIndex(List=flip_2, Indices="0", Wrap=True)
flip_4 = FlipMatrix(Data=culln)
ln = Line(StartPoint=cull_i_3, EndPoint=flip_4)

L = ClusterOutput(ln)

# ==== cluster Cluster_14
pt = ClusterInput()

pt_2 = Point(pt)
flip = FlipMatrix(Data=pt_2)
cull_i = CullIndex(List=pt_2, Indices="0", Wrap=True)
cull_i_2 = CullIndex(List=flip, Indices="0", Wrap=True)
flip_2 = FlipMatrix(Data=cull_i)
flip_3 = FlipMatrix(Data=cull_i_2)
lng = ListLength(List=flip_2)
lng_2 = ListLength(List=flip_3)
culln = CullNth(List=flip_2, CullFrequency=lng)
culln_2 = CullNth(List=flip_3, CullFrequency=lng_2)
flip_4 = FlipMatrix(Data=culln_2)
ln = Line(StartPoint=culln, EndPoint=flip_4)

L = ClusterOutput(ln)

# ==== cluster Cluster_15
num = ClusterInput()
data = ClusterInput()
num_2 = ClusterInput()

num_3 = Number(num)
data_2 = Data(data)
num_4 = Number(num_2)

num_5 = Number(expr("x-1", num_3))
cluster = Cluster_3(num=num_4, num_2=num_3)
multiplication = Multiplication(A=data_2, B=num_5)
round = Round(Number=multiplication)  # -> Nearest, Floor, Ceiling
dcon = DeleteConsecutive(Set=round.Nearest, Wrap=False)  # -> Set, Count
cluster_2 = Cluster_2(data=cluster, data_2=dcon.Set)

cull_pattern_matrix = ClusterOutput(cluster_2)

# ==== cluster Cluster_18
data = ClusterInput()
data_2 = ClusterInput()
data_3 = ClusterInput()

data_4 = Data(data)
data_5 = Data(data_2)
data_6 = Data(data_3)
flip = FlipMatrix(Data=data_4)
replace = ReplaceItems(List=data_4, Item="True", Indices=data_5, Wrap="True")  # -> simplify(List)

cluster = Cluster_17(data=data_4)
tstat = TreeStatistics(Tree=data_5)  # -> Paths, Length, Count
panel = Panel(tstat.Count)
panel_2 = Panel(data_5)
panel_3 = Panel(replace)

replace_2 = ReplaceItems(List=cluster, Item="True", Indices=data_6, Wrap="True")
flip_2 = FlipMatrix(Data=replace_2)

cluster_2 = Cluster_17(data=replace_2)

or = GateOr(A=replace, B=cluster_2)
data_7 = Data(or)

data_8 = ClusterOutput(data_7)

# ==== cluster Cluster_19
panel = Panel("""6
2""")
num = ClusterInput()
num_2 = ClusterInput()
num_3 = Number(graft(panel))
panel_2 = Panel(num_3)
c_script = CSharpScript()  # -> out, A, pbolt, vbolt; inputs lines: tree of Line, points: list of Point3d
# ---------- c_script: C# ----------
    DataTree<Line> linestree = new DataTree<Line>();




    GH_Path path = new GH_Path();
    GH_Path pointpath = new GH_Path();
    Point3d punt = new Point3d();
    DataTree<Point3d> plist = new DataTree<Point3d>();
    DataTree<Vector3d> vlist = new DataTree<Vector3d>();

    for (int b = 0; b < lines.BranchCount; b++)
    {
      int i = 0;
      foreach (Line line in lines.Branches[b])
      {
        //Ervoor
        pointpath = new GH_Path(b);
        path = new GH_Path(b, i);
        if (line.FromX <= points[i].X && line.ToX <= points[i].X)
        {
          linestree.Add(line, path);
        }
        //Ertussen
        if (line.FromX < points[i].X && line.ToX > points[i].X)
        {
          double stuk = points[i].X - line.FromX;
          double length = line.ToX - line.FromX;
          double percentage = stuk / length;
          double Xnew = percentage * line.Direction.X + line.FromX;
          double Ynew = percentage * line.Direction.Y + line.FromY;
          double Znew = percentage * line.Direction.Z + line.FromZ;
          Point3d cpoint = new Point3d(Xnew, Ynew, Znew);
          Line lineA = new Line(line.From, cpoint);

          linestree.Add(lineA, path);
          punt = cpoint;
          plist.Add(punt, pointpath);
          vlist.Add(line.Direction, pointpath);
          //volgende punt
          //volgende path
          i = i + 1;
          path = new GH_Path(b, i);
          foreach (Point3d point in points)
          {
            if (line.FromX < point.X && line.ToX > point.X)
            {

            }
          }
          if (line.ToX > points[i].X)
          {
            punt = cpoint;

          }
          else
          {
            Line lineB = new Line(cpoint, line.To);
            linestree.Add(lineB, path);
          }
        }
        //Erna (bestaat eigenlijk niet)
        if (line.FromX >= points[i].X && line.ToX >= points[i].X)
        {
          i = i + 1;
          path = new GH_Path(b, i);
          linestree.Add(line, path);
          //moet eindigen
        }
      }
    }

    A = linestree;
    pbolt = plist;
    vbolt = vlist;
# ---------- end c_script ----------
num_4 = Number("2")
dup = DuplicateData(Data="False", Number=num_4, Order=True)  # -> graft(Data)
dup_2 = DuplicateData(Data=dup, Number=num_4, Order=True)  # -> simplify(Data)
path_mapper = PathMapper(dup_2, source="{A;B;C}", target="{A;C;B}")
panel_3 = Panel("0")

num_5 = Number(num)
num_6 = Number(num_2)
dup_3 = DuplicateData(Data="False", Number=num_5, Order=True)  # -> simplify(graft(Data))
dup_4 = DuplicateData(Data=dup_3, Number=num_6, Order=True)

panel_4 = Panel(num_6)
pshift = ShiftPaths(Data=dup_4, Offset=-1)
c_script_2 = CSharpScript(intList=num_5, intListRows=num_6)  # -> out, A; inputs intList: list of Int32, intListRows: list
# ---------- c_script_2: C# ----------
    DataTree<string> linestree = new DataTree<string>();
    GH_Path path = new GH_Path();

    for (int a = 0; a < intList.Count; a++)
    {

      for (int b = 0; b < intList[a];b++)
      {
        for (int c = 0;c < intList[a];c++)
        {
          path = new GH_Path(a, b);
          linestree.Add("false", path);
        }
      }
    }

    A = linestree;
# ---------- end c_script_2 ----------
c_script_3 = CSharpScript(intList=num_5, intListRows=num_6)  # -> out, A; inputs intList: list of Int32, intListRows: list of Int32
# ---------- c_script_3: C# ----------
    DataTree<string> linestree = new DataTree<string>();
    GH_Path path = new GH_Path();

    for (int a = 0; a < intList.Count; a++)
    {

      for (int b = 0; b < intList[a];b++)
      {
        for (int c = 0;c < intListRows[a];c++)
        {
          path = new GH_Path(a, b);
          linestree.Add("false", path);
        }
      }
    }

    A = linestree;
# ---------- end c_script_3 ----------
ma = MassAddition(Input=panel_4)  # -> Result, PartialResults
lng = ListLength(List=panel_4)
data = Data(simplify(dup_4))
mindex = MemberIndex(Set=panel_4, Member=panel_4)  # -> flatten(Index), Count
series = Series(Start=mindex.Index, Step="0", Count=panel_4)  # -> flatten(Series)
path_mapper_2 = PathMapper(data, source="{A;B;C}", target="{A;C;B}")
series_2 = Series(Start="0", Step="0", Count=ma.Result)  # -> flatten(Series)
series_3 = Series(Start="0", Step=1, Count=panel_4)  # -> flatten(Series)

data_2 = Data(c_script_3.A)

data_3 = ClusterOutput(data_2)
merge = Merge(Data1=graft(series_2), Data2=graft(series), Data3=graft(series_3))
pshift_2 = ShiftPaths(Data=path_mapper_2, Offset=Slider(0, range=0..10))
path = ConstructPath(Indices=merge)  # -> flatten(Branch)
split = SplitTree(Data=path_mapper_2)  # -> Positive, Negative
trim = TrimTree(Tree=path_mapper_2, Depth=1)
tstat = TreeStatistics(Tree=path_mapper_2)  # -> Paths, Length, Count
replace = ReplacePaths(Data=data, Search=tstat.Paths, Replace=reverse(tstat.Paths))
branch = TreeBranch(Tree=path_mapper_2, Path=path, MaintainPaths=True)
panel_5 = Panel(c_script_2.A)
panel_6 = Panel(tstat.Paths)

# ==== cluster Cluster_20
pt = ClusterInput()

pt_2 = Point(pt)
flip = FlipMatrix(Data=pt_2)
panel = Panel("0")
cull_i = CullIndex(List=pt_2, Indices="0", Wrap=True)
flip_2 = FlipMatrix(Data=cull_i)

cluster = Cluster_17(data=pt_2)
cluster_2 = Cluster_17(data=cull_i)

lng = ListLength(List=cluster)  # -> expr("x-1", Length)
cull_i_2 = CullIndex(List=cluster, Indices=lng, Wrap=True)
flip_3 = FlipMatrix(Data=cull_i_2)
cull_i_3 = CullIndex(List=cluster_2, Indices="0", Wrap=True)

cluster_3 = Cluster_17(data=cull_i_2)

lng_2 = ListLength(List=cluster_3)
culln = CullNth(List=cluster_3, CullFrequency=lng_2)
flip_4 = FlipMatrix(Data=culln)

cluster_4 = Cluster_17(data=culln)

ln = Line(StartPoint=cull_i_3, EndPoint=cluster_4)

L = ClusterOutput(ln)

# ==== cluster Cluster_21
pt = ClusterInput()

pt_2 = Point(pt)
cull_i = CullIndex(List=pt_2, Indices="0", Wrap=True)

cluster = Cluster_17(data=pt_2)
cluster_2 = Cluster_17(data=cull_i)

cull_i_2 = CullIndex(List=cluster, Indices="0", Wrap=True)
lng = ListLength(List=cluster_2)
culln = CullNth(List=cluster_2, CullFrequency=lng)

cluster_3 = Cluster_17(data=cull_i_2)

lng_2 = ListLength(List=cluster_3)
culln_2 = CullNth(List=cluster_3, CullFrequency=lng_2)

cluster_4 = Cluster_17(data=culln_2)

ln = Line(StartPoint=culln, EndPoint=cluster_4)

L = ClusterOutput(ln)

# ==== cluster Cluster_22
data = ClusterInput()
data_2 = ClusterInput()
data_3 = ClusterInput()
data_4 = ClusterInput()
data_5 = ClusterInput()
data_6 = ClusterInput()
int = ClusterInput()
data_7 = Data(data)
data_8 = Data(data_2)
data_9 = Data(data_3)
data_10 = Data(data_4)
data_11 = Data(data_5)
data_12 = Data(data_6)
int_2 = Integer(int)
item = ListItem(List=data_7, Index=int_2, Wrap=True)
item_2 = ListItem(List=data_8, Index=int_2, Wrap=True)
item_3 = ListItem(List=data_9, Index=int_2, Wrap=True)
item_4 = ListItem(List=data_10, Index=int_2, Wrap=True)
item_5 = ListItem(List=data_11, Index=int_2, Wrap=True)
item_6 = ListItem(List=data_12, Index=int_2, Wrap=True)
lng = ListLength(List=item)
dup = DuplicateData(Data=", Mx kNm:", Number=lng, Order=True)  # -> simplify(Data)
dup_2 = DuplicateData(Data=", My kNm:", Number=lng, Order=True)  # -> simplify(Data)
dup_3 = DuplicateData(Data=", Mz kNm:", Number=lng, Order=True)  # -> simplify(Data)
dup_4 = DuplicateData(Data="X kN:", Number=lng, Order=True)  # -> simplify(Data)
dup_5 = DuplicateData(Data=", Y kN:", Number=lng, Order=True)  # -> simplify(Data)
dup_6 = DuplicateData(Data=", Z kN:", Number=lng, Order=True)  # -> simplify(Data)
merge = Merge(
    Data1=dup_4,
    Data2=item,
    Data3=dup_5,
    Data4=item_2,
    Data5=dup_6,
    Data6=item_3,
    Data7=dup,
    Data8=item_4,
    Data9=dup_2,
    Data10=item_5,
    Data11=dup_3,
    Data12=item_6)
join = TextJoin(Text=merge)
R = ClusterOutput(join)

# ==== cluster Cluster_23
data = ClusterInput()
data_2 = Data(data)
lng = ListLength(List=data_2)
item = ListItem(List=data_2, Index=expr("x-1", lng), Wrap=True)
item_2 = ListItem(List=data_2, Index=0, Wrap=True)
end = EndPoints(Curve=item_2)  # -> Start, End
end_2 = EndPoints(Curve=item)  # -> Start, End
ln = Line(StartPoint=end.Start, EndPoint=end_2.End)
L = ClusterOutput(ln)

# ==== cluster Cluster_24
C = ClusterInput()
len = Length(Curve=C)  # -> flatten(Length)
sort = SortList(Keys=len, ValuesA=len)  # -> Keys, ValuesA
dcon = DeleteConsecutive(Set=sort.Keys, Wrap=False)  # -> Set, Count
data = Data(graft(dcon.Set))
data_2 = Data(sort.Keys)
equals = Equality(FirstNumber=data_2, SecondNumber=data)  # -> simplify(Equality), Inequality
cull = CullPattern(List=data_2, CullPattern=equals.Equality)
lng = ListLength(List=cull)  # -> flatten(Length)
data_3 = Data(dcon.Set)
expression = Expression(x=lng, y=data_3, Expression="Format(\"There are {0:0} lines of {1:0.00} m\", x,y)")
R = ClusterOutput(expression)

# ==== cluster Cluster_25
G = ClusterInput()
X = ClusterInput()
vec = VectorXYZ(XComponent=X, YComponent=0, ZComponent=0)  # -> Vector, Length
move = Move(Geometry=G, Motion=vec.Vector)  # -> Geometry, Transform
data = Data(move.Geometry)
tstat = TreeStatistics(Tree=data)  # -> Paths, Length, Count
dpath = DeconstructPath(Branch=tstat.Paths)
data_2 = Data(graft(tstat.Length))
flip = FlipMatrix(Data=dpath)
data_3 = ClusterInput()
bang = ExplodeTree(Data=flip)  # -> flatten(Branch0), flatten(Branch1)
data_4 = Data(data_3)
data_5 = Data(graft(bang.Branch0))
data_6 = Data(graft(bang.Branch1))
multiplication = Multiplication(A=bang.Branch0, B=data_4)
multiplication_2 = Multiplication(A=bang.Branch1, B=data_4)
path = ConstructPath(Indices=[data_5, data_6])  # -> flatten(Branch)
vec_2 = VectorXYZ(XComponent=multiplication, YComponent=multiplication_2, ZComponent=0)  # -> Vector, Length
unflatten = UnflattenTree(Tree=vec_2.Vector, Guide=path)  # -> graft(Tree)
data_7 = Data(flatten(data))
dup = DuplicateData(Data=unflatten, Number=data_2, Order=True)  # -> flatten(Data)
move_2 = Move(Geometry=data_7, Motion=dup)  # -> Geometry, Transform
G_2 = ClusterOutput(move_2.Geometry)
panel = Panel(move_2.Geometry)

# ==== cluster Cluster_26
num = ClusterInput()
num_2 = ClusterInput()
line = ClusterInput()
num_3 = ClusterInput()
num_4 = Number(num)
num_5 = Number(num_2)
line_2 = Line(line)
num_6 = Number(num_3)
cluster = Cluster_25(G=line_2, data_3=num_5, X=num_4)
line_3 = Line(cluster)
pipe = Pipe(Curve=line_3, Radius=num_6, Caps=0)  # -> flatten(Pipe)
dom = ConstructDomain(DomainStart="0", DomainEnd="1")
pshift = ShiftPaths(Data=line_2, Offset=-1)
P = ClusterOutput(pipe)
range = Range(Domain=dom, Steps=Slider(8, range=0..100))
lng = ListLength(List=pshift)
data = Data(flatten(lng))
data_2 = Data(range)
c_script = CSharpScript(lengths=data, colorlist=data_2)  # -> out, A; inputs lengths: list of Double, colorlist: list of Double
# ---------- c_script: C# ----------
    DataTree<double> tree = new DataTree<double>();
    GH_Path path = new GH_Path();
    int w = 0;


    for (int b = 0; b < lengths.Count; b++)
    {
      for (int c = 0;c < lengths[b];c++)
      {
        double num = colorlist[(w % colorlist.Count)];
        //tree.Add(num, path);
        tree.Add(num);
      }
      w = w + 1;

    }
    A = tree;
# ---------- end c_script ----------
data_3 = Data(flatten(c_script.A))
gradient = Gradient(
    LowerLimit=0,
    UpperLimit=1,
    Parameter=data_3,
    stops=[0: RGB(35, 99, 187), 0: RGB(234, 38, 0), 0: RGBA(255, 255, 255, 0), 0.25: RGB(234, 126, 0), 0.5: RGB(254, 244, 84), 0.75: RGB(173, 203, 249)])
lng_2 = ListLength(List=gradient)
dup = DuplicateData(Data=" (100)", Number=lng_2, Order=True)  # -> flatten(Data)
merge = Merge(Data1=graft(gradient), Data2=graft(dup))
join = TextJoin(Text=merge)  # -> flatten(Result)
R = ClusterOutput(join)

# ==== cluster Cluster_9
pt = ClusterInput()

pt_2 = Point(pt)
lng = ListLength(List=pt_2)
cull_i = CullIndex(List=pt_2, Indices="0", Wrap=True)
culln = CullNth(List=pt_2, CullFrequency=lng)
ln = Line(StartPoint=cull_i, EndPoint=culln)

L = ClusterOutput(ln)

# ==== cluster Cluster_17
data = ClusterInput()
data_2 = Data(data)
cluster = Cluster_16(T=data_2)  # -> R, R_2
num = Number(cluster.R)
num_2 = Number(cluster.R_2)
c_script = CSharpScript(lines=data_2, x=num, y=num_2)  # -> out, B, C, A, D; inputs lines: tree of Point3d, x: list of Int32, y: list of Int32
# ---------- c_script: C# ----------
    DataTree<Point3d> linestree = new DataTree<Point3d>();
    GH_Path path = new GH_Path();

    for (int a = 0; a < x.Count; a++)
    {

      //for (int b = 0; b < lines.Branches[a].Count;b++)
      
      int b = 0;
      foreach (Point3d line in lines.Branches[a])
      {
        double c = lines.Branches[a].Count;
        path = new GH_Path(x[a], b);
        linestree.Add(line, path);
        b = b + 1;
      }
    }
    B = lines.BranchCount;
    C = lines.Paths.IsReadOnly;
    D = lines.Branches.Count;

    A = linestree;
# ---------- end c_script ----------
A = ClusterOutput(c_script.A)

# ==== cluster Cluster_16
T = ClusterInput()
tstat = TreeStatistics(Tree=T)  # -> Paths, Length, Count
split = TextSplit(Text=tstat.Paths, Separators=";")
item = ListItem(List=split, Index=0, Wrap=True)
item_2 = ListItem(List=split, Index="1", Wrap=True)
rep = ReplaceText(Text=item, Find="{", RecursiveReplace=False)  # -> flatten(Result)
rep_2 = ReplaceText(Text=item_2, Find="}", RecursiveReplace=False)  # -> flatten(Result)
R = ClusterOutput(rep)
R_2 = ClusterOutput(rep_2)
